# Dynamo graph script.dyn (Dynamo 2.5.0.7460)
# packages: Structural Design 2019.12.11, spring nodes 132.2.5, Genius Loci 2020.8.3, Rhythm 2020.7.25, KYSUDO 2019.8.5, archi-lab.net 2021.25.15, RIE 2020.11.18

categories = Categories("OST_Walls")
code_block = CodeBlock { 1; "Walls"; "Doors/Windows"; }
boolean = BoolSelector(true)
# note: Custom Node: Structural Design v.2020.4.10
pickObjectsOfCategory = StructuralDesign.Model.Selection.PickObjectsOfCategory(category=categories, objectType=code_block.out0, statusPrompt=code_block.out1, refresh=boolean)
categories_2 = Categories("OST_Doors")
categories_3 = Categories("OST_Windows")
list_create = List.Create(item0=categories_2, item1=categories_3)
pickObjectsOfCategory_2 = StructuralDesign.Model.Selection.PickObjectsOfCategory(category=list_create, objectType=code_block.out0, statusPrompt=code_block.out2, refresh=boolean)
getLocation = Element.GetLocation(element=pickObjectsOfCategory_2)
code_block_2 = CodeBlock(A=pickObjectsOfCategory_2) { A[0]; }
code_block_3 = CodeBlock { "Level"; }
# note: Custom Node: Rhythm v.2020.7.25
ʳʰʸᵗʰᵐ_elements = Rhythm.Revit.Elements.Elements.GetParameterValueByNameCaSeiNSeNSiTiVe(element=code_block_2, parameterName=code_block_3)
plane_by_level = Custom[Plane by Level](level=ʳʰʸᵗʰᵐ_elements)  # package Genius Loci; Constructs a Plane from a level.
# note: Custom Node: spring nodes v.132.2.5
pullOntoPlane = Custom[Springs.Point.PullOntoPlane](point=getLocation, plane=plane_by_level)  # package spring nodes; Pulls (projects) the point onto the input plane, following the plane normal.
code_block_4 = CodeBlock { 150; }
byCenterPointRadius = Circle.ByCenterPointRadius(centerPoint=pullOntoPlane, radius=code_block_4)
getLocation_2 = Element.GetLocation(element=pickObjectsOfCategory)
pullOntoPlane_2 = Curve.PullOntoPlane(curve=getLocation_2, plane=plane_by_level)
doesIntersect = Geometry.DoesIntersect(geometry=byCenterPointRadius, other=pullOntoPlane_2, lacing=CrossProduct)
filterByBoolMask = List.FilterByBoolMask(list=pickObjectsOfCategory, mask=doesIntersect@L2)
code_block_5 = CodeBlock(a=filterByBoolMask.in) { a; }
count = List.Count(list=code_block_5@@L2)
code_block_6 = CodeBlock { 4; }
le = count <= code_block_6
filterByBoolMask_2 = List.FilterByBoolMask(list=code_block_5, mask=le)
code_block_7 = CodeBlock { "Width"; }
ʳʰʸᵗʰᵐ_elements_2 = Rhythm.Revit.Elements.Elements.GetParameterValueByNameTypeOrInstance(element=filterByBoolMask_2.in, parameterName=code_block_7)
code_block_8 = CodeBlock { 40; }
gt = ʳʰʸᵗʰᵐ_elements_2 > code_block_8
filterByBoolMask_3 = List.FilterByBoolMask(list=filterByBoolMask_2.in, mask=gt)
code_block_9 = CodeBlock(bejoin=filterByBoolMask_3.out) { bejoin; }
code_block_10 = CodeBlock(join=filterByBoolMask_3.in) { join; }
# note: Custom Node: KYSUDO v.2019.8.5
join_geometry = Custom[Join Geometry](Elements_A=code_block_10@L2, Elements_B=code_block_9@L2)  # package KYSUDO
isEmpty = List.IsEmpty(list=join_geometry.Elements_A)

# group: Isolate element
# note: Custom Node: Rhythm v.2020.7.25
ʳʰʸᵗʰᵐ_elements_joinedelements = Rhythm.Revit.Elements.Elements.JoinedElements(element=code_block_9)
isEmpty_2 = List.IsEmpty(list=ʳʰʸᵗʰᵐ_elements_joinedelements@L2)
filterByBoolMask_4 = List.FilterByBoolMask(list=code_block_10, mask=isEmpty)
filterByBoolMask_5 = List.FilterByBoolMask(list=code_block_9, mask=isEmpty)
list_create_2 = List.Create(item0=filterByBoolMask_4.in, item1=filterByBoolMask_5.in)
flatten = List.Flatten(list=list_create_2)
code_block_11 = CodeBlock { true; }
# note: Custom Node: RIE v.2020.11.18
RIE_ActiveView = Custom[RIE_ActiveView](Refresh=code_block_11)  # package RIE; Returns active view in current document.
isolate_in_view = Custom[Isolate in View](element=flatten, view=RIE_ActiveView)  # package archi-lab.net; This node will take input of elements and a view to isolate selected elements in a view.
