# Dynamo graph script.dyn (Dynamo 2.3.0.5885)
# packages: Structural Design 2019.12.11, Hot Gear 2017.11.9

pickElementsByRectangle = StructuralDesign.Model.Selection.PickElementsByRectangle()
code_block = CodeBlock { "Zone"; }
get_revit_selection = Custom[Get Revit Selection]()  # package Hot Gear
getParameterValueByName = Element.GetParameterValueByName(element=get_revit_selection, parameterName=code_block)
setParameterByName = Element.SetParameterByName(element=pickElementsByRectangle, parameterName=code_block, value=getParameterValueByName, lacing=Longest)
code_block_2 = CodeBlock { "Sub_Zone"; }
getParameterValueByName_2 = Element.GetParameterValueByName(element=get_revit_selection, parameterName=code_block_2)
setParameterByName_2 = Element.SetParameterByName(element=pickElementsByRectangle, parameterName=code_block_2, value=getParameterValueByName_2, lacing=Longest)
code_block_3 = CodeBlock { "Unit"; }
getParameterValueByName_3 = Element.GetParameterValueByName(element=get_revit_selection, parameterName=code_block_3)
setParameterByName_3 = Element.SetParameterByName(element=pickElementsByRectangle, parameterName=code_block_3, value=getParameterValueByName_3, lacing=Longest)
