# Dynamo graph script.dyn (Dynamo 2.6.1.8786)
# packages: Structural Design 2019.12.11, archi-lab.net 2020.23.13, Chynamo 0.8.5, Data-Shapes 2022.2.96, Rhythm 2020.7.25, Rhythm 2021.12.1

categories = Categories("OST_Rooms")
code_block = CodeBlock { "Select Rooms Then"; "Select Walls, Floor AND CEILING First"; }
boolean = BoolSelector(true)
ʳʰʸᵗʰᵐ_helpers_usermessage = Rhythm.Revit.Helpers.Helpers.UserMessage(caption=code_block.out0, message=code_block.out0, obj=boolean)
pickObjectsOfCategory = StructuralDesign.Model.Selection.PickObjectsOfCategory(category=categories, statusPrompt=code_block.out0, refresh=ʳʰʸᵗʰᵐ_helpers_usermessage)
flatten = List.Flatten(list=pickObjectsOfCategory)
code_block_2 = CodeBlock { "Center"; }
boundaries = archilab.Revit.Elements.Room.Boundaries(room=flatten, boundaryLocation=code_block_2)
byJoinedCurves = PolyCurve.ByJoinedCurves(curves=boundaries.Curves)
nullIndice = Custom[NullIndice](list=byJoinedCurves)  # package Chynamo; Get all null indice from a list
getItemAtIndex = List.GetItemAtIndex(list=flatten, index=nullIndice)
code_block_3 = CodeBlock { "User"; "Can't copy parameter from this room"; }
ʳʰʸᵗʰᵐ_elements = Rhythm.Revit.Elements.Elements.SetParameterValueByNameCaSeiNSeNSiTiVe(element=getItemAtIndex, parameterName=code_block_3.out0, value=code_block_3.out1)
categories_2 = Categories("OST_Walls")
categories_3 = Categories("OST_Floors")
categories_4 = Categories("OST_Ceilings")
join = List.Join(list0=categories_2, list1=categories_3, list2=categories_4)
boolean_2 = BoolSelector(true)
ʳʰʸᵗʰᵐ_helpers_usermessage_2 = Rhythm.Revit.Helpers.Helpers.UserMessage(caption=code_block.out1, message=code_block.out1, obj=boolean_2)
pickObjectsOfCategory_2 = StructuralDesign.Model.Selection.PickObjectsOfCategory(category=join, statusPrompt=code_block.out1, refresh=ʳʰʸᵗʰᵐ_helpers_usermessage_2)
flatten_2 = List.Flatten(list=pickObjectsOfCategory_2)
code_block_4 = CodeBlock { 20; }
offset = Curve.Offset(curve=byJoinedCurves, distance=code_block_4)
ZAxis = Vector.ZAxis()
code_block_5 = CodeBlock { 3100; }
extrudeAsSolid = Curve.ExtrudeAsSolid(curve=offset, direction=ZAxis, distance=code_block_5)
string_from_object = FromObject(obj=flatten_2)
code_block_6 = CodeBlock(A=string_from_object) { A!= "Walls"; }
filterByBoolMask = List.FilterByBoolMask(list=flatten_2, mask=code_block_6)
getLocation = Element.GetLocation(element=filterByBoolMask.out)
geometry = Element.Geometry(element=filterByBoolMask.in)
join_2 = List.Join(list0=getLocation, list1=geometry)
flatten_3 = List.Flatten(list=join_2)
doesIntersect = Geometry.DoesIntersect(geometry=extrudeAsSolid, other=flatten_3, lacing=CrossProduct)
flatten_4 = List.Flatten(list=doesIntersect@L3)
filterByBoolMask_2 = List.FilterByBoolMask(list=flatten_2, mask=flatten_4@L2)
code_block_7 = CodeBlock { "Select Parameter To Copy"; "Chooes"; true; "Cancle"; 700; 400; 150; }
code_block_8 = CodeBlock { "Parameter To Copy"; "Chooes"; true; false; 200; }
code_block_9 = CodeBlock(a=flatten) { a[0]; }
parameters = Element.Parameters(element=code_block_9)
name = Parameter.Name(parameter=parameters)
listview_data = Custom[Listview Data](InputName=code_block_8.out0, Keys=name, Values=name, Height_optionnal=code_block_8.out4, ShowId_optionnal=code_block_8.out3)  # package Data-Shapes; Create data for ListView input in UI.MultiInputForm ++ . Check out www.data-shapes.net for more infos.
code_block_10 = CodeBlock { "Extend Boundary"; "20"; true; "Upto from LEVEL?"; "3100"; true; }
textbox_data = Custom[TextBox Data](InputName=code_block_10.out0, DefaultText=code_block_10.out1, IsNumberEntry=code_block_10.out2)  # package Data-Shapes; Create Data for TextBox input in UI.MultipleInputForm ++ . Check out www.data-shapes.net for more informations
textbox_data_2 = Custom[TextBox Data](InputName=code_block_10.out3, DefaultText=code_block_10.out4, IsNumberEntry=code_block_10.out5)
list_create = List.Create(item0=listview_data, item1=textbox_data, item2=textbox_data_2)
multipleinputform = Custom[MultipleInputForm ++](Description_optional=code_block_7.out0, ButtonText_optional=code_block_7.out1, Inputs=list_create, Toggle=code_block_7.out2, CancelButtonText_optional=code_block_7.out3, MaxHeight_optional=code_block_7.out4, Width_optional=code_block_7.out5, LabelWidth_optional=code_block_7.out6)  # package Data-Shapes; Create a form with multiple inputs. see www.data-shapes.net for tutorials and infos!
code_block_11 = CodeBlock(ParametersCopy=multipleinputform.User_Inputs) { ParametersCopy[0]; }
code_block_12 = CodeBlock(a=code_block_11) { a+"-->Paste to"; }
code_block_13 = CodeBlock(A=pickObjectsOfCategory_2) { A[0]; }
parameters_2 = Element.Parameters(element=code_block_13)
name_2 = Parameter.Name(parameter=parameters_2)
count = List.Count(list=code_block_11)
cycle = List.Cycle(list=name_2@@L3, amount=count)
flatten_5 = List.Flatten(list=cycle@L2)
boolean_3 = BoolSelector(true)
python_script = Python(IN[0]=code_block_12, IN[1]=flatten_5, IN[2]=boolean_3)
# ---------- python_script.python (214 lines) ----------
#Copyright (c) mostafa el ayoubi ,  2016
#Data-Shapes http://www.data-shapes.net , elayoubi.mostafa@gmail.com

import clr
clr.AddReference('System.Windows.Forms')
clr.AddReference('System.Drawing')

from System.Drawing import Point
from System.Windows.Forms import Application, Button, Form, Label, TextBox, CheckBox, FolderBrowserDialog, OpenFileDialog, DialogResult, ComboBox, FormBorderStyle
from System.Collections.Generic import *

clr.AddReference('RevitAPIUI')
from  Autodesk.Revit.UI import Selection

clr.AddReference('RevitNodes')
import Revit
clr.ImportExtensions(Revit.Elements)
clr.ImportExtensions(Revit.GeometryConversion)

clr.AddReference('RevitServices')
from RevitServices.Persistence import DocumentManager
doc = DocumentManager.Instance.CurrentDBDocument
uidoc = DocumentManager.Instance.CurrentUIApplication.ActiveUIDocument

class MultiTextBoxForm(Form):
	

    def __init__(self):
        self.Text = 'Data-Shapes | Multi Input UI'
        self.output = []
        self.values = []

    def setclose(self, sender, event):
    	cbindexread = 0
    	for f in self.output:
    		if f.GetType() == TextBox:
    			self.values.append(f.Text)
    		if f.GetType() == CheckBox:
    			self.values.append(f.Checked)
    		if f.GetType() == Button:
    			if f.Tag == None :
    				self.values.append(f.Text)
    			else:
    				self.values.append(f.Tag)
    		if f.GetType() == ComboBox:
    			self.values.append(globals() ['dict%d'%(cbindexread)][f.Text])
    			cbindexread += 1
    	self.Close()

    def reset(self, sender, event):
		pass

    def openfile(self, sender, event):
		ofd = OpenFileDialog()
		dr = ofd.ShowDialog()
		if dr == DialogResult.OK:
			sender.Text = ofd.FileName

    def opendirectory(self, sender, event):
		fbd = FolderBrowserDialog()
		dr = fbd.ShowDialog()
		if dr == DialogResult.OK:
			sender.Text = fbd.SelectedPath

    def pickobjects(self, sender, event):
		sel = uidoc.Selection.PickObjects(Selection.ObjectType.Element,'')
		selelem = [doc.GetElement(s.ElementId) for s in sel]
		sender.Tag = (selelem)

    def pickfaces(self, sender, event):
		selface = uidoc.Selection.PickObjects(Selection.ObjectType.Face,'')
		faces = [uidoc.Document.GetElement(s).GetGeometryObjectFromReference(s).ToProtoType(True) for s in selface]
		sender.Tag = [i for f in faces for i in f]

    def pickedges(self, sender, event):
		seledge = uidoc.Selection.PickObjects(Selection.ObjectType.Edge,'')
		edges = [uidoc.Document.GetElement(s).GetGeometryObjectFromReference(s).AsCurve().ToProtoType(True) for s in seledge]
		sender.Tag = edges

    def topmost(self):
		self.TopMost = True
	


form = MultiTextBoxForm()
form.topmost()

xlabel = 30
xinput = 200
y = 10
fields = []
error = 0
cbindex = 0
#Input form

if isinstance(IN[0],list):
	inputnames = IN[0]
else:
	inputnames = [IN[0]]

if isinstance(IN[1],list):
	inputtypes = IN[1]
else:
	inputtypes = [IN[1]]

for i,j in zip(inputnames,inputtypes):
	label = Label()
	label.Location = Point(xlabel,y+4)
	label.Height = 20
	label.Width = 150
	label.Text = str(i)
	form.Controls.Add(label)
	if isinstance(j,list):
		cb = ComboBox()
		cb.Location = Point(xinput,y)
		cb.Width = 250
		globals()['dict%d'%(cbindex)] = {}
		try :
			for k in j:
				globals()['dict%d'%(cbindex)][k.Name] = k
				cb.Items.Add(k.Name)
		except :
			for k in j:
				try:
					globals()['dict%d'%(cbindex)][str(k)] = k
				except:
					globals()['dict%d'%(cbindex)][k.encode('utf-8').decode('utf-8')] = k
				cb.Items.Add(k)
		form.Controls.Add(cb)
		form.output.append(cb)
		cbindex += 1
	elif j == 's':
		tb = TextBox()
		tb.Text = 'Default'
		tb.Width = 300
		tb.Location = Point(xinput,y)
		form.Controls.Add(tb)
		form.Controls.Add(label)
		form.output.append(tb)
	elif j == 'bool':
		yn = CheckBox()
		yn.Location = Point(xinput,y)
		yn.Text = 'Yes/No'
		form.Controls.Add(yn)
		form.output.append(yn)
	elif j == 'fp':
		fp = Button()
		fp.Width = 300
		fp.Text = 'FilePath'
		fp.Location = Point(xinput,y)
		form.Controls.Add(fp)
		fp.Click += form.openfile
		form.output.append(fp)
	elif j == 'dp':
		dp = Button()
		dp.Width = 300
		dp.Text = 'DirectoryPath'
		dp.Location = Point(xinput,y)
		form.Controls.Add(dp)
		dp.Click += form.opendirectory
		form.output.append(dp)
	elif j == 'se':
		se = Button()
		se.Width = 300
		se.Text = 'Select model element(s)'
		se.Location = Point(xinput,y)
		form.Controls.Add(se)
		se.Click += form.pickobjects
		form.output.append(se)
	elif j == 'sf':
		sf = Button()
		sf.Width = 300
		sf.Text = 'Select face(s)'
		sf.Location = Point(xinput,y)
		form.Controls.Add(sf)
		sf.Click += form.pickfaces
		form.output.append(sf)
	elif j == 'sed':
		sed = Button()
		sed.Width = 300
		sed.Text = 'Select Edge(s)'
		sed.Location = Point(xinput,y)
		form.Controls.Add(sed)
		sed.Click += form.pickedges
		form.output.append(sed)

	else :
		error = 'One or more input types are invalid, visit http://www.data-shapes.net for more informations'
	y+= 30


button = Button()
button.Text = 'Set values'
button.Width = 200
button.Location = Point (100,y+30)
button.Click += form.setclose
form.Controls.Add(button)

form.MaximizeBox = False
form.MinimizeBox = False
form.FormBorderStyle = FormBorderStyle.FixedSingle


form.Height = y + 120
form.Width = 500

if error == 0 and IN[2] == True:
	Application.Run(form)
	result = form.values
	OUT = result,True

elif IN[2] == False:
	result = "Set toggle to true!"
	OUT = result,False
# ----------------------------------------
code_block_14 = CodeBlock(a=python_script) { a[0]; }
count_2 = List.Count(list=filterByBoolMask_2.in@L2)
cycle_2 = List.Cycle(list=code_block_14, amount=count_2)
allFalse = List.AllFalse(list=doesIntersect@L3)
filterByBoolMask_3 = List.FilterByBoolMask(list=flatten, mask=allFalse)
ʳʰʸᵗʰᵐ_elements_2 = Rhythm.Revit.Elements.Elements.GetParameterValueByNameTypeOrInstance(element=filterByBoolMask_3.out@L2, parameterName=code_block_11@L1, lacing=Longest)
transpose = List.Transpose(lists=ʳʰʸᵗʰᵐ_elements_2)
cycle_3 = List.Cycle(list=transpose@L2, amount=count_2@L1)
code_block_15 = CodeBlock(WallElement=filterByBoolMask_2.in, ParameterName=cycle_2, ValuePara=cycle_3) { WallElement; ParameterName; ValuePara; }
ʳʰʸᵗʰᵐ_elements_3 = Rhythm.Revit.Elements.Elements.SetParameterByNameTypeOrInstance(element=code_block_15.WallElement@L2, parameterName=code_block_15.ParameterName@L2, value=code_block_15.ValuePara@L2, lacing=Longest)
