# Dynamo graph script.dyn (Dynamo 2.3.0.5885)
# packages: Data-Shapes 2022.2.96, Rhythm 2020.7.25, Crumple 1.0.7, Orchid 203.3.1.8192

code_block = CodeBlock { "CreateRoom"; }
code_block_2 = CodeBlock { "Create Floor By Room"; "Create Floor"; true; "Cancle"; 300; }
code_block_3 = CodeBlock { "Select Level"; }
categories = Categories("OST_Levels")
all_elements_of_category = ElementsOfCategory(Category=categories)
name = Element.Name(element=all_elements_of_category)
dropdown_data = Custom[DropDown Data](InputName=code_block_3, Keys=name, Values=all_elements_of_category)  # package Data-Shapes; Create data for DropDown input in UI.MultiInputForm ++ . Check out www.data-shapes.net for more infos.
code_block_4 = CodeBlock { "Select Room"; "Select multi"; }
categories_2 = Categories("OST_Rooms")
selectmodelelements_data = Custom[SelectModelElements Data](InputName=code_block_4.out0, ButtonText=code_block_4.out1, CategoryFilter=categories_2)  # package Data-Shapes; Creates a Revit element selection input for UI.MultipleInputForm++ . Check out www.data-shapes.net for more infos!
code_block_5 = CodeBlock { "Select FloorType"; }
categories_3 = Categories("OST_Floors")
o_elementtype_bycategory = Orchid.RevitProject.Elements.ElementType.ByCategory(category=categories_3)
name_2 = Element.Name(element=o_elementtype_bycategory)
dropdown_data_2 = Custom[DropDown Data](InputName=code_block_5, Keys=name_2, Values=o_elementtype_bycategory)
list_create = List.Create(item0=dropdown_data, item1=selectmodelelements_data, item2=dropdown_data_2)
multipleinputform = Custom[MultipleInputForm ++](Description_optional=code_block_2.out0, ButtonText_optional=code_block_2.out1, Inputs=list_create, Toggle=code_block_2.out2, CancelButtonText_optional=code_block_2.out3, Width_optional=code_block_2.out4)  # package Data-Shapes; Create a form with multiple inputs. see www.data-shapes.net for tutorials and infos!
code_block_6 = CodeBlock(selectedLevels=multipleinputform.User_Inputs, selectedRooms=multipleinputform.User_Inputs, FloorTypes=multipleinputform.User_Inputs) { selectedLevels[0]; selectedRooms[1]; FloorTypes[2]; }
roomBoundaries = Custom[RoomBoundaries](rooms=code_block_6.out1)  # package Crumple; For a room or list of rooms, return all boundary (and internal) curves. The curves will be based on the currently nominated project room boundary settings.
byOutlineTypeAndLevel = Floor.ByOutlineTypeAndLevel(outlineCurves=roomBoundaries, floorType=code_block_6.out2, level=code_block_6.out0)
code_block_7 = CodeBlock(a=byOutlineTypeAndLevel) { a==null; }
filterByBoolMask = List.FilterByBoolMask(list=byOutlineTypeAndLevel, mask=code_block_7)
count = List.Count(list=filterByBoolMask.out)
count_2 = List.Count(list=filterByBoolMask.in)
code_block_8 = CodeBlock(room=count, area=count, roomfall=count_2) { "Have " + room + " was create by " + area + " Have " + roomfall + " cant create --> create lines"; }
ʳʰʸᵗʰᵐ_helpers_simpleusermessage = Rhythm.Revit.Helpers.Helpers.SimpleUserMessage(caption=code_block, message=code_block_8)
code_block_9 = CodeBlock { "Sub_Zone"; }
code_block_10 = CodeBlock { "Name"; }
getParameterValueByName = Element.GetParameterValueByName(element=code_block_6.out1, parameterName=code_block_10)
ʳʰʸᵗʰᵐ_elements = Rhythm.Revit.Elements.Elements.SetParameterByNameTypeOrInstance(element=byOutlineTypeAndLevel, parameterName=code_block_9, value=getParameterValueByName)
filterByBoolMask_2 = List.FilterByBoolMask(list=roomBoundaries, mask=code_block_7)
byCurve = ModelCurve.ByCurve(curve=filterByBoolMask_2.in)
