# Dynamo graph script.dyn (Dynamo 2.3.0.5885)
# packages: Data-Shapes 2022.2.96, Rhythm 2020.7.25

code_block = CodeBlock { "CreateRoom"; }
code_block_2 = CodeBlock { "Create Room By Area and Name"; "Create Room"; true; "Cancle"; 300; }
code_block_3 = CodeBlock { "Select Level"; }
categories = Categories("OST_Levels")
all_elements_of_category = ElementsOfCategory(Category=categories)
name = Element.Name(element=all_elements_of_category)
dropdown_data = Custom[DropDown Data](InputName=code_block_3, Keys=name, Values=all_elements_of_category)  # package Data-Shapes; Create data for DropDown input in UI.MultiInputForm ++ . Check out www.data-shapes.net for more infos.
code_block_4 = CodeBlock { "Select Area"; "Select multi"; }
categories_2 = Categories("OST_Areas")
selectmodelelements_data = Custom[SelectModelElements Data](InputName=code_block_4.out0, ButtonText=code_block_4.out1, CategoryFilter=categories_2)  # package Data-Shapes; Creates a Revit element selection input for UI.MultipleInputForm++ . Check out www.data-shapes.net for more infos!
list_create = List.Create(item0=dropdown_data, item1=selectmodelelements_data)
multipleinputform = Custom[MultipleInputForm ++](Description_optional=code_block_2.out0, ButtonText_optional=code_block_2.out1, Inputs=list_create, Toggle=code_block_2.out2, CancelButtonText_optional=code_block_2.out3, Width_optional=code_block_2.out4)  # package Data-Shapes; Create a form with multiple inputs. see www.data-shapes.net for tutorials and infos!
code_block_5 = CodeBlock(selectedLevels=multipleinputform.User_Inputs, selectedAreas=multipleinputform.User_Inputs) { selectedLevels[0]; selectedAreas[1]; }
getLocation = Element.GetLocation(element=code_block_5.out1)
code_block_6 = CodeBlock { "Name"; }
getParameterValueByName = Element.GetParameterValueByName(element=code_block_5.out1, parameterName=code_block_6)
byLocation = Room.ByLocation(level=code_block_5.out0, location=getLocation, name=getParameterValueByName)
count = List.Count(list=byLocation)
count_2 = List.Count(list=getParameterValueByName)
code_block_7 = CodeBlock(room=count, area=count_2) { "Have " + room + " Room was create by " + area + " Areas"; }
ʳʰʸᵗʰᵐ_helpers_simpleusermessage = Rhythm.Revit.Helpers.Helpers.SimpleUserMessage(caption=code_block, message=code_block_7)
