# Dynamo graph script.dyn (Dynamo 2.3.0.5885)
# packages: Clockwork for Dynamo 2.x 2.3.0, Chynamo 0.8.5, Rhythm 2020.7.25, Orchid 203.3.1.8192, Data-Shapes 2022.2.96

code_block = CodeBlock { 200; }

# group: UI
code_block_2 = CodeBlock { "Create FinishCeiling ByBeam"; "Create"; true; "Cancle"; 300; 150; }
code_block_3 = CodeBlock { "Wall Type"; "Level Base"; }
categories = Categories("OST_Levels")
all_elements_of_category = ElementsOfCategory(Category=categories)
name = Element.Name(element=all_elements_of_category)
dropdown_data = Custom[DropDown Data](InputName=code_block_3.out1, Keys=name, Values=all_elements_of_category)  # package Data-Shapes; Create data for DropDown input in UI.MultiInputForm ++ . Check out www.data-shapes.net for more infos.
code_block_4 = CodeBlock { "Floor ThickNess"; "150"; }
boolean = BoolSelector(true)
textbox_data = Custom[TextBox Data](InputName=code_block_4.out0, DefaultText=code_block_4.out1, IsNumberEntry=boolean)  # package Data-Shapes; Create Data for TextBox input in UI.MultipleInputForm ++ . Check out www.data-shapes.net for more informations
code_block_5 = CodeBlock { "Pick Link BEAM"; "PickMulti"; }
selectlinkedelement_s_data = Custom[SelectLinkedElement(s) Data](InputName=code_block_5.out0, ButtonText=code_block_5.out1)  # package Data-Shapes; Create a button input for UI.MultipleInputForm++ that allows to select elements in à linked document. See www.data-shapes.net for more infos!
list_create = List.Create(item0=dropdown_data, item1=textbox_data, item2=selectlinkedelement_s_data)
multipleinputform = Custom[MultipleInputForm ++](Description_optional=code_block_2.out0, ButtonText_optional=code_block_2.out1, Inputs=list_create, Toggle=code_block_2.out2, CancelButtonText_optional=code_block_2.out3, Width_optional=code_block_2.out4, LabelWidth_optional=code_block_2.out5)  # package Data-Shapes; Create a form with multiple inputs. see www.data-shapes.net for tutorials and infos!
code_block_6 = CodeBlock(LevelBase=multipleinputform.User_Inputs, Beams=multipleinputform.User_Inputs, FloorThickNess=multipleinputform.User_Inputs) { LevelBase[0]; Beams[2]; FloorThickNess[1]; }
categories_2 = Categories("OST_Walls")  # frozen
o_elementtype_bycategory = Orchid.RevitProject.Elements.ElementType.ByCategory(category=categories_2)
name_2 = Element.Name(element=o_elementtype_bycategory)
dropdown_data_2 = Custom[DropDown Data](InputName=code_block_3.out0, Keys=name_2, Values=o_elementtype_bycategory)

geometry = Custom[Element.Geometry+](element=code_block_6.out1)  # package Clockwork for Dynamo 2.x; Returns Dynamo AND native Revit geometry of a given element
code_block_7 = CodeBlock(Solids=geometry.dynamoGeometry) { Solids; }
flatten = List.Flatten(list=code_block_7)
nullIndice = Custom[NullIndice](list=flatten)  # package Chynamo; Get all null indice from a list
removeItemAtIndex = List.RemoveItemAtIndex(list=code_block_7, indices=nullIndice)
explode = Geometry.Explode(geometry=removeItemAtIndex)
code_block_8 = CodeBlock { 0.5; }
normalAtParameter = Surface.NormalAtParameter(surface=explode, u=code_block_8, v=code_block_8)
ZAxis = Vector.ZAxis()
isParallel = Vector.IsParallel(vector=normalAtParameter, other=ZAxis)
filterByBoolMask = List.FilterByBoolMask(list=explode, mask=isParallel)
code_block_9 = CodeBlock(a=filterByBoolMask.in) { a; }
normalAtParameter_2 = Surface.NormalAtParameter(surface=code_block_9, u=code_block_8, v=code_block_8)
Z = Vector.Z(vector=normalAtParameter_2)
code_block_10 = CodeBlock(a=Z) { a<0; }
filterByBoolMask_2 = List.FilterByBoolMask(list=code_block_9, mask=code_block_10)
code_block_11 = CodeBlock(a=filterByBoolMask_2.in) { a; }
perimeterCurves = Surface.PerimeterCurves(surface=code_block_11)
byCurve = Custom[ByCurve](curve=perimeterCurves)  # package Chynamo; Create line from curve start and end points
flatten_2 = List.Flatten(list=byCurve@L3)
direction = Line.Direction(line=flatten_2)
removeItemAtIndex_2 = List.RemoveItemAtIndex(list=code_block_6.out1, indices=nullIndice)
code_block_12 = CodeBlock(elements=removeItemAtIndex_2) { elements; }
getLocation = Element.GetLocation(element=code_block_12)
direction_2 = Line.Direction(line=getLocation)
isParallel_2 = Vector.IsParallel(vector=direction, other=direction_2)
filterByBoolMask_3 = List.FilterByBoolMask(list=flatten_2, mask=isParallel_2)
code_block_13 = CodeBlock(LineAsLocationWalls=filterByBoolMask_3.in) { LineAsLocationWalls; }
direction_3 = Line.Direction(line=code_block_13)
ZAxis_2 = Vector.ZAxis()
code_block_14 = CodeBlock { 90; }
rotate = Vector.Rotate(vector=direction_3, axis=ZAxis_2, degrees=code_block_14)
wall_types = WallTypes("PI-TR5-033514-GRI(4)-PNT(1)-CEI")
code_block_15 = CodeBlock { "Width"; }
ʳʰʸᵗʰᵐ_elements = Rhythm.Revit.Elements.Elements.GetParameterValueByNameTypeOrInstance(element=wall_types, parameterName=code_block_15)
code_block_16 = CodeBlock(w=ʳʰʸᵗʰᵐ_elements) { w/2; }
translate = Geometry.Translate(geometry=code_block_13, direction=rotate, distance=code_block_16)
code_block_17 = CodeBlock { "h"; "Reference Level"; }
ʳʰʸᵗʰᵐ_elements_2 = Rhythm.Revit.Elements.Elements.GetParameterValueByNameTypeOrInstance(element=code_block_12, parameterName=code_block_17.out0)
code_block_18 = CodeBlock(hd=ʳʰʸᵗʰᵐ_elements_2, hs=code_block_6.out2) { hd-hs; }
byCurveAndHeight = Wall.ByCurveAndHeight(curve=translate, height=code_block_18, level=code_block_6.out0, wallType=wall_types, lacing=Longest)
code_block_19 = CodeBlock { "Base Offset"; "Location Line"; 5; }
code_block_20 = CodeBlock { 0.5; }
pointAtParameter = Curve.PointAtParameter(curve=code_block_13, param=code_block_20)
plane = Custom[Level.Plane](level=code_block_6.out0)  # package Clockwork for Dynamo 2.x; Retrieves the plane of a given level
distanceTo = Geometry.DistanceTo(geometry=pointAtParameter, other=plane)
ʳʰʸᵗʰᵐ_elements_3 = Rhythm.Revit.Elements.Elements.SetParameterByNameTypeOrInstance(element=byCurveAndHeight, parameterName=code_block_19.out0, value=distanceTo)
ʳʰʸᵗʰᵐ_elements_4 = Rhythm.Revit.Elements.Elements.SetParameterByNameTypeOrInstance(element=ʳʰʸᵗʰᵐ_elements_3, parameterName=code_block_19.out1, value=code_block_19.out2)
code_block_21 = CodeBlock(SolidsFlip=removeItemAtIndex) { SolidsFlip; }
flatten_3 = List.Flatten(list=code_block_21)
geometry_2 = Element.Geometry(element=ʳʰʸᵗʰᵐ_elements_4)
flatten_4 = List.Flatten(list=geometry_2@L3)
intersect = Geometry.Intersect(geometry=flatten_3, other=flatten_4@L2, lacing=Longest)
string_from_object = FromObject(obj=intersect)
code_block_22 = CodeBlock(a=string_from_object) { a=="Solid"; }
allTrue = List.AllTrue(list=code_block_22@@L2)
filterByBoolMask_4 = List.FilterByBoolMask(list=ʳʰʸᵗʰᵐ_elements_4, mask=allTrue)
flatten_5 = List.Flatten(list=filterByBoolMask_4.in)
flip = Custom[Wall.Flip](wall=flatten_5)  # package Clockwork for Dynamo 2.x; Flips the orientation of a given wall - DO ***NOT*** USE IN AUTOMATIC MODE
count = List.Count(list=nullIndice)
code_block_23 = CodeBlock(n=count) { "Cant Create Finsish"; "Have "+ n + " Cant create by Beam cause Cant create solid"; }
ʳʰʸᵗʰᵐ_helpers_simpleusermessage = Rhythm.Revit.Helpers.Helpers.SimpleUserMessage(caption=code_block_23.out0, message=code_block_23.out1)
