# Dynamo graph script.dyn (Dynamo 2.3.0.5885)
# packages: archi-lab.net 2021.25.15, Rhythm 2020.7.25, Clockwork for Dynamo 2.x 2.3.0, RIE 2020.11.18, Structural Design 2019.12.11, Data-Shapes 2022.2.96, MEPover 2022.10.30

code_block = CodeBlock()
# ---------- code_block.designscript (5 lines) ----------
["Doors",
"Windows"];
1;
"Select Door And Window";
true;
# ----------------------------------------
byName = Category.ByName(name=code_block.out0)
code_block_2 = CodeBlock { "Refresh"; true; }
boolean_input = Custom[Boolean input](InputName=code_block_2.out0, DefaultValue=code_block_2.out1)  # package Data-Shapes; Creates a boolean input for UI.MultipleInputForm ++ . Check out www.data-shapes.net for more infos!

# group: UI
code_block_3 = CodeBlock { "Create Lintel"; "Create"; true; "Cancle"; 210; }
code_block_4 = CodeBlock { "Select Family Name of Lintel"; }
categories = Categories("OST_StructuralFraming")
all_families_of_category = Custom[All Families Of Category](category=categories)  # package Clockwork for Dynamo 2.x; Gets all famiies of a given category in the model (does *not *work for system families)
name = Element.Name(element=all_families_of_category)
dropdown_data = Custom[DropDown Data](InputName=code_block_4, Keys=name, Values=all_families_of_category)  # package Data-Shapes; Create data for DropDown input in UI.MultiInputForm ++ . Check out www.data-shapes.net for more infos.
code_block_5 = CodeBlock { "Extend-BothSide from Door/Window"; "250"; true; }
textbox_data = Custom[TextBox Data](InputName=code_block_5.out0, DefaultText=code_block_5.out1, IsNumberEntry=code_block_5.out2)  # package Data-Shapes; Create Data for TextBox input in UI.MultipleInputForm ++ . Check out www.data-shapes.net for more informations
list_create = List.Create(item0=dropdown_data, item1=textbox_data, item2=boolean_input)
boolean = BoolSelector(true)
multipleinputform = Custom[MultipleInputForm ++](Description_optional=code_block_3.out0, ButtonText_optional=code_block_3.out1, Inputs=list_create, Toggle=boolean, CancelButtonText_optional=code_block_3.out3, LabelWidth_optional=code_block_3.out4)  # package Data-Shapes; Create a form with multiple inputs. see www.data-shapes.net for tutorials and infos!
code_block_6 = CodeBlock(FamilyLintel=multipleinputform.User_Inputs, Extends=multipleinputform.User_Inputs, Refresh=multipleinputform.User_Inputs) { FamilyLintel[0]; Extends[1]; Refresh[2]; }

pickObjectsOfCategory = StructuralDesign.Model.Selection.PickObjectsOfCategory(category=byName, objectType=code_block.out1, statusPrompt=code_block.out2, refresh=code_block_6.out2)

# group: Get Physical information
getHost = FamilyInstance.GetHost(familyInstance=pickObjectsOfCategory)

code_block_7 = CodeBlock { null; }
RIE_IndexOf = Custom[RIE_IndexOf](list=getHost, Item=code_block_7)  # package RIE; Returns a sublistlist with all indexes for each item.
removeItemAtIndex = List.RemoveItemAtIndex(list=pickObjectsOfCategory, indices=RIE_IndexOf)

# group: Get None-Physical information from Doors/Windows
code_block_8 = CodeBlock { "Rough Width"; "Rough Height"; "Level"; Bcolumns=200; "Sill Height"; }
ʳʰʸᵗʰᵐ_elements = Rhythm.Revit.Elements.Elements.GetParameterValueByNameTypeOrInstance(element=removeItemAtIndex, parameterName=code_block_8.out2)
ʳʰʸᵗʰᵐ_elements_2 = Rhythm.Revit.Elements.Elements.GetParameterValueByNameTypeOrInstance(element=removeItemAtIndex, parameterName=code_block_8.out0)
ʳʰʸᵗʰᵐ_elements_3 = Rhythm.Revit.Elements.Elements.GetParameterValueByNameTypeOrInstance(element=removeItemAtIndex, parameterName=code_block_8.out1)
ʳʰʸᵗʰᵐ_elements_4 = Rhythm.Revit.Elements.Elements.GetParameterValueByNameTypeOrInstance(element=removeItemAtIndex, parameterName=code_block_8.out4)

removeItemAtIndex_2 = List.RemoveItemAtIndex(list=getHost, indices=RIE_IndexOf)

# group: Information from Host
code_block_9 = CodeBlock { "Width"; }
ʳʰʸᵗʰᵐ_elements_5 = Rhythm.Revit.Elements.Elements.GetParameterValueByNameTypeOrInstance(element=removeItemAtIndex_2, parameterName=code_block_9)

string_from_object = FromObject(obj=ʳʰʸᵗʰᵐ_elements_5)
code_block_10 = CodeBlock { 0; 3; }
substring = String.Substring(str=string_from_object, startIndex=code_block_10.out0, length=code_block_10.out1)
chọn_chiều_cao_lintel_theo_bề = CodeBlock(Width=ʳʰʸᵗʰᵐ_elements_2)  # "Chọn chiều cao lintel theo bề rộng cửa"
# ---------- chọn_chiều_cao_lintel_theo_bề.designscript (3 lines) ----------
Width<=1200? 70 :
(1200<Width)&&(Width<=2400)? 140 :
(2400<Width)&&(Width<=3600)? 280 : 300;
# ----------------------------------------
string_from_object_2 = FromObject(obj=chọn_chiều_cao_lintel_theo_bề)
toNumber = String.ToNumber(str=string_from_object_2)
code_block_11 = CodeBlock(b=substring, h=toNumber) { "Lintel-"+b+"x"+h; }
string_from_object_3 = FromObject(obj=code_block_11)
family_types_of_family = Custom[Family types of family](family=code_block_6.out0)  # package MEPover; Returns every family type of the given Family
code_block_12 = CodeBlock(a=family_types_of_family) { a[0]; }
byName_2 = FamilyType.ByName(name=string_from_object_3)
code_block_13 = CodeBlock { null; }
RIE_IndexOf_2 = Custom[RIE_IndexOf](list=byName_2, Item=code_block_13)
getItemAtIndex = List.GetItemAtIndex(list=string_from_object_3, index=RIE_IndexOf_2)
uniqueItems = List.UniqueItems(list=getItemAtIndex)
duplicate = archilab.Revit.Elements.ElementTypes.Duplicate(element=code_block_12, name=uniqueItems)
passthrough = Custom[Passthrough](passThrough=string_from_object_3, waitFor=duplicate)  # package Clockwork for Dynamo 2.x; Forces a sequential order of execution. The node wired into the output of the Passthrough node will be executed *after* the node wired into the waitFor input (e.g. important for some Revit operations). The value of the passThrough input will be passed on to the node wired into the output port of the Passthrough node.
byName_3 = FamilyType.ByName(name=passthrough)

# group: Create Beam
beamByCurve = StructuralFraming.BeamByCurve(level=ʳʰʸᵗʰᵐ_elements, structuralFramingType=byName_3)  # frozen; unwired: curve
code_block_14 = CodeBlock(RH=ʳʰʸᵗʰᵐ_elements_3, hbeam=chọn_chiều_cao_lintel_theo_bề, SillHeight=ʳʰʸᵗʰᵐ_elements_4) { z; RH; hbeam; SillHeight; z=RH; }

code_block_15 = CodeBlock { "b"; "h"; }
code_block_16 = CodeBlock { "-"; "x"; }
split = String.Split(str=uniqueItems, separator0=code_block_16.out0, separator1=code_block_16.out1)
code_block_17 = CodeBlock { 1; 2; }
getItemAtIndex_2 = List.GetItemAtIndex(list=split@L2, index=code_block_17.out0)
toNumber_2 = String.ToNumber(str=getItemAtIndex_2)
ʳʰʸᵗʰᵐ_elements_6 = Rhythm.Revit.Elements.Elements.SetParameterByNameTypeOrInstance(element=duplicate, parameterName=code_block_15.out0, value=toNumber_2)
getItemAtIndex_3 = List.GetItemAtIndex(list=split@L2, index=code_block_17.out1)
toNumber_3 = String.ToNumber(str=getItemAtIndex_3)
ʳʰʸᵗʰᵐ_elements_7 = Rhythm.Revit.Elements.Elements.SetParameterByNameTypeOrInstance(element=duplicate, parameterName=code_block_15.out1, value=toNumber_3)
getLocation = Element.GetLocation(element=removeItemAtIndex_2)
string_from_object_4 = FromObject(obj=getLocation)
code_block_18 = CodeBlock { "Line"; }
contains = String.Contains(str=string_from_object_4, searchFor=code_block_18)
filterByBoolMask = List.FilterByBoolMask(list=removeItemAtIndex_2, mask=contains)
getLocation_2 = Element.GetLocation(element=filterByBoolMask.in)
filterByBoolMask_2 = List.FilterByBoolMask(list=removeItemAtIndex, mask=contains)
getLocation_3 = Element.GetLocation(element=filterByBoolMask_2.in)
closestPointTo = Geometry.ClosestPointTo(geometry=getLocation_2, other=getLocation_3)
direction = Line.Direction(line=getLocation_2)
code_block_19 = CodeBlock { "Rough Width"; "Level"; }
ʳʰʸᵗʰᵐ_elements_8 = Rhythm.Revit.Elements.Elements.GetParameterValueByNameTypeOrInstance(element=filterByBoolMask_2.in, parameterName=code_block_19.out0)
code_block_20 = CodeBlock(w=ʳʰʸᵗʰᵐ_elements_8, ex=code_block_6.out1) { w/2+ex; }
byStartPointDirectionLength = Line.ByStartPointDirectionLength(startPoint=closestPointTo, direction=direction, length=code_block_20)
extendStart = Curve.ExtendStart(curve=byStartPointDirectionLength, distance=code_block_20)
ʳʰʸᵗʰᵐ_elements_9 = Rhythm.Revit.Elements.Elements.GetParameterValueByNameTypeOrInstance(element=filterByBoolMask_2.in, parameterName=code_block_19.out1)
RIE_IndexOf_3 = Custom[RIE_IndexOf](list=removeItemAtIndex, Item=filterByBoolMask_2.in)
getItemAtIndex_4 = List.GetItemAtIndex(list=byName_3, index=RIE_IndexOf_3)
flatten = List.Flatten(list=getItemAtIndex_4)
line = CodeBlock(Locations=extendStart, ReferenceLeves=ʳʰʸᵗʰᵐ_elements_9, Types=flatten, DorW=filterByBoolMask_2.in) { Locations; ReferenceLeves; Types; DorW; }
getLocation_4 = Element.GetLocation(element=filterByBoolMask.out)
centerPoint = Arc.CenterPoint(arc=getLocation_4)
getLocation_5 = Element.GetLocation(element=filterByBoolMask_2.out)
closestPointTo_2 = Geometry.ClosestPointTo(geometry=getLocation_4, other=getLocation_5)
code_block_21 = CodeBlock { "Rough Width"; "Level"; }
ʳʰʸᵗʰᵐ_elements_10 = Rhythm.Revit.Elements.Elements.GetParameterValueByNameTypeOrInstance(element=filterByBoolMask_2.out, parameterName=code_block_21.out0)
PI = Math.PI()
radius = Arc.Radius(arc=getLocation_4)
code_block_22 = CodeBlock(W=ʳʰʸᵗʰᵐ_elements_10, ex=code_block_6.out1, pi=PI, r=radius) { (180*(W/2+ex))/(pi*r); }
byCenterPointStartPointSweepAngle = Arc.ByCenterPointStartPointSweepAngle(centerPoint=centerPoint, startPoint=closestPointTo_2, sweepAngle=code_block_22)
endPoint = Curve.EndPoint(curve=byCenterPointStartPointSweepAngle)
code_block_23 = CodeBlock(l=code_block_22) { -2*l; }
byCenterPointStartPointSweepAngle_2 = Arc.ByCenterPointStartPointSweepAngle(centerPoint=centerPoint, startPoint=endPoint, sweepAngle=code_block_23)
ʳʰʸᵗʰᵐ_elements_11 = Rhythm.Revit.Elements.Elements.GetParameterValueByNameTypeOrInstance(element=filterByBoolMask_2.out, parameterName=code_block_21.out1)
RIE_IndexOf_4 = Custom[RIE_IndexOf](list=removeItemAtIndex, Item=filterByBoolMask_2.out)
getItemAtIndex_5 = List.GetItemAtIndex(list=byName_3, index=RIE_IndexOf_4)
flatten_2 = List.Flatten(list=getItemAtIndex_5)
ARC = CodeBlock(Locations=byCenterPointStartPointSweepAngle_2, ReferenceLeves=ʳʰʸᵗʰᵐ_elements_11, Types=flatten_2, DorW=filterByBoolMask_2.out) { Locations; ReferenceLeves; Types; DorW; }
join = List.Join(list0=line.Locations, list1=ARC.Locations)
join_2 = List.Join(list0=line.ReferenceLeves, list1=ARC.ReferenceLeves)
join_3 = List.Join(list0=line.Types, list1=ARC.Types)
join_4 = List.Join(list0=line.DorW, list1=ARC.DorW)
line_2 = CodeBlock(Locations=join, ReferenceLeves=join_2, Types=join_3, DorW=join_4) { Locations; ReferenceLeves; Types; DorW; }
beamByCurve_2 = StructuralFraming.BeamByCurve(curve=line_2.Locations, level=line_2.ReferenceLeves, structuralFramingType=line_2.Types)
code_block_24 = CodeBlock { "Start Level Offset"; "End Level Offset"; }
code_block_25 = CodeBlock { "Rough Height"; }
ʳʰʸᵗʰᵐ_elements_12 = Rhythm.Revit.Elements.Elements.GetParameterValueByNameTypeOrInstance(element=line_2.DorW, parameterName=code_block_25)
ʳʰʸᵗʰᵐ_elements_13 = Rhythm.Revit.Elements.Elements.SetParameterValueByNameCaSeiNSeNSiTiVe(element=beamByCurve_2, parameterName=code_block_24.out0, value=ʳʰʸᵗʰᵐ_elements_12)
ʳʰʸᵗʰᵐ_elements_14 = Rhythm.Revit.Elements.Elements.SetParameterValueByNameCaSeiNSeNSiTiVe(element=beamByCurve_2, parameterName=code_block_24.out1, value=ʳʰʸᵗʰᵐ_elements_12)
