# Dynamo graph script.dyn (Dynamo 2.3.0.5885)
# packages: Data-Shapes 2022.2.96, Clockwork for Dynamo 2.x 2.3.0, MEPover 2022.10.30, Structural Design 2019.12.11, Rhythm 2020.7.25, Genius Loci 2022.8.5, RIE 2020.11.18, OpenMEP 1.0.0, Orchid 203.3.1.8192, archi-lab.net 2021.25.15

categories = Categories("OST_Walls")
code_block = CodeBlock { 1; "Select Wall"; true; }
pickObjectsOfCategory = StructuralDesign.Model.Selection.PickObjectsOfCategory(category=categories, objectType=code_block.out0, statusPrompt=code_block.out1, refresh=code_block.out2)
code_block_2 = CodeBlock { "Width"; }
code_block_3 = CodeBlock { "Select Column Link"; "Pick"; }
selectlinkedelement_s_data = Custom[SelectLinkedElement(s) Data](InputName=code_block_3.out0, ButtonText=code_block_3.out1)  # package Data-Shapes; Create a button input for UI.MultipleInputForm++ that allows to select elements in à linked document. See www.data-shapes.net for more infos!
boolean = BoolSelector(true)

# group: UI
code_block_4 = CodeBlock { "Create Stiffiner at wall base Wall condition"; "Create"; true; "Cancel"; 150; }
code_block_5 = CodeBlock { "Select Family"; "Select Base Level"; }
categories_2 = Categories("OST_StructuralColumns")
code_block_6 = CodeBlock { true; }
all_families_of_category = Custom[All Families Of Category](category=categories_2, toggle=code_block_6)  # package Clockwork for Dynamo 2.x; Gets all famiies of a given category in the model (does *not *work for system families)
name = Element.Name(element=all_families_of_category)
dropdown_data = Custom[DropDown Data](InputName=code_block_5.out0, Keys=name, Values=all_families_of_category)  # package Data-Shapes; Create data for DropDown input in UI.MultiInputForm ++ . Check out www.data-shapes.net for more infos.
categories_3 = Categories("OST_Levels")
all_elements_of_category = ElementsOfCategory(Category=categories_3)
name_2 = Element.Name(element=all_elements_of_category)
dropdown_data_2 = Custom[DropDown Data](InputName=code_block_5.out1, Keys=name_2, Values=all_elements_of_category)
code_block_7 = CodeBlock { "Column Spacing"; "3000"; true; }
textbox_data = Custom[TextBox Data](InputName=code_block_7.out0, DefaultText=code_block_7.out1, IsNumberEntry=code_block_7.out2)  # package Data-Shapes; Create Data for TextBox input in UI.MultipleInputForm ++ . Check out www.data-shapes.net for more informations
code_block_8 = CodeBlock { "Column Height"; "200"; true; }
textbox_data_2 = Custom[TextBox Data](InputName=code_block_8.out0, DefaultText=code_block_8.out1, IsNumberEntry=code_block_8.out2)
list_create = List.Create(item0=dropdown_data, item1=dropdown_data_2, item2=textbox_data, item3=textbox_data_2, item4=selectlinkedelement_s_data)
multipleinputform = Custom[MultipleInputForm ++](Description_optional=code_block_4.out0, ButtonText_optional=code_block_4.out1, Inputs=list_create, Toggle=boolean, CancelButtonText_optional=code_block_4.out3, LabelWidth_optional=code_block_4.out4)  # package Data-Shapes; Create a form with multiple inputs. see www.data-shapes.net for tutorials and infos!

code_block_9 = CodeBlock(FamilyColumn=multipleinputform.User_Inputs, LevelBase=multipleinputform.User_Inputs, ColumnSpacing=multipleinputform.User_Inputs, ColumnHeight=multipleinputform.User_Inputs, ColumnLink=multipleinputform.User_Inputs) { FamilyColumn[0]; LevelBase[1]; ColumnSpacing[2]; ColumnHeight[3]; ColumnLink[4]; }

# group: DUPLICATE NEW TYPE BY WALL WIDTH
ʳʰʸᵗʰᵐ_elements = Rhythm.Revit.Elements.Elements.GetParameterValueByNameTypeOrInstance(element=pickObjectsOfCategory, parameterName=code_block_2)
floor = Math.Floor(number=ʳʰʸᵗʰᵐ_elements)
floor_2 = Math.Floor(number=code_block_9.out3)
code_block_10 = CodeBlock(b=floor, h=floor_2) { b+"x"+h; }
family_types_of_family = Custom[Family types of family](family=code_block_9.out0)  # package MEPover; Returns every family type of the given Family
code_block_11 = CodeBlock(a=family_types_of_family) { a[0]; }
uniqueItems = List.UniqueItems(list=code_block_10)
name_3 = Element.Name(element=family_types_of_family)
eq = uniqueItems == name_3@L2  # lacing=Longest
allFalse = List.AllFalse(list=eq@L2)
filterByBoolMask = List.FilterByBoolMask(list=uniqueItems, mask=allFalse)
element_duplicate = Custom[Element Duplicate](element=code_block_11, name=filterByBoolMask.in)  # package Genius Loci; Duplicates the given element (view, element type).
passthrough = Custom[Passthrough](passThrough=code_block_10, waitFor=element_duplicate)  # package Clockwork for Dynamo 2.x; Forces a sequential order of execution. The node wired into the output of the Passthrough node will be executed *after* the node wired into the waitFor input (e.g. important for some Revit operations). The value of the passThrough input will be passed on to the node wired into the output port of the Passthrough node.
byName = FamilyType.ByName(name=passthrough)

code_block_12 = CodeBlock { 1; }
chop = List.Chop(list=byName, lengths=code_block_12)
list_create_2 = List.Create()  # unwired: item0, item1
getLocation = Element.GetLocation(element=pickObjectsOfCategory)
code_block_13 = CodeBlock(HColumn=code_block_9.out3, Spacing=code_block_9.out2) { HColumn; Spacing; }
length = Curve.Length(curve=getLocation)
code_block_14 = CodeBlock(Hcl=code_block_13.HColumn, L=length, SP=code_block_13.Spacing) { Hcl/2/L..(L-Hcl/2)/L..SP/L; (L-Hcl/2)/L; }
pointAtParameter = Curve.PointAtParameter(curve=getLocation, param=code_block_14.out0)
pointAtParameter_2 = Curve.PointAtParameter(curve=getLocation, param=code_block_14.out1)
combine = List.Combine(comb=list_create_2, list1=pointAtParameter, list2=pointAtParameter_2)
flatten = List.Flatten(list=combine@@L3)
code_block_15 = CodeBlock(LineWall=getLocation) { LineWall; }
list_create_3 = List.Create()  # unwired: item0, item1, item2, item3
length_2 = Curve.Length(curve=code_block_15)
code_block_16 = CodeBlock(A=code_block_13.HColumn, L=length_2, SP=code_block_13.Spacing) { A/(2*L); L/L; SP/L; 1; }
pointAtParameter_3 = Curve.PointAtParameter(curve=code_block_15, param=code_block_16.out0)
pointAtParameter_4 = Curve.PointAtParameter(curve=code_block_15, param=code_block_16.out3)
RIE_Wall_GetDoorsAndWindows = Custom[RIE_Wall_GetDoorsAndWindows](walls=pickObjectsOfCategory)  # package RIE; Retrieves Doors and Windows hosted by input wall element
list_create_4 = List.Create(item0=RIE_Wall_GetDoorsAndWindows.doors, item1=RIE_Wall_GetDoorsAndWindows.windows)
transpose = List.Transpose(lists=list_create_4)
getLocation_2 = Element.GetLocation(element=transpose)
flatten_2 = List.Flatten(list=getLocation_2@@L3)
closestPointTo = Geometry.ClosestPointTo(geometry=getLocation, other=flatten_2)
direction = Line.Direction(line=getLocation)
code_block_17 = CodeBlock { "Rough Width"; }
ʳʰʸᵗʰᵐ_elements_2 = Rhythm.Revit.Elements.Elements.GetParameterValueByNameTypeOrInstance(element=transpose, parameterName=code_block_17)
flatten_3 = List.Flatten(list=ʳʰʸᵗʰᵐ_elements_2@@L3)
code_block_18 = CodeBlock(w=flatten_3) { w/2; }
translate = Geometry.Translate(geometry=closestPointTo, direction=direction, distance=code_block_18)
reverse = Vector.Reverse(vector=direction)
translate_2 = Geometry.Translate(geometry=closestPointTo, direction=reverse, distance=code_block_18)
combine_2 = List.Combine(comb=list_create_3, list1=pointAtParameter_3, list2=pointAtParameter_4, list3=translate, list4=translate_2)
flatten_4 = List.Flatten(list=combine_2@L3)
clear_list = Custom[Clear List](input=flatten_4)  # package archi-lab.net; This node will remove all Null and Empty Lists from any list.
splitByPoints = Curve.SplitByPoints(curve=code_block_15, points=clear_list)
count = List.Count(list=splitByPoints@L2)
code_block_19 = CodeBlock(n=count) { 1..n-1..2; }
getItemAtIndex = List.GetItemAtIndex(list=splitByPoints@L2, index=code_block_19@L2)
flatten_5 = List.Flatten(list=getItemAtIndex)
doesIntersect = Geometry.DoesIntersect(geometry=flatten@@L1, other=flatten_5@L1, lacing=CrossProduct)
o_list_anytrue = Orchid.Common.List.AnyTrue(list=doesIntersect@L3)
filterByBoolMask_2 = List.FilterByBoolMask(list=flatten, mask=o_list_anytrue)
code_block_20 = CodeBlock { 400; }
byCenterPointRadius = Circle.ByCenterPointRadius(centerPoint=filterByBoolMask_2.in, radius=code_block_20)
code_block_21 = CodeBlock(LinkElements=code_block_9.out4) { LinkElements; }
geometry = Element.Geometry(element=code_block_21)
flatten_6 = List.Flatten(list=geometry)
doesIntersect_2 = Geometry.DoesIntersect(geometry=byCenterPointRadius@@L1, other=flatten_6@L1, lacing=CrossProduct)
allFalse_2 = List.AllFalse(list=doesIntersect_2@@L2)
filterByBoolMask_3 = List.FilterByBoolMask(list=filterByBoolMask_2.in, mask=allFalse_2)
isEmpty = List.IsEmpty(list=filterByBoolMask_3.in@@L2)
filterByBoolMask_4 = List.FilterByBoolMask(list=chop, mask=isEmpty)
isNull = Object.IsNull(obj=code_block_21)
filterByBoolMask_5 = List.FilterByBoolMask(list=filterByBoolMask_3.in, mask=isEmpty)
RIE_If = Custom[RIE_If](Test=isNull, True=filterByBoolMask_2.in, False=filterByBoolMask_5.out)  # package RIE; An If node that keeps list structure, empty lists and so forth.
count_2 = List.Count(list=RIE_If@L2)
cycle = List.Cycle(list=filterByBoolMask_4.in@L2, amount=count_2@L1)
code_block_22 = CodeBlock(LevelBase=code_block_9.out1) { LevelBase; }
byPointAndLevel = FamilyInstance.ByPointAndLevel(familyType=cycle, point=RIE_If, level=code_block_22)
ZAxis = Vector.ZAxis()
orientation = Custom[Wall.Orientation](wall=pickObjectsOfCategory)  # package Clockwork for Dynamo 2.x; Gets the orientation of a given wall instance (normal of the exterior face of the wall). Will *not* work for walls hosted on mass faces or in-place walls.
XAxis = Vector.XAxis()
angleAboutAxis = Vector.AngleAboutAxis(vector=orientation, otherVector=XAxis, rotationAxis=ZAxis)
code_block_23 = CodeBlock { 1; }
chop_2 = List.Chop(list=angleAboutAxis, lengths=code_block_23)
cycle_2 = List.Cycle(list=chop_2@L2, amount=count_2@L1)
rotate = OpenMEPRevit.Element.Element.Rotate(element=byPointAndLevel, vectorAxis=ZAxis, angle=cycle_2)
code_block_24 = CodeBlock { "Unconnected Height"; "Base Offset"; "Top Offset"; "Base Constraint"; "Base Level"; "Top Level"; }
code_block_25 = CodeBlock(Walls=pickObjectsOfCategory) { Walls; }
chop_3 = List.Chop(list=code_block_25, lengths=code_block_23)
ʳʰʸᵗʰᵐ_elements_3 = Rhythm.Revit.Elements.Elements.GetParameterValueByNameTypeOrInstance(element=chop_3, parameterName=code_block_24.out1)
cycle_3 = List.Cycle(list=ʳʰʸᵗʰᵐ_elements_3@L2, amount=count_2@L1)
ʳʰʸᵗʰᵐ_elements_4 = Rhythm.Revit.Elements.Elements.SetParameterByNameTypeOrInstance(element=rotate, parameterName=code_block_24.out1, value=cycle_3)
ʳʰʸᵗʰᵐ_elements_5 = Rhythm.Revit.Elements.Elements.GetParameterValueByNameTypeOrInstance(element=chop_3, parameterName=code_block_24.out0)
cycle_4 = List.Cycle(list=ʳʰʸᵗʰᵐ_elements_5@L2, amount=count_2@L1)
code_block_26 = CodeBlock(a=cycle_3, b=cycle_4) { a+b; }
ʳʰʸᵗʰᵐ_elements_6 = Rhythm.Revit.Elements.Elements.SetParameterByNameTypeOrInstance(element=rotate, parameterName=code_block_24.out2, value=code_block_26)
ʳʰʸᵗʰᵐ_elements_7 = Rhythm.Revit.Elements.Elements.GetParameterValueByNameTypeOrInstance(element=chop_3, parameterName=code_block_24.out3)
cycle_5 = List.Cycle(list=ʳʰʸᵗʰᵐ_elements_7@L2, amount=count_2@L1)
ʳʰʸᵗʰᵐ_elements_8 = Rhythm.Revit.Elements.Elements.SetParameterByNameTypeOrInstance(element=ʳʰʸᵗʰᵐ_elements_6, parameterName=code_block_24.out5, value=cycle_5)
ʳʰʸᵗʰᵐ_elements_9 = Rhythm.Revit.Elements.Elements.SetParameterByNameTypeOrInstance(element=rotate, parameterName=code_block_24.out4, value=cycle_5)
