# Dynamo graph script.dyn (Dynamo 2.6.1.8786)
# packages: Data-Shapes 2022.2.96, RIE 2020.11.18, archi-lab.net 2021.25.15, Bang! 2021.4.3

boolean = BoolSelector(true)
getWarnings = Bang.Revit.Elements.WarningTools.GetWarnings(toggle=boolean)
code_block = CodeBlock { "Get WarningType"; "iSolAte element"; true; "Cancel"; 400; 600; 150; }
code_block_2 = CodeBlock { "Warning Name"; "SELECT SOLID"; "SELECT"; }
uniqueItems = List.UniqueItems(list=getWarnings.Warning_Text)  # graph output
boolean_2 = BoolSelector(true)
dropdown_data = Custom[DropDown Data](InputName=code_block_2.out0, Keys=uniqueItems, Values=uniqueItems, Sorted_optional=boolean_2)  # package Data-Shapes; Create data for DropDown input in UI.MultiInputForm ++ . Check out www.data-shapes.net for more infos.
multipleinputform = Custom[MultipleInputForm ++](Description_optional=code_block.out0, ButtonText_optional=code_block.out1, Inputs=dropdown_data, Toggle=code_block.out2, CancelButtonText_optional=code_block.out3, MaxHeight_optional=code_block.out4, Width_optional=code_block.out5, LabelWidth_optional=code_block.out6)  # package Data-Shapes; Create a form with multiple inputs. see www.data-shapes.net for tutorials and infos!
code_block_3 = CodeBlock(a=multipleinputform.User_Inputs) { a[0]; }
flatten = List.Flatten(list=code_block_3)
eq = getWarnings.Warning_Text == flatten  # lacing=Longest
filterByBoolMask = List.FilterByBoolMask(list=getWarnings.Failing_Elements, mask=eq)
flatten_2 = List.Flatten(list=filterByBoolMask.in)
uniqueItems_2 = List.UniqueItems(list=flatten_2)
boolean_3 = BoolSelector(true)
RIE_ActiveView = Custom[RIE_ActiveView](Refresh=boolean_3)  # package RIE; Returns active view in current document.
isolate_in_view = Custom[Isolate in View](element=uniqueItems_2, view=RIE_ActiveView)  # package archi-lab.net
