# Dynamo graph script.dyn (Dynamo 2.5.0.7460)
# packages: Orchid 203.3.1.8192, Data-Shapes 2022.2.96, Rhythm 2020.7.25

code_block = CodeBlock { "Copy Element link"; "Copy"; true; "Cancle"; 400; 400; 150; }
code_block_2 = CodeBlock { "Select Link"; "Select"; }
selectmodelelements_data = Custom[SelectModelElements Data](InputName=code_block_2.out0, ButtonText=code_block_2.out1)  # package Data-Shapes; Creates a Revit element selection input for UI.MultipleInputForm++ . Check out www.data-shapes.net for more infos!
code_block_3 = CodeBlock { "Select Element Link"; "Select"; }
selectlinkedelement_s_data = Custom[SelectLinkedElement(s) Data](InputName=code_block_3.out0, ButtonText=code_block_3.out1)  # package Data-Shapes; Create a button input for UI.MultipleInputForm++ that allows to select elements in à linked document. See www.data-shapes.net for more infos!
list_create = List.Create(item0=selectmodelelements_data, item1=selectlinkedelement_s_data)
multipleinputform = Custom[MultipleInputForm ++](Description_optional=code_block.out0, ButtonText_optional=code_block.out1, Inputs=list_create, Toggle=code_block.out2, CancelButtonText_optional=code_block.out3, MaxHeight_optional=code_block.out4, Width_optional=code_block.out5, LabelWidth_optional=code_block.out6)  # package Data-Shapes; Create a form with multiple inputs. see www.data-shapes.net for tutorials and infos!
code_block_4 = CodeBlock(link=multipleinputform.User_Inputs, Elementss=multipleinputform.User_Inputs) { link[0]; Elementss[1]; }

# group: UI-Copy element from File Link
o_link_document = Orchid.RevitProject.Common.Link.Document(instance=code_block_4.out0)
o_document_current = Orchid.RevitProject.Common.Document.Current()
type = Object.Type(obj=code_block_4.out1)
code_block_5 = CodeBlock { "Type"; true; }
contains = String.Contains(str=type, searchFor=code_block_5.out0, ignoreCase=code_block_5.out1)
filterByBoolMask = List.FilterByBoolMask(list=code_block_4.out1, mask=contains)
o_document_copyelement = Orchid.RevitProject.Common.Document.CopyElement(source=o_link_document, target=o_document_current, element=filterByBoolMask.out)

code_block_6 = CodeBlock { "Workset"; }
ʳʰʸᵗʰᵐ_elements = Rhythm.Revit.Elements.Elements.GetParameterValueByNameCaSeiNSeNSiTiVe(element=code_block_4.out1, parameterName=code_block_6)
ʳʰʸᵗʰᵐ_elements_2 = Rhythm.Revit.Elements.Elements.SetParameterByNameTypeOrInstance(parameterName=code_block_6, value=ʳʰʸᵗʰᵐ_elements)  # unwired: element
