# Dynamo graph SetLocation.dyn (Dynamo 2.3.0.5885)
# packages: bimorphNodes 3.0.3, Structural Design 2019.12.11, Rhythm 2020.7.25, Clockwork for Dynamo 2.x 2.3.0, spring nodes 132.2.5, Orchid 203.3.1.8192

code_block = CodeBlock { "Select cad"; }
boolean = BoolSelector(true)
pickElements = StructuralDesign.Model.Selection.PickElements(statusPrompt=code_block, refresh=boolean)
code_block_2 = CodeBlock { "AxisAlignRevit"; }
curvesFromCADLayers = CAD.CurvesFromCADLayers(importInstance=pickElements, layerNames=code_block_2)
flatten = List.Flatten(list=curvesFromCADLayers.Curve@L2)
transpose = List.Transpose(lists=flatten)
code_block_3 = CodeBlock(A=transpose) { A[0]; }
code_block_4 = CodeBlock(A=transpose) { A[1]; }
intersectAll = Geometry.IntersectAll(geometry=code_block_3@L1, others=code_block_4@L1)
code_block_5 = CodeBlock { "Select Grid"; }
pickElements_2 = StructuralDesign.Model.Selection.PickElements(statusPrompt=code_block_5, refresh=boolean)
code_block_6 = CodeBlock(GridAlignX=pickElements_2, GridAlignY=pickElements_2) { GridAlignX[0]; GridAlignY[1]; }
curve = Grid.Curve(grid=code_block_6.out0)
curve_2 = Grid.Curve(grid=code_block_6.out1)
intersect = Geometry.Intersect(geometry=curve, other=curve_2)
code_block_7 = CodeBlock { "Base Level"; }
ʳʰʸᵗʰᵐ_elements = Rhythm.Revit.Elements.Elements.GetParameterValueByNameTypeOrInstance(element=pickElements, parameterName=code_block_7)
plane = Custom[Level.Plane](level=ʳʰʸᵗʰᵐ_elements)  # package Clockwork for Dynamo 2.x; Retrieves the plane of a given level
pullOntoPlane = Custom[Springs.Point.PullOntoPlane](point=intersect, plane=plane, lacing=Longest)  # package spring nodes; Pulls (projects) the point onto the input plane, following the plane normal.
byStartPointEndPoint = Line.ByStartPointEndPoint(startPoint=intersectAll, endPoint=pullOntoPlane, lacing=Longest)
direction = Line.Direction(line=byStartPointEndPoint)
o_element_move = Orchid.RevitProject.Elements.Element.Move(element=pickElements, vector=direction)
