# Dynamo graph script.dyn "GE-ReloadLink" (Dynamo 2.3.0.5885)
# packages: Orchid 203.3.1.8192, Data-Shapes 2022.2.96, Genius Loci 2022.8.5, Rhythm 2020.7.25

code_block = CodeBlock { "Cad Susscessfull Reload byPath"; }
code_block_2 = CodeBlock { "Reload Link By Path"; "Reload"; "Cancle"; true; 850; 400; 150; }
code_block_3 = CodeBlock { "Seach Path"; }
string = StringInput("W:\Project")
textbox_data = Custom[TextBox Data](InputName=code_block_3, DefaultText=string)  # package Data-Shapes; Create Data for TextBox input in UI.MultipleInputForm ++ . Check out www.data-shapes.net for more informations
code_block_4 = CodeBlock { "FilePath"; ""; "GetPath"; }
directorypath_data = Custom[DirectoryPath Data](InputName=code_block_4.out0, ButtonText=code_block_4.out2)  # package Data-Shapes; Creates a DirectoryPath input for UI.MultipleInputForm ++ . Check out www.data-shapes.net for more infos!
code_block_5 = CodeBlock { "SelectLink"; 400; true; false; }
o_document_current = Orchid.RevitProject.Common.Document.Current()
o_link_getcadlink = Orchid.RevitProject.Common.Link.GetCadLink(document=o_document_current)
name = Element.Name(element=o_link_getcadlink)
sortByKey = List.SortByKey(list=o_link_getcadlink, keys=name)
listview_data = Custom[Listview Data](InputName=code_block_5.out0, Keys=sortByKey.sorted_keys, Values=sortByKey.sorted_list, Height_optionnal=code_block_5.out1, HilightInView_optionnal=code_block_5.out3, DisplayModeOnly_optionnal=code_block_5.out3, ShowElementCount_optionnal=code_block_5.out3, SortItems_optionnal=code_block_5.out3, ShowId_optionnal=code_block_5.out3)  # package Data-Shapes; Create data for ListView input in UI.MultiInputForm ++ . Check out www.data-shapes.net for more infos.
list_create = List.Create(item0=textbox_data, item1=directorypath_data, item2=listview_data)
multipleinputform = Custom[MultipleInputForm ++](Description_optional=code_block_2.out0, ButtonText_optional=code_block_2.out1, Inputs=list_create, Toggle=code_block_2.out3, CancelButtonText_optional=code_block_2.out2, MaxHeight_optional=code_block_2.out4, Width_optional=code_block_2.out5, LabelWidth_optional=code_block_2.out6)  # package Data-Shapes; Create a form with multiple inputs. see www.data-shapes.net for tutorials and infos!
code_block_6 = CodeBlock(cadlink=multipleinputform.User_Inputs, PathReload=multipleinputform.User_Inputs, Directoryfrompath=multipleinputform.User_Inputs) { cadlink[2]; PathReload[1]; Directoryfrompath[0]; }
name_2 = Element.Name(element=code_block_6.out0)
o_link_instance = Orchid.RevitProject.Common.Link.Instance(link=code_block_6.out0)
directory_from_path = DirectoryObject(path=code_block_6.out1)
string_2 = StringInput("W:\Project")
contains = String.Contains(str=directory_from_path, searchFor=string_2)
isNull = Object.IsNull(obj=contains)
directory_from_path_2 = DirectoryObject(path=code_block_6.out2)
if_ = If(test=isNull, true=directory_from_path_2, false=directory_from_path)
code_block_7 = CodeBlock { "*dwg"; }
getDirectoryContents = FileSystem.GetDirectoryContents(directory=if_, searchString=code_block_7)
contains_2 = String.Contains(str=getDirectoryContents.files, searchFor=name_2, lacing=CrossProduct)
countTrue = List.CountTrue(list=contains_2@L2)
code_block_8 = CodeBlock(a=countTrue) { a<=1; }
filterByBoolMask = List.FilterByBoolMask(list=contains_2, mask=code_block_8)
o_list_anytrue = Orchid.Common.List.AnyTrue(list=filterByBoolMask.in)
filterByBoolMask_2 = List.FilterByBoolMask(list=getDirectoryContents.files, mask=o_list_anytrue)
repath_cad_importinstance = Custom[Repath CAD ImportInstance](importInstance=o_link_instance, FilePath=filterByBoolMask_2.in)  # package Genius Loci; Reloads the CAD link from the input path.
name_3 = Element.Name(element=repath_cad_importinstance)
setDifference = List.SetDifference(list1=name_2, list2=name_3)
python_script = Python(IN[0]=setDifference)
# ---------- python_script.python (3 lines) ----------
element = IN[0]
result_string = '\n'.join(element)
OUT = result_string
# ----------------------------------------
python_script_2 = Python(IN[0]=name_3)  # same code as python_script
python_script_3 = Python(IN[0]=python_script, IN[1]=python_script_2)
# ---------- python_script_3.python (4 lines) ----------
CadCanntLoad = IN[0]
CadLoadSuccess = IN[1]
result_string = "Cad Cannot Load " + '\n'+ CadCanntLoad + '\n' + "Cad Load Success " + '\n' + CadLoadSuccess
OUT = result_string
# ----------------------------------------
ʳʰʸᵗʰᵐ_helpers_simpleusermessage = Rhythm.Revit.Helpers.Helpers.SimpleUserMessage(caption=code_block, message=python_script_3)
