# Dynamo graph script.dyn (Dynamo 2.3.0.5885)
# packages: bimorphNodes 3.0.3, Rhythm 2020.7.25, Data-Shapes 2022.2.96, RIE 2020.11.18

code_block = CodeBlock { "SET STG_MARK FOR BEAM"; "RUN"; true; "Cancle"; 500; 400; 200; }
code_block_2 = CodeBlock { "Select Model"; "Beams"; }
categories = Categories("OST_StructuralFraming")
selectmodelelements_data = Custom[SelectModelElements Data](InputName=code_block_2.out0, ButtonText=code_block_2.out1, CategoryFilter=categories)  # package Data-Shapes; Creates a Revit element selection input for UI.MultipleInputForm++ . Check out www.data-shapes.net for more infos!
code_block_3 = CodeBlock { "Select Cad Link"; "Cad"; }
selectmodelelements_data_2 = Custom[SelectModelElements Data](InputName=code_block_3.out0, ButtonText=code_block_3.out1)
code_block_4 = CodeBlock { "TextLayerName"; "General Name"; "ForX/ForY"; }
textbox_data = Custom[TextBox Data](InputName=code_block_4.out0)  # package Data-Shapes; Create Data for TextBox input in UI.MultipleInputForm ++ . Check out www.data-shapes.net for more informations
code_block_5 = CodeBlock { "Run With beams Yes->y / No->x"; "ForX, ForY"; }
boolean_input = Custom[Boolean input](InputName=code_block_5.out0)  # package Data-Shapes; Creates a boolean input for UI.MultipleInputForm ++ . Check out www.data-shapes.net for more infos!
textbox_data_2 = Custom[TextBox Data](InputName=code_block_4.out1, DefaultText=code_block_4.out2)
list_create = List.Create(item0=selectmodelelements_data, item1=selectmodelelements_data_2, item2=textbox_data, item3=boolean_input, item4=textbox_data_2)
multipleinputform = Custom[MultipleInputForm ++](Description_optional=code_block.out0, ButtonText_optional=code_block.out1, Inputs=list_create, Toggle=code_block.out2, CancelButtonText_optional=code_block.out3, MaxHeight_optional=code_block.out4, Width_optional=code_block.out5, LabelWidth_optional=code_block.out6)  # package Data-Shapes; Create a form with multiple inputs. see www.data-shapes.net for tutorials and infos!
code_block_6 = CodeBlock(elemens=multipleinputform.User_Inputs, cad=multipleinputform.User_Inputs, textlayername=multipleinputform.User_Inputs, yesno=multipleinputform.User_Inputs, TextGeneral=multipleinputform.User_Inputs) { elemens[0]; cad[1]; textlayername[2]; yesno[3]; TextGeneral[4]; }
code_block_7 = CodeBlock(A=code_block_6.out3) { A; }
XAxis = Vector.XAxis()
getLocation = Element.GetLocation(element=code_block_6.out0)
direction = Line.Direction(line=getLocation)
angleWithVector = Vector.AngleWithVector(vector=XAxis, otherVector=direction)
round = Math.Round(number=angleWithVector)
code_block_8 = CodeBlock(A=round) { A==90; }
filterByBoolMask = List.FilterByBoolMask(list=code_block_6.out0, mask=code_block_8)
filterByBoolMask_2 = List.FilterByBoolMask(list=getLocation, mask=code_block_8)
code_block_9 = CodeBlock(A=filterByBoolMask_2.in) { A; }
fromLayers = CADTextData.FromLayers(importInstance=code_block_6.out1, layerNames=code_block_6.out2)
originPoint = CADTextData.OriginPoint(cADTextData=fromLayers.CADTextData)
flatten = List.Flatten(list=originPoint)
rotation = CADTextData.Rotation(cADTextData=fromLayers.CADTextData)
flatten_2 = List.Flatten(list=rotation)
code_block_10 = CodeBlock(A=flatten_2) { A==90; }
filterByBoolMask_3 = List.FilterByBoolMask(list=flatten, mask=code_block_10)
code_block_11 = CodeBlock(A=filterByBoolMask_3.in) { A; }
textValue = CADTextData.TextValue(cADTextData=fromLayers.CADTextData)
flatten_3 = List.Flatten(list=textValue)
filterByBoolMask_4 = List.FilterByBoolMask(list=flatten_3, mask=code_block_10)
code_block_12 = CodeBlock(A=filterByBoolMask_4.in) { A; }
list_create_2 = List.Create(item0=filterByBoolMask.in, item1=code_block_9, item2=code_block_11, item3=code_block_12)
code_block_13 = CodeBlock(A=round) { A==0; }
filterByBoolMask_5 = List.FilterByBoolMask(list=code_block_6.out0, mask=code_block_13)
filterByBoolMask_6 = List.FilterByBoolMask(list=getLocation, mask=code_block_13)
code_block_14 = CodeBlock(A=filterByBoolMask_6.in) { A; }
code_block_15 = CodeBlock(A=flatten_2) { A==0; }
filterByBoolMask_7 = List.FilterByBoolMask(list=flatten, mask=code_block_15)
code_block_16 = CodeBlock(A=filterByBoolMask_7.in) { A; }
filterByBoolMask_8 = List.FilterByBoolMask(list=flatten_3, mask=code_block_15)
code_block_17 = CodeBlock(A=filterByBoolMask_8.in) { A; }
list_create_3 = List.Create(item0=filterByBoolMask_5.in, item1=code_block_14, item2=code_block_16, item3=code_block_17)
RIE_If = Custom[RIE_If](Test=code_block_7, True=list_create_2, False=list_create_3)  # package RIE; An If node that keeps list structure, empty lists and so forth.
code_block_18 = CodeBlock(Elements=RIE_If, LocationBeam=RIE_If, LocationText=RIE_If, TextValue=RIE_If) { Elements[0]; LocationBeam[1]; LocationText[2]; TextValue[3]; }
code_block_19 = CodeBlock { "STG_Mark"; }
ʳʰʸᵗʰᵐ_elements = Rhythm.Revit.Elements.Elements.SetParameterByNameTypeOrInstance(element=code_block_18.out0, parameterName=code_block_19, value=code_block_6.out4)
code_block_20 = CodeBlock { "STG_Mark"; }
code_block_21 = CodeBlock(A=code_block_18.out1) { A; }
code_block_22 = CodeBlock(A=code_block_18.out2) { A; }
distanceTo = Geometry.DistanceTo(geometry=code_block_21, other=code_block_22, lacing=CrossProduct)
minimumItem = List.MinimumItem(list=distanceTo)
RIE_IndexOf = Custom[RIE_IndexOf](list=distanceTo@L2, Item=minimumItem@L1)  # package RIE; Returns a sublistlist with all indexes for each item.
getItemAtIndex = List.GetItemAtIndex(list=code_block_18.out3, index=RIE_IndexOf)
code_block_23 = CodeBlock { 0; }
getItemAtIndex_2 = List.GetItemAtIndex(list=getItemAtIndex@L2, index=code_block_23)
code_block_24 = CodeBlock { "("; }
split = String.Split(str=getItemAtIndex_2, separator0=code_block_24)
code_block_25 = CodeBlock { 0; }
getItemAtIndex_3 = List.GetItemAtIndex(list=split@L2, index=code_block_25)
ʳʰʸᵗʰᵐ_elements_2 = Rhythm.Revit.Elements.Elements.SetParameterByNameTypeOrInstance(element=ʳʰʸᵗʰᵐ_elements, parameterName=code_block_20, value=getItemAtIndex_3)
