# Dynamo graph script.dyn (Dynamo 2.19.3.6394)
# packages: Genius Loci 2022.8.5, Data-Shapes 2022.2.96, Rhythm 2020.7.25, Orchid 203.3.1.8192, RIE 2020.11.18, archi-lab.net 2021.25.15, Clockwork for Dynamo 2.x 2.3.0, spring nodes 132.2.5, bimorphNodes 3.0.3, Orchid 2.19.5.6862, archi-lab.net 2024.217.1024, OpenMEP 1.0.0

code_block = CodeBlock { "Select Location File"; "Go"; true; "Cancle"; 800; 500; 150; }
string = StringInput("FilePath")
string_2 = StringInput("W:\Project")
textbox_data = Custom[TextBox Data](InputName=string, DefaultText=string_2)  # package Data-Shapes; Create Data for TextBox input in UI.MultipleInputForm ++ . Check out www.data-shapes.net for more informations
code_block_2 = CodeBlock { "Select Grid SameIn CadImport"; 100; true; false; }
o_grid_all = Orchid.RevitProject.Datums.Grid.InDocument()
name = Element.Name(element=o_grid_all)
listview_data = Custom[Listview Data](InputName=code_block_2.out0, Keys=name, Values=o_grid_all, Height_optionnal=code_block_2.out1, SortItems_optionnal=code_block_2.out2, ShowId_optionnal=code_block_2.out3)  # package Data-Shapes; Create data for ListView input in UI.MultiInputForm ++ . Check out www.data-shapes.net for more infos.
code_block_3 = CodeBlock { "Select level base cad"; false; true; 200; }
categories = Categories("OST_Levels")
all_elements_of_category = ElementsOfCategory(Category=categories)
name_2 = Element.Name(element=all_elements_of_category)
listview_data_2 = Custom[Listview Data](InputName=code_block_3.out0, Keys=name_2, Values=all_elements_of_category, Height_optionnal=code_block_3.out3, HilightInView_optionnal=code_block_3.out1, SortItems_optionnal=code_block_3.out2, ShowId_optionnal=code_block_3.out1)
code_block_4 = CodeBlock { "AxisLayerName-Incad-01Layer"; "AxisAlignRevit"; false; }
textbox_data_2 = Custom[TextBox Data](InputName=code_block_4.out0, DefaultText=code_block_4.out1, IsNumberEntry=code_block_4.out2)
list_create = List.Create(item0=textbox_data, item1=listview_data, item2=listview_data_2, item3=textbox_data_2)
boolean = BoolSelector(true)
multipleinputform = Custom[MultipleInputForm ++](Description_optional=code_block.out0, ButtonText_optional=code_block.out1, Inputs=list_create, Toggle=boolean, CancelButtonText_optional=code_block.out3, MaxHeight_optional=code_block.out4, Width_optional=code_block.out5, LabelWidth_optional=code_block.out6)  # package Data-Shapes; Create a form with multiple inputs. see www.data-shapes.net for tutorials and infos!
code_block_5 = CodeBlock(Paths=multipleinputform.User_Inputs, BaseLevels=multipleinputform.User_Inputs, GridAlign=multipleinputform.User_Inputs, LayerName=multipleinputform.User_Inputs) { Paths[0]; BaseLevels[2]; GridAlign[1]; LayerName[3]; }
directory_from_path = DirectoryObject(path=code_block_5.out0)
code_block_6 = CodeBlock { "*dwg"; }
getDirectoryContents = FileSystem.GetDirectoryContents(directory=directory_from_path, searchString=code_block_6)
flatten = List.Flatten(list=getDirectoryContents.files)
string_from_object = FromObject(obj=directory_from_path)
split = String.Split(string=getDirectoryContents.files, separator0=string_from_object)
flatten_2 = List.Flatten(list=split)
code_block_7 = CodeBlock { ".dwg"; }
split_2 = String.Split(string=flatten_2, separator0=code_block_7)
flatten_3 = List.Flatten(list=split_2)
name_3 = Element.Name(element=code_block_5.out1)
code_block_8 = CodeBlock(lv=name_3) { "Level-CadBase "+lv; }
o_document_current = Orchid.RevitProject.Common.Document.Current()
cadLink = Orchid.RevitProject.Common.Link.CadLink(document=o_document_current)
name_4 = Element.Name(element=cadLink)
sortByKey = List.SortByKey(list=cadLink, keys=name_4)
name_5 = Element.Name(element=sortByKey.sortedList)
split_3 = String.Split(string=name_5, separator0=code_block_7)
flatten_4 = List.Flatten(list=split_3)
setIntersection = List.SetIntersection(list1=flatten_3, list2=flatten_4)
setDifference = List.SetDifference(list1=flatten_3, list2=setIntersection)
clear_list = Custom[Clear List](input=setDifference)  # package archi-lab.net; This node will remove all Null and Empty Lists from any list.
list_create_2 = List.Create(item0=clear_list)
count = List.Count(list=name_3)
cycle = List.Cycle(list=list_create_2, amount=count)
boolean_2 = BoolSelector(true)
python_script = Python(IN[0]=code_block_8, IN[1]=cycle, IN[2]=boolean_2)  # IronPython2
# ---------- python_script.python (213 lines) ----------
#Copyright (c) mostafa el ayoubi ,  2016
#Data-Shapes http://www.data-shapes.net , elayoubi.mostafa@gmail.com

import clr
clr.AddReference('System.Windows.Forms')
clr.AddReference('System.Drawing')

from System.Drawing import Point
from System.Windows.Forms import Application, Button, Form, Label, TextBox, CheckBox, FolderBrowserDialog, OpenFileDialog, DialogResult, ComboBox, FormBorderStyle
from System.Collections.Generic import *

clr.AddReference('RevitAPIUI')
from  Autodesk.Revit.UI import Selection

clr.AddReference('RevitNodes')
import Revit
clr.ImportExtensions(Revit.Elements)
clr.ImportExtensions(Revit.GeometryConversion)

clr.AddReference('RevitServices')
from RevitServices.Persistence import DocumentManager
doc = DocumentManager.Instance.CurrentDBDocument
uidoc = DocumentManager.Instance.CurrentUIApplication.ActiveUIDocument

class MultiTextBoxForm(Form):
	

    def __init__(self):
        self.Text = 'Data-Shapes | Multi Input UI'
        self.output = []
        self.values = []

    def setclose(self, sender, event):
    	cbindexread = 0
    	for f in self.output:
    		if f.GetType() == TextBox:
    			self.values.append(f.Text)
    		if f.GetType() == CheckBox:
    			self.values.append(f.Checked)
    		if f.GetType() == Button:
    			if f.Tag == None :
    				self.values.append(f.Text)
    			else:
    				self.values.append(f.Tag)
    		if f.GetType() == ComboBox:
    			self.values.append(globals() ['dict%d'%(cbindexread)][f.Text])
    			cbindexread += 1
    	self.Close()

    def reset(self, sender, event):
		pass

    def openfile(self, sender, event):
		ofd = OpenFileDialog()
		dr = ofd.ShowDialog()
		if dr == DialogResult.OK:
			sender.Text = ofd.FileName

    def opendirectory(self, sender, event):
		fbd = FolderBrowserDialog()
		dr = fbd.ShowDialog()
		if dr == DialogResult.OK:
			sender.Text = fbd.SelectedPath

    def pickobjects(self, sender, event):
		sel = uidoc.Selection.PickObjects(Selection.ObjectType.Element,'')
		selelem = [doc.GetElement(s.ElementId) for s in sel]
		sender.Tag = (selelem)

    def pickfaces(self, sender, event):
		selface = uidoc.Selection.PickObjects(Selection.ObjectType.Face,'')
		faces = [uidoc.Document.GetElement(s).GetGeometryObjectFromReference(s).ToProtoType(True) for s in selface]
		sender.Tag = [i for f in faces for i in f]

    def pickedges(self, sender, event):
		seledge = uidoc.Selection.PickObjects(Selection.ObjectType.Edge,'')
		edges = [uidoc.Document.GetElement(s).GetGeometryObjectFromReference(s).AsCurve().ToProtoType(True) for s in seledge]
		sender.Tag = edges

    def topmost(self):
		self.TopMost = True
	


form = MultiTextBoxForm()
form.topmost()

xlabel = 5
xinput = 200
y = 10
fields = []
error = 0
cbindex = 0
#Input form

if isinstance(IN[0],list):
	inputnames = IN[0]
else:
	inputnames = [IN[0]]

if isinstance(IN[1],list):
	inputtypes = IN[1]
else:
	inputtypes = [IN[1]]

for i,j in zip(inputnames,inputtypes):
	label = Label()
	label.Location = Point(xlabel,y+0)
	label.Height = 20
	label.Width = 150
	label.Text = str(i)
	form.Controls.Add(label)
	if isinstance(j,list):
		cb = ComboBox()
		cb.Location = Point(xinput,y)
		cb.Width = 250
		globals()['dict%d'%(cbindex)] = {}
		try :
			for k in j:
				globals()['dict%d'%(cbindex)][k.Name] = k
				cb.Items.Add(k.Name)
		except :
			for k in j:
				try:
					globals()['dict%d'%(cbindex)][str(k)] = k
				except:
					globals()['dict%d'%(cbindex)][k.encode('utf-8').decode('utf-8')] = k
				cb.Items.Add(k)
		form.Controls.Add(cb)
		form.output.append(cb)
		cbindex += 1
	elif j == 's':
		tb = TextBox()
		tb.Text = 'Default'
		tb.Width = 300
		tb.Location = Point(xinput,y)
		form.Controls.Add(tb)
		form.Controls.Add(label)
		form.output.append(tb)
	elif j == 'bool':
		yn = CheckBox()
		yn.Location = Point(xinput,y)
		yn.Text = 'Yes/No'
		form.Controls.Add(yn)
		form.output.append(yn)
	elif j == 'fp':
		fp = Button()
		fp.Width = 300
		fp.Text = 'FilePath'
		fp.Location = Point(xinput,y)
		form.Controls.Add(fp)
		fp.Click += form.openfile
		form.output.append(fp)
	elif j == 'dp':
		dp = Button()
		dp.Width = 300
		dp.Text = 'DirectoryPath'
		dp.Location = Point(xinput,y)
		form.Controls.Add(dp)
		dp.Click += form.opendirectory
		form.output.append(dp)
	elif j == 'se':
		se = Button()
		se.Width = 300
		se.Text = 'Select model element(s)'
		se.Location = Point(xinput,y)
		form.Controls.Add(se)
		se.Click += form.pickobjects
		form.output.append(se)
	elif j == 'sf':
		sf = Button()
		sf.Width = 300
		sf.Text = 'Select face(s)'
		sf.Location = Point(xinput,y)
		form.Controls.Add(sf)
		sf.Click += form.pickfaces
		form.output.append(sf)
	elif j == 'sed':
		sed = Button()
		sed.Width = 300
		sed.Text = 'Select Edge(s)'
		sed.Location = Point(xinput,y)
		form.Controls.Add(sed)
		sed.Click += form.pickedges
		form.output.append(sed)

	else :
		error = 'One or more input types are invalid, visit http://www.data-shapes.net for more informations'
	y+= 40


button = Button()
button.Text = 'Link Cad'
button.Width = 150
button.Location = Point (200,y+30)
button.Click += form.setclose
form.Controls.Add(button)

form.MaximizeBox = False
form.MinimizeBox = False
form.FormBorderStyle = FormBorderStyle.FixedSingle

form.Width = 500
form.Height = y + 150

if error == 0 and IN[2] == True:
	Application.Run(form)
	result = form.values
	OUT = result,True

elif IN[2] == False:
	result = "Set toggle to true!"
	OUT = result,False
# ----------------------------------------
code_block_9 = CodeBlock(Cads=python_script) { Cads[0]; }
RIE_IndexOf = Custom[RIE_IndexOf](list=flatten_3, Item=code_block_9)  # package RIE; Returns a sublistlist with all indexes for each item.
flatten_5 = List.Flatten(list=RIE_IndexOf)
getItemAtIndex = List.GetItemAtIndex(list=flatten, index=flatten_5)
views = Custom[Level.Views](level=code_block_5.out1)  # package Clockwork for Dynamo 2.x; Returns all views associated with a given level
code_block_10 = CodeBlock(views=views.firstView) { views; }

# group: Link active
code_block_11 = CodeBlock { "Success Link file?"; }
flatten_6 = List.Flatten(list=getItemAtIndex)
enumerate_dwg_import_options = Custom[Enumerate DWG import options]()  # package Genius Loci; Enumerate Color mode, Type of Placement and Type of Unit. Works with the "Link DWG" and "Import DWG" nodes.
code_block_12 = CodeBlock(Colors=enumerate_dwg_import_options.Colormode, Placements=enumerate_dwg_import_options.Placement, Unittype=enumerate_dwg_import_options.Unit) { Colors[1]; Placements[2]; Unittype[0]; 1; }
boolean_3 = BoolSelector(true)
link_dwg = Custom[Link DWG](Filepaths=flatten_6, views=code_block_10, CustomScale=code_block_12.out3, Colormode=code_block_12.out0, Placement=code_block_12.out1, unit=code_block_12.out2, AllView=boolean_3, lacing=Longest)  # package Genius Loci; Link DWGs in views with options. Use with the Enumerate DWG import options node. Based on a archilab's script.
code_block_13 = CodeBlock(CadLinks=link_dwg.Name) { CadLinks; }
python_script_2 = Python(IN[0]=code_block_13)  # IronPython2
# ---------- python_script_2.python (3 lines) ----------
element = IN[0]
result_string = '\n'.join(element)
OUT = result_string
# ----------------------------------------
ʳʰʸᵗʰᵐ_helpers_simpleusermessage = Rhythm.Revit.Helpers.Helpers.SimpleUserMessage(caption=code_block_11, message=python_script_2)
curvesFromCADLayers = CAD.CurvesFromCADLayers(importInstance=link_dwg.ImportInstance, layerNames=code_block_5.out3)

code_block_14 = CodeBlock(CadsWasLink=link_dwg.ImportInstance) { CadsWasLink; }
flatten_7 = List.Flatten(list=curvesFromCADLayers.Curve@L2)
transpose = List.Transpose(lists=flatten_7)
code_block_15 = CodeBlock(a=transpose) { a[0]; a[1]; }
intersect = Geometry.Intersect(geometry=code_block_15.out0, other=code_block_15.out1)
code_block_16 = CodeBlock { "Base Level"; "Work Plane"; }
ʳʰʸᵗʰᵐ_elements = Rhythm.Revit.Elements.Elements.GetParameterValueByNameTypeOrInstance(element=link_dwg.ImportInstance, parameterName=code_block_16.out1)
plane = Custom[Level.Plane](level=ʳʰʸᵗʰᵐ_elements)  # package Clockwork for Dynamo 2.x; Retrieves the plane of a given level
pullOntoPlane = Custom[Springs.Point.PullOntoPlane](point=intersect, plane=plane, lacing=Longest)  # package spring nodes; Pulls (projects) the point onto the input plane, following the plane normal.
flatten_8 = List.Flatten(list=pullOntoPlane)
code_block_17 = CodeBlock(GridAlignX=code_block_5.out2, GridAlignY=code_block_5.out2) { GridAlignX[0]; GridAlignY[1]; }
curve = Grid.Curve(grid=code_block_17.out0)
curve_2 = Grid.Curve(grid=code_block_17.out1)
intersect_2 = Geometry.Intersect(geometry=curve, other=curve_2)
pullOntoPlane_2 = Custom[Springs.Point.PullOntoPlane](point=intersect_2, plane=plane, lacing=Longest)
byStartPointEndPoint = Line.ByStartPointEndPoint(startPoint=flatten_8, endPoint=pullOntoPlane_2, lacing=Longest)
direction = Line.Direction(line=byStartPointEndPoint)
moveElements = archilab.Revit.Elements.Elements.MoveElements(elements=code_block_14@L1, translation=direction@L1)  # frozen
moveElement = OpenMEPRevit.Element.Element.MoveElement(element=code_block_14, newLocation=pullOntoPlane_2)
