# Dynamo graph script.dyn (Dynamo 2.19.3.6394)
# packages: Clockwork for Dynamo 2.x 2.3.0, bimorphNodes 3.0.3, Orchid 203.3.1.8192, RIE 2020.11.18, SteamNodes 1.2.4, Data-Shapes 2022.2.96

o_schedule_all = Orchid.RevitProject.Schedules.Schedule.InDocument()
name = Element.Name(element=o_schedule_all)
boolean = BoolSelector(false)
file_path = Filename(".\ExportSchedule.py")
python_script = Python(IN[0]=boolean, IN[1]=file_path)  # IronPython2
# ---------- python_script.python (15 lines) ----------
# Lấy đường dẫn đến file Wpf từ đầu vào IN[0]
file_path = IN[1]

try:
    # Mở file Wpf để đọc
    with open(file_path, 'r') as file:
        # Đọc nội dung của file
        file_content = file.read()
        
        # Hiển thị nội dung file
        print(file_content)
        OUT = file_content
except Exception as e:
    # Hiển thị lỗi nếu có
    OUT = str(e)
# ----------------------------------------
boolean_2 = BoolSelector(false)
getRevitSelection = Custom[Tool.GetRevitSelection](reset=boolean_2)  # package SteamNodes; Get the selection from the Revit UI, use boolean action to refresh when selection must be updated
elementType = Element.ElementType(element=getRevitSelection)
name_2 = Element.Name(element=elementType)
code_block = CodeBlock(a=name_2) { a=="Schedule"; }
filterByBoolMask = List.FilterByBoolMask(list=getRevitSelection, mask=code_block)
file_path_2 = Filename(".\saveExcelPath.txt")
python_script_from_string = PythonStringNode(script=python_script, IN[0]=o_schedule_all, IN[1]=filterByBoolMask.in, IN[2]=file_path_2)  # IronPython2
code_block_2 = CodeBlock(a=python_script_from_string) { a; }
code_block_3 = CodeBlock { "ScheduleExport"; "PathLink"; }
valueAtKey = DesignScript.Builtin.Dictionary.ValueAtKey(dictionary=code_block_2, key=code_block_3.out0)
uniqueItems = List.UniqueItems(list=valueAtKey)
RIE_IndexOf = Custom[RIE_IndexOf](list=name, Item=uniqueItems)  # package RIE; Returns a sublistlist with all indexes for each item.
flatten = List.Flatten(list=RIE_IndexOf)
getItemAtIndex = List.GetItemAtIndex(list=o_schedule_all, index=flatten)
valueAtKey_2 = DesignScript.Builtin.Dictionary.ValueAtKey(dictionary=code_block_2, key=code_block_3.out1)
code_block_4 = CodeBlock(ScheduleExport=getItemAtIndex, LinkPath=valueAtKey_2) { ScheduleExport; LinkPath; }
code_block_5 = CodeBlock(ScheduleExport=code_block_4.ScheduleExport, Filepath=code_block_4.LinkPath) { ScheduleExport; Filepath[1]; true; false; 0; }
name_3 = Element.Name(element=code_block_5.ScheduleExport)
code_block_6 = CodeBlock(a=name_3) { a; }
code_block_7 = CodeBlock { "Data_ScheduleList"; }
join = List.Join(list0=code_block_6, list1=code_block_7)
code_block_8 = CodeBlock(SheetNames=join) { SheetNames; }
string = StringInput("=HYPERLINK(\"#'")
worksheets = Custom[Excel.Worksheets](FilePath=code_block_4.LinkPath)  # package Data-Shapes; Gets worksheet names from specified Excel workbook.
string_2 = StringInput("'!A1\", \"")
string_3 = StringInput("\")")
code_block_9 = CodeBlock(a=string, SheetNames=worksheets, b=string_2, c=string_3) { a+SheetNames+b+SheetNames+c; }
getData = Revit.Schedule.GetData(scheduleView=code_block_5.ScheduleExport, removeHeading=code_block_5.out3, refresh=code_block_5.out2)
deconstruct = List.Deconstruct(list=getData@L3)
code_block_10 = CodeBlock(a=deconstruct.first) { a; }
code_block_11 = CodeBlock(a=deconstruct.rest) { a; }
deconstruct_2 = List.Deconstruct(list=code_block_11@@L2)
code_block_12 = CodeBlock(s=deconstruct_2.first) { s; }
o_string_tonumber = Orchid.Common.String.ToNumber(string=code_block_12)
isNull = Object.IsNull(object=o_string_tonumber)
o_list_anytrue = Orchid.Common.List.AnyTrue(list=isNull)
code_block_13 = CodeBlock { " "; }
split = String.Split(string=code_block_12, separator0=code_block_13)
if_ = If(test=o_list_anytrue, true=code_block_12, false=split)
code_block_14 = CodeBlock { " "; }
replaceEmptyLists = Custom[List.ReplaceEmptyLists](seq=if_@@L3, Replacement=code_block_14)  # package Clockwork for Dynamo 2.x; Replaces all empty lists within a given list with a substitute
code_block_15 = CodeBlock { 0; }
getItemAtIndex_2 = List.GetItemAtIndex(list=replaceEmptyLists@@L2, index=code_block_15)
code_block_16 = CodeBlock(s=deconstruct_2.rest) { s; }
toNumber = String.ToNumber(string=code_block_16)
python_script_2 = Python(IN[0]=code_block_16, IN[1]=toNumber)  # CPython3
# ---------- python_script_2.python (15 lines) ----------
# IN[0] = original list (node 1)
# IN[1] = converted list (node 2)

list1 = IN[0]
list2 = IN[1]

def replace_nulls(l1, l2):
    # nếu là list lồng nhau thì xử lý đệ quy
    if isinstance(l1, list) and isinstance(l2, list):
        return [replace_nulls(a, b) for a, b in zip(l1, l2)]
    else:
        # nếu l2 là null thì trả về l1
        return l1 if l2 is None else l2

OUT = replace_nulls(list1, list2)
# ----------------------------------------
code_block_17 = CodeBlock { ""; }
ne = python_script_2 != code_block_17
code_block_18 = CodeBlock { "'"; }
add = code_block_18 + python_script_2
if_2 = If(test=ne, true=python_script_2, false=add)
transpose = List.Transpose(lists=if_2@@L3)
addItemToFront = List.AddItemToFront(item=getItemAtIndex_2@L2, list=transpose@L3)
transpose_2 = List.Transpose(lists=addItemToFront@@L3)
addItemToFront_2 = List.AddItemToFront(item=code_block_10@L2, list=transpose_2@L3)
addItemToEnd = List.AddItemToEnd(item=code_block_9, list=addItemToFront_2)
exportToExcel = Data.ExportToExcel(filePath=code_block_4.LinkPath, sheetName=code_block_8, startRow=code_block_5.out4, startColumn=code_block_5.out4, data=addItemToEnd, overWrite=code_block_5.out2)
