# Dynamo graph script.dyn "script (1)" (Dynamo 2.3.0.5885)
# packages: Clockwork for Dynamo 2.x 2.3.0, ACOPackage 1.0.4, Orchid 203.3.1.8192, RIE 2020.11.18, Data-Shapes 2022.2.96, Crumple 1.0.7, archi-lab.net 2021.25.15, spring nodes 132.2.5, KYSUDO 2019.8.5

# group: UI-Select element
code_block = CodeBlock { "Dim Element"; "Dim"; true; 600; 400; 220; "CanCle"; }
code_block_2 = CodeBlock { "Select ModelBase To Reset Location"; "Select"; }
# note: Custom Node: Data-Shapes v.2022.2.96
selectmodelelements_data = Custom[SelectModelElements Data](InputName=code_block_2.out0, ButtonText=code_block_2.out1)  # package Data-Shapes; Creates a Revit element selection input for UI.MultipleInputForm++ . Check out www.data-shapes.net for more infos!
code_block_3 = CodeBlock { "Select Model"; "Select"; }
selectmodelelements_data_2 = Custom[SelectModelElements Data](InputName=code_block_3.out0, ButtonText=code_block_3.out1)
list_create = List.Create(item0=selectmodelelements_data, item1=selectmodelelements_data_2)
multipleinputform = Custom[MultipleInputForm ++](Description_optional=code_block.out0, ButtonText_optional=code_block.out1, Inputs=list_create, Toggle=code_block.out2, CancelButtonText_optional=code_block.out6, MaxHeight_optional=code_block.out3, Width_optional=code_block.out4, LabelWidth_optional=code_block.out5)  # package Data-Shapes; Create a form with multiple inputs. see www.data-shapes.net for tutorials and infos!
code_block_4 = CodeBlock(ElementBase=multipleinputform.User_Inputs, ElementDim=multipleinputform.User_Inputs) { ElementBase[0]; ElementDim[1]; }

getLocation = Element.GetLocation(element=code_block_4.out1)
string_from_object = FromObject(obj=getLocation)
code_block_5 = CodeBlock { "Line"; }
contains = String.Contains(str=string_from_object, searchFor=code_block_5)
filterByBoolMask = List.FilterByBoolMask(list=code_block_4.out1, mask=contains)

# group: Filter
getLocation_2 = Element.GetLocation(element=filterByBoolMask.in)
direction = Line.Direction(line=getLocation_2)
isParallel = Vector.IsParallel(vector=direction, other=direction, lacing=CrossProduct)
filterByBoolMask_2 = List.FilterByBoolMask(list=filterByBoolMask.in, mask=isParallel@L2)
code_block_6 = CodeBlock(a=filterByBoolMask_2.in) { a; }
uniqueItems = List.UniqueItems(list=code_block_6)
count = List.Count(list=uniqueItems@L2)
code_block_7 = CodeBlock(a=count) { a>1; }
filterByBoolMask_3 = List.FilterByBoolMask(list=uniqueItems, mask=code_block_7)

# group: Filter reference needed to create dim and location line of dim For elements has location is Line
faces = Element.Faces(element=filterByBoolMask_3.in)
# note: Custom Node: Clockwork v.2.3.0
fromDynamoSurface = Custom[RevitFaceReference.FromDynamoSurface](DynamoSurface=faces)  # package Clockwork for Dynamo 2.x; Returns the underlying Revit face reference of a given surface
code_block_8 = CodeBlock { 0.5; }
normalAtParameter = Surface.NormalAtParameter(surface=faces, u=code_block_8, v=code_block_8)
ZAxis = Vector.ZAxis()
code_block_9 = CodeBlock { 90; }
rotate = Vector.Rotate(vector=normalAtParameter, axis=ZAxis, degrees=code_block_9)
getLocation_3 = Element.GetLocation(element=filterByBoolMask_3.in)
direction_2 = Line.Direction(line=getLocation_3)
isParallel_2 = Vector.IsParallel(vector=rotate, other=direction_2)
boolean = BoolSelector(false)
# note: Custom Node: Crumple v.1.0.7
replaceNulls = Custom[ReplaceNulls](lst=isParallel_2, replace=boolean)  # package Crumple; Replaces all nulls with a given substitute.
filterByBoolMask_4 = List.FilterByBoolMask(list=fromDynamoSurface@@L2, mask=replaceNulls@L2)
code_block_10 = CodeBlock(ReferenceCreateDim=filterByBoolMask_4.in) { ReferenceCreateDim; }
code_block_11 = CodeBlock { 0; }
getItemAtIndex = List.GetItemAtIndex(list=code_block_10@@L2, index=code_block_11)
code_block_12 = CodeBlock { 0; 0.5; 90; }
getItemAtIndex_2 = List.GetItemAtIndex(list=getLocation_3@@L2, index=code_block_12.out0)
pointAtParameter = Curve.PointAtParameter(curve=getItemAtIndex_2, param=code_block_12.out1)
ZAxis_2 = Vector.ZAxis()
rotate_2 = Geometry.Rotate(geometry=getItemAtIndex_2, origin=pointAtParameter, axis=ZAxis_2, degrees=code_block_12.out2)
code_block_13 = CodeBlock { 1; }
chop = List.Chop(list=rotate_2, lengths=code_block_13)

# group: Create Dim-line
# note: Custom Node: Orchid v. 203.3.1.8192
o_dimensiontype_all = Orchid.RevitProject.Annotations.DimensionType.All()
code_block_14 = CodeBlock(a=o_dimensiontype_all) { a[0]; }
# note: Custom Node: archilab v.2021.25.15
clear_list = Custom[Clear List](input=getItemAtIndex)  # package archi-lab.net; This node will remove all Null and Empty Lists from any list.
boolean_2 = BoolSelector(true)
# note: Custom Node: RIE v.2020.11.18
RIE_ActiveView = Custom[RIE_ActiveView](Refresh=boolean_2)  # package RIE; Returns active view in current document.
# note: Custom Node: ACOPackage v.1.0.4
createDimensionFromReference = ACOSolution.Annotation.CreateDimensionFromReference(dimensionType=code_block_14, referenceArray=clear_list@L2, activeView=RIE_ActiveView, curve=chop@L2)

# note: Custom Node: KYSUDO v.2019.8.5
element_faces = Custom[Element Faces](element=filterByBoolMask.out)  # package KYSUDO
code_block_15 = CodeBlock(a=element_faces.Other) { 0.5; a; }
normalAtParameter_2 = Surface.NormalAtParameter(surface=code_block_15.a, u=code_block_15.out0, v=code_block_15.out0)
code_block_16 = CodeBlock { 0; }
getItemAtIndex_3 = List.GetItemAtIndex(list=normalAtParameter_2@@L2, index=code_block_16)
isParallel_3 = Vector.IsParallel(vector=normalAtParameter_2, other=getItemAtIndex_3)
groupByKey = List.GroupByKey(list=normalAtParameter_2@L2, keys=isParallel_3@L2)
code_block_17 = CodeBlock(a=groupByKey.groups) { a; }
getItemAtIndex_4 = List.GetItemAtIndex(list=code_block_17@@L2, index=code_block_16)
indexOf = List.IndexOf(list=normalAtParameter_2@L2, element=getItemAtIndex_4@L2)
getItemAtIndex_5 = List.GetItemAtIndex(list=code_block_15.a@L2, index=indexOf@L2)

# group: Filter reference needed to create dim and location line of dim
flatten = List.Flatten(list=getItemAtIndex_5)
code_block_18 = CodeBlock { 0.5; }
normalAtParameter_3 = Surface.NormalAtParameter(surface=flatten, u=code_block_18, v=code_block_18)
code_block_19 = CodeBlock { 0; }
code_block_20 = CodeBlock { 1; 0.5; }

# group: GROUP AllELEMENT OF TYPE LOCATION
indexOf_2 = List.IndexOf(list=filterByBoolMask.out, element=code_block_4.out0)
code_block_21 = CodeBlock { -1; }
KSD_RemoveItem = Custom[KSD_RemoveItem](list=indexOf_2, item=code_block_21)  # package KYSUDO
getItemAtIndex_6 = List.GetItemAtIndex(list=filterByBoolMask.out, index=KSD_RemoveItem)
indexOf_3 = List.IndexOf(list=filterByBoolMask.in, element=code_block_4.out0)
code_block_22 = CodeBlock { -1; }
KSD_RemoveItem_2 = Custom[KSD_RemoveItem](list=indexOf_3, item=code_block_22)
getItemAtIndex_7 = List.GetItemAtIndex(list=filterByBoolMask.in, index=KSD_RemoveItem_2)

indexOf_4 = List.IndexOf(list=filterByBoolMask.out, element=getItemAtIndex_6)
getItemAtIndex_8 = List.GetItemAtIndex(list=getItemAtIndex_5, index=indexOf_4)
code_block_23 = CodeBlock { 0.5; }
normalAtParameter_4 = Surface.NormalAtParameter(surface=getItemAtIndex_8, u=code_block_23, v=code_block_23)
flatten_2 = List.Flatten(list=normalAtParameter_4)
isNotEmpty = Custom[List.IsNotEmpty](seq=flatten_2)  # package Clockwork for Dynamo 2.x; Just the inversion of the built-in Is Empty List node.
RIE_If = Custom[RIE_If](Test=isNotEmpty, True=flatten_2, False=normalAtParameter_3)  # package RIE; An If node that keeps list structure, empty lists and so forth.

# group (continued): Filter reference needed to create dim and location line of dim
isParallel_4 = Vector.IsParallel(vector=RIE_If, other=normalAtParameter_3, lacing=CrossProduct)
filterByBoolMask_5 = List.FilterByBoolMask(list=flatten, mask=isParallel_4@L2)
code_block_24 = CodeBlock(FaceCreateReference=filterByBoolMask_5.in) { FaceCreateReference; }

uniqueItems_2 = List.UniqueItems(list=code_block_24)

# group (continued): Filter reference needed to create dim and location line of dim
# note: Custom Node: Clockwork v.2.3.0
fromDynamoSurface_2 = Custom[RevitFaceReference.FromDynamoSurface](DynamoSurface=uniqueItems_2)
getItemAtIndex_9 = List.GetItemAtIndex(list=uniqueItems_2@L2, index=code_block_19)
getIsoline = Surface.GetIsoline(surface=getItemAtIndex_9, isoDirection=code_block_20.out0, parameter=code_block_20.out1)

chop_2 = List.Chop(list=getIsoline, lengths=code_block_13)

# group: Create Dim-Point
# note: Custom Node: Orchid v. 203.3.1.8192
o_dimensiontype_all_2 = Orchid.RevitProject.Annotations.DimensionType.All()
code_block_25 = CodeBlock(a=o_dimensiontype_all_2) { a[0]; }
boolean_3 = BoolSelector(true)
# note: Custom Node: RIE v.2020.11.18
RIE_ActiveView_2 = Custom[RIE_ActiveView](Refresh=boolean_3)
# note: Custom Node: ACOPackage v.1.0.4
createDimensionFromReference_2 = ACOSolution.Annotation.CreateDimensionFromReference(dimensionType=code_block_25, referenceArray=fromDynamoSurface_2@L2, activeView=RIE_ActiveView_2, curve=chop_2@L2)

indexOf_5 = List.IndexOf(list=filterByBoolMask_3.in, element=getItemAtIndex_7, lacing=CrossProduct)
code_block_26 = CodeBlock { -1; }
eq = indexOf_5 == code_block_26
filterByBoolMask_6 = List.FilterByBoolMask(list=indexOf_5, mask=eq)

# group: SetLocation Element with location is line
removeItemAtIndex = List.RemoveItemAtIndex(list=filterByBoolMask_3.in@L2, indices=filterByBoolMask_6.out@L2)
# note: Custom Node: Chynamo v.0.8.5
flatten_3 = List.Flatten(list=removeItemAtIndex)
getLocation_4 = Element.GetLocation(element=removeItemAtIndex)
flatten_4 = List.Flatten(list=getLocation_4)
code_block_27 = CodeBlock { 0.5; }
pointAtParameter_2 = Curve.PointAtParameter(curve=getLocation_4, param=code_block_27)
# note: Custom Node: Clockwork v.2.3.0
isNotEmpty_2 = Custom[List.IsNotEmpty](seq=getItemAtIndex_7)
code_block_28 = CodeBlock { null; }
if_ = If(test=isNotEmpty_2, true=filterByBoolMask_3.in, false=code_block_28)
getItemAtIndex_10 = List.GetItemAtIndex(list=if_@L2, index=filterByBoolMask_6.out@L2)
getLocation_5 = Element.GetLocation(element=getItemAtIndex_10)
pointAtParameter_3 = Curve.PointAtParameter(curve=getLocation_5, param=code_block_27)
normalAtParameter_5 = Curve.NormalAtParameter(curve=getLocation_5, param=code_block_27)
byOriginNormal = Plane.ByOriginNormal(origin=pointAtParameter_3, normal=normalAtParameter_5)
closestPointTo = Geometry.ClosestPointTo(geometry=byOriginNormal@L1, other=pointAtParameter_2@L2)
byStartPointEndPoint = Line.ByStartPointEndPoint(startPoint=pointAtParameter_2, endPoint=closestPointTo)
direction_3 = Line.Direction(line=byStartPointEndPoint)
length = Vector.Length(vector=direction_3)
code_block_29 = CodeBlock(vectorLength=length) { vectorLength !=0; }
length_2 = Curve.Length(curve=byStartPointEndPoint)
python_script = Python(IN[0]=length_2)
# ---------- python_script.python (21 lines) ----------
def round_to_nearest(n):
    # Làm tròn số n đến cấp gần nhất của 0 hoặc 5
    if n % 5 < 2.5:
        return int(n // 5) * 5
    else:
        return int(n // 5 + 1) * 5

# Danh sách các số cần làm tròn
numbers = IN[0]

# Tạo danh sách để lưu kết quả
result = []

# Lặp qua từng danh sách con trong numbers
for sublist in numbers:
    # Lặp qua từng số trong danh sách con và làm tròn
    rounded_numbers = [round_to_nearest(num) for num in sublist]
    # Thêm kết quả đã làm tròn vào danh sách kết quả
    result.append(rounded_numbers)

OUT = result
# ----------------------------------------
code_block_30 = CodeBlock(a=python_script, b=length_2) { a-b; }
code_block_31 = CodeBlock(rounds=code_block_30, vectorLength=length) { -rounds/vectorLength; vectorLength; }
if_2 = If(test=code_block_29, true=code_block_31.out0, false=code_block_31.vectorLength)
scale = Vector.Scale(vector=direction_3, scale_factor=if_2)
flatten_5 = List.Flatten(list=scale)
translate = Geometry.Translate(geometry=flatten_4, direction=flatten_5)
# note: Custom Node: spring nodes v.132.2.5
setLocation = Custom[Springs.Element.SetLocation](element=flatten_3, location=translate)  # package spring nodes; Attempts to modify the location of the input element. This can effectively add as a move comand in Revit. Works for both line based and point based elements.

removeItemAtIndex_2 = List.RemoveItemAtIndex(list=filterByBoolMask.out, indices=indexOf_4)
code_block_32 = CodeBlock(ElementSetLocation=removeItemAtIndex_2, ElementsBase=getItemAtIndex_6) { ElementSetLocation; ElementsBase; }
getLocation_6 = Element.GetLocation(element=code_block_32.ElementSetLocation)
flatten_6 = List.Flatten(list=getItemAtIndex_8)
removeItemAtIndex_3 = List.RemoveItemAtIndex(list=getItemAtIndex_5, indices=indexOf_4)
normalAtParameter_6 = Surface.NormalAtParameter(surface=removeItemAtIndex_3, u=code_block_23, v=code_block_23)
isParallel_5 = Vector.IsParallel(vector=normalAtParameter_6, other=flatten_2, lacing=CrossProduct)
transpose = List.Transpose(lists=isParallel_5@L3)
boolean_4 = BoolSelector(true)
indexOf_6 = List.IndexOf(list=transpose@@L2, element=boolean_4)
getItemAtIndex_11 = List.GetItemAtIndex(list=flatten_6, index=indexOf_6)
code_block_33 = CodeBlock(SurfacesEBase=getItemAtIndex_11, SurfaceESet=removeItemAtIndex_3) { SurfacesEBase; SurfaceESet; 0.5; }
pointAtParameter_4 = Surface.PointAtParameter(surface=code_block_33.SurfacesEBase, u=code_block_33.out2, v=code_block_33.out2)
normalAtParameter_7 = Surface.NormalAtParameter(surface=code_block_33.SurfacesEBase, u=code_block_33.out2, v=code_block_33.out2)
byOriginNormal_2 = Plane.ByOriginNormal(origin=pointAtParameter_4, normal=normalAtParameter_7)
pointAtParameter_5 = Surface.PointAtParameter(surface=code_block_33.SurfaceESet, u=code_block_33.out2, v=code_block_33.out2)
closestPointTo_2 = Geometry.ClosestPointTo(geometry=byOriginNormal_2, other=pointAtParameter_5)
byStartPointEndPoint_2 = Line.ByStartPointEndPoint(startPoint=closestPointTo_2, endPoint=pointAtParameter_5)
direction_4 = Line.Direction(line=byStartPointEndPoint_2)
code_block_34 = CodeBlock { 0; }
byCoordinates = Vector.ByCoordinates(x=code_block_34, y=code_block_34, z=code_block_34)
# note: Custom Node: Clockwork v.2.3.0
replaceNull = Custom[List.ReplaceNull](seq=direction_4@L2, replacement=byCoordinates)  # package Clockwork for Dynamo 2.x; Replaces all null values within a given list with a substitute
length_3 = Vector.Length(vector=replaceNull)
code_block_35 = CodeBlock(vectorLength=length_3) { vectorLength !=0; }
length_4 = Curve.Length(curve=byStartPointEndPoint_2)
replaceNull_2 = Custom[List.ReplaceNull](seq=length_4@L2, replacement=code_block_34)
python_script_2 = Python(IN[0]=replaceNull_2)  # same code as python_script
code_block_36 = CodeBlock(a=python_script_2, b=replaceNull_2) { a-b; }
code_block_37 = CodeBlock(rounds=code_block_36, vectorLength=length_3) { rounds/vectorLength; vectorLength; }
if_3 = If(test=code_block_35, true=code_block_37.out0, false=code_block_37.vectorLength)
scale_2 = Vector.Scale(vector=replaceNull, scale_factor=if_3)
code_block_38 = CodeBlock { 0; 1; }
getItemAtIndex_12 = List.GetItemAtIndex(list=scale_2@L2, index=code_block_38.out0)
translate_2 = Geometry.Translate(geometry=getLocation_6, direction=getItemAtIndex_12)
getItemAtIndex_13 = List.GetItemAtIndex(list=scale_2@L2, index=code_block_38.out1)
translate_3 = Geometry.Translate(geometry=translate_2, direction=getItemAtIndex_13)
# note: Custom Node: spring nodes v.132.2.5
setLocation_2 = Custom[Springs.Element.SetLocation](element=code_block_32.ElementSetLocation, location=translate_3)
