# Dynamo graph script.dyn (Dynamo 2.3.0.5885)
# packages: spring nodes 132.2.5, Structural Design 2019.12.11, Orchid 203.3.1.8192

all_elements_in_active_view = ElementsInView()
code_block = CodeBlock { 1; "SelectMultiple Element"; true; }
pickObjects = StructuralDesign.Model.Selection.PickObjects(objectType=code_block.out0, statusPrompt=code_block.out1, refresh=code_block.out2)
elementType = Element.ElementType(element=pickObjects)
id = Element.Id(element=elementType)
elementType_2 = Element.ElementType(element=all_elements_in_active_view)
id_2 = Element.Id(element=elementType_2)
eq = id == id_2  # lacing=CrossProduct
transpose = List.Transpose(lists=eq)
o_list_anytrue = Orchid.Common.List.AnyTrue(list=transpose)
filterByBoolMask = List.FilterByBoolMask(list=all_elements_in_active_view, mask=o_list_anytrue)
boolean = BoolSelector(true)
selectInRevit = Custom[Springs.SelectInRevit](element=filterByBoolMask.in, reset=boolean)  # package spring nodes; Selects the input elements inside the Revit UI.
