# Dynamo graph script.dyn (Dynamo 2.6.1.8786)
# packages: Structural Design 2021.1.5, bimorphNodes 3.0.3, KYSUDO 2019.8.5

code_block = CodeBlock { "Select 1"; "Select 2"; }
boolean = BoolSelector(true)
pickElements = StructuralDesign.Model.Selection.PickElements(statusPrompt=code_block.out0, refresh=boolean)
boundingBox = Element.BoundingBox(element=pickElements)
pickElements_2 = StructuralDesign.Model.Selection.PickElements(statusPrompt=code_block.out1, refresh=boolean)
getElementsIntersect = Revit.BoundingBox.GetElementsIntersect(boundingBox=boundingBox, elements=pickElements_2)
switch_join = Custom[Switch Join](ElementsA=getElementsIntersect@L2, ElementsB=pickElements)  # package KYSUDO
