# Dynamo graph script.dyn (Dynamo 2.6.1.8786)
# packages: KYSUDO 2019.8.5, Structural Design 2021.1.5

code_block = CodeBlock { "Select Ele1"; "Select Ele2"; }
boolean = BoolSelector(true)
pickElements = StructuralDesign.Model.Selection.PickElements(statusPrompt=code_block.out0, refresh=boolean)
pickElements_2 = StructuralDesign.Model.Selection.PickElements(statusPrompt=code_block.out1, refresh=boolean)
unJoin = Custom[UnJoin](Elements_A=pickElements, Elements_B=pickElements_2)  # package KYSUDO
