# Dynamo graph script.dyn (Dynamo 2.3.0.5885)
# packages: Structural Design 2019.12.11, Clockwork for Dynamo 2.x 2.3.0, bimorphNodes 3.0.3

code_block = CodeBlock { "Select Void Cut"; true; "Select Ele be Cut"; }
pickElements = StructuralDesign.Model.Selection.PickElements(statusPrompt=code_block.out0, refresh=code_block.out1)
boundingBox = Element.BoundingBox(element=pickElements)
pickElements_2 = StructuralDesign.Model.Selection.PickElements(statusPrompt=code_block.out2, refresh=code_block.out1)
getElementsIntersect = Revit.BoundingBox.GetElementsIntersect(boundingBox=boundingBox, elements=pickElements_2)
code_block_2 = CodeBlock { 1; }
chop = List.Chop(list=pickElements, lengths=code_block_2)
cutGeometry = Custom[Element.CutGeometry](elementToBeCut=getElementsIntersect@L2, cuttingElement=chop@L1, lacing=Longest)  # package Clockwork for Dynamo 2.x; Adds a solid-solid cut for two model elements (if possible).
