# Dynamo graph script.dyn (Dynamo 2.6.1.8786)
# packages: Macro4BIM 2020.0.10, Data-Shapes 2022.2.96

current = Document.Current()
activeView = Document.ActiveView(document=current)
code_block = CodeBlock { "Set Filter Override"; "Set"; true; "Cancel"; 800; 500; 150; }
code_block_2 = CodeBlock { "Select filter"; false; 500; }
filters = View.Filters(view=activeView)
name = Element.Name(element=filters)
listview_data = Custom[Listview Data](InputName=code_block_2.out0, Keys=name, Values=filters, Height_optionnal=code_block_2.out2, ShowId_optionnal=code_block_2.out1)  # package Data-Shapes; Create data for ListView input in UI.MultiInputForm ++ . Check out www.data-shapes.net for more infos.
code_block_3 = CodeBlock { "ResetAll Override filter"; false; }
boolean_input = Custom[Boolean input](InputName=code_block_3.out0, DefaultValue=code_block_3.out1)  # package Data-Shapes; Creates a boolean input for UI.MultipleInputForm ++ . Check out www.data-shapes.net for more infos!
list_create = List.Create(item0=listview_data, item1=boolean_input)
multipleinputform = Custom[MultipleInputForm ++](Description_optional=code_block.out0, ButtonText_optional=code_block.out1, Inputs=list_create, Toggle=code_block.out2, CancelButtonText_optional=code_block.out3, MaxHeight_optional=code_block.out4, Width_optional=code_block.out5, LabelWidth_optional=code_block.out6)  # package Data-Shapes; Create a form with multiple inputs. see www.data-shapes.net for tutorials and infos!
code_block_4 = CodeBlock(ViewFilters=multipleinputform.User_Inputs, Reset=multipleinputform.User_Inputs) { ViewFilters[0]; Reset[1]; }
count = List.Count(list=code_block_4.out0)
code_block_5 = CodeBlock(count=count) { 0..239..#count; 180..240..#count; }
code_block_6 = CodeBlock(count=count) { 70..150..#count; }
𝑀⁴𝐵_colors_hls_to_rgb = Custom[𝑀⁴𝐵 Colors.HLS_to_RGB](hue=code_block_5.out0, lightness=code_block_6, saturation=code_block_5.out1)  # package Macro4BIM
alpha = Color.Alpha(color=𝑀⁴𝐵_colors_hls_to_rgb)
red = Color.Red(color=𝑀⁴𝐵_colors_hls_to_rgb)
green = Color.Green(color=𝑀⁴𝐵_colors_hls_to_rgb)
blue = Color.Blue(color=𝑀⁴𝐵_colors_hls_to_rgb)
byARGB = Color.ByARGB(a=alpha, r=red, g=green, b=blue)
fill_patterns = FillPatterns("<Solid fill>")
byProperties = Revit.Filter.OverrideGraphicSettings.ByProperties(cutFillColor=byARGB, projectionFillColor=byARGB, cutFillPattern=fill_patterns, projectionFillPattern=fill_patterns)
boolean = BoolSelector(true)
setFilterOverrides = View.SetFilterOverrides(view=activeView, parameterFilter=code_block_4.out0, overrides=byProperties, hide=boolean)

# group: Control
byProperties_2 = Revit.Filter.OverrideGraphicSettings.ByProperties()
code_block_7 = CodeBlock { "Do not thing"; }
if_ = If(test=code_block_4.out1, true=byProperties_2, false=code_block_7)
boolean_2 = BoolSelector(true)
setFilterOverrides_2 = View.SetFilterOverrides(view=activeView, parameterFilter=filters, overrides=if_, hide=boolean_2)
