# Dynamo graph script.dyn (Dynamo 2.3.0.5885)
# packages: Rhythm 2020.7.25, Data-Shapes 2022.2.96, Orchid 203.3.1.8192, RIE 2020.11.18

RIE_ActiveView = Custom[RIE_ActiveView]()  # package RIE; Returns active view in current document.
filters = View.Filters(view=RIE_ActiveView)
filterOverrides = View.FilterOverrides(view=RIE_ActiveView, parameterFilter=filters)
code_block = CodeBlock { "Set ViewFilter Visible"; "Set..."; true; "Cancel X"; 800; 600; 200; }
code_block_2 = CodeBlock { ["Keep Visible","Reset"]; [true,false]; 0; "Keep old visible"; }
radiobuttons_data = Custom[RadioButtons Data](InputName=code_block_2.out3, Keys=code_block_2.out0, Values=code_block_2.out1, DefaultValueIndex=code_block_2.out2)  # package Data-Shapes; Create radio buttons input for UI.MultipleInputForm ++ .
code_block_3 = CodeBlock { "Select Filter for Visible"; false; true; 400; }
name = Element.Name(element=filters)
listview_data = Custom[Listview Data](InputName=code_block_3.out0, Keys=name, Values=filters, Height_optionnal=code_block_3.out3, SortItems_optionnal=code_block_3.out2, ShowId_optionnal=code_block_3.out1)  # package Data-Shapes; Create data for ListView input in UI.MultiInputForm ++ . Check out www.data-shapes.net for more infos.
list_create = List.Create(item0=radiobuttons_data, item1=listview_data)
multipleinputform = Custom[MultipleInputForm ++](Description_optional=code_block.out0, ButtonText_optional=code_block.out1, Inputs=list_create, Toggle=code_block.out2, CancelButtonText_optional=code_block.out3, MaxHeight_optional=code_block.out4, Width_optional=code_block.out5, LabelWidth_optional=code_block.out6)  # package Data-Shapes; Create a form with multiple inputs. see www.data-shapes.net for tutorials and infos!
code_block_4 = CodeBlock(a=multipleinputform.User_Inputs) { a[0]; a[1]; }
list_create_2 = List.Create()  # unwired: item0, item1
flatten = List.Flatten(list=filters)
name_2 = Element.Name(element=flatten)
flatten_2 = List.Flatten(list=code_block_4.out1)
name_3 = Element.Name(element=flatten_2)
o_string_contains = Orchid.Common.String.Contains(string=name_2, searchFor=name_3)
ʳʰʸᵗʰᵐ_view_getfiltervisibility = Rhythm.Revit.Views.View.GetFilterVisibility(view=RIE_ActiveView, viewFilter=filters)
combine = List.Combine(comb=list_create_2, list1=o_string_contains, list2=ʳʰʸᵗʰᵐ_view_getfiltervisibility)
o_list_anytrue = Orchid.Common.List.AnyTrue(list=combine)
if_ = If(test=code_block_4.out0, true=o_list_anytrue, false=o_string_contains)
setFilterOverrides = View.SetFilterOverrides(view=RIE_ActiveView, parameterFilter=filters, overrides=filterOverrides, hide=if_)
