# Dynamo graph script.dyn (Dynamo 2.6.1.8786)
# packages: Crumple 1.0.7, Data-Shapes 2022.2.96, Clockwork for Dynamo 2.x 2.3.0, RIE 2020.11.18, Genius Loci 2020.8.3, Macro4BIM 2020.0.10, Orchid 203.3.1.8192, Rhythm 2020.7.25, Rhythm 2021.6.1, archi-lab.net 2021.25.2721, Crumple 2022.2.13

code_block = CodeBlock { "SELECT FILTER YOU WANT TO CREATE"; "CREATE"; true; "CANCEL"; 700; 800; 400; }

# group: GET ALL MODEL CATEGORIES IN DOCUMENT
current = Document.Current()
python_script = Python(IN[0]=current)
# ---------- python_script.python (21 lines) ----------
import clr
clr.AddReference('RevitAPI')
from Autodesk.Revit.DB import *

clr.AddReference("RevitServices")
import RevitServices
from RevitServices.Persistence import DocumentManager

doc = DocumentManager.Instance.CurrentDBDocument

#allElements = FilteredElementCollector(doc).WhereElementIsNotElementType().WhereElementIsViewIndependent().ToElements()
allElements = FilteredElementCollector(doc).WhereElementIsNotElementType().ToElements()

filteredElements = []

for element in allElements:
	if element.Category != None and element.Parameters.Size > 0  and element.HasPhases:
		if element.Category.CategoryType == CategoryType.Model and (element.Category.SubCategories.Size > 0 or element.Category.CanAddSubcategory):
			filteredElements.append(element)

OUT = filteredElements
# ----------------------------------------
type = Object.Type(obj=python_script)
code_block_2 = CodeBlock { "ImportInstance"; }
boolean = BoolSelector(false)
contains = String.Contains(str=type, searchFor=code_block_2, ignoreCase=boolean)
filterByBoolMask = List.FilterByBoolMask(list=python_script, mask=contains)
category = Custom[Element.Category+](element=filterByBoolMask.out)  # package Clockwork for Dynamo 2.x; Returns the category of a given element. Unlike the OOTB node Element.GetCategory, it will work for subcategories, families, family documents, schedules, graphics styles and view filters as well.
code_block_3 = CodeBlock(CATE=category.category) { CATE; }

# group: ui select Category
code_block_4 = CodeBlock { "SELECT CATEGORIES FILTER"; "SELECT"; true; "CANCEL"; 600; 500; 200; }
code_block_5 = CodeBlock { "WHICH CATEGORIES"; 250; true; false; }
uniqueItems = List.UniqueItems(list=code_block_3)
listview_data = Custom[Listview Data](InputName=code_block_5.out0, Keys=uniqueItems, Values=uniqueItems, Height_optionnal=code_block_5.out1, SortItems_optionnal=code_block_5.out2, ShowId_optionnal=code_block_5.out3)  # package Data-Shapes; Create data for ListView input in UI.MultiInputForm ++ . Check out www.data-shapes.net for more infos.
multipleinputform = Custom[MultipleInputForm ++](Description_optional=code_block_4.out0, ButtonText_optional=code_block_4.out1, Inputs=listview_data, Toggle=code_block_4.out2, CancelButtonText_optional=code_block_4.out3, MaxHeight_optional=code_block_4.out4, Width_optional=code_block_4.out5, LabelWidth_optional=code_block_4.out6)  # package Data-Shapes; Create a form with multiple inputs. see www.data-shapes.net for tutorials and infos!
code_block_6 = CodeBlock(Cate=multipleinputform.User_Inputs) { Cate; }

all_elements_of_category = ElementsOfCategory(Category=code_block_6)
firstItem = List.FirstItem(list=all_elements_of_category@L2)
parameters = Element.Parameters(element=firstItem)
name = Parameter.Name(parameter=parameters)
elementType = Element.ElementType(element=firstItem)
parameters_2 = Element.Parameters(element=elementType)
name_2 = Parameter.Name(parameter=parameters_2)
list_create = List.Create(item0=name, item1=name_2)

# group: GET PARAMETER CONTAINT IN ALL CATEGORIES
transpose = List.Transpose(lists=list_create)
flatten = List.Flatten(list=transpose@L3)

flatten_2 = List.Flatten(list=flatten)

# group (continued): GET PARAMETER CONTAINT IN ALL CATEGORIES
uniqueItems_2 = List.UniqueItems(list=flatten_2)
contains_2 = List.Contains(list=flatten, item=uniqueItems_2, lacing=CrossProduct)
transpose_2 = List.Transpose(lists=contains_2)
allTrue = List.AllTrue(list=transpose_2@L2)
filterByBoolMask_2 = List.FilterByBoolMask(list=uniqueItems_2, mask=allTrue)

# group: UI SELECTTION PARAMETER
flatten_3 = List.Flatten(list=all_elements_of_category)
code_block_7 = CodeBlock { "SELECT PARAMETER CREATE FILTER"; "SELECT"; true; "CANCEL"; 450; 500; 200; }
code_block_8 = CodeBlock { "Which Parameter"; true; "Rule Type"; }
dropdown_data = Custom[DropDown Data](InputName=code_block_8.out0, Keys=filterByBoolMask_2.in, Values=filterByBoolMask_2.in, Sorted_optional=code_block_8.out1)  # package Data-Shapes; Create data for DropDown input in UI.MultiInputForm ++ . Check out www.data-shapes.net for more infos.
code_block_9 = CodeBlock()
# ---------- code_block_9.designscript (3 lines) ----------
["BeginsWith","Contains","EndWith","Equals","GeaterOrEqual","Greater","Less","LessOrEqual","NotBeginsWith","NotContains","NotEndsWith","NotEquals"];
"Rule Name Filter";
"99-";
# ----------------------------------------
dropdown_data_2 = Custom[DropDown Data](InputName=code_block_8.out2, Keys=code_block_9.out0, Values=code_block_9.out0, Sorted_optional=code_block_8.out1)
textbox_data = Custom[TextBox Data](InputName=code_block_9.out1, DefaultText=code_block_9.out2)  # package Data-Shapes; Create Data for TextBox input in UI.MultipleInputForm ++ . Check out www.data-shapes.net for more informations
list_create_2 = List.Create(item0=dropdown_data, item1=dropdown_data_2, item2=textbox_data)
multipleinputform_2 = Custom[MultipleInputForm ++](Description_optional=code_block_7.out0, ButtonText_optional=code_block_7.out1, Inputs=list_create_2, Toggle=code_block_7.out2, CancelButtonText_optional=code_block_7.out3, MaxHeight_optional=code_block_7.out4, Width_optional=code_block_7.out5, LabelWidth_optional=code_block_7.out6)
code_block_10 = CodeBlock(PARAMETER=multipleinputform_2.User_Inputs, RuleFilter=multipleinputform_2.User_Inputs, RuleName=multipleinputform_2.User_Inputs) { PARAMETER[0]; RuleFilter[1]; RuleName[2]; }

ʳʰʸᵗʰᵐ_elements = Rhythm.Revit.Elements.Elements.GetParameterValueByNameTypeOrInstance(element=flatten_3, parameterName=code_block_10.out0)

# group: CREATE FILTER RULE
uniqueItems_3 = List.UniqueItems(list=ʳʰʸᵗʰᵐ_elements)
code_block_11 = CodeBlock { "null"; }
list_replacenulls = Custom[© List.ReplaceNulls](lst=uniqueItems_3, replace=code_block_11)  # package Crumple; Replaces all nulls with a given substitute.
type_2 = Object.Type(obj=list_replacenulls)
code_block_12 = CodeBlock { "Revit.Element"; }
contains_3 = String.Contains(str=type_2, searchFor=code_block_12)
name_3 = Element.Name(element=list_replacenulls)
if_ = If(test=contains_3, true=name_3, false=list_replacenulls)
list_replacenulls_2 = Custom[© List.ReplaceNulls](lst=if_, replace=code_block_11)
parameterByName = Parameter.ParameterByName(element=flatten_3, name=code_block_10.out0)
clear_list = Custom[Clear List](input=parameterByName)  # package archi-lab.net; This node will remove all Null and Empty Lists from any list.
byRuleType = Revit.Filter.FilterRule.ByRuleType(type=code_block_10.out1, value=list_replacenulls_2, parameter=clear_list)
count = List.Count(list=list_replacenulls)
cycle = List.Cycle(list=code_block_10.out0, amount=count)
ruler_name_parameterfilter = CodeBlock(UserName=code_block_10.out2, Para=cycle, Value=if_) { UserName+"-" +Para+"-"+Value; }

count_2 = List.Count(list=list_replacenulls)
code_block_13 = CodeBlock(a=byRuleType) { a==null; }
countTrue = List.CountTrue(list=code_block_13)

# group: remove filter was created
element_types = ElementTypes("FilterElement")
all_elements_of_class = Custom[All Elements of Class+](type=element_types)  # package Genius Loci; Get the instances of the given type. Works with ElementType, FamilyType, ViewFamilyType, Wall/Floor/Roof/CeilingType, GroupType, FilledRegionType and TextNoteType.
name_4 = Element.Name(element=all_elements_of_class)
contains_4 = List.Contains(list=name_4@L2, item=ruler_name_parameterfilter, lacing=Longest)
filterByBoolMask_3 = List.FilterByBoolMask(list=ruler_name_parameterfilter, mask=contains_4)
o_list_indexof = Orchid.Common.List.IndexOf(list=ruler_name_parameterfilter, item=filterByBoolMask_3.in)
flatten_4 = List.Flatten(list=o_list_indexof)
count_3 = List.Count(list=flatten_4)
removeItemAtIndex = List.RemoveItemAtIndex(list=ruler_name_parameterfilter, indices=o_list_indexof)
removeItemAtIndex_2 = List.RemoveItemAtIndex(list=byRuleType, indices=o_list_indexof)

code_block_14 = CodeBlock(WillCreate=count_2, CantCreate=countTrue, DOUBLES=count_3) { WillCreate-CantCreate-DOUBLES; }
code_block_15 = CodeBlock(N=code_block_14, Total=count_2, X=count_3)
# ---------- code_block_15.designscript (6 lines) ----------
"Have " + N + "/" +Total + " Filter Can Create_"+
"AND HAVE " + X + " FILTER IS WAS CREATED" +
"SELECT FILTER YOU WANT TO CREATE";
300;
true;
false;
# ----------------------------------------
listview_data_2 = Custom[Listview Data](InputName=code_block_15.out0, Keys=removeItemAtIndex, Values=removeItemAtIndex, Height_optionnal=code_block_15.out1, SortItems_optionnal=code_block_15.out2, ShowId_optionnal=code_block_15.out3)
multipleinputform_3 = Custom[MultipleInputForm ++](Description_optional=code_block.out0, ButtonText_optional=code_block.out1, Inputs=listview_data_2, Toggle=code_block.out2, CancelButtonText_optional=code_block.out3, MaxHeight_optional=code_block.out4, Width_optional=code_block.out5, LabelWidth_optional=code_block.out6)
code_block_16 = CodeBlock(FilterWillCreate=multipleinputform_3.User_Inputs) { FilterWillCreate[0]; }
o_list_indexof_2 = Orchid.Common.List.IndexOf(list=removeItemAtIndex, item=code_block_16)
getItemAtIndex = List.GetItemAtIndex(list=removeItemAtIndex_2, index=o_list_indexof_2)
flatten_5 = List.Flatten(list=getItemAtIndex)

# group: Create Filter
byRules = Revit.Filter.ParameterFilterElement.ByRules(name=code_block_16, categories=code_block_6, rules=flatten_5, lacing=Longest)

# group: ADD FILTER TO VIEW AND SET OVERRIDE
RIE_ActiveView = Custom[RIE_ActiveView]()  # package RIE; Returns active view in current document.
count_4 = List.Count(list=byRules)
code_block_17 = CodeBlock(COUNT=count_4)
# ---------- code_block_17.designscript (3 lines) ----------
"SET OVERRIDE FILTER";
"HAVE " + COUNT+ " FILTER WAS CREATE
DO YOU WANT ADD TO ACTIVE VIEW AND SET OVERRIDE GRAPHIC";
# ----------------------------------------
fill_patterns = FillPatterns()  # nothing selected
code_block_18 = CodeBlock(COUNT=count_4) { 0..239..#COUNT; 100..120..#COUNT; 150..230..#COUNT; }
𝑀⁴𝐵_colors_hls_to_rgb = Custom[𝑀⁴𝐵 Colors.HLS_to_RGB](hue=code_block_18.out0, lightness=code_block_18.out1, saturation=code_block_18.out2)  # package Macro4BIM
alpha = Color.Alpha(color=𝑀⁴𝐵_colors_hls_to_rgb)
red = Color.Red(color=𝑀⁴𝐵_colors_hls_to_rgb)
green = Color.Green(color=𝑀⁴𝐵_colors_hls_to_rgb)
blue = Color.Blue(color=𝑀⁴𝐵_colors_hls_to_rgb)
byARGB = Color.ByARGB(a=alpha, r=red, g=green, b=blue)
create_overridegraphicsettings = Custom[Create OverrideGraphicSettings](SurfaceForegroundPattern=fill_patterns, SurfaceForegroundPatternColor=byARGB, CutForegroundPattern=fill_patterns, CutForegroundPatternColor=byARGB, lacing=Longest)  # package Genius Loci; Create a OverrideGraphicSettings (All graphic inputs are optional). Unlike the OOTB OverrideGraphicSettings.ByProperties node, the Foreground and background patterns are available. Note : Prior to Revit 2019, the materials have only one surface pattern and one cut pattern.

ʳʰʸᵗʰᵐ_helpers_usermessage = Rhythm.Revit.Helpers.Helpers.UserMessage(caption=code_block_17.out0, message=code_block_17.out1, obj=byRules)

# group (continued): ADD FILTER TO VIEW AND SET OVERRIDE
flatten_6 = List.Flatten(list=ʳʰʸᵗʰᵐ_helpers_usermessage)
view_add_filter = Custom[View Add Filter](view=RIE_ActiveView, filterElement=flatten_6, overrides=create_overridegraphicsettings, lacing=Longest)  # package Genius Loci; Add a Filter and set its overrides to a view. Unlike the OOTB nodes, it also works with SelectionFilterElement. For use with the Create OverrideGraphicSettings node.
