# Dynamo graph script.dyn (Dynamo 2.6.1.8786)
# packages: Genius Loci 2020.8.3, archi-lab.net 2021.25.15, Data-Shapes 2022.2.96

code_block = CodeBlock { "DELETE VIEW FILTER"; "DELETE"; true; "CANCLE"; 800; 600; 200; }
code_block_2 = CodeBlock { "CHOOSE FILTER DELETE"; 500; true; false; }
element_types = ElementTypes("FilterElement")
current = Document.Current()
all_elements_of_type = Custom[All Elements of Type+](type=element_types, docOrRevitLinkInstance=current)  # package Genius Loci; Get the instances of the given type. Works with ElementType, FamilyType, ViewFamilyType, Wall/Floor/Roof/CeilingType, GroupType, FilledRegionType and TextNoteType.
name = Element.Name(element=all_elements_of_type)
listview_data = Custom[Listview Data](InputName=code_block_2.out0, Keys=name, Values=all_elements_of_type, Height_optionnal=code_block_2.out1, SortItems_optionnal=code_block_2.out2, ShowId_optionnal=code_block_2.out3)  # package Data-Shapes; Create data for ListView input in UI.MultiInputForm ++ . Check out www.data-shapes.net for more infos.
multipleinputform = Custom[MultipleInputForm ++](Description_optional=code_block.out0, ButtonText_optional=code_block.out1, Inputs=listview_data, Toggle=code_block.out2, CancelButtonText_optional=code_block.out3, MaxHeight_optional=code_block.out4, Width_optional=code_block.out5, LabelWidth_optional=code_block.out6)  # package Data-Shapes; Create a form with multiple inputs. see www.data-shapes.net for tutorials and infos!
code_block_3 = CodeBlock(DELETEFILTER=multipleinputform.User_Inputs) { DELETEFILTER[0]; }
delete = archilab.Revit.Elements.Elements.Delete(element=code_block_3)
