# Dynamo graph script.dyn (Dynamo 2.3.0.5885)
# packages: Data-Shapes 2022.2.96, archi-lab.net 2021.25.15, spring nodes 132.2.5

activeView = Custom[Springs.Doc.ActiveView]()  # package spring nodes; Selects the current document's active view. Supports more view types than the built-in option. Will be depreciated once the bult in node works with all plan types.
code_block = CodeBlock { "REMOVE FILTER FROM ACTIVE VIEW"; "REMOVE"; true; "CANCLE"; 700; 500; 150; }
code_block_2 = CodeBlock { "Select filter to REMOVE"; 400; true; false; }
filters = View.Filters(view=activeView)
name = Element.Name(element=filters)
listview_data = Custom[Listview Data](InputName=code_block_2.out0, Keys=name, Values=filters, Height_optionnal=code_block_2.out1, SortItems_optionnal=code_block_2.out2, ShowId_optionnal=code_block_2.out3)  # package Data-Shapes; Create data for ListView input in UI.MultiInputForm ++ . Check out www.data-shapes.net for more infos.
multipleinputform = Custom[MultipleInputForm ++](Description_optional=code_block.out0, ButtonText_optional=code_block.out1, Inputs=listview_data, Toggle=code_block.out2, CancelButtonText_optional=code_block.out3, MaxHeight_optional=code_block.out4, Width_optional=code_block.out5, LabelWidth_optional=code_block.out6)  # package Data-Shapes; Create a form with multiple inputs. see www.data-shapes.net for tutorials and infos!
code_block_3 = CodeBlock(filter=multipleinputform.User_Inputs) { filter[0]; }
removeFilter = archilab.Revit.Views.Views.RemoveFilter(view=activeView, viewFilter=code_block_3)
