# Dynamo graph script.dyn (Dynamo 2.3.0.5885)
# packages: archi-lab.net 2021.25.15, Clockwork for Dynamo 2.x 2.3.0, RIE 2020.11.18

boolean = BoolSelector(true)
file_path = Filename(".\DuplicateView.py")
python_script = Python(IN[0]=boolean, IN[1]=file_path)
# ---------- python_script.python (15 lines) ----------
# Lấy đường dẫn đến file Wpf từ đầu vào IN[0]
file_path = IN[1]

try:
    # Mở file Wpf để đọc
    with open(file_path, 'r') as file:
        # Đọc nội dung của file
        file_content = file.read()
        
        # Hiển thị nội dung file
        print(file_content)
        OUT = file_content
except Exception as e:
    # Hiển thị lỗi nếu có
    OUT = str(e)
# ----------------------------------------
python_script_from_string = PythonStringNode(script=python_script)
code_block = CodeBlock { "View Old id"; "View New Name"; "Duplicate Option"; "View Template"; }
valueAtKey = DesignScript.Builtin.Dictionary.ValueAtKey(dictionary=python_script_from_string, key=code_block.out0)
byID = Custom[Element.ByID](IdOrUniqueId=valueAtKey)  # package Clockwork for Dynamo 2.x; Gets the Revit element(s) for a list of IDs (or a single ID). Optionally retrieves elements from linked documents as well.
valueAtKey_2 = DesignScript.Builtin.Dictionary.ValueAtKey(dictionary=python_script_from_string, key=code_block.out1)
valueAtKey_3 = DesignScript.Builtin.Dictionary.ValueAtKey(dictionary=python_script_from_string, key=code_block.out2)
duplicate = archilab.Revit.Views.Views.Duplicate(view=byID, name=valueAtKey_2, options=valueAtKey_3)
RIE_GetAllViewTemplates = Custom[RIE_GetAllViewTemplates]()  # package RIE; Gets all view templates. Forked from SpringNodes
valueAtKey_4 = DesignScript.Builtin.Dictionary.ValueAtKey(dictionary=python_script_from_string, key=code_block.out3)
name = Element.Name(element=RIE_GetAllViewTemplates)
eq = valueAtKey_4 == name  # lacing=CrossProduct
filterByBoolMask = List.FilterByBoolMask(list=RIE_GetAllViewTemplates, mask=eq@L2)
flatten = List.Flatten(list=filterByBoolMask.in)
setViewTemplate = archilab.Revit.Views.Views.SetViewTemplate(view=duplicate, viewTemplate=flatten)
