# Dynamo graph script.dyn (Dynamo 2.3.0.5885)

current = Document.Current()
activeView = Document.ActiveView(document=current)
code_block = CodeBlock { ["Floors" ,"Structural Columns", "Structural Framing", "Structural Foundations","Walls"]; }
byName = Category.ByName(name=code_block)
color_palette = ColorPalette({R: 147, G: 123, B: 254, A: 255})
fill_patterns = FillPatterns("<Solid fill>")
code_block_2 = CodeBlock { 10; }
byProperties = Revit.Filter.OverrideGraphicSettings.ByProperties(cutFillColor=color_palette, projectionFillColor=color_palette, projectionLineColor=color_palette, cutFillPattern=fill_patterns, projectionFillPattern=fill_patterns, transparency=code_block_2)
color_palette_2 = ColorPalette({R: 255, G: 163, B: 10, A: 255})
fill_patterns_2 = FillPatterns("<Solid fill>")
code_block_3 = CodeBlock { 0; }
byProperties_2 = Revit.Filter.OverrideGraphicSettings.ByProperties(cutFillColor=color_palette_2, projectionFillColor=color_palette_2, projectionLineColor=color_palette_2, cutFillPattern=fill_patterns_2, projectionFillPattern=fill_patterns_2, transparency=code_block_3)
color_palette_3 = ColorPalette({R: 0, G: 218, B: 141, A: 255})
fill_patterns_3 = FillPatterns("<Solid fill>")
code_block_4 = CodeBlock { 0; }
byProperties_3 = Revit.Filter.OverrideGraphicSettings.ByProperties(cutFillColor=color_palette_3, projectionFillColor=color_palette_3, projectionLineColor=color_palette_3, cutFillPattern=fill_patterns_3, projectionFillPattern=fill_patterns_3, transparency=code_block_4)
color_palette_4 = ColorPalette({R: 134, G: 17, B: 171, A: 255})
fill_patterns_4 = FillPatterns("<Solid fill>")
code_block_5 = CodeBlock { 0; }
byProperties_4 = Revit.Filter.OverrideGraphicSettings.ByProperties(cutFillColor=color_palette_4, projectionFillColor=color_palette_4, projectionLineColor=color_palette_4, cutFillPattern=fill_patterns_4, projectionFillPattern=fill_patterns_4, transparency=code_block_5)
color_palette_5 = ColorPalette({R: 144, G: 238, B: 144, A: 255})
fill_patterns_5 = FillPatterns("<Solid fill>")
code_block_6 = CodeBlock { 5; }
byProperties_5 = Revit.Filter.OverrideGraphicSettings.ByProperties(cutFillColor=color_palette_5, projectionFillColor=color_palette_5, projectionLineColor=color_palette_5, cutFillPattern=fill_patterns_5, projectionFillPattern=fill_patterns_5, transparency=code_block_6)
list_create = List.Create(item0=byProperties, item1=byProperties_2, item2=byProperties_3, item3=byProperties_4, item4=byProperties_5)
setCategoryOverrides = View.SetCategoryOverrides(view=activeView, category=byName, overrides=list_create)
