# Dynamo graph script.dyn (Dynamo 2.3.0.5885)
# packages: Dynamo for Rebar 2.0.2, Structural Design 2019.12.11, Orchid 203.3.1.8192, spring nodes 132.2.5, BIM4Struc.Rebar 1.3.0, Chynamo 0.8.5, KYSUDO 2019.8.5, Data-Shapes 2022.2.96, archi-lab.net 2020.23.13, RIE 2020.11.18

# group: UI
code_block = CodeBlock { "CREATE REBAR FOR COLUMN FROM EXCEL DATA"; "Create"; true; "Cancel"; 800; 500; 200; }
code_block_2 = CodeBlock { "Select file excel "; "Check file format"; "Select"; "Sheet name"; "BN-Structural Column Schedule"; }
filepath_data = Custom[FilePath Data](InputName=code_block_2.out0, DefaulPath=code_block_2.out1, ButtonText=code_block_2.out2)  # package Data-Shapes; Create filepath input for UI.MultipleInputForm ++ . Check out www.data-shapes.net for more infos !
textbox_data = Custom[TextBox Data](InputName=code_block_2.out3, DefaultText=code_block_2.out4)  # package Data-Shapes; Create Data for TextBox input in UI.MultipleInputForm ++ . Check out www.data-shapes.net for more informations
code_block_3 = CodeBlock { "Select Model "; "Select Column"; "Structural Columns"; }
byName = Category.ByName(name=code_block_3.out2)
selectmodelelements_data = Custom[SelectModelElements Data](InputName=code_block_3.out0, ButtonText=code_block_3.out1, CategoryFilter=byName)  # package Data-Shapes; Creates a Revit element selection input for UI.MultipleInputForm++ . Check out www.data-shapes.net for more infos!
list_create = List.Create(item0=filepath_data, item1=textbox_data, item2=selectmodelelements_data)
multipleinputform = Custom[MultipleInputForm ++](Description_optional=code_block.out0, ButtonText_optional=code_block.out1, Inputs=list_create, Toggle=code_block.out2, CancelButtonText_optional=code_block.out3, MaxHeight_optional=code_block.out4, Width_optional=code_block.out5, LabelWidth_optional=code_block.out6)  # package Data-Shapes; Create a form with multiple inputs. see www.data-shapes.net for tutorials and infos!
code_block_4 = CodeBlock(Filepath=multipleinputform.User_Inputs, Sheetname=multipleinputform.User_Inputs, Modelselect=multipleinputform.User_Inputs) { Filepath[0]; Sheetname[1]; Modelselect[2]; }

# group: GET BASE LINE_ PLEASE CHECK SURFACE TOP AND BOTTOM OF COLUMN
element_faces = Custom[Element Faces](element=code_block_4.out2)  # package KYSUDO
code_block_5 = CodeBlock(a=element_faces.Bottom) { a; }
perimeterCurves = Surface.PerimeterCurves(surface=code_block_5)
byJoinedCurves = PolyCurve.ByJoinedCurves(curves=perimeterCurves)
flatten = List.Flatten(list=byJoinedCurves)
getRebarCover = Custom[Element.GetRebarCover](element=code_block_4.out2)  # package BIM4Struc.Rebar; Get the rebar cover dimensions for a selected element.
rebarBarType = RevitRebarBarType()  # nothing selected
rebarDiameter = StructuralDesign.Rebar.Properties.RebarDiameter(rebar=rebarBarType)
code_block_6 = CodeBlock(cover=getRebarCover.Other, barD=rebarDiameter) { cover+barD/2; }
code_block_7 = CodeBlock { 0.5; }
pointAtParameter = Surface.PointAtParameter(surface=code_block_5, u=code_block_7, v=code_block_7)
offset = Custom[Springs.Curve.Offset+](curve=flatten, distance=code_block_6, point=pointAtParameter)  # package spring nodes; Offsets a curve towards the specified point
code_block_8 = CodeBlock(a=element_faces.Top) { a; }
pointAtParameter_2 = Surface.PointAtParameter(surface=code_block_8, u=code_block_7, v=code_block_7)
byStartPointEndPoint = Line.ByStartPointEndPoint(startPoint=pointAtParameter_2, endPoint=pointAtParameter)
direction = Line.Direction(line=byStartPointEndPoint)

boolean = BoolSelector(false)

# group: GET DATA FROM EXCEL
file_from_path = FileObject(path=code_block_4.out0)
importExcel = Data.ImportExcel(file=file_from_path, sheetName=code_block_4.out1, showExcel=boolean)
restOfItems = List.RestOfItems(list=importExcel)
transpose = List.Transpose(lists=restOfItems)
code_block_9 = CodeBlock(b=transpose, h=transpose, mark=transpose, Rb=transpose, Rh=transpose, Diamain=transpose, DiaSti=transpose, AddSti=transpose, AddStiBartype=transpose) { b[1]; h[2]; mark[3]; Rb[4]; Rh[5]; Diamain[6]; DiaSti[7]; AddSti[8]; AddStiBartype[9]; }
code_block_10 = CodeBlock { "STG_Mark"; }
getParameterValueByName = Element.GetParameterValueByName(element=code_block_4.out2, parameterName=code_block_10)

clear_list = Custom[Clear List](input=code_block_9.out2)  # package archi-lab.net; This node will remove all Null and Empty Lists from any list.

# group (continued): GET DATA FROM EXCEL
o_list_indexof = Orchid.Common.List.IndexOf(list=clear_list, item=getParameterValueByName)
list_getitematindex_rebar_bar = List.GetItemAtIndex(list=code_block_9.out6, index=o_list_indexof)  # "List.GetItemAtIndex (Rebar bar Type_Stirrup)"
list_getitematindex_rebar_bar_2 = List.GetItemAtIndex(list=code_block_9.out5, index=o_list_indexof)  # "List.GetItemAtIndex (Rebar bar Type_Main)"
getItemAtIndex = List.GetItemAtIndex(list=code_block_9.out0, index=o_list_indexof)
getItemAtIndex_2 = List.GetItemAtIndex(list=code_block_9.out1, index=o_list_indexof)
nrebarh_list_getitematindex = List.GetItemAtIndex(list=code_block_9.out4, index=o_list_indexof)
nrebarb_list_getitematindex = List.GetItemAtIndex(list=code_block_9.out3, index=o_list_indexof)

# group: PROPERTIES OF MAIN REBAR
flatten_2 = List.Flatten(list=list_getitematindex_rebar_bar_2)
byName_2 = RebarBarType.ByName(name=flatten_2)
getBarDiameter = Custom[RebarType.GetBarDiameter](rebarBarType=byName_2)  # package BIM4Struc.Rebar; Get the diameter of a given Rebar Bar Type
rebarStyle = RevitRebarStyle("Standard")
rebarHookOrientation = RevitRebarHookOrientation("Right")
rebarHookType = RevitRebarHookType("None")

# group: PROPERTIES OF REBAR STIRRUP
id = Element.Id(element=code_block_4.out2)
rebarStyle_2 = RevitRebarStyle("StirrupTie")
flatten_3 = List.Flatten(list=list_getitematindex_rebar_bar)
byName_3 = RebarBarType.ByName(name=flatten_3)
rebarHookOrientation_2 = RevitRebarHookOrientation("Right")
rebarHookType_2 = RevitRebarHookType("None")
length = Curve.Length(curve=byStartPointEndPoint)
code_block_11 = CodeBlock(PHI=getBarDiameter, L=length)
# ---------- code_block_11.designscript (5 lines) ----------
90*PHI;
0;
//HC/4;
L-90*PHI-0;
//HC/4;
# ----------------------------------------
ZAxis = Vector.ZAxis()

boolean_2 = BoolSelector(true)
join = List.Join()  # unwired: list0, list1
relay = Relay(rebarDiameter)
code_block_12 = CodeBlock(cover=getRebarCover.Other, barD=relay, DiaMain=getBarDiameter) { cover+barD+DiaMain/2; }
relay_2 = Relay(pointAtParameter)
offset_2 = Custom[Springs.Curve.Offset+](curve=flatten, distance=code_block_12, point=relay_2)
code_block_13 = CodeBlock { 1; }
flatten_4 = List.Flatten(list=offset_2, amt=code_block_13)
explode = Geometry.Explode(geometry=flatten_4)
length_2 = Curve.Length(curve=explode)
round = Math.Round(number=length_2)
uniqueItems = List.UniqueItems(list=round@L2)
count = List.Count(list=uniqueItems@L2)
code_block_14 = CodeBlock(A=count) { A>1; }
boolean_3 = BoolSelector(false)
o_list_indexof_2 = Orchid.Common.List.IndexOf(list=code_block_14, item=boolean_3)
isEmpty = List.IsEmpty(list=o_list_indexof_2)
filterByBoolMask = List.FilterByBoolMask(list=explode, mask=code_block_14)
length_3 = Curve.Length(curve=filterByBoolMask.in)
round_2 = Math.Round(number=length_3)
maximumItem = List.MaximumItem(list=round_2)
o_list_indexof_3 = Orchid.Common.List.IndexOf(list=round_2@L2, item=maximumItem@L1)
flatten_5 = List.Flatten(list=o_list_indexof_3@L3)
getItemAtIndex_3 = List.GetItemAtIndex(list=filterByBoolMask.in@L2, index=flatten_5@L2)
byCurve = Custom[ByCurve](curve=filterByBoolMask.out)  # package Chynamo; Create line from curve start and end points
direction_2 = Line.Direction(line=byCurve)
code_block_15 = CodeBlock { 0; }
getItemAtIndex_4 = List.GetItemAtIndex(list=direction_2@L2, index=code_block_15)
isParallel = Vector.IsParallel(vector=direction_2@L2, other=getItemAtIndex_4, lacing=Longest)
filterByBoolMask_2 = List.FilterByBoolMask(list=filterByBoolMask.out, mask=isParallel)
code_block_16 = CodeBlock(a=filterByBoolMask_2.in) { a; }
flatten_6 = List.Flatten(list=o_list_indexof_2@L2)
flatten_7 = List.Flatten(list=flatten_6@L3)
boolean_4 = BoolSelector(false)
RIE_InsertItemAtIndex = Custom[RIE_InsertItemAtIndex](list=getItemAtIndex_3@L3, Item=code_block_16@L3, Index=flatten_7@L2, method=boolean_4, lacing=Longest)  # package RIE; Inserts Items into list at given index
safeIF = Custom[SafeIF](Test=isEmpty, TrueResult=getItemAtIndex_3, FalseResult=RIE_InsertItemAtIndex)  # package Chynamo; Safe IF to avoid true/false data lost
flatten_8 = List.Flatten(list=safeIF@L2)
code_block_17 = CodeBlock { 0; }
getItemAtIndex_5 = List.GetItemAtIndex(list=flatten_8@L2, index=code_block_17)
code_block_18 = CodeBlock(n=nrebarh_list_getitematindex) { 0..1..1/(n-1); }
pointAtParameter_3 = Curve.PointAtParameter(curve=getItemAtIndex_5, param=code_block_18)
flatten_9 = List.Flatten(list=pointAtParameter_3@L2)
ZAxis_2 = Vector.ZAxis()
code_block_19 = CodeBlock { ["Base Level","Base Offset","Top Level","Top Offset"]; }
getParameterValueByName_2 = Element.GetParameterValueByName(element=code_block_4.out2@L1, parameterName=code_block_19@L1, lacing=CrossProduct)
code_block_20 = CodeBlock { 0; 1; 2; 3; }
getItemAtIndex_6 = List.GetItemAtIndex(list=getParameterValueByName_2@L2, index=code_block_20.out0)
elevation = Level.Elevation(level=getItemAtIndex_6)
round_3 = Math.Round(number=elevation)
getItemAtIndex_7 = List.GetItemAtIndex(list=getParameterValueByName_2@L2, index=code_block_20.out2)
elevation_2 = Level.Elevation(level=getItemAtIndex_7)
round_4 = Math.Round(number=elevation_2)
getItemAtIndex_8 = List.GetItemAtIndex(list=getParameterValueByName_2@L2, index=code_block_20.out3)
getItemAtIndex_9 = List.GetItemAtIndex(list=getParameterValueByName_2@L2, index=code_block_20.out1)
set_rebar_with_ø = CodeBlock(a=round_3, b=round_4, c=getItemAtIndex_8, d=getItemAtIndex_9, phi=getBarDiameter) { -a+b+c+d+45*phi; }
byStartPointDirectionLength = Line.ByStartPointDirectionLength(startPoint=flatten_9@L2, direction=ZAxis_2, length=set_rebar_with_ø@L1, lacing=Longest)
code_block_21 = CodeBlock(n=nrebarh_list_getitematindex) { 1..n-1..2; }
flatten_10 = List.Flatten(list=code_block_21@L2)
getItemAtIndex_10 = List.GetItemAtIndex(list=byStartPointDirectionLength@L2, index=flatten_10@L2)
ZAxis_3 = Vector.ZAxis()
code_block_22 = CodeBlock(phi=getBarDiameter) { 45*phi; }
translate = Geometry.Translate(geometry=getItemAtIndex_10, direction=ZAxis_3, distance=code_block_22)
setDifference = List.SetDifference(list1=byStartPointDirectionLength, list2=getItemAtIndex_10)
combine = List.Combine(comb=join, list1=translate, list2=setDifference)
relay_3 = Relay(rebarStyle)
relay_4 = Relay(byName_2)
relay_5 = Relay(rebarHookOrientation)
relay_6 = Relay(rebarHookType)
setDifference_2 = List.SetDifference(list1=explode, list2=flatten_8)

# group: CREATE MAIN REBAR
code_block_23 = CodeBlock { 0; }
getItemAtIndex_11 = List.GetItemAtIndex(list=setDifference_2@L2, index=code_block_23)
byCurve_2 = Custom[ByCurve](curve=getItemAtIndex_11)
direction_3 = Line.Direction(line=byCurve_2)
byCurve_3 = Rebar.ByCurve(curve=combine, hostElementId=id, rebarStyle=relay_3, rebarBarType=relay_4, startHookOrientation=relay_5, endHookOrientation=rebarHookOrientation, startHookType=rebarHookType, endHookType=relay_6, vector=direction_3, lacing=Longest)
length_4 = Curve.Length(curve=getItemAtIndex_11)
code_block_24 = CodeBlock(arrayLength=length_4) { arrayLength; }
flatten_11 = List.Flatten(list=code_block_24)
count_2 = List.Count(list=byCurve_3@L2)
code_block_25 = CodeBlock(Numberposition=nrebarb_list_getitematindex) { Numberposition; }
flatten_12 = List.Flatten(list=code_block_25)
cycle = List.Cycle(list=flatten_12@L1, amount=count_2@L1)

round_5 = Math.Round(number=flatten_11)

# group (continued): CREATE MAIN REBAR
cycle_2 = List.Cycle(list=round_5@L1, amount=count_2@L1)
setLayoutAsFixedNumber = StructuralDesign.Rebar.Layout.SetLayoutAsFixedNumber(rebar=byCurve_3, arrayLength=cycle_2, numberOfBarPositions=cycle)

list_getitematindex_add_stir_dia = List.GetItemAtIndex(list=code_block_9.out7, index=o_list_indexof)
flatten_13 = List.Flatten(list=list_getitematindex_add_stir_dia)
string_from_object = FromObject(obj=flatten_13)
code_block_26 = CodeBlock { "null"; }
ne = string_from_object != code_block_26
boolean_5 = BoolSelector(true)
o_list_indexof_4 = Orchid.Common.List.IndexOf(list=ne, item=boolean_5)
getItemAtIndex_12 = List.GetItemAtIndex(list=code_block_4.out2, index=o_list_indexof_4)
color_palette = ColorPalette({R: 255, G: 0, B: 0, A: 255})
overrideColorInView = Element.OverrideColorInView(element=getItemAtIndex_12, color=color_palette)
getItemAtIndex_13 = List.GetItemAtIndex(list=flatten_8, index=o_list_indexof_4)
list_getitematindex_add_stir = List.GetItemAtIndex(list=code_block_9.out8, index=o_list_indexof)  # "List.GetItemAtIndex (Add-Stir-Bartype)"
getItemAtIndex_14 = List.GetItemAtIndex(list=list_getitematindex_add_stir, index=o_list_indexof_4)  # frozen
flatten_14 = List.Flatten(list=getItemAtIndex_14)
code_block_27 = CodeBlock(A=flatten_14) { A=="Stirrup - T1"; }
filterByBoolMask_3 = List.FilterByBoolMask(list=getItemAtIndex_13, mask=code_block_27)
code_block_28 = CodeBlock { 0; 1; }
getItemAtIndex_15 = List.GetItemAtIndex(list=filterByBoolMask_3.out@L2, index=code_block_28.out1)
getItemAtIndex_16 = List.GetItemAtIndex(list=nrebarh_list_getitematindex, index=o_list_indexof_4)  # frozen
flatten_15 = List.Flatten(list=getItemAtIndex_16)
filterByBoolMask_4 = List.FilterByBoolMask(list=flatten_15, mask=code_block_27)
code_block_29 = CodeBlock(n=filterByBoolMask_4.out) { 0..1..1/(n-1); }
pointAtParameter_4 = Curve.PointAtParameter(curve=getItemAtIndex_15, param=code_block_29)
getItemAtIndex_17 = List.GetItemAtIndex(list=filterByBoolMask_3.out@L2, index=code_block_28.out1)
relay_7 = Relay(offset)
code_block_30 = CodeBlock(a=relay_7) { a; }
list_create_2 = List.Create()  # unwired: item0, item1
getItemAtIndex_18 = List.GetItemAtIndex(list=filterByBoolMask_3.in@L2, index=code_block_28.out0)
code_block_31 = CodeBlock(n=filterByBoolMask_4.in) { 0..1..1/(n-1); }
code_block_32 = CodeBlock { 2; 4; }
slice = List.Slice(list=code_block_31@L2, start=code_block_32.out0, end=code_block_32.out1)
pointAtParameter_5 = Curve.PointAtParameter(curve=getItemAtIndex_18, param=slice)
getItemAtIndex_19 = List.GetItemAtIndex(list=filterByBoolMask_3.in@L2, index=code_block_28.out1)
pointAtParameter_6 = Curve.PointAtParameter(curve=getItemAtIndex_19, param=slice)
combine_2 = List.Combine(comb=list_create_2, list1=pointAtParameter_5, list2=pointAtParameter_6)
flatten_16 = List.Flatten(list=combine_2@L3)
byPoints = Polygon.ByPoints(points=flatten_16)
byPatch = Surface.ByPatch(closedCurve=byPoints)
perimeterCurves_2 = Surface.PerimeterCurves(surface=byPatch)
byJoinedCurves_2 = PolyCurve.ByJoinedCurves(curves=perimeterCurves_2)
code_block_33 = CodeBlock { 1; }
chop = List.Chop(list=byJoinedCurves_2, lengths=code_block_33)
filterByBoolMask_5 = List.FilterByBoolMask(list=o_list_indexof_4, mask=code_block_27)
code_block_34 = CodeBlock(a=filterByBoolMask_5.in) { a; }
insert = List.Insert(list=code_block_30@L2, element=chop@L1, index=code_block_34@L1)

# group: 90phi
byJoinedCurves_3 = PolyCurve.ByJoinedCurves(curves=offset)
byCurve_4 = Rebar.ByCurve(curve=byJoinedCurves_3, hostElementId=id, rebarStyle=rebarStyle_2, rebarBarType=byName_3, startHookOrientation=rebarHookOrientation_2, endHookOrientation=rebarHookOrientation_2, startHookType=rebarHookType_2, endHookType=rebarHookType_2, vector=direction, lacing=Longest)
code_block_35 = CodeBlock { 100; }

# group: L-9Phi-Hc/4
rebarShape = RevitRebarShape("Str_S_135_135")
translate_2 = Geometry.Translate(geometry=byJoinedCurves_3, direction=ZAxis, distance=code_block_11.out0)
byCurve_5 = Rebar.ByCurve(curve=translate_2, hostElementId=id, rebarStyle=rebarStyle_2, rebarBarType=byName_3, startHookOrientation=rebarHookOrientation_2, endHookOrientation=rebarHookOrientation_2, startHookType=rebarHookType_2, endHookType=rebarHookType_2, vector=direction, lacing=Longest)
setRebarShapeId = StructuralDesign.Rebar.Create.SetRebarShapeId(rebar=byCurve_5, rebarShape=rebarShape)
code_block_36 = CodeBlock { 200; }
boolean_6 = BoolSelector(false)
setLayoutAsMaximumSpacing = StructuralDesign.Rebar.Layout.SetLayoutAsMaximumSpacing(rebar=setRebarShapeId, spacing=code_block_36, arrayLength=code_block_11.out2, includeFirstBar=boolean_6, includeLastBar=boolean_6)

# group (continued): 90phi
setRebarShapeId_2 = StructuralDesign.Rebar.Create.SetRebarShapeId(rebar=byCurve_4, rebarShape=rebarShape)
setLayoutAsMaximumSpacing_2 = StructuralDesign.Rebar.Layout.SetLayoutAsMaximumSpacing(rebar=setRebarShapeId_2, spacing=code_block_35, arrayLength=code_block_11.out0, includeFirstBar=boolean_2, includeLastBar=boolean_2)

# group: Hc/4
translate_3 = Geometry.Translate(geometry=translate_2, direction=ZAxis, distance=code_block_11.out2)
byCurve_6 = Rebar.ByCurve(curve=translate_3, hostElementId=id, rebarStyle=rebarStyle_2, rebarBarType=byName_3, startHookOrientation=rebarHookOrientation_2, endHookOrientation=rebarHookOrientation_2, startHookType=rebarHookType_2, endHookType=rebarHookType_2, vector=direction, lacing=Longest)
setRebarShapeId_3 = StructuralDesign.Rebar.Create.SetRebarShapeId(rebar=byCurve_6, rebarShape=rebarShape)
code_block_37 = CodeBlock { 100; }
boolean_7 = BoolSelector(true)
setLayoutAsMaximumSpacing_3 = StructuralDesign.Rebar.Layout.SetLayoutAsMaximumSpacing(rebar=setRebarShapeId_3, spacing=code_block_37, arrayLength=code_block_11.out1, includeFirstBar=boolean_7, includeLastBar=boolean_7)
