# Dynamo graph script.dyn (Dynamo 2.3.0.5885)
# packages: KYSUDO 2019.8.5, Structural Design 2019.12.11, Dynamo for Rebar 2.0.2, Rhythm 2020.7.25, Data-Shapes 2022.2.96, spring nodes 132.2.5, Clockwork for Dynamo 2.x 2.3.0, Orchid 203.3.1.8192, Crumple 1.0.7, archi-lab.net 2020.23.13, SteamNodes 1.2.4, WombatDynamo 1.3.2

list_create = List.Create()  # unwired: item0, item1
code_block = CodeBlock { "Create FreeFormRebar From Model"; "Create"; true; "Cancle"; 800; 500; 300; }

# group: Select Model
code_block_2 = CodeBlock { "Select Model Wall"; "Select"; }
categories = Categories("OST_Walls")
selectmodelelements_data = Custom[SelectModelElements Data](InputName=code_block_2.out0, ButtonText=code_block_2.out1, CategoryFilter=categories)  # package Data-Shapes; Creates a Revit element selection input for UI.MultipleInputForm++ . Check out www.data-shapes.net for more infos!

categories_2 = Categories("OST_Rebar")
boolean = BoolSelector(true)
allElementTypesOf = Custom[Springs.Collector.AllElementTypesOf](CategoryOrElemType=categories_2, refresh=boolean)  # package spring nodes; Works with either categories, element types or revit classed . Can be applied as a function. No ties to the Document.Changed event.
familyName = Custom[FamilyType.FamilyName](familyType=allElementTypesOf)  # package Clockwork for Dynamo 2.x; Returns the *family* name of a given family *type*
groupByKey = List.GroupByKey(list=allElementTypesOf, keys=familyName)
stringFromObject_PY = Custom[StringFromObject_PY](obj=groupByKey.unique_keys)  # package Crumple; Uses the python str() function to convert data types to strings. Unlike 'string from object' this will trim trailing 0's from numbers.
code_block_3 = CodeBlock { "Rebar Bar"; "Rebar Hook"; "Rebar Shape"; }
o_list_indexof = Orchid.Common.List.IndexOf(list=stringFromObject_PY, item=code_block_3.out0)
rebarbartype_list_getitematindex = List.GetItemAtIndex(list=groupByKey.groups, index=o_list_indexof)
name = Element.Name(element=rebarbartype_list_getitematindex)

# group: Main Rebar
code_block_4 = CodeBlock { "Main Diameter"; }
dropdown_data = Custom[DropDown Data](InputName=code_block_4, Keys=name, Values=rebarbartype_list_getitematindex)  # package Data-Shapes; Create data for DropDown input in UI.MultiInputForm ++ . Check out www.data-shapes.net for more infos.
code_block_5 = CodeBlock { "Spacing OF MainRebar"; "200"; true; }
textbox_data = Custom[TextBox Data](InputName=code_block_5.out0, DefaultText=code_block_5.out1, IsNumberEntry=code_block_5.out2)  # package Data-Shapes; Create Data for TextBox input in UI.MultipleInputForm ++ . Check out www.data-shapes.net for more informations

# group: Stirrup Rebar Following Wall Length 1
code_block_6 = CodeBlock { "Stirrup Diameter"; }
dropdown_data_2 = Custom[DropDown Data](InputName=code_block_6, Keys=name, Values=rebarbartype_list_getitematindex)
code_block_7 = CodeBlock { "Spacing OF Stirrup Follow Wall Length"; "200"; true; }
textbox_data_2 = Custom[TextBox Data](InputName=code_block_7.out0, DefaultText=code_block_7.out1, IsNumberEntry=code_block_7.out2)

o_list_indexof_2 = Orchid.Common.List.IndexOf(list=stringFromObject_PY, item=code_block_3.out2)
rebar_shape_list_getitematindex = List.GetItemAtIndex(list=groupByKey.groups, index=o_list_indexof_2)
name_2 = Element.Name(element=rebar_shape_list_getitematindex)

# group: Stirrup Rebar Following Wall Length 2
code_block_8 = CodeBlock { "TypeShape"; "Stirrup Diameter"; }
dropdown_data_3 = Custom[DropDown Data](InputName=code_block_8.out0, Keys=name_2, Values=rebar_shape_list_getitematindex)
dropdown_data_4 = Custom[DropDown Data](InputName=code_block_8.out1, Keys=name, Values=rebarbartype_list_getitematindex)
code_block_9 = CodeBlock { "Spacing OF Stirrup Follow Wall Length 2"; "200"; true; "Spacing OF Stirrup Follow Wall Height"; }
textbox_data_3 = Custom[TextBox Data](InputName=code_block_9.out0, DefaultText=code_block_9.out1, IsNumberEntry=code_block_9.out2)
textbox_data_4 = Custom[TextBox Data](InputName=code_block_9.out3, DefaultText=code_block_9.out1, IsNumberEntry=code_block_9.out2)

list_create_2 = List.Create(item0=selectmodelelements_data, item1=dropdown_data, item2=textbox_data, item3=dropdown_data_2, item4=textbox_data_2, item5=dropdown_data_3, item6=dropdown_data_4, item7=textbox_data_3, item8=textbox_data_4)
flatten = List.Flatten(list=list_create_2)
multipleinputform = Custom[MultipleInputForm ++](Description_optional=code_block.out0, ButtonText_optional=code_block.out1, Inputs=flatten, Toggle=code_block.out2, CancelButtonText_optional=code_block.out3, MaxHeight_optional=code_block.out4, Width_optional=code_block.out5, LabelWidth_optional=code_block.out6)  # package Data-Shapes; Create a form with multiple inputs. see www.data-shapes.net for tutorials and infos!
code_block_10 = CodeBlock(element=multipleinputform.User_Inputs, MainDia=multipleinputform.User_Inputs, MainSpa=multipleinputform.User_Inputs, Stirrup1Dia=multipleinputform.User_Inputs, Stirrup1Spacing=multipleinputform.User_Inputs, Stirrup2Shape=multipleinputform.User_Inputs, StirrupLSpacingLength=multipleinputform.User_Inputs, StirrupHSpacingLength=multipleinputform.User_Inputs)
# ---------- code_block_10.designscript (9 lines) ----------
element[0];
MainDia[1];
MainSpa[2];
Stirrup1Dia[3];
Stirrup1Spacing[4];
Stirrup2Shape[5];
Stirrup1Dia[6];
StirrupLSpacingLength[7];
StirrupHSpacingLength[8];
# ----------------------------------------
getLocation = Element.GetLocation(element=code_block_10.out0)
byJoinedCurves = PolyCurve.ByJoinedCurves(curves=getLocation)
element_faces = Custom[Element Faces](element=code_block_10.out0)  # package KYSUDO
flatten_2 = List.Flatten(list=element_faces.Bottom)
byJoinedSurfaces = PolySurface.ByJoinedSurfaces(surfaces=flatten_2)
perimeterCurves = Surface.PerimeterCurves(surface=byJoinedSurfaces)
byJoinedCurves_2 = PolyCurve.ByJoinedCurves(curves=perimeterCurves@L2)
basePlane = PolyCurve.BasePlane(polyCurve=byJoinedCurves_2)
pullOntoPlane = Curve.PullOntoPlane(curve=byJoinedCurves, plane=basePlane)
code_block_11 = CodeBlock(a=code_block_10.out0) { a[0]; "Width"; "Unconnected Height"; }
ʳʰʸᵗʰᵐ_elements = Rhythm.Revit.Elements.Elements.GetParameterValueByNameTypeOrInstance(element=code_block_11.out0, parameterName=code_block_11.out1)
rebarHostCover = StructuralDesign.Rebar.Properties.RebarHostCover(element=code_block_11.out0)
properties_rebardiameter_main = StructuralDesign.Rebar.Properties.RebarDiameter(rebar=code_block_10.out1)  # "Properties.RebarDiameter (Main Dia)"
ʳʰʸᵗʰᵐ_elements_2 = Rhythm.Revit.Elements.Elements.GetParameterValueByNameTypeOrInstance(element=code_block_11.out0, parameterName=code_block_11.out2)
properties_rebardiameter_stirrup = StructuralDesign.Rebar.Properties.RebarDiameter(rebar=code_block_10.out3)  # "Properties.RebarDiameter (Stirrup Dia 1)"
code_block_12 = CodeBlock(Width=ʳʰʸᵗʰᵐ_elements, Cover=rebarHostCover.Other, MainDia=properties_rebardiameter_main, WallHeigth=ʳʰʸᵗʰᵐ_elements_2, StirrupDia=properties_rebardiameter_stirrup) { Width/2-Cover-MainDia/2; WallHeigth-Cover-MainDia/2; Width/2-Cover-MainDia-StirrupDia/2; }
code_block_13 = CodeBlock(RebarLocation=code_block_12.out0, RebarLength=code_block_12.out1) { -RebarLocation; RebarLength; }
smartOffset = WombatDynamo.Curve.SmartOffset(curve=pullOntoPlane, offsetDist=code_block_13.out0)
smartOffset_2 = WombatDynamo.Curve.SmartOffset(curve=pullOntoPlane, offsetDist=code_block_12.out0)
length = Curve.Length(curve=smartOffset_2)
code_block_14 = CodeBlock(length=length, MainSpaing=code_block_10.out2) { 0..length..MainSpaing; }
code_block_15 = CodeBlock(a=code_block_14, b=length) { a/b; }
pointAtParameter = Curve.PointAtParameter(curve=smartOffset_2, param=code_block_15)
closestPointTo = Geometry.ClosestPointTo(geometry=smartOffset, other=pointAtParameter)
ZAxis = Vector.ZAxis()
byStartPointDirectionLength = Line.ByStartPointDirectionLength(startPoint=closestPointTo, direction=ZAxis, length=code_block_13.RebarLength)
endPoint = Curve.EndPoint(curve=byStartPointDirectionLength)
ZAxis_2 = Vector.ZAxis()
byStartPointDirectionLength_2 = Line.ByStartPointDirectionLength(startPoint=pointAtParameter, direction=ZAxis_2, length=code_block_13.RebarLength)
code_block_16 = CodeBlock { 100; }
extendStart = Curve.ExtendStart(curve=byStartPointDirectionLength_2, distance=code_block_16)
endPoint_2 = Curve.EndPoint(curve=extendStart)
byStartPointEndPoint = Line.ByStartPointEndPoint(startPoint=endPoint, endPoint=endPoint_2)
flatten_3 = List.Flatten(list=byStartPointEndPoint)
flatten_4 = List.Flatten(list=extendStart)
combine = List.Combine(comb=list_create, list1=flatten_3, list2=flatten_4)
byJoinedCurves_3 = PolyCurve.ByJoinedCurves(curves=combine@L2)
code_block_17 = CodeBlock(elementhost=code_block_11.out0) { elementhost; }
id = Element.Id(element=code_block_17)
rebarStyle = RevitRebarStyle("Standard")
rebarHookOrientation = RevitRebarHookOrientation("Right")  # frozen
rebarHookType = RevitRebarHookType("None")
normal = Curve.Normal(curve=byJoinedCurves_3)
byCurve = Rebar.ByCurve(curve=byJoinedCurves_3, hostElementId=id, rebarStyle=rebarStyle, rebarBarType=code_block_10.out1, startHookOrientation=rebarHookOrientation, endHookOrientation=rebarHookOrientation, startHookType=rebarHookType, endHookType=rebarHookType, vector=normal)
o_list_indexof_3 = Orchid.Common.List.IndexOf(list=stringFromObject_PY, item=code_block_3.out1)
rebar_hook_list_getitematindex = List.GetItemAtIndex(list=groupByKey.groups, index=o_list_indexof_3)
name_3 = Element.Name(element=rebar_hook_list_getitematindex)
byStartPointDirectionLength_3 = Line.ByStartPointDirectionLength(startPoint=closestPointTo, direction=ZAxis_2, length=code_block_13.RebarLength)
extendStart_2 = Curve.ExtendStart(curve=byStartPointDirectionLength_3, distance=code_block_16)
flatten_5 = List.Flatten(list=extendStart_2)
combine_2 = List.Combine(comb=list_create, list1=flatten_3, list2=flatten_5)
byJoinedCurves_4 = PolyCurve.ByJoinedCurves(curves=combine_2@L2)
byCurve_2 = Rebar.ByCurve(curve=byJoinedCurves_4, hostElementId=id, rebarStyle=rebarStyle, rebarBarType=code_block_10.out1, startHookOrientation=rebarHookOrientation, endHookOrientation=rebarHookOrientation, startHookType=rebarHookType, endHookType=rebarHookType, vector=normal)
code_block_18 = CodeBlock { "Extend MainRebar For Couple"; "200"; true; }
textbox_data_5 = Custom[TextBox Data](InputName=code_block_18.out0, DefaultText=code_block_18.out1, IsNumberEntry=code_block_18.out2)
type = Object.Type(obj=getLocation)
code_block_19 = CodeBlock { "Arc"; }
contains = String.Contains(str=type, searchFor=code_block_19)
allFalse = List.AllFalse(list=contains)
offset = Curve.Offset(curve=pullOntoPlane, distance=code_block_12.out2)
byJoinedCurves_5 = PolyCurve.ByJoinedCurves(curves=offset)
code_block_20 = CodeBlock(Stirrup1Location=code_block_12.out2) { -Stirrup1Location; }
offset_2 = Curve.Offset(curve=pullOntoPlane, distance=code_block_20)
byJoinedCurves_6 = PolyCurve.ByJoinedCurves(curves=offset_2)
list_create_3 = List.Create(item0=byJoinedCurves_5, item1=byJoinedCurves_6)
runMe = Custom[Tool.RunMe](Boolean=allFalse, ThingToDo=list_create_3)  # package SteamNodes; Use Boolean to perform an action
relay = Relay(code_block_11.out0)
id_2 = Element.Id(element=relay)
rebarStyle_2 = RevitRebarStyle("StirrupTie")
rebarHookOrientation_2 = RevitRebarHookOrientation("Right")
rebarHookType_2 = RevitRebarHookType("None")
normal_2 = Curve.Normal(curve=offset)
byCurve_3 = Rebar.ByCurve(curve=runMe, hostElementId=id_2, rebarStyle=rebarStyle_2, rebarBarType=code_block_10.out3, startHookOrientation=rebarHookOrientation_2, endHookOrientation=rebarHookOrientation_2, startHookType=rebarHookType_2, endHookType=rebarHookType_2, vector=normal_2)
setLayoutAsMaximumSpacing = StructuralDesign.Rebar.Layout.SetLayoutAsMaximumSpacing(rebar=byCurve_3, spacing=code_block_10.out4, arrayLength=code_block_12.out1)
code_block_21 = CodeBlock { true; }
contains_2 = List.Contains(list=contains, item=code_block_21)
runMe_2 = Custom[Tool.RunMe](Boolean=contains_2, ThingToDo=list_create_3)
ZAxis_3 = Vector.ZAxis()
code_block_22 = CodeBlock(Hwall=code_block_12.out1, Spacing=code_block_10.out4) { Hwall/Spacing; }
round = Math.Round(number=code_block_22)
code_block_23 = CodeBlock(Spacing=code_block_10.out4, n=round) { 0..Spacing*n..Spacing; }
translate = Geometry.Translate(geometry=runMe_2, direction=ZAxis_3@L1, distance=code_block_23@L1, lacing=CrossProduct)
explode = Geometry.Explode(geometry=translate)
flatten_6 = List.Flatten(list=explode@L2)
relay_2 = Relay(id_2)
freeFormRebarByCurves = Rebar.FreeFormRebarByCurves(curves=flatten_6, hostElementId=relay_2, rebarBarType=code_block_10.out3)
pullOntoPlane_2 = Curve.PullOntoPlane(curve=getLocation, plane=basePlane)
ZAxis_4 = Vector.ZAxis()
translate_2 = Geometry.Translate(geometry=byJoinedCurves_6, direction=ZAxis_4, distance=code_block_10.out4)
ZAxis_5 = Vector.ZAxis()
translate_3 = Geometry.Translate(geometry=byJoinedCurves_5, direction=ZAxis_5, distance=code_block_10.out4)
length_2 = Curve.Length(curve=translate_3)
code_block_24 = CodeBlock(length=length_2, StirrupLSpaing=code_block_10.out7) { 0..length..StirrupLSpaing; }
code_block_25 = CodeBlock(a=code_block_24, b=length_2) { a/b; }
pointAtParameter_2 = Curve.PointAtParameter(curve=translate_3, param=code_block_25)
closestPointTo_2 = Geometry.ClosestPointTo(geometry=translate_2, other=pointAtParameter_2)
byStartPointEndPoint_2 = Line.ByStartPointEndPoint(startPoint=closestPointTo_2@L1, endPoint=pointAtParameter_2@L1)
ZAxis_6 = Vector.ZAxis()
code_block_26 = CodeBlock(Hwall=code_block_12.out1, SpacingH=code_block_10.out8) { 0..Hwall-SpacingH..SpacingH; }
translate_4 = Geometry.Translate(geometry=byStartPointEndPoint_2@L2, direction=ZAxis_6@L1, distance=code_block_26@L1, lacing=Longest)
freeFormRebarByCurves_2 = Rebar.FreeFormRebarByCurves(curves=translate_4@L2, hostElementId=relay_2, rebarBarType=code_block_10.out3)
length_3 = Curve.Length(curve=getLocation)
code_block_27 = CodeBlock(L=length_3) { 0..L..10; }
code_block_28 = CodeBlock(A=code_block_27, B=length_3) { A/B; }
pointAtParameter_3 = Curve.PointAtParameter(curve=getLocation, param=code_block_28)
byPoints = PolyCurve.ByPoints(points=pointAtParameter_3)
byJoinedCurves_7 = PolyCurve.ByJoinedCurves(curves=byPoints@L1)
curves = PolyCurve.Curves(polyCurve=byJoinedCurves_4)
freeFormRebarByCurves_3 = Rebar.FreeFormRebarByCurves(curves=curves, hostElementId=id, rebarBarType=code_block_10.out1)
