# Dynamo graph script.dyn "RB-CreateStirrupAndVaibo" (Dynamo 2.3.0.5885)
# packages: Rhythm 2020.7.25, BIM4Struc.Rebar 1.3.0, Dynamo for Rebar 2.0.2, Structural Design 2019.12.11, Data-Shapes 2022.2.96, RIE 2020.11.18, KYSUDO 2019.8.5, Chynamo 0.8.5, spring nodes 132.2.5

# group: UI
code_block = CodeBlock { "Create Rebar"; "Create"; true; "Cancel"; 500; 400; 200; }
code_block_2 = CodeBlock()
# ---------- code_block_2.designscript (10 lines) ----------
"Choose type Rebar Create";
["Stirrup a50","Vai bo"];
[0,1];
true;
55;

"Select Small Beam";
"Select Main Beam";
"Select";
true;
# ----------------------------------------
categories = Categories("OST_StructuralFraming")
selectmodelelements_data = Custom[SelectModelElements Data](InputName=code_block_2.out5, ButtonText=code_block_2.out7, CategoryFilter=categories, SelectSingleElement=code_block_2.out8)  # package Data-Shapes; Creates a Revit element selection input for UI.MultipleInputForm++ . Check out www.data-shapes.net for more infos!
selectmodelelements_data_2 = Custom[SelectModelElements Data](InputName=code_block_2.out6, ButtonText=code_block_2.out7, CategoryFilter=categories, SelectSingleElement=code_block_2.out8)
listview_data = Custom[Listview Data](InputName=code_block_2.out0, Keys=code_block_2.out1, Values=code_block_2.out2, Height_optionnal=code_block_2.out4)  # package Data-Shapes; Create data for ListView input in UI.MultiInputForm ++ . Check out www.data-shapes.net for more infos.
list_create = List.Create(item0=selectmodelelements_data, item1=selectmodelelements_data_2, item2=listview_data)
multipleinputform = Custom[MultipleInputForm ++](Description_optional=code_block.out0, ButtonText_optional=code_block.out1, Inputs=list_create, Toggle=code_block.out2, CancelButtonText_optional=code_block.out3, MaxHeight_optional=code_block.out4, Width_optional=code_block.out5, LabelWidth_optional=code_block.out6)  # package Data-Shapes; Create a form with multiple inputs. see www.data-shapes.net for tutorials and infos!
code_block_3 = CodeBlock(SmallBeam=multipleinputform.User_Inputs, MainBeam=multipleinputform.User_Inputs, TypeCreate=multipleinputform.User_Inputs) { SmallBeam[0]; MainBeam[1]; TypeCreate[2]; }
code_block_4 = CodeBlock { 0; 1; }
contains = List.Contains(list=code_block_3.out2, item=code_block_4.out0)
contains_2 = List.Contains(list=code_block_3.out2, item=code_block_4.out1)

element_faces = Custom[Element Faces](element=code_block_3.out1)  # package KYSUDO
code_block_5 = CodeBlock(a=element_faces.Top) { a; }
area = Surface.Area(surface=code_block_5)
maximumItem = List.MaximumItem(list=area)
RIE_IndexOf = Custom[RIE_IndexOf](list=area, Item=maximumItem)  # package RIE; Returns a sublistlist with all indexes for each item.
getItemAtIndex = List.GetItemAtIndex(list=code_block_5, index=RIE_IndexOf)
getLocation = Element.GetLocation(element=code_block_3.out1)
direction = Line.Direction(line=getLocation)
XAxis = Vector.XAxis()
isParallel = Vector.IsParallel(vector=direction, other=XAxis)
code_block_6 = CodeBlock { 0; 1; }
if_ = If(test=isParallel, true=code_block_6.out0, false=code_block_6.out1)
code_block_7 = CodeBlock { 0.5; }
getIsoline = Surface.GetIsoline(surface=getItemAtIndex, isoDirection=if_, parameter=code_block_7)
code_block_8 = CodeBlock { 0.5; }
pointAtParameter = Curve.PointAtParameter(curve=getIsoline, param=code_block_8)
getLocation_2 = Element.GetLocation(element=code_block_3.out0)
code_block_9 = CodeBlock { 0.5; }
pointAtParameter_2 = Curve.PointAtParameter(curve=getLocation_2, param=code_block_9)
ZAxis = Vector.ZAxis()
code_block_10 = CodeBlock { 500; }
translate = Geometry.Translate(geometry=pointAtParameter_2, direction=ZAxis, distance=code_block_10)
byLineAndPoint = Plane.ByLineAndPoint(line=getLocation_2, point=translate)
pullOntoPlane = Custom[Springs.Point.PullOntoPlane](point=pointAtParameter, plane=byLineAndPoint)  # package spring nodes; Pulls (projects) the point onto the input plane, following the plane normal.
code_block_11 = CodeBlock { 10000; }
extendEnd = Curve.ExtendEnd(curve=getIsoline, distance=code_block_11)
extendStart = Curve.ExtendStart(curve=extendEnd, distance=code_block_11)
byCurve = Custom[ByCurve](curve=extendStart)  # package Chynamo; Create line from curve start and end points
direction_2 = Line.Direction(line=byCurve)
code_block_12 = CodeBlock { "b"; "h"; }
ʳʰʸᵗʰᵐ_elements = Rhythm.Revit.Elements.Elements.GetParameterValueByNameTypeOrInstance(element=code_block_3.out0, parameterName=code_block_12.out0)
formula = Formula("b/2+50", b=ʳʰʸᵗʰᵐ_elements)
translate_2 = Geometry.Translate(geometry=pullOntoPlane, direction=direction_2, distance=formula)
byOriginNormal = Plane.ByOriginNormal(origin=translate_2, normal=direction_2)
geometry = Element.Geometry(element=code_block_3.out1)
intersect = Geometry.Intersect(geometry=byOriginNormal, other=geometry)
perimeterCurves = Surface.PerimeterCurves(surface=intersect)
byJoinedCurves = PolyCurve.ByJoinedCurves(curves=perimeterCurves)
getRebarCover = Custom[Element.GetRebarCover](element=code_block_3.out1)  # package BIM4Struc.Rebar; Get the rebar cover dimensions for a selected element.
code_block_13 = CodeBlock(cover=getRebarCover.Other) { -cover; }
offset = Curve.Offset(curve=byJoinedCurves, distance=code_block_13)
byJoinedCurves_2 = PolyCurve.ByJoinedCurves(curves=offset)
flatten = List.Flatten(list=byJoinedCurves_2)
reverse = Vector.Reverse(vector=direction_2)
formula_2 = Formula("b+100", b=ʳʰʸᵗʰᵐ_elements)
translate_3 = Geometry.Translate(geometry=offset, direction=reverse, distance=formula_2)
byJoinedCurves_3 = PolyCurve.ByJoinedCurves(curves=translate_3)
flatten_2 = List.Flatten(list=byJoinedCurves_3)
list_create_2 = List.Create(item0=flatten, item1=flatten_2)
code_block_14 = CodeBlock { "NOT CREATE"; }
if_2 = If(test=contains, true=list_create_2, false=code_block_14)
code_block_15 = CodeBlock(A=if_2) { A[0]; A[1]; }

# group: Properties for Stirrup
id = Element.Id(element=code_block_3.out1)
rebarStyle = RevitRebarStyle("StirrupTie")
rebarBarType = RevitRebarBarType("Ø8")
rebarHookOrientation = RevitRebarHookOrientation("Left")
rebarHookType = RevitRebarHookType("None")

byCurve_2 = Rebar.ByCurve(curve=code_block_15.out0, hostElementId=id, rebarStyle=rebarStyle, rebarBarType=rebarBarType, startHookOrientation=rebarHookOrientation, endHookOrientation=rebarHookOrientation, startHookType=rebarHookType, endHookType=rebarHookType, vector=direction_2)
byCurve_3 = Rebar.ByCurve(curve=code_block_15.out1, hostElementId=id, rebarStyle=rebarStyle, rebarBarType=rebarBarType, startHookOrientation=rebarHookOrientation, endHookOrientation=rebarHookOrientation, startHookType=rebarHookType, endHookType=rebarHookType, vector=reverse)
list_create_3 = List.Create(item0=byCurve_2, item1=byCurve_3)
flatten_3 = List.Flatten(list=list_create_3)
ʳʰʸᵗʰᵐ_elements_2 = Rhythm.Revit.Elements.Elements.GetParameterValueByNameTypeOrInstance(element=code_block_3.out1, parameterName=code_block_12.out1)
code_block_16 = CodeBlock(Hbeam=ʳʰʸᵗʰᵐ_elements_2) { Hbeam; }
code_block_17 = CodeBlock(h=code_block_16) { h>500; }
code_block_18 = CodeBlock(h=code_block_16) { h/2; h; }
if_3 = If(test=code_block_17, true=code_block_18.out0, false=code_block_18.h)
code_block_19 = CodeBlock(LengthArray=if_3) { LengthArray/50; 50; 300; }
round = Math.Round(number=code_block_19.out0)
boolean = BoolSelector(true)
setLayoutAsNumberWithSpacing = StructuralDesign.Rebar.Layout.SetLayoutAsNumberWithSpacing(rebar=flatten_3, numberOfBarPositions=round, spacing=code_block_19.out1, barsOnNormalSide=boolean, includeFirstBar=boolean, includeLastBar=boolean, lacing=Longest)
code_block_20 = CodeBlock { "Hook At Start"; "Hook At End"; }
rebarHookType_2 = RevitRebarHookType("Hook-Stirrup_Tie-135")
ʳʰʸᵗʰᵐ_elements_3 = Rhythm.Revit.Elements.Elements.SetParameterByNameTypeOrInstance(element=setLayoutAsNumberWithSpacing, parameterName=code_block_20.out1, value=rebarHookType_2)
ʳʰʸᵗʰᵐ_elements_4 = Rhythm.Revit.Elements.Elements.SetParameterByNameTypeOrInstance(element=ʳʰʸᵗʰᵐ_elements_3, parameterName=code_block_20.out0, value=rebarHookType_2)
translate_4 = Geometry.Translate(geometry=pullOntoPlane, direction=reverse, distance=formula)
translate_5 = Geometry.Translate(geometry=translate_4, direction=reverse, distance=if_3)
translate_6 = Geometry.Translate(geometry=translate_5, direction=reverse, distance=code_block_19.out2)
ZAxis_2 = Vector.ZAxis()
code_block_21 = CodeBlock(cover=getRebarCover.Other) { -cover-30; cover+10; }
translate_7 = Geometry.Translate(geometry=translate_6, direction=ZAxis_2, distance=code_block_21.out0)
translate_8 = Geometry.Translate(geometry=translate_5, direction=ZAxis_2, distance=code_block_21.out0)
code_block_22 = CodeBlock { 0.5; }
normalAtParameter = Curve.NormalAtParameter(curve=byCurve, param=code_block_22)
byOriginNormal_2 = Plane.ByOriginNormal(origin=translate_4, normal=normalAtParameter)
intersect_2 = Geometry.Intersect(geometry=byOriginNormal_2, other=byJoinedCurves_3)
flatten_4 = List.Flatten(list=intersect_2)
Z = Point.Z(point=flatten_4)
sortByKey = List.SortByKey(list=flatten_4, keys=Z)
code_block_23 = CodeBlock(point=sortByKey.sorted_list) { point[0]; }
translate_9 = Geometry.Translate(geometry=code_block_23, direction=ZAxis_2, distance=code_block_21.out1)
intersect_3 = Geometry.Intersect(geometry=byOriginNormal_2, other=byJoinedCurves_2)
flatten_5 = List.Flatten(list=intersect_3)
Z_2 = Point.Z(point=flatten_5)
sortByKey_2 = List.SortByKey(list=flatten_5, keys=Z_2)
code_block_24 = CodeBlock(point=sortByKey_2.sorted_list) { point[0]; }
translate_10 = Geometry.Translate(geometry=code_block_24, direction=ZAxis_2, distance=code_block_21.out1)
translate_11 = Geometry.Translate(geometry=translate_2, direction=direction_2, distance=if_3)
translate_12 = Geometry.Translate(geometry=translate_11, direction=ZAxis_2, distance=code_block_21.out0)
translate_13 = Geometry.Translate(geometry=translate_11, direction=direction_2, distance=code_block_19.out2)
translate_14 = Geometry.Translate(geometry=translate_13, direction=ZAxis_2, distance=code_block_21.out0)
list_create_4 = List.Create(item0=translate_7, item1=translate_8, item2=translate_9, item3=translate_10, item4=translate_12, item5=translate_14)
flatten_6 = List.Flatten(list=list_create_4)
byPoints = PolyCurve.ByPoints(points=flatten_6)
ʳʰʸᵗʰᵐ_elements_5 = Rhythm.Revit.Elements.Elements.GetParameterValueByNameTypeOrInstance(element=code_block_3.out1, parameterName=code_block_12.out0)
code_block_25 = CodeBlock(b=ʳʰʸᵗʰᵐ_elements_5, cover=getRebarCover.Other) { b/2-cover-20; }
translate_15 = Geometry.Translate(geometry=byPoints, direction=normalAtParameter, distance=code_block_25)
if_4 = If(test=contains_2, true=translate_15, false=code_block_14)

# group: Properties for vaibo
id_2 = Element.Id(element=code_block_3.out1)
rebarStyle_2 = RevitRebarStyle("StirrupTie")
rebarBarType_2 = RevitRebarBarType("Ø16")
rebarHookOrientation_2 = RevitRebarHookOrientation("Left")
rebarHookType_3 = RevitRebarHookType("None")

reverse_2 = Vector.Reverse(vector=normalAtParameter)
byCurve_4 = Rebar.ByCurve(curve=if_4, hostElementId=id_2, rebarStyle=rebarStyle_2, rebarBarType=rebarBarType_2, startHookOrientation=rebarHookOrientation_2, endHookOrientation=rebarHookOrientation_2, startHookType=rebarHookType_3, endHookType=rebarHookType_3, vector=reverse_2)
code_block_26 = CodeBlock(b=ʳʰʸᵗʰᵐ_elements_5, cover=getRebarCover.Other) { b>500; b-2*cover-30; }
code_block_27 = CodeBlock { 2; 4; }
if_5 = If(test=code_block_26.out0, true=code_block_27.out1, false=code_block_27.out0)
boolean_2 = BoolSelector(true)
setLayoutAsFixedNumber = StructuralDesign.Rebar.Layout.SetLayoutAsFixedNumber(rebar=byCurve_4, arrayLength=code_block_26.out1, numberOfBarPositions=if_5, barsOnNormalSide=boolean_2, includeFirstBar=boolean_2, includeLastBar=boolean_2)
list_create_5 = List.Create(item0=ʳʰʸᵗʰᵐ_elements_4, item1=setLayoutAsFixedNumber)
boolean_3 = BoolSelector(true)
RIE_ActiveView = Custom[RIE_ActiveView](Refresh=boolean_3)  # package RIE; Returns active view in current document.
setUnobscuredInView = Custom[Rebar.SetUnobscuredInView](rebarElements=list_create_5, views=RIE_ActiveView, unobscured=boolean_3)  # package BIM4Struc.Rebar; Sets this rebar element to be shown unobscured in a view.
setSolidInView = Custom[Rebar.SetSolidInView](rebarElements=setUnobscuredInView, views=RIE_ActiveView, solid=boolean_3)  # package BIM4Struc.Rebar; Sets this rebar element to be shown solidly in a 3D view.
