# Dynamo graph Home.dyn (Dynamo 2.5.0.7460)
# packages: LinkDWG 0.3.91

boolean = BoolSelector(true)  # frozen
selectObjects = Custom[SelectObjects](Run=boolean)  # package LinkDWG; UI to select objects in AutoCAD
COMObjectProperties = Custom[COMObjectProperties](COM_Object=selectObjects)  # package LinkDWG; Get properties of COM Object
code_block = CodeBlock { 3; }
getItemAtIndex = List.GetItemAtIndex(list=COMObjectProperties.1_Values@L2, index=code_block)
boolean_2 = BoolSelector(true)
python_script = Python(IN[0]=boolean_2, IN[1]=boolean_2)
# ---------- python_script.python (51 lines) ----------
import clr
import System
clr.AddReference('System.Windows.Forms')
from System.Windows.Forms import MessageBox

run = IN[0]        # True → chạy chọn
show_msg = IN[1]   # True → hiện hướng dẫn

acad = None
try:
    acad = System.Runtime.InteropServices.Marshal.GetActiveObject("AutoCAD.Application")
except:
    OUT = "Không tìm thấy AutoCAD"
    quit()

doc = acad.ActiveDocument
result = []

if run and doc:
    try:
        if show_msg:
            MessageBox.Show(
                "Chuyển sang AutoCAD và PICK các đối tượng.\nNhấn ENTER để kết thúc.",
                "Select in AutoCAD"
            )

        doc.Activate()

        # Lưu users5 để không làm ảnh hưởng đến user
        backup_var = doc.GetVariable("users5")

        # AutoLISP gọi ssget để pick đối tượng
        
        cmd = "(and(princ\042" + "\042)(setq ss(ssget))(setvar\042users5\042\042LinkDWGUIOK\042)(command\042_.Select\042ss\042\042)) "
        
        doc.SendCommand(cmd)

        sel = doc.ActiveSelectionSet

        if sel:
            for obj in sel:
                result.append(obj)

        # Clear ss
        #doc.SendCommand('(setq ss nil)')
        #doc.SetVariable("users5", backup_var)

    except Exception as e:
        result = str(e)

OUT = result
# ----------------------------------------
python_script_2 = Python(IN[0]=python_script)  # graph output
# ---------- python_script_2.python (84 lines) ----------
# --- Imports cơ bản ---
import clr
clr.AddReference('ProtoGeometry')
from Autodesk.DesignScript.Geometry import *

import Autodesk
import System

# --- AutoCAD → Dynamo support ---
def _ToDSPoint(coord):
    return Point.ByCoordinates(coord[0], coord[1], coord[2])

def _ToDSPoints2D(coords, z=0):
    pts = []
    for i in range(0, len(coords), 2):
        pts.append(Point.ByCoordinates(coords[i], coords[i+1], z))
    return pts

# --- Convert Polyline ---
def _ACADConvertPolyline(vlo):
    try:
        # 2D polyline
        if hasattr(vlo, "Coordinates"):
            coords = list(vlo.Coordinates)
            pts = _ToDSPoints2D(coords)
            return PolyCurve.ByPoints(pts)

        # 3D polyline
        if hasattr(vlo, "Coordinate"):
            coords = list(vlo.Coordinate)
            pts = []
            for i in range(0, len(coords), 3):
                pts.append(Point.ByCoordinates(coords[i], coords[i+1], coords[i+2]))
            return PolyCurve.ByPoints(pts)

        # Nếu polyline phức tạp (LWPOLYLINE có bulge)
        if hasattr(vlo, "Explode"):
            pieces = []
            for seg in vlo.Explode():
                if hasattr(seg, "StartPoint") and hasattr(seg, "EndPoint"):
                    p0 = _ToDSPoint(seg.StartPoint)
                    p1 = _ToDSPoint(seg.EndPoint)
                    pieces.append(Line.ByStartPointEndPoint(p0, p1))
                seg.Delete()
            return PolyCurve.ByJoinedCurves(pieces)

    except:
        return None


# --- WRAP / UNWRAP ---
def _ForceList(obj):
    if hasattr(obj, "__iter__"):
        return obj
    return [obj]

def unwrap(obj):
    if hasattr(obj, "__iter__"):
        return [unwrap(x) for x in obj]
    if hasattr(obj, "comobject"):
        return obj.comobject.Document.HandleToObject(obj.handle)
    return obj


# --- MAIN ---
vlo = IN[0]
rtn = []

if vlo:
    for obj in _ForceList(vlo):
        cad_obj = unwrap(obj)

        # chỉ xử lý polyline
        if hasattr(cad_obj, "ObjectName") and "Polyline" in cad_obj.ObjectName:
            poly = _ACADConvertPolyline(cad_obj)
            if poly: rtn.append(poly)

# chuẩn hóa output
if len(rtn) == 1:
    OUT = rtn[0]
elif rtn == []:
    OUT = None
else:
    OUT = rtn
# ----------------------------------------
blockProperties = Custom[BlockProperties]()  # package LinkDWG; Get COM Block properties; unwired: COM_Block
circleProperties = Custom[CircleProperties](COM_Circle=blockProperties.7_COM_NestAttributes)  # package LinkDWG; Get COM circle properties
blockProperties_2 = Custom[BlockProperties]()  # unwired: COM_Block
nestAttributes = Custom[NestAttributes](COM_AttBlock=blockProperties_2.7_COM_NestAttributes)  # package LinkDWG; Get nest attribute COM object(s) from parent block
MTextProperties = Custom[MTextProperties]()  # package LinkDWG; Get COM TEXT/MTEXT properties; unwired: COM_MText
MLeaderProperties = Custom[MLeaderProperties]()  # package LinkDWG; Get COM MLeader properties; unwired: COM_MLeader
attributeProperties = Custom[AttributeProperties](COM_Attribute=blockProperties_2.7_COM_NestAttributes)  # package LinkDWG; Get COM NestAttribute/AttributeDefinition properties
dynamicProperties = Custom[DynamicProperties](COM_DynBlock=blockProperties_2.7_COM_NestAttributes)  # package LinkDWG; Get the proerties of AutoCAD Dynamic Block
nestAttributes_2 = Custom[NestAttributes]()  # unwired: COM_AttBlock
getCOMObjects = Custom[GetCOMObjects]()  # package LinkDWG; Get all COM Objects from current DBX drawing; unwired: COM_DBXDocument
getCOMObjects_2 = Custom[GetCOMObjects]()
COMObjectProperties_2 = Custom[COMObjectProperties]()  # unwired: COM_Object
boolean_3 = BoolSelector(true)
pickObject = Custom[PickObject](Run=boolean_3)  # package LinkDWG; UI to pick an object in AutoCAD
python_script_3 = Python(IN[0]=pickObject)
# ---------- python_script_3.python (95 lines) ----------
# Python Script for Dynamo: Input IN[0] as wrapped COM Block object from AutoCAD, unwrap, explode and extract only circles
# Outputs: List of DS Circle geometries

import clr
clr.AddReference('ProtoGeometry')
from Autodesk.DesignScript.Geometry import *

from System import Math

# ------------------- Unwrap from Segment 1 -------------------
def unwrap(lst):
    if hasattr(lst, "__iter__"):
        rtn = []
        for x in lst:
            rtn.append(unwrap(x))
    elif hasattr(lst, "comobject") and hasattr(lst, "layer") and hasattr(lst, "handle"):
        # Lấy object gốc từ handle
        doc = lst.comobject.Document  # Document từ comobject gốc
        rtn = doc.HandleToObject(lst.handle)
    else:
        rtn = lst
    return rtn

# ------------------- Helper -------------------
def ToDSPoint(acad_coord):
    return Point.ByCoordinates(acad_coord[0], acad_coord[1], acad_coord[2])

def GetLayerLock(acad_doc, layer_name, cache):
    if layer_name in cache:
        return cache[layer_name]
    try:
        layer = acad_doc.Layers.Item(layer_name)
        locked = layer.Lock
        cache[layer_name] = locked
        return locked
    except:
        return False

def DuplicateAndExplode(obj):
    try:
        obj.Copy()
        d = obj.Document
        d.SendCommand("Select (entlast)  ")
        d.SendCommand("Explode  ")
        d.SendCommand("Select (ssget \"_p\")  ")
        return d.ActiveSelectionSet
    except:
        return None

# ------------------- Convert only Circle to DS Circle -------------------
def ConvertCircle(obj):
    try:
        center = ToDSPoint(obj.Center)
        radius = obj.Radius
        return Circle.ByCenterPointRadius(center, radius)
    except: return None

# ------------------- Main recursive to get only Circles from Block -------------------
def GetDSCircles(obj, explode_blocks=True, lock_cache=None, acad_doc=None):
    circles = []
    if lock_cache is None: lock_cache = {}
    if acad_doc is None: acad_doc = obj.Document
    if GetLayerLock(acad_doc, obj.Layer, lock_cache):
        return circles

    name = obj.ObjectName
    try:
        if name == "AcDbCircle":
            c = ConvertCircle(obj)
            if c: circles.append(c)
        elif name == "AcDbBlockReference" and explode_blocks:
            exploded = DuplicateAndExplode(obj)
            if exploded:
                for i in range(exploded.Count):
                    sub = exploded.Item(i)
                    circles.extend(GetDSCircles(sub, explode_blocks, lock_cache, acad_doc))
                    sub.Delete()
    except: pass
    return circles

# ------------------- Main -------------------
vlo = IN[0]  # Wrapped COM Block object (e.g., from unwrap or previous node)
output = []

if vlo is not None:
    try:
        # Unwrap để lấy object gốc
        unwrapped = unwrap(vlo)
        lock_cache = {}
        acad_doc = unwrapped.Document  # Bây giờ dùng unwrapped
        output = GetDSCircles(unwrapped, True, lock_cache, acad_doc)
    except Exception as ex:
        output = str(ex)

OUT = output
# ----------------------------------------
code_block_2 = CodeBlock { a[1]; }  # unwired: a
leaderProperties = Custom[LeaderProperties](COM_Leader=code_block_2)  # package LinkDWG; Get COM Leader properties
COMObjectProperties_3 = Custom[COMObjectProperties]()  # unwired: COM_Object
pickObject_2 = Custom[PickObject](Run=boolean_3)
python_script_4 = Python(IN[0]=pickObject_2)
# ---------- python_script_4.python (140 lines) ----------
# Python Script for Dynamo: Input IN[0] as wrapped COM Block object from AutoCAD, unwrap, explode and extract only leaders
# Outputs: List of DS PolyCurve geometries representing leaders

import clr
clr.AddReference('ProtoGeometry')
from Autodesk.DesignScript.Geometry import *


from System import Math

# ------------------- Unwrap from Segment 1 -------------------
def unwrap(lst):
    if hasattr(lst, "__iter__"):
        rtn = []
        for x in lst:
            rtn.append(unwrap(x))
    elif hasattr(lst, "comobject") and hasattr(lst, "layer") and hasattr(lst, "handle"):
        # Lấy object gốc từ handle
        doc = lst.comobject.Document  # Document từ comobject gốc
        rtn = doc.HandleToObject(lst.handle)
    else:
        rtn = lst
    return rtn

# ------------------- Helper from Segment 2 -------------------
def _ToDSPoints3D(dat):
    rtn = []
    m = -3
    n = len(dat)-2
    for abc in dat: 
        m+= 3
        if m < n:
            px=Point.ByCoordinates(dat[m], dat[m+1], dat[m+2])
            rtn.append(px)
    return rtn

def ToDSPoint(acad_coord):
    return Point.ByCoordinates(acad_coord[0], acad_coord[1], acad_coord[2])

def GetLayerLock(acad_doc, layer_name, cache):
    if layer_name in cache:
        return cache[layer_name]
    try:
        layer = acad_doc.Layers.Item(layer_name)
        locked = layer.Lock
        cache[layer_name] = locked
        return locked
    except:
        return False

def DuplicateAndExplode(obj):
    try:
        obj.Copy()
        d = obj.Document
        d.SendCommand("Select (entlast)  ")
        d.SendCommand("Explode  ")
        d.SendCommand("Select (ssget \"_p\")  ")
        return d.ActiveSelectionSet
    except:
        return None

# ------------------- Convert only Leader to DS PolyCurve -------------------
def ConvertLeader(obj):
    try:
        # For AcDbLeader: Coordinates is flat array
        coords = list(obj.Coordinates)  # Convert variant to list
        points = _ToDSPoints3D(coords)
        if len(points) < 2:
            return None
        # Create lines between points and join to PolyCurve
        lines = []
        for i in range(len(points) - 1):
            lines.append(Line.ByStartPointEndPoint(points[i], points[i+1]))
        return PolyCurve.ByJoinedCurves(lines)
    except: return None

# ------------------- Handle MLeader (basic: extract leader lines) -------------------
def ConvertMLeader(obj):
    try:
        curves = []
        # MLeader có multiple leader lines
        for idx in range(obj.LeaderCount):
            verts = list(obj.GetLeaderVertices(idx))  # flat array
            points = _ToDSPoints3D(verts)
            if len(points) < 2:
                continue
            lines = []
            for i in range(len(points) - 1):
                lines.append(Line.ByStartPointEndPoint(points[i], points[i+1]))
            curves.append(PolyCurve.ByJoinedCurves(lines))
        if curves:
            return curves  # list of PolyCurves if multiple
        return None
    except: return None

# ------------------- Main recursive to get only Leaders from Block -------------------
def GetDSLeaders(obj, explode_blocks=True, lock_cache=None, acad_doc=None):
    leaders = []
    if lock_cache is None: lock_cache = {}
    if acad_doc is None: acad_doc = obj.Document
    if GetLayerLock(acad_doc, obj.Layer, lock_cache):
        return leaders

    name = obj.ObjectName
    try:
        if name == "AcDbLeader":
            c = ConvertLeader(obj)
            if c: leaders.append(c)
        elif name == "AcDbMLeader":
            c = ConvertMLeader(obj)
            if c:
                if isinstance(c, list):
                    leaders.extend(c)
                else:
                    leaders.append(c)
        elif name == "AcDbBlockReference" and explode_blocks:
            exploded = DuplicateAndExplode(obj)
            if exploded:
                for i in range(exploded.Count):
                    sub = exploded.Item(i)
                    leaders.extend(GetDSLeaders(sub, explode_blocks, lock_cache, acad_doc))
                    sub.Delete()
    except: pass
    return leaders

# ------------------- Main -------------------
vlo = IN[0]  # Wrapped COM Block object (e.g., from unwrap or previous node)
output = []

if vlo is not None:
    try:
        # Unwrap để lấy object gốc
        unwrapped = unwrap(vlo)
        lock_cache = {}
        acad_doc = unwrapped.Document  # Bây giờ dùng unwrapped
        output = GetDSLeaders(unwrapped, True, lock_cache, acad_doc)
    except Exception as ex:
        output = str(ex)

OUT = output
# ----------------------------------------
selectObjects_2 = Custom[SelectObjects]()
boolean_4 = BoolSelector(true)
python_script_5 = Python(IN[0]=boolean_4, IN[1]=boolean_4)  # same code as python_script
python_script_6 = Python(IN[0]=python_script_5)  # same code as python_script_4
