# Dynamo graph script.dyn (Dynamo 2.3.0.5885)
# packages: LinkDWG2 0.4.18, LinkDWG 0.3.91, Rhythm 2020.7.25, Orchid 203.3.1.8192, RIE 2020.11.18, Structural Design 2019.12.11, archi-lab.net 2021.25.15, Clockwork for Dynamo 2.x 2.3.0

createby_type_name = StringInput("F1-850x850x800")  # graph input
byName = FamilyType.ByName(name=createby_type_name)
isNull = Object.IsNull(obj=byName)
select_CategoryCreate = ModelCategories("Structural Columns")  # graph input
o_elementtype_bycategory = Orchid.RevitProject.Elements.ElementType.ByCategory(category=select_CategoryCreate)
o_document_current = Orchid.RevitProject.Common.Document.Current()
select_Polycurve = BoolSelector(true)  # graph input
selectObjects = Custom[SelectObjects](Execute=select_Polycurve)  # package LinkDWG2; Select objects on screen
polylineProperties = Custom[PolylineProperties](COM_Polyline=selectObjects)  # package LinkDWG; Get the COM LWPolyline properties
code_block = CodeBlock(a=polylineProperties.0_PolyCurve) { a; }
pickLocationLine_Cad = BoolSelector(true)  # graph input
pickObject = Custom[PickObject](Execute=pickLocationLine_Cad)  # package LinkDWG2; Pick an object in AutoCAD
lineProperty = Custom[LineProperty](COM_Lines=pickObject)  # package LinkDWG2; Get COM line properties
pickLocationLine_Revit = BoolSelector(true)  # graph input
pickElementsByRectangle = StructuralDesign.Model.Selection.PickElementsByRectangle(refresh=pickLocationLine_Revit)
geometry = Element.Geometry(element=pickElementsByRectangle)
startPoint = Curve.StartPoint(curve=geometry)
byStartPointEndPoint = Line.ByStartPointEndPoint(startPoint=lineProperty.0_StartPoint, endPoint=startPoint)
direction = Line.Direction(line=byStartPointEndPoint)
length = Curve.Length(curve=byStartPointEndPoint)
translate = Geometry.Translate(geometry=code_block, direction=direction, distance=length, lacing=Longest)
ZAxis = Vector.ZAxis()
degree_rotate = DoubleInput(-90)  # graph input
rotate = Geometry.Rotate(geometry=translate, origin=startPoint, axis=ZAxis, degrees=degree_rotate, lacing=Longest)
flatten = List.Flatten(list=rotate)
byPatch = Surface.ByPatch(closedCurve=flatten)
clear_list = Custom[Clear List](input=byPatch)  # package archi-lab.net; This node will remove all Null and Empty Lists from any list.
code_block_2 = CodeBlock { 0; 1; 0.5; }
getIsoline = Surface.GetIsoline(surface=clear_list, isoDirection=code_block_2.out0, parameter=code_block_2.out2)
length_2 = Curve.Length(curve=getIsoline)
round = Math.Round(number=length_2)
floor = Math.Floor(number=round)
getIsoline_2 = Surface.GetIsoline(surface=clear_list, isoDirection=code_block_2.out1, parameter=code_block_2.out2)
length_3 = Curve.Length(curve=getIsoline_2)
round_2 = Math.Round(number=length_3)
floor_2 = Math.Floor(number=round_2)
code_block_3 = CodeBlock(A=floor, B=floor_2) { A>B; }
code_block_4 = CodeBlock(A=floor, B=floor_2) { A + "x" + B; B + "x"+ A; }
if_ = If(test=code_block_3, true=code_block_4.out1, false=code_block_4.out0)
uniqueItems = List.UniqueItems(list=if_)
select_CategoryCreate_2 = ModelCategories("Structural Columns")  # graph input
o_elementtype_bycategory_2 = Orchid.RevitProject.Elements.ElementType.ByCategory(category=select_CategoryCreate_2)
name = Element.Name(element=o_elementtype_bycategory_2)
contains = List.Contains(list=uniqueItems, item=name, lacing=CrossProduct)
allFalse = List.AllFalse(list=contains@L2)
filterByBoolMask = List.FilterByBoolMask(list=uniqueItems, mask=allFalse)
code_block_5 = CodeBlock(a=filterByBoolMask.out) { a[0]; }
o_elementtype_byname = Orchid.RevitProject.Elements.ElementType.ByName(document=o_document_current, name=code_block_5)
duplicate = archilab.Revit.Elements.ElementTypes.Duplicate(element=o_elementtype_byname, name=filterByBoolMask.in)
passthrough = Custom[Passthrough](passThrough=o_elementtype_bycategory, waitFor=duplicate)  # package Clockwork for Dynamo 2.x; Forces a sequential order of execution. The node wired into the output of the Passthrough node will be executed *after* the node wired into the waitFor input (e.g. important for some Revit operations). The value of the passThrough input will be passed on to the node wired into the output port of the Passthrough node.
name_2 = Element.Name(element=passthrough)
RIE_IndexOf = Custom[RIE_IndexOf](list=name_2, Item=if_)  # package RIE; Returns a sublistlist with all indexes for each item.
getItemAtIndex = List.GetItemAtIndex(list=passthrough, index=RIE_IndexOf)
if_2 = If(test=isNull, true=getItemAtIndex, false=byName)
flatten_2 = List.Flatten(list=if_2)
code_block_6 = CodeBlock { 0.5; }
pointAtParameter = Surface.PointAtParameter(surface=clear_list, u=code_block_6, v=code_block_6)
levels = Levels("SF-LC2-03")  # graph input
byPointAndLevel = FamilyInstance.ByPointAndLevel(familyType=flatten_2, point=pointAtParameter, level=levels, lacing=Longest)
elementCreate = Watch(byPointAndLevel)  # graph output
