# Dynamo graph script.dyn (Dynamo 2.3.0.5885)
# packages: spring nodes 132.2.5, Rhythm 2020.7.25

boolean = BoolSelector(true)
selectFaces = Custom[Springs.SelectFaces+](refresh=boolean)  # package spring nodes; Select multiple faces from inside the Revit UI. Be sure to press "Finish" once done. Unlike the built-in node, face references of instances will be added sucessfully and you'l get the pick points. You can use a Boolean toggle to refresh your selection.
flatten = List.Flatten(list=selectFaces.faces)
area = Surface.Area(surface=flatten)
sum = Math.Sum(values=area)
convert_between_units = DynamoConvert(sum, MeasurementType="Area", FromConversion="SquareMillimeter", ToConversion="SquareMeter")
code_block = CodeBlock { 3; }
round = Math.Round(number=convert_between_units, digits=code_block)
code_block_2 = CodeBlock(a=round) { "Formwork-Area"; "Total FormWork by PickFace:  " + a + " m2"; }
ʳʰʸᵗʰᵐ_helpers_usermessage = Rhythm.Revit.Helpers.Helpers.UserMessage(caption=code_block_2.out0, message=code_block_2.out1, obj=round)
