# Dynamo graph script.dyn "CalculationFormwork-V2" (Dynamo 2.3.0.5885)
# packages: Rhythm 2020.7.25, spring nodes 132.2.5, Orchid 203.3.1.8192, Structural Design 2019.12.11, archi-lab.net 2021.25.15, RIE 2020.11.18, SteamNodes 1.2.4, bimorphNodes 3.0.3, Clockwork for Dynamo 2.x 2.3.0, OpenMEP 1.0.0

# group: Select element to check
code_block = CodeBlock()
# ---------- code_block.designscript (9 lines) ----------
["Floors",
"Stairs",
"Structural Columns",
"Structural Foundations",
"Structural Framing",
"Walls"];
1;
"Select model Element";
true;
# ----------------------------------------
byName = Category.ByName(name=code_block.out0)
pickObjectsOfCategory = StructuralDesign.Model.Selection.PickObjectsOfCategory(category=byName, objectType=code_block.out1, statusPrompt=code_block.out2)

code_block_2 = CodeBlock(A=pickObjectsOfCategory) { A; }
geometry = Element.Geometry(element=code_block_2)
flatten = List.Flatten(list=geometry)
boundingBox = Element.BoundingBox(element=pickObjectsOfCategory)
all_elements_in_active_view = ElementsInView()
code_block_3 = CodeBlock { 10; }
getElementsIntersect = Revit.BoundingBox.GetElementsIntersect(boundingBox=boundingBox, elements=all_elements_in_active_view, tolerance=code_block_3)
flatten_2 = List.Flatten(list=getElementsIntersect)
uniqueItems = List.UniqueItems(list=flatten_2)
geometry_2 = Element.Geometry(element=uniqueItems)
flatten_3 = List.Flatten(list=geometry_2)
byUnion = Custom[Solid.ByUnion+](solids=flatten_3)  # package Clockwork for Dynamo 2.x; The OOTB node Solid.ByUnion occasionally fails when trying to merge solids with almost adjacent faces. This node will return the minimum amount of joined solids possible in such cases instead of returning null.
explode = Geometry.Explode(geometry=byUnion@L1)
flatten_4 = List.Flatten(list=explode)
code_block_4 = CodeBlock { 0.5; }
normalAtParameter = Surface.NormalAtParameter(surface=flatten_4, u=code_block_4, v=code_block_4)

# group: Define Face by direction with Vector Z
list_create = List.Create()  # unwired: item0, item1
ZAxis = Vector.ZAxis()
angleWithVector = Vector.AngleWithVector(vector=normalAtParameter, otherVector=ZAxis)
round = Math.Round(number=angleWithVector)
code_block_5 = CodeBlock(ALPHA=round) { ALPHA<=45; ALPHA>=135; }
combine = List.Combine(comb=list_create, list1=code_block_5.out0, list2=code_block_5.out1)
transpose = List.Transpose(lists=combine@L3)
o_list_anytrue = Orchid.Common.List.AnyTrue(list=transpose)
filterByBoolMask = List.FilterByBoolMask(list=flatten_4, mask=o_list_anytrue)
code_block_6 = CodeBlock(SurfaceSIDE=filterByBoolMask.out) { SurfaceSIDE; }
code_block_7 = CodeBlock(SurfaceTOPBOTTOM=filterByBoolMask.in) { SurfaceTOPBOTTOM; }

intersect = Geometry.Intersect(geometry=flatten, other=code_block_6, lacing=CrossProduct)
flatten_5 = List.Flatten(list=intersect@L3)
string_from_object = FromObject(obj=flatten_5)
code_block_8 = CodeBlock { "Surface"; }
eq = string_from_object == code_block_8
filterByBoolMask_2 = List.FilterByBoolMask(list=flatten_5@L2, mask=eq@L2)
code_block_9 = CodeBlock(Side_SurfaceINelement=filterByBoolMask_2.in) { Side_SurfaceINelement; }
code_block_10 = CodeBlock(Side_SurfaceINelement=code_block_9) { Side_SurfaceINelement; }
code_block_11 = CodeBlock(A=pickObjectsOfCategory) { A; }
geometry_3 = Element.Geometry(element=code_block_11)
intersect_2 = Geometry.Intersect(geometry=geometry_3@L1, other=code_block_7, lacing=CrossProduct)
flatten_6 = List.Flatten(list=intersect_2@L3)
string_from_object_2 = FromObject(obj=flatten_6)
code_block_12 = CodeBlock { "Surface"; }
eq_2 = string_from_object_2 == code_block_12
filterByBoolMask_3 = List.FilterByBoolMask(list=flatten_6@L2, mask=eq_2@L2)
code_block_13 = CodeBlock(Side_SurfaceINelement=filterByBoolMask_3.in) { Side_SurfaceINelement; }
code_block_14 = CodeBlock { 0.5; }
normalAtParameter_2 = Surface.NormalAtParameter(surface=code_block_13, u=code_block_14, v=code_block_14)
Z = Vector.Z(vector=normalAtParameter_2)
code_block_15 = CodeBlock(a=Z) { a<0; }
filterByBoolMask_4 = List.FilterByBoolMask(list=code_block_13, mask=code_block_15)
code_block_16 = CodeBlock(Bottom_SurfaceINelement=filterByBoolMask_4.in) { Bottom_SurfaceINelement; }

# group: Set area for formwork
code_block_17 = CodeBlock(Elementcheckformwork=pickObjectsOfCategory) { Elementcheckformwork; }  # frozen
code_block_18 = CodeBlock { "AreaFormwork_Side"; }
area = Surface.Area(surface=code_block_10)
sum = Math.Sum(values=area)
convert_between_units = DynamoConvert(sum, MeasurementType="Area", FromConversion="SquareMillimeter", ToConversion="SquareMeter")
code_block_19 = CodeBlock { 3; }
round_2 = Math.Round(number=convert_between_units, digits=code_block_19)
ʳʰʸᵗʰᵐ_elements = Rhythm.Revit.Elements.Elements.SetParameterByNameTypeOrInstance(element=code_block_17, parameterName=code_block_18, value=round_2)
code_block_20 = CodeBlock { "AreaFormwork_Bottom"; }
area_2 = Surface.Area(surface=code_block_16)
sum_2 = Math.Sum(values=area_2)
convert_between_units_2 = DynamoConvert(sum_2, MeasurementType="Area", FromConversion="SquareMillimeter", ToConversion="SquareMeter")
code_block_21 = CodeBlock { 2; }
round_3 = Math.Round(number=convert_between_units_2, digits=code_block_21)
ʳʰʸᵗʰᵐ_elements_2 = Rhythm.Revit.Elements.Elements.SetParameterByNameTypeOrInstance(element=code_block_17, parameterName=code_block_20, value=round_3)

list_create_2 = List.Create()  # unwired: item0, item1

# group: Create moder by directshape
code_block_22 = CodeBlock { "Create GeometryFormWork"; "Create FormWork ?"; true; }
ʳʰʸᵗʰᵐ_helpers_usermessage = Rhythm.Revit.Helpers.Helpers.UserMessage(caption=code_block_22.out0, message=code_block_22.out1, obj=code_block_22.out2)
combine_2 = List.Combine(comb=list_create_2, list1=code_block_10, list2=code_block_16)
flatten_7 = List.Flatten(list=combine_2@L3)
byUnion_2 = Surface.ByUnion(surfaces=flatten_7)
code_block_23 = CodeBlock { null; }
RIE_If = Custom[RIE_If](Test=ʳʰʸᵗʰᵐ_helpers_usermessage, True=byUnion_2, False=code_block_23, lacing=Longest)  # package RIE; An If node that keeps list structure, empty lists and so forth.
flatten_8 = List.Flatten(list=RIE_If)
categories = Categories("OST_GenericModel")
id = Element.Id(element=pickObjectsOfCategory)
code_block_24 = CodeBlock(id=id) { "Model Formwork For ElementId "+ id; }
byGeometry = Custom[Springs.DirectShape.ByGeometry](geometry=flatten_8@L2, category=categories, name=code_block_24)  # package spring nodes; Convert the input geometry to DirectShape element inside the Revit document. It supports solids or surfaces. It is based on an alternative process that uses a SAT import and can produce smooth surfaces. Each created DS will have a unique type. Make sure that each input geometry has a unique name. You can either feed a single category for all geometries or a unique category for each geometry - the node's lacing is set to longest by default. The default category is Generic Models.

flatten_9 = List.Flatten(list=geometry_3)
string_from_object_3 = FromObject(obj=flatten_9)
isNullOrEmpty = OpenMEPSandbox.Core.String.IsNullOrEmpty(value=string_from_object_3)
o_list_anytrue_2 = Orchid.Common.List.AnyTrue(list=isNullOrEmpty)
code_block_25 = CodeBlock { "Element can't create Geometry please check"; "isolate element"; true; }
runMe = Custom[Tool.RunMe](Boolean=o_list_anytrue_2, ThingToDo=code_block_25.out0)  # package SteamNodes; Use Boolean to perform an action
code_block_26 = CodeBlock { true; }
indexOf = List.IndexOf(list=isNullOrEmpty, element=code_block_26)
getItemAtIndex = List.GetItemAtIndex(list=code_block_11, index=indexOf)
ʳʰʸᵗʰᵐ_helpers_usermessage_2 = Rhythm.Revit.Helpers.Helpers.UserMessage(caption=runMe, message=code_block_25.out1, obj=getItemAtIndex)
RIE_ActiveView = Custom[RIE_ActiveView](Refresh=code_block_25.out2)  # package RIE; Returns active view in current document.
isolate_in_view = Custom[Isolate in View](element=ʳʰʸᵗʰᵐ_helpers_usermessage_2, view=RIE_ActiveView)  # package archi-lab.net; This node will take input of elements and a view to isolate selected elements in a view.
