# Dynamo graph script.dyn (Dynamo 2.3.0.5885)
# packages: Structural Design 2019.12.11, spring nodes 132.2.5

boolean = BoolSelector(true)
pickElementsByRectangle = StructuralDesign.Model.Selection.PickElementsByRectangle(refresh=boolean)
rebarHostElement = StructuralDesign.Rebar.Properties.RebarHostElement(rebar=pickElementsByRectangle)
selectInRevit = Custom[Springs.SelectInRevit](element=rebarHostElement)  # package spring nodes; Selects the input elements inside the Revit UI.
