# Dynamo graph script.dyn (Dynamo 2.3.0.5885)
# packages: spring nodes 132.2.5, Structural Design 2019.12.11, Clockwork for Dynamo 2.x 2.3.0

boolean = BoolSelector(true)
pickElementsByRectangle = StructuralDesign.Model.Selection.PickElementsByRectangle(refresh=boolean)
category = Custom[Element.Category+](element=pickElementsByRectangle)  # package Clockwork for Dynamo 2.x; Returns the category of a given element. Unlike the OOTB node Element.GetCategory, it will work for subcategories, families, family documents, schedules, subcategories and graphics styles as well.
string_from_object = FromObject(obj=category.category)
code_block = CodeBlock(A=string_from_object) { A=="Structural Rebar"; }
filterByBoolMask = List.FilterByBoolMask(list=pickElementsByRectangle, mask=code_block)
selectInRevit = Custom[Springs.SelectInRevit](element=filterByBoolMask.in, reset=boolean)  # package spring nodes; Selects the input elements inside the Revit UI.
