# Dynamo graph script.dyn (Dynamo 2.3.0.5885)
# packages: Data-Shapes 2022.2.96, Structural Design 2019.12.11, BIM4Struc.Rebar 1.3.0, Rhythm 2020.7.25, Clockwork for Dynamo 2.x 2.3.0

code_block = CodeBlock { "Select Rebar"; "Select"; "Structural Rebar"; 1; }
byName = Category.ByName(name=code_block.out2)
boolean = BoolSelector(true)
pickObjectsOfCategory = StructuralDesign.Model.Selection.PickObjectsOfCategory(category=byName, objectType=code_block.out3, statusPrompt=code_block.out0, refresh=boolean)
code_block_2 = CodeBlock(a=pickObjectsOfCategory) { a; }
code_block_3 = CodeBlock { "Select Parameter To Copy"; "Chooes"; true; "Cancle"; 500; 500; 150; }
code_block_4 = CodeBlock { "Parameter To Copy"; "Chooes"; true; false; 200; }
all_elements_of_category = ElementsOfCategory(Category=byName)
code_block_5 = CodeBlock(a=all_elements_of_category) { a[0]; }
parameters = Element.Parameters(element=code_block_5)
name = Parameter.Name(parameter=parameters)
listview_data = Custom[Listview Data](InputName=code_block_4.out0, Keys=name, Values=name, Height_optionnal=code_block_4.out4, ShowId_optionnal=code_block_4.out3)  # package Data-Shapes; Create data for ListView input in UI.MultiInputForm ++ . Check out www.data-shapes.net for more infos.
multipleinputform = Custom[MultipleInputForm ++](Description_optional=code_block_3.out0, ButtonText_optional=code_block_3.out1, Inputs=listview_data, Toggle=code_block_3.out2, CancelButtonText_optional=code_block_3.out3, MaxHeight_optional=code_block_3.out4, Width_optional=code_block_3.out5, LabelWidth_optional=code_block_3.out6)  # package Data-Shapes; Create a form with multiple inputs. see www.data-shapes.net for tutorials and infos!
code_block_6 = CodeBlock(ParametersCopy=multipleinputform.User_Inputs) { ParametersCopy[0]; }
code_block_7 = CodeBlock(a=code_block_6) { a+"-->Paste to"; }
count = List.Count(list=code_block_6)
cycle = List.Cycle(list=name@@L3, amount=count)
flatten = List.Flatten(list=cycle@L2)
boolean_2 = BoolSelector(true)
python_script = Python(IN[0]=code_block_7, IN[1]=flatten, IN[2]=boolean_2)
# ---------- python_script.python (214 lines) ----------
#Copyright (c) mostafa el ayoubi ,  2016
#Data-Shapes http://www.data-shapes.net , elayoubi.mostafa@gmail.com

import clr
clr.AddReference('System.Windows.Forms')
clr.AddReference('System.Drawing')

from System.Drawing import Point
from System.Windows.Forms import Application, Button, Form, Label, TextBox, CheckBox, FolderBrowserDialog, OpenFileDialog, DialogResult, ComboBox, FormBorderStyle
from System.Collections.Generic import *

clr.AddReference('RevitAPIUI')
from  Autodesk.Revit.UI import Selection

clr.AddReference('RevitNodes')
import Revit
clr.ImportExtensions(Revit.Elements)
clr.ImportExtensions(Revit.GeometryConversion)

clr.AddReference('RevitServices')
from RevitServices.Persistence import DocumentManager
doc = DocumentManager.Instance.CurrentDBDocument
uidoc = DocumentManager.Instance.CurrentUIApplication.ActiveUIDocument

class MultiTextBoxForm(Form):
	

    def __init__(self):
        self.Text = 'Data-Shapes | Multi Input UI'
        self.output = []
        self.values = []

    def setclose(self, sender, event):
    	cbindexread = 0
    	for f in self.output:
    		if f.GetType() == TextBox:
    			self.values.append(f.Text)
    		if f.GetType() == CheckBox:
    			self.values.append(f.Checked)
    		if f.GetType() == Button:
    			if f.Tag == None :
    				self.values.append(f.Text)
    			else:
    				self.values.append(f.Tag)
    		if f.GetType() == ComboBox:
    			self.values.append(globals() ['dict%d'%(cbindexread)][f.Text])
    			cbindexread += 1
    	self.Close()

    def reset(self, sender, event):
		pass

    def openfile(self, sender, event):
		ofd = OpenFileDialog()
		dr = ofd.ShowDialog()
		if dr == DialogResult.OK:
			sender.Text = ofd.FileName

    def opendirectory(self, sender, event):
		fbd = FolderBrowserDialog()
		dr = fbd.ShowDialog()
		if dr == DialogResult.OK:
			sender.Text = fbd.SelectedPath

    def pickobjects(self, sender, event):
		sel = uidoc.Selection.PickObjects(Selection.ObjectType.Element,'')
		selelem = [doc.GetElement(s.ElementId) for s in sel]
		sender.Tag = (selelem)

    def pickfaces(self, sender, event):
		selface = uidoc.Selection.PickObjects(Selection.ObjectType.Face,'')
		faces = [uidoc.Document.GetElement(s).GetGeometryObjectFromReference(s).ToProtoType(True) for s in selface]
		sender.Tag = [i for f in faces for i in f]

    def pickedges(self, sender, event):
		seledge = uidoc.Selection.PickObjects(Selection.ObjectType.Edge,'')
		edges = [uidoc.Document.GetElement(s).GetGeometryObjectFromReference(s).AsCurve().ToProtoType(True) for s in seledge]
		sender.Tag = edges

    def topmost(self):
		self.TopMost = True
	


form = MultiTextBoxForm()
form.topmost()

xlabel = 30
xinput = 200
y = 10
fields = []
error = 0
cbindex = 0
#Input form

if isinstance(IN[0],list):
	inputnames = IN[0]
else:
	inputnames = [IN[0]]

if isinstance(IN[1],list):
	inputtypes = IN[1]
else:
	inputtypes = [IN[1]]

for i,j in zip(inputnames,inputtypes):
	label = Label()
	label.Location = Point(xlabel,y+4)
	label.Height = 20
	label.Width = 150
	label.Text = str(i)
	form.Controls.Add(label)
	if isinstance(j,list):
		cb = ComboBox()
		cb.Location = Point(xinput,y)
		cb.Width = 250
		globals()['dict%d'%(cbindex)] = {}
		try :
			for k in j:
				globals()['dict%d'%(cbindex)][k.Name] = k
				cb.Items.Add(k.Name)
		except :
			for k in j:
				try:
					globals()['dict%d'%(cbindex)][str(k)] = k
				except:
					globals()['dict%d'%(cbindex)][k.encode('utf-8').decode('utf-8')] = k
				cb.Items.Add(k)
		form.Controls.Add(cb)
		form.output.append(cb)
		cbindex += 1
	elif j == 's':
		tb = TextBox()
		tb.Text = 'Default'
		tb.Width = 300
		tb.Location = Point(xinput,y)
		form.Controls.Add(tb)
		form.Controls.Add(label)
		form.output.append(tb)
	elif j == 'bool':
		yn = CheckBox()
		yn.Location = Point(xinput,y)
		yn.Text = 'Yes/No'
		form.Controls.Add(yn)
		form.output.append(yn)
	elif j == 'fp':
		fp = Button()
		fp.Width = 300
		fp.Text = 'FilePath'
		fp.Location = Point(xinput,y)
		form.Controls.Add(fp)
		fp.Click += form.openfile
		form.output.append(fp)
	elif j == 'dp':
		dp = Button()
		dp.Width = 300
		dp.Text = 'DirectoryPath'
		dp.Location = Point(xinput,y)
		form.Controls.Add(dp)
		dp.Click += form.opendirectory
		form.output.append(dp)
	elif j == 'se':
		se = Button()
		se.Width = 300
		se.Text = 'Select model element(s)'
		se.Location = Point(xinput,y)
		form.Controls.Add(se)
		se.Click += form.pickobjects
		form.output.append(se)
	elif j == 'sf':
		sf = Button()
		sf.Width = 300
		sf.Text = 'Select face(s)'
		sf.Location = Point(xinput,y)
		form.Controls.Add(sf)
		sf.Click += form.pickfaces
		form.output.append(sf)
	elif j == 'sed':
		sed = Button()
		sed.Width = 300
		sed.Text = 'Select Edge(s)'
		sed.Location = Point(xinput,y)
		form.Controls.Add(sed)
		sed.Click += form.pickedges
		form.output.append(sed)

	else :
		error = 'One or more input types are invalid, visit http://www.data-shapes.net for more informations'
	y+= 30


button = Button()
button.Text = 'Set values'
button.Width = 200
button.Location = Point (100,y+30)
button.Click += form.setclose
form.Controls.Add(button)

form.MaximizeBox = False
form.MinimizeBox = False
form.FormBorderStyle = FormBorderStyle.FixedSingle


form.Height = y + 120
form.Width = 500

if error == 0 and IN[2] == True:
	Application.Run(form)
	result = form.values
	OUT = result,True

elif IN[2] == False:
	result = "Set toggle to true!"
	OUT = result,False
# ----------------------------------------
code_block_8 = CodeBlock(ParameterPaste=python_script) { ParameterPaste[0]; }
getHost = Custom[Rebar.GetHost](Rebars=pickObjectsOfCategory)  # package BIM4Struc.Rebar; Get the family instance and ID from the host of the selected rebar.
code_block_9 = CodeBlock(a=getHost.Elements) { a; }
ʳʰʸᵗʰᵐ_elements = Rhythm.Revit.Elements.Elements.GetParameterValueByNameTypeOrInstance(element=code_block_9, parameterName=code_block_6@L2, lacing=Longest)
ʳʰʸᵗʰᵐ_elements_2 = Rhythm.Revit.Elements.Elements.SetParameterValueByNameCaSeiNSeNSiTiVe(element=code_block_2, parameterName=code_block_8@L2, value=ʳʰʸᵗʰᵐ_elements@L2, lacing=Longest)
count_2 = List.Count(list=getHost.NonHostedRebar)
code_block_10 = CodeBlock(COUNT=count_2) { "HAVE  " +COUNT+ "  Rebar have no host"; "Success"; "CHECK REBAR HOST"; }
isNotEmpty = Custom[List.IsNotEmpty](seq=getHost.NonHostedRebar)  # package Clockwork for Dynamo 2.x; Just the inversion of the built-in Is Empty List node.
if_ = If(test=isNotEmpty, true=code_block_10.out0, false=code_block_10.out1)
ʳʰʸᵗʰᵐ_helpers_usermessage = Rhythm.Revit.Helpers.Helpers.UserMessage(caption=code_block_10.out2, message=if_, obj=getHost.NonHostedRebar)
code_block_11 = CodeBlock { "Comments"; "Check Host"; }
ʳʰʸᵗʰᵐ_elements_3 = Rhythm.Revit.Elements.Elements.SetParameterValueByNameCaSeiNSeNSiTiVe(element=ʳʰʸᵗʰᵐ_helpers_usermessage, parameterName=code_block_11.out0@L2, value=code_block_11.out1@L2, lacing=Longest)
