# Dynamo graph script.dyn (Dynamo 2.3.0.5885)
# packages: BIM4Struc.Rebar 1.3.0, Data-Shapes 2022.2.96

categories = Categories("OST_Rebar")
boolean = BoolSelector(true)
select_model_elements_of = Custom[Select Model Elements of Category](Categories=categories, Toggle=boolean)  # package Data-Shapes; Allows to perform a manual selection with a category filter.
code_block = CodeBlock { "Sub_Zone"; }
getHost = Custom[Rebar.GetHost](Rebars=select_model_elements_of)  # package BIM4Struc.Rebar; Get the family instance and ID from the host of the selected rebar.
getParameterValueByName = Element.GetParameterValueByName(element=getHost.Elements, parameterName=code_block)
setParameterByName = Element.SetParameterByName(element=select_model_elements_of, parameterName=code_block, value=getParameterValueByName)
code_block_2 = CodeBlock { "STG-Mark"; }
code_block_3 = CodeBlock { "Zone"; }
code_block_4 = CodeBlock { "Zone"; }
getParameterValueByName_2 = Element.GetParameterValueByName(element=getHost.Elements, parameterName=code_block_4)
setParameterByName_2 = Element.SetParameterByName(element=select_model_elements_of, parameterName=code_block_3, value=getParameterValueByName_2)
code_block_5 = CodeBlock { "STG_Mark"; }
getParameterValueByName_3 = Element.GetParameterValueByName(element=getHost.Elements, parameterName=code_block_5)
setParameterByName_3 = Element.SetParameterByName(element=select_model_elements_of, parameterName=code_block_5, value=getParameterValueByName_3)
