# Dynamo graph script.dyn (Dynamo 2.19.3.6394)
# packages: spring nodes 204.1.0, Chynamo 0.8.5, Data-Shapes 2022.2.96

# group: UI
code_block = CodeBlock { "Create Voil Solid"; "Create"; true; "Cancel"; 500; 400; 200; }
code_block_2 = CodeBlock()
# ---------- code_block_2.designscript (8 lines) ----------
"Select Element Link? _OR_";
"Select";
"Category ?";
"Structural";
"Solid Family File Path";

"Family Name will Create";
"";
# ----------------------------------------
selectlinkedelement_s_data = Custom[SelectLinkedElement(s) Data](InputName=code_block_2.out0, ButtonText=code_block_2.out1)  # package Data-Shapes; Create a button input for UI.MultipleInputForm++ that allows to select elements in à linked document. See www.data-shapes.net for more infos!
file_path = Filename("G:\BINHNGO\Dynamo\0.1 Family revit\Metric Generic Model.rft")
filepath_data = Custom[FilePath Data](InputName=code_block_2.out4, DefaulPath=file_path)  # package Data-Shapes; Create filepath input for UI.MultipleInputForm ++ . Check out www.data-shapes.net for more infos !

textbox_data = Custom[TextBox Data](InputName=code_block_2.out5, DefaultText=code_block_2.out6)  # package Data-Shapes; Create Data for TextBox input in UI.MultipleInputForm ++ . Check out www.data-shapes.net for more informations

# group (continued): UI
list_create = List.Create(item0=selectlinkedelement_s_data, item1=filepath_data, item2=textbox_data)
multipleinputform = Custom[MultipleInputForm ++](Description_optional=code_block.out0, ButtonText_optional=code_block.out1, Inputs=list_create, Toggle=code_block.out2, CancelButtonText_optional=code_block.out3, MaxHeight_optional=code_block.out4, Width_optional=code_block.out5, LabelWidth_optional=code_block.out6)  # package Data-Shapes; Create a form with multiple inputs. see www.data-shapes.net for tutorials and infos!
code_block_3 = CodeBlock(Element=multipleinputform.User_Inputs, FamilyPath=multipleinputform.User_Inputs, FamilyNameCreate=multipleinputform.User_Inputs) { Element[0]; FamilyPath[1]; FamilyNameCreate[2]; }

# group: To Revit
solids = Element.Solids(element=code_block_3.out0)

# group: CreateModel
ꟿ_familyinstance_bygeometry = Custom[ꟿ FamilyInstance.ByGeometry]()  # package spring nodes; You must provide a valid family template path that will be used for all input geometry objects. The project units(and not the templates) will be used to determine the size of the output geometry. The provided category will be used only if the family template supports it. If not, the default template category will be used instead. Likewise, the family material(provided as a string) will be set only if a material with that name exists in the template. If not, the default material will be used instead ("By Category"). For void cuts, the material settings will be ignored. The Subcategory name is an optional input. If you'd like to skip assigning a Subcategory to any new instance, simply use null. The node expects a unique family name for each geometry object. The rest of the input lists will be processed as if the node lacing is set to longest.; unwired: geometry, familyTemplatePath, familyName
flatten = List.Flatten(list=solids)
removenull_lunchbox = Custom[RemoveNull-Lunchbox](list=flatten)  # package Chynamo; Remove null from input list, imported from Lunchbox
byUnion = Solid.ByUnion(solids=removenull_lunchbox)
categories = Categories("OST_GenericModel")
string = StringInput("Hidden Lines")

python_script = Python(IN[0]=byUnion)  # CPython3; unwired: IN[1]
# ---------- python_script.python (103 lines) ----------
# ==============================
# Dynamo Python – SolidUtils
# ==============================

import clr

# Revit Services
clr.AddReference("RevitServices")
from RevitServices.Persistence import DocumentManager

# Revit API
clr.AddReference("RevitAPI")
from Autodesk.Revit.DB import (
    Solid,
    GeometryInstance,
    Options,
    Transform,
    SolidUtils
)

doc = DocumentManager.Instance.CurrentDBDocument

# ==============================
# INPUT
# ==============================
# IN[0] : Element | Solid | List[Element/Solid]
# IN[1] : Transform (optional) – nếu None → Identity

input_data = IN[0]
input_transform = IN[1] if len(IN) > 1 else None

# ==============================
# UTILS
# ==============================

def ensure_list(obj):
    if isinstance(obj, list):
        return obj
    return [obj]

def get_solids_from_geom(geom):
    """Extract valid solids from GeometryElement"""
    solids = []
    for g in geom:
        if isinstance(g, Solid) and g.Volume > 0:
            solids.append(g)

        elif isinstance(g, GeometryInstance):
            inst_geom = g.GetInstanceGeometry()
            for ig in inst_geom:
                if isinstance(ig, Solid) and ig.Volume > 0:
                    solids.append(ig)
    return solids

def get_solids(obj):
    """Accept Solid or Element"""
    solids = []

    if isinstance(obj, Solid):
        if obj.Volume > 0:
            solids.append(obj)

    else:
        try:
            opt = Options()
            geom = obj.get_Geometry(opt)
            if geom:
                solids.extend(get_solids_from_geom(geom))
        except:
            pass

    return solids

# ==============================
# MAIN
# ==============================

inputs = ensure_list(input_data)

# Transform
if input_transform and isinstance(input_transform, Transform):
    tf = input_transform
else:
    tf = Transform.Identity

result_solids = []

for item in inputs:
    solids = get_solids(item)

    for s in solids:
        try:
            new_solid = SolidUtils.CreateTransformed(s, tf)
            if new_solid and new_solid.Volume > 0:
                result_solids.append(new_solid)
        except:
            pass

# ==============================
# OUTPUT
# ==============================

OUT = result_solids
# ----------------------------------------
python_script_2 = Python(IN[0]=byUnion, IN[1]=code_block_3.out1, IN[2]=code_block_3.out2, IN[3]=categories, IN[6]=string)  # CPython3; frozen; unwired: IN[4], IN[5]
# ---------- python_script_2.python (299 lines) ----------
# ============================================================
# Create FreeForm Family from Dynamo Geometry
# Revit 2024 | Dynamo | IronPython 2.7
# FULL FIX: single solid + ExportToSAT
# ============================================================

import clr
import System
import sys
import traceback
from itertools import repeat

# ------------------ IronPython Lib ------------------
pf_path = System.Environment.GetFolderPath(
    System.Environment.SpecialFolder.ProgramFilesX86
)
sys.path.append('%s\\IronPython 2.7\\Lib' % pf_path)

# ------------------ Dynamo Geometry ------------------
clr.AddReference('ProtoGeometry')
from Autodesk.DesignScript.Geometry import *
from Autodesk.DesignScript.Geometry import Point as DynPoint

# ------------------ Revit Services ------------------
clr.AddReference('RevitServices')
from RevitServices.Persistence import DocumentManager
from RevitServices.Transactions import TransactionManager

doc = DocumentManager.Instance.CurrentDBDocument
uiapp = DocumentManager.Instance.CurrentUIApplication
app = uiapp.Application

# ------------------ Revit API ------------------
clr.AddReference('RevitAPI')
from Autodesk.Revit.DB import *
from Autodesk.Revit.DB.Structure import StructuralType

# ------------------ Revit Nodes ------------------
clr.AddReference('RevitNodes')
import Revit
clr.ImportExtensions(Revit.Elements)
clr.ImportExtensions(Revit.GeometryConversion)

# ===================================================
# UTILS (FIX SINGLE SOLID)
# ===================================================

def tolist(x):
    if isinstance(x, list):
        return x
    return [x]

def PadLists(lists):
    base = len(lists[0])
    for i in xrange(1, len(lists)):
        if len(lists[i]) < base:
            lists[i].extend(
                repeat(lists[i][-1], base - len(lists[i]))
            )
        elif len(lists[i]) > base:
            lists[i] = lists[i][:base]
    return lists

# ===================================================
# FAMILY LOAD OPTIONS (FIXED)
# ===================================================

class FamLoadOpt(IFamilyLoadOptions):
    def OnFamilyFound(self, familyInUse, overwriteParameterValues):
        overwriteParameterValues.Value = True
        return True

    def OnSharedFamilyFound(self, familyInUse, source, overwriteParameterValues):
        overwriteParameterValues.Value = True
        return True

# ===================================================
# INPUTS
# ===================================================

geom     = tolist(IN[0])
fam_path = IN[1]
names    = tolist(IN[2])
category = tolist(IN[3])
material = tolist(IN[4])
isVoid   = tolist(IN[5])
subcat   = tolist(IN[6])

origin = XYZ.Zero
str_typ = StructuralType.NonStructural
temp_path = System.IO.Path.GetTempPath()
invalid_chars = System.IO.Path.GetInvalidFileNameChars()

acceptable_views = (
    'ThreeD', 'FloorPlan', 'EngineeringPlan',
    'CeilingPlan', 'Elevation', 'Section'
)

# ------------------ Units (Revit 2024) ------------------
if int(doc.Application.VersionNumber) > 2021:
    units = doc.GetUnits().GetFormatOptions(
        ForgeTypeId("autodesk.spec.aec:length")
    ).GetUnitTypeId()
else:
    units = doc.GetUnits().GetFormatOptions(
        UnitType.UT_Length
    ).DisplayUnits

factor = UnitUtils.ConvertToInternalUnits(1, units)

# ------------------ Import Options ------------------
satOpt = SATImportOptions()
satOpt.Placement = ImportPlacement.Origin
satOpt.Unit = ImportUnit.Foot

SaveAsOpt = SaveAsOptions()
SaveAsOpt.OverwriteExistingFile = True

# ===================================================
# GEOMETRY HELPER
# ===================================================

def get_valid_solid(import_instance):
    opt = Options()
    opt.ComputeReferences = True

    geo = import_instance.get_Geometry(opt)
    for g in geo:
        if isinstance(g, GeometryInstance):
            for obj in g.GetInstanceGeometry():
                if isinstance(obj, Solid) and obj.Volume > 1e-6:
                    return obj
    return None

# ===================================================
# MAIN FUNCTION
# ===================================================

def CreateFamilyFromGeometry(
        s1, name1, cat1, isVoid1, mat1, subcat1):

    try:
        # ---------- Validate ----------
        if any(c in name1 for c in invalid_chars):
            raise Exception("Invalid family name: " + name1)

        enable_mat = mat1 not in [None, ""]
        enable_sub = subcat1 not in [None, ""]

        TransactionManager.ForceCloseTransaction(
            TransactionManager.Instance
        )

        # ---------- New Family ----------
        famdoc = app.NewFamilyDocument(fam_path)

        # ---------- Scale ----------
        if factor != 1:
            s1 = s1.Scale(factor)

        vec = Vector.ByTwoPoints(
            BoundingBox.ByGeometry(s1).MinPoint,
            DynPoint.Origin()
        )
        s1 = s1.Translate(vec)

        # ---------- Export SAT (FIX) ----------
        sat_path = System.IO.Path.Combine(
            temp_path, name1 + ".sat"
        )
        Geometry.ExportToSAT([s1], sat_path)

        # ---------- Find View ----------
        view1 = None
        for v in FilteredElementCollector(famdoc).OfClass(View):
            if not v.IsTemplate and str(v.ViewType) in acceptable_views:
                view1 = v
                break

        # ---------- Import SAT ----------
        t = Transaction(famdoc, "Import SAT")
        t.Start()
        satId = famdoc.Import(sat_path, satOpt, view1)
        t.Commit()

        import_inst = famdoc.GetElement(satId)
        solid = get_valid_solid(import_inst)

        if not solid:
            raise Exception("No valid solid from SAT")

        # ---------- Cleanup ----------
        t = Transaction(famdoc, "Cleanup")
        t.Start()
        famdoc.Delete(satId)
        t.Commit()
        System.IO.File.Delete(sat_path)

        # ---------- Category ----------
        try:
            famdoc.OwnerFamily.FamilyCategory = \
                famdoc.Settings.Categories.get_Item(cat1.Name)
        except:
            pass

        # ---------- Create FreeForm ----------
        t = Transaction(famdoc, "Create FreeForm")
        t.Start()
        ff = FreeFormElement.Create(famdoc, solid)

        if isVoid1:
            ff.get_Parameter(
                BuiltInParameter.ELEMENT_IS_CUTTING
            ).Set(1)
            famdoc.OwnerFamily.get_Parameter(
                BuiltInParameter.FAMILY_ALLOW_CUT_WITH_VOIDS
            ).Set(1)
        else:
            if enable_mat:
                fam_mat = None
                for m in FilteredElementCollector(famdoc).OfClass(Material):
                    if m.Name == mat1:
                        fam_mat = m
                        break
                if fam_mat:
                    ff.get_Parameter(
                        BuiltInParameter.MATERIAL_ID_PARAM
                    ).Set(fam_mat.Id)

            if enable_sub:
                fam_cat = famdoc.OwnerFamily.FamilyCategory
                subs = fam_cat.SubCategories
                if subs.Contains(subcat1):
                    sc = subs[subcat1]
                else:
                    sc = famdoc.Settings.Categories.NewSubcategory(
                        fam_cat, subcat1
                    )
                ff.Subcategory = sc

        t.Commit()

        # ---------- Save & Load ----------
        save_path = System.IO.Path.Combine(
            temp_path, name1 + ".rfa"
        )
        famdoc.SaveAs(save_path, SaveAsOpt)
        family = famdoc.LoadFamily(doc, FamLoadOpt())
        famdoc.Close(False)
        System.IO.File.Delete(save_path)

        # ---------- Place Instance ----------
        symbol_id = list(family.GetFamilySymbolIds())[0]
        symbol = doc.GetElement(symbol_id)

        t = Transaction(doc, "Place Family")
        t.Start()
        if not symbol.IsActive:
            symbol.Activate()

        inst = doc.Create.NewFamilyInstance(
            origin, symbol, str_typ
        )
        ElementTransformUtils.MoveElement(
            doc, inst.Id, vec.Reverse().ToXyz()
        )
        t.Commit()

        return inst.ToDSType(False), family.ToDSType(False)

    except:
        return traceback.format_exc(), ""

# ===================================================
# EXECUTION (SAFE FOR SINGLE SOLID)
# ===================================================

if len(geom) == len(names) == len(category) == \
   len(isVoid) == len(material) == len(subcat):

    results = map(
        CreateFamilyFromGeometry,
        geom, names, category, isVoid, material, subcat
    )

elif len(geom) == len(names):
    padded = PadLists([geom, category, isVoid, material, subcat])
    results = map(
        CreateFamilyFromGeometry,
        geom, names,
        padded[1], padded[2], padded[3], padded[4]
    )
else:
    results = [("Geometry & Name mismatch", "")]

OUT = (
    [r[0] for r in results],
    [r[1] for r in results]
)
# ----------------------------------------
python_script_3 = Python(IN[0]=byUnion, IN[1]=code_block_3.out1, IN[2]=code_block_3.out2, IN[3]=categories, IN[6]=string)  # IronPython2; frozen; unwired: IN[4], IN[5]
# ---------- python_script_3.python (303 lines) ----------
# ============================================================
# Create FreeForm Family from Dynamo Geometry
# Revit 2024 + Dynamo + IronPython 2.7 (SAFE VERSION)
# Refactor & Fix by ChatGPT
# ============================================================

import clr
import System
from System.Collections.Generic import *
from itertools import repeat
import sys
import traceback

# ------------------ IronPython Lib ------------------
pf_path = System.Environment.GetFolderPath(
    System.Environment.SpecialFolder.ProgramFilesX86
)
sys.path.append('%s\\IronPython 2.7\\Lib' % pf_path)

# ------------------ Dynamo Geometry ------------------
clr.AddReference('ProtoGeometry')
from Autodesk.DesignScript.Geometry import *
from Autodesk.DesignScript.Geometry import Point as DynPoint

# ------------------ Revit Services ------------------
clr.AddReference('RevitServices')
from RevitServices.Persistence import DocumentManager
from RevitServices.Transactions import TransactionManager

doc = DocumentManager.Instance.CurrentDBDocument
uiapp = DocumentManager.Instance.CurrentUIApplication
app = uiapp.Application

# ------------------ Revit API ------------------
clr.AddReference('RevitAPI')
from Autodesk.Revit.DB import *
from Autodesk.Revit.DB.Structure import StructuralType

# ------------------ Revit Nodes ------------------
clr.AddReference('RevitNodes')
import Revit
clr.ImportExtensions(Revit.Elements)
clr.ImportExtensions(Revit.GeometryConversion)

# ===================================================
# UTILS
# ===================================================

def tolist(x):
    if isinstance(x, list):
        return x
    else:
        return [x]


def PadLists(lists):
    base_len = len(lists[0])
    for i in xrange(1, len(lists)):
        if len(lists[i]) < base_len:
            lists[i].extend(
                repeat(lists[i][-1], base_len - len(lists[i]))
            )
        elif len(lists[i]) > base_len:
            lists[i] = lists[i][:base_len]
    return lists

# ===================================================
# FAMILY LOAD OPTIONS (FIXED)
# ===================================================

class FamLoadOpt(IFamilyLoadOptions):
    def OnFamilyFound(self, familyInUse, overwriteParameterValues):
        overwriteParameterValues.Value = True
        return True

    def OnSharedFamilyFound(self, familyInUse, source, overwriteParameterValues):
        overwriteParameterValues.Value = True
        return True

# ===================================================
# SETTINGS
# ===================================================

geom      = tolist(IN[0])
fam_path  = IN[1]
names     = tolist(IN[2])
category  = tolist(IN[3])
material  = tolist(IN[4])
isVoid    = tolist(IN[5])
subcat    = tolist(IN[6])

origin = XYZ.Zero
str_typ = StructuralType.NonStructural
temp_path = System.IO.Path.GetTempPath()
invalid_chars = System.IO.Path.GetInvalidFileNameChars()

acceptable_views = (
    'ThreeD', 'FloorPlan', 'EngineeringPlan',
    'CeilingPlan', 'Elevation', 'Section'
)

# ---------- Units (Revit 2024) ----------
if int(doc.Application.VersionNumber) > 2021:
    units = doc.GetUnits().GetFormatOptions(
        ForgeTypeId("autodesk.spec.aec:length")
    ).GetUnitTypeId()
else:
    units = doc.GetUnits().GetFormatOptions(
        UnitType.UT_Length
    ).DisplayUnits

factor = UnitUtils.ConvertToInternalUnits(1, units)

# ---------- Import Options ----------
satOpt = SATImportOptions()
satOpt.Placement = ImportPlacement.Origin
satOpt.Unit = ImportUnit.Foot

SaveAsOpt = SaveAsOptions()
SaveAsOpt.OverwriteExistingFile = True

# ===================================================
# GEOMETRY HELPERS
# ===================================================

def get_valid_solid(import_instance):
    opt = Options()
    opt.ComputeReferences = True
    geo = import_instance.get_Geometry(opt)

    for g in geo:
        if isinstance(g, GeometryInstance):
            inst_geo = g.GetInstanceGeometry()
            for obj in inst_geo:
                if isinstance(obj, Solid) and obj.Volume > 1e-6:
                    return obj
    return None

# ===================================================
# MAIN FUNCTION
# ===================================================

def CreateFamilyFromGeometry(
        s1, name1, cat1, isVoid1, mat1, subcat1):

    try:
        # ---------- Validate name ----------
        if any(c in name1 for c in invalid_chars):
            raise Exception("Invalid family name: " + name1)

        enable_mat = mat1 not in [None, ""]
        enable_sub  = subcat1 not in [None, ""]

        TransactionManager.ForceCloseTransaction(
            TransactionManager.Instance
        )

        # ---------- New Family ----------
        famdoc = app.NewFamilyDocument(fam_path)

        # ---------- Scale & Move ----------
        if factor != 1:
            s1 = s1.Scale(factor)

        vec = Vector.ByTwoPoints(
            BoundingBox.ByGeometry(s1).MinPoint,
            DynPoint.Origin()
        )
        s1 = s1.Translate(vec)

        # ---------- Export SAT ----------
        sat_path = System.IO.Path.Combine(
            temp_path, name1 + ".sat"
        )
        Geometry.ExportToSAT(s1, sat_path)

        # ---------- Find View ----------
        view1 = None
        for v in FilteredElementCollector(famdoc).OfClass(View):
            if not v.IsTemplate and str(v.ViewType) in acceptable_views:
                view1 = v
                break

        # ---------- Import SAT ----------
        t = Transaction(famdoc, "Import SAT")
        t.Start()
        satId = famdoc.Import(sat_path, satOpt, view1)
        t.Commit()

        import_inst = famdoc.GetElement(satId)
        solid = get_valid_solid(import_inst)

        if not solid:
            raise Exception("No valid solid found")

        # ---------- Cleanup ----------
        t = Transaction(famdoc, "Cleanup")
        t.Start()
        famdoc.Delete(satId)
        t.Commit()
        System.IO.File.Delete(sat_path)

        # ---------- Category ----------
        try:
            famdoc.OwnerFamily.FamilyCategory = \
                famdoc.Settings.Categories.get_Item(cat1.Name)
        except:
            pass

        # ---------- Create FreeForm ----------
        t = Transaction(famdoc, "Create FreeForm")
        t.Start()
        ff = FreeFormElement.Create(famdoc, solid)

        if isVoid1:
            ff.get_Parameter(
                BuiltInParameter.ELEMENT_IS_CUTTING
            ).Set(1)
            famdoc.OwnerFamily.get_Parameter(
                BuiltInParameter.FAMILY_ALLOW_CUT_WITH_VOIDS
            ).Set(1)
        else:
            if enable_mat:
                fam_mat = None
                for m in FilteredElementCollector(famdoc).OfClass(Material):
                    if m.Name == mat1:
                        fam_mat = m
                        break
                if fam_mat:
                    ff.get_Parameter(
                        BuiltInParameter.MATERIAL_ID_PARAM
                    ).Set(fam_mat.Id)

            if enable_sub:
                fam_cat = famdoc.OwnerFamily.FamilyCategory
                subs = fam_cat.SubCategories
                if subs.Contains(subcat1):
                    sc = subs[subcat1]
                else:
                    sc = famdoc.Settings.Categories.NewSubcategory(
                        fam_cat, subcat1
                    )
                ff.Subcategory = sc

        t.Commit()

        # ---------- Save & Load ----------
        save_path = System.IO.Path.Combine(
            temp_path, name1 + ".rfa"
        )
        famdoc.SaveAs(save_path, SaveAsOpt)
        family = famdoc.LoadFamily(doc, FamLoadOpt())
        famdoc.Close(False)
        System.IO.File.Delete(save_path)

        # ---------- Place Instance ----------
        symbol_id = list(family.GetFamilySymbolIds())[0]
        symbol = doc.GetElement(symbol_id)

        t = Transaction(doc, "Place Family")
        t.Start()
        if not symbol.IsActive:
            symbol.Activate()

        inst = doc.Create.NewFamilyInstance(
            origin, symbol, str_typ
        )
        ElementTransformUtils.MoveElement(
            doc, inst.Id, vec.Reverse().ToXyz()
        )
        t.Commit()

        return inst.ToDSType(False), family.ToDSType(False)

    except:
        return traceback.format_exc(), ""

# ===================================================
# EXECUTION
# ===================================================

if len(geom) == len(names) == len(category) == \
   len(isVoid) == len(material) == len(subcat):

    results = map(
        CreateFamilyFromGeometry,
        geom, names, category, isVoid, material, subcat
    )

elif len(geom) == len(names):
    padded = PadLists([geom, category, isVoid, material, subcat])
    results = map(
        CreateFamilyFromGeometry,
        geom, names,
        padded[1], padded[2], padded[3], padded[4]
    )
else:
    results = [("Geometry & Name mismatch", "")]

OUT = (
    [r[0] for r in results],
    [r[1] for r in results]
)
# ----------------------------------------
python_script_4 = Python(IN[0]=byUnion, IN[1]=code_block_3.out1, IN[2]=code_block_3.out2, IN[3]=categories, IN[6]=string)  # IronPython2; unwired: IN[4], IN[5]; same code as python_script_2
