# Dynamo graph script.dyn (Dynamo 2.3.0.5885)
# packages: Structural Design 2019.12.11, Data-Shapes 2022.2.96, Clockwork for Dynamo 2.x 2.3.0, Rhythm 2020.7.25, archi-lab.net 2021.25.15, RIE 2020.11.18, MEPover 2022.10.30

# group: Select-Wall
code_block = CodeBlock { "Walls"; 1; "Select Wall"; true; }
byName = Category.ByName(name=code_block.out0)
pickObjectsOfCategory = StructuralDesign.Model.Selection.PickObjectsOfCategory(category=byName, objectType=code_block.out1, statusPrompt=code_block.out2)

# group: Get-Infor
getLocation = Element.GetLocation(element=pickObjectsOfCategory)
code_block_2 = CodeBlock { "Base Constraint"; "Width"; "Unconnected Height"; }
ʳʰʸᵗʰᵐ_elements = Rhythm.Revit.Elements.Elements.GetParameterValueByNameTypeOrInstance(element=pickObjectsOfCategory, parameterName=code_block_2.out1)
ʳʰʸᵗʰᵐ_elements_2 = Rhythm.Revit.Elements.Elements.GetParameterValueByNameTypeOrInstance(element=pickObjectsOfCategory, parameterName=code_block_2.out0)

ZAxis = Vector.ZAxis()
code_block_3 = CodeBlock { "Hight Beam By Wall Condition"; "300"; true; }
textbox_data = Custom[TextBox Data](InputName=code_block_3.out0, DefaultText=code_block_3.out1, IsNumberEntry=code_block_3.out2)  # package Data-Shapes; Create Data for TextBox input in UI.MultipleInputForm ++ . Check out www.data-shapes.net for more informations

# group: UI
code_block_4 = CodeBlock { "Create Lintel"; "Create"; true; "Cancle"; 210; }
code_block_5 = CodeBlock { "Select Family Name of Lintel"; "Level Base"; }
categories = Categories("OST_StructuralFraming")
all_families_of_category = Custom[All Families Of Category](category=categories)  # package Clockwork for Dynamo 2.x; Gets all famiies of a given category in the model (does *not *work for system families)
name = Element.Name(element=all_families_of_category)
dropdown_data = Custom[DropDown Data](InputName=code_block_5.out0, Keys=name, Values=all_families_of_category)  # package Data-Shapes; Create data for DropDown input in UI.MultiInputForm ++ . Check out www.data-shapes.net for more infos.
code_block_6 = CodeBlock { "MaxHight"; "3000"; true; }
textbox_data_2 = Custom[TextBox Data](InputName=code_block_6.out0, DefaultText=code_block_6.out1, IsNumberEntry=code_block_6.out2)
boolean = BoolSelector(true)

categories_2 = Categories("OST_Levels")
all_elements_of_category = ElementsOfCategory(Category=categories_2)
name_2 = Element.Name(element=all_elements_of_category)
dropdown_data_2 = Custom[DropDown Data](InputName=code_block_5.out1, Keys=name_2, Values=all_elements_of_category)

# group (continued): UI
list_create = List.Create(item0=dropdown_data, item1=textbox_data_2, item2=textbox_data, item3=dropdown_data_2)
multipleinputform = Custom[MultipleInputForm ++](Description_optional=code_block_4.out0, ButtonText_optional=code_block_4.out1, Inputs=list_create, Toggle=boolean, CancelButtonText_optional=code_block_4.out3, LabelWidth_optional=code_block_4.out4)  # package Data-Shapes; Create a form with multiple inputs. see www.data-shapes.net for tutorials and infos!
code_block_7 = CodeBlock(FamilyLintel=multipleinputform.User_Inputs, MaxHeight=multipleinputform.User_Inputs, H=multipleinputform.User_Inputs, SLevels=multipleinputform.User_Inputs) { FamilyLintel[0]; MaxHeight[1]; H[2]; SLevels[3]; }

translate = Geometry.Translate(geometry=getLocation, direction=ZAxis, distance=code_block_7.out1)
floor = Math.Floor(number=ʳʰʸᵗʰᵐ_elements)
floor_2 = Math.Floor(number=code_block_7.out2)
code_block_8 = CodeBlock(b=floor, h=floor_2) { "Lintel-"+b+"x"+h; }
family_types_of_family = Custom[Family types of family](family=code_block_7.out0)  # package MEPover; Returns every family type of the given Family
code_block_9 = CodeBlock(a=family_types_of_family) { a[0]; }
byName_2 = FamilyType.ByName(name=code_block_8)
code_block_10 = CodeBlock { null; }
RIE_IndexOf = Custom[RIE_IndexOf](list=byName_2, Item=code_block_10)  # package RIE; Returns a sublistlist with all indexes for each item.
getItemAtIndex = List.GetItemAtIndex(list=code_block_8, index=RIE_IndexOf)
uniqueItems = List.UniqueItems(list=getItemAtIndex)
duplicate = archilab.Revit.Elements.ElementTypes.Duplicate(element=code_block_9, name=uniqueItems)
passthrough = Custom[Passthrough](passThrough=code_block_8, waitFor=duplicate)  # package Clockwork for Dynamo 2.x; Forces a sequential order of execution. The node wired into the output of the Passthrough node will be executed *after* the node wired into the waitFor input (e.g. important for some Revit operations). The value of the passThrough input will be passed on to the node wired into the output port of the Passthrough node.
byName_3 = FamilyType.ByName(name=passthrough)
beamByCurve = StructuralFraming.BeamByCurve(curve=translate, level=code_block_7.out3, structuralFramingType=byName_3)

# group: To Revit-JOIN
code_block_11 = CodeBlock(Framings=beamByCurve, WallsE=pickObjectsOfCategory) { Framings; WallsE; }
joinGeometry = Custom[Element.JoinGeometry](element1=code_block_11.Framings, element2=code_block_11.WallsE)  # package Clockwork for Dynamo 2.x; Joins two model elements (if possible). Only works inside the project environment.

# group: Control-SETLOCATION
code_block_12 = CodeBlock { "y Justification"; "z Justification"; "Reference Level"; }
code_block_13 = CodeBlock(ELevels=ʳʰʸᵗʰᵐ_elements_2) { 1; 3; ELevels[0]; }
setParameterByName = Element.SetParameterByName(element=beamByCurve, parameterName=code_block_12.out0, value=code_block_13.out0)
setParameterByName_2 = Element.SetParameterByName(element=beamByCurve, parameterName=code_block_12.out1, value=code_block_13.out1)

setParameterByName_3 = Element.SetParameterByName(element=beamByCurve, parameterName=code_block_12.out2, value=code_block_7.out3)
