# Dynamo graph script.dyn "alinefinishwall" (Dynamo 2.3.0.5885)
# packages: Rhythm 2020.7.25

boolean = BoolSelector(true)  # graph input
categories = Categories("OST_Walls")
isolated_pick_model_elements = Custom[Isolated Pick Model Elements(ordered)](refresh=boolean, category=categories)  # package Rhythm; Pick model elements in desired order of a desired category.
code_block = CodeBlock(a=isolated_pick_model_elements) { a[0]; a[1]; }
getLocation = Element.GetLocation(element=code_block.out1)
code_block_2 = CodeBlock { 0.5; }
pointAtParameter = Curve.PointAtParameter(curve=getLocation, param=code_block_2)
getLocation_2 = Element.GetLocation(element=code_block.out0)
pointAtParameter_2 = Curve.PointAtParameter(curve=getLocation_2, param=code_block_2)
ZAxis = Vector.ZAxis()
code_block_3 = CodeBlock { 500; }
byStartPointDirectionLength = Line.ByStartPointDirectionLength(startPoint=pointAtParameter_2, direction=ZAxis, length=code_block_3)
endPoint = Curve.EndPoint(curve=byStartPointDirectionLength)
byLineAndPoint = Plane.ByLineAndPoint(line=getLocation_2, point=endPoint)
closestPointTo = Geometry.ClosestPointTo(geometry=byLineAndPoint, other=pointAtParameter)
byStartPointEndPoint = Line.ByStartPointEndPoint(startPoint=pointAtParameter, endPoint=closestPointTo)
direction = Line.Direction(line=byStartPointEndPoint)
distanceTo = Geometry.DistanceTo(geometry=pointAtParameter, other=byLineAndPoint)
code_block_4 = CodeBlock { "Width"; }
ʳʰʸᵗʰᵐ_elements = Rhythm.Revit.Elements.Elements.GetParameterValueByNameTypeOrInstance(element=code_block.out0, parameterName=code_block_4)
ʳʰʸᵗʰᵐ_elements_2 = Rhythm.Revit.Elements.Elements.GetParameterValueByNameTypeOrInstance(element=code_block.out1, parameterName=code_block_4)
code_block_5 = CodeBlock(a=distanceTo, wmsr=ʳʰʸᵗʰᵐ_elements, wfn=ʳʰʸᵗʰᵐ_elements_2) { a-wmsr/2-wfn/2; }
translate = Geometry.Translate(geometry=getLocation, direction=direction, distance=code_block_5)
setLocation = Element.SetLocation(element=code_block.out1, geometry=translate)
