# Dynamo graph script.dyn (Dynamo 2.3.0.5885)
# packages: KYSUDO 2019.8.5, Data-Shapes 2022.2.96

code_block = CodeBlock { "JOIN ELEMENT"; "JOIN"; true; "CANCLE"; 300; 400; 200; }
code_block_2 = CodeBlock { "Pick element Cut"; "Pick element beCut"; }
categories = Categories("OST_Floors")
selectmodelelements_data = Custom[SelectModelElements Data](InputName=code_block_2.out0, CategoryFilter=categories)  # package Data-Shapes; Creates a Revit element selection input for UI.MultipleInputForm++ . Check out www.data-shapes.net for more infos!
categories_2 = Categories("OST_Floors")
selectmodelelements_data_2 = Custom[SelectModelElements Data](InputName=code_block_2.out1, CategoryFilter=categories_2)
list_create = List.Create(item0=selectmodelelements_data, item1=selectmodelelements_data_2)
multipleinputform = Custom[MultipleInputForm ++](Description_optional=code_block.out0, ButtonText_optional=code_block.out1, Inputs=list_create, Toggle=code_block.out2, CancelButtonText_optional=code_block.out3, MaxHeight_optional=code_block.out4, Width_optional=code_block.out5, LabelWidth_optional=code_block.out6)  # package Data-Shapes; Create a form with multiple inputs. see www.data-shapes.net for tutorials and infos!
code_block_3 = CodeBlock(Floorcut=multipleinputform.User_Inputs, Floorbecut=multipleinputform.User_Inputs) { Floorcut[0]; Floorbecut[1]; }
join_geometry = Custom[Join Geometry](Elements_A=code_block_3.out0, Elements_B=code_block_3.out1)  # package KYSUDO
