# Dynamo graph script.dyn (Dynamo 2.3.0.5885)
# packages: Structural Design 2019.12.11, bimorphNodes 3.0.3, spring nodes 132.2.5

code_block = CodeBlock { a; }  # unwired: a
code_block_2 = CodeBlock { "Select All element"; }
boolean = BoolSelector(true)
pickElements = StructuralDesign.Model.Selection.PickElements(statusPrompt=code_block_2, refresh=boolean)
string_from_object = FromObject(obj=pickElements)
code_block_3 = CodeBlock(A=string_from_object) { A=="Group"; }
filterByBoolMask = List.FilterByBoolMask(list=pickElements, mask=code_block_3)
code_block_4 = CodeBlock { 1; }
chop = List.Chop(list=filterByBoolMask.out, lengths=code_block_4)
boundingBox = Element.BoundingBox(element=filterByBoolMask.out)
code_block_5 = CodeBlock { 10; }
getElementsIntersect = Revit.BoundingBox.GetElementsIntersect(boundingBox=boundingBox, elements=filterByBoolMask.out, tolerance=code_block_5)
unjoin = Custom[Springs.Element.Unjoin](firstElement=chop@L2, secondElement=getElementsIntersect@L2, lacing=Longest)  # package spring nodes; Unjoins the element(s) in the second list from the primary input element.
