# Dynamo graph script.dyn "Check OverLap" (Dynamo 2.3.0.5885)
# packages: Structural Design 2019.12.11, Clockwork for Dynamo 2.x 2.3.0, Orchid 203.3.1.8192, Rhythm 2020.7.25

code_block = CodeBlock { "Select Element to check OverLap"; "Pick Element"; }
boolean = BoolSelector(true)
ʳʰʸᵗʰᵐ_helpers_usermessage = Rhythm.Revit.Helpers.Helpers.UserMessage(caption=code_block.out0, message=code_block.out1, obj=boolean)
pickObjects = StructuralDesign.Model.Selection.PickObjects(statusPrompt=code_block.out0, refresh=ʳʰʸᵗʰᵐ_helpers_usermessage)
flatten = List.Flatten(list=pickObjects)
geometry = Element.Geometry(element=flatten)
flatten_2 = List.Flatten(list=geometry)
intersectAll = Geometry.IntersectAll(geometry=flatten_2, others=flatten_2, lacing=CrossProduct)
type = Object.Type(obj=intersectAll)
code_block_2 = CodeBlock { "Solid"; }
contains = String.Contains(str=type, searchFor=code_block_2)
code_block_3 = CodeBlock { false; }
replaceEmptyLists = Custom[List.ReplaceEmptyLists](seq=contains@L3, Replacement=code_block_3)  # package Clockwork for Dynamo 2.x; Replaces all empty lists within a given list with a substitute
o_list_alltrue = Orchid.Common.List.AllTrue(list=replaceEmptyLists)
filterByBoolMask = List.FilterByBoolMask(list=flatten, mask=o_list_alltrue@L2)
code_block_4 = CodeBlock(ElementOverlap=filterByBoolMask.in) { ElementOverlap; }
code_block_5 = CodeBlock { 1; }
chop = List.Chop(list=flatten, lengths=code_block_5)
setDifference = List.SetDifference(list1=code_block_4@L2, list2=chop@L2)
isEmpty = List.IsEmpty(list=setDifference@L2)
filterByBoolMask_2 = List.FilterByBoolMask(list=flatten, mask=isEmpty)
code_block_6 = CodeBlock { "CheckOverLap"; }
filterByBoolMask_3 = List.FilterByBoolMask(list=setDifference, mask=isEmpty)
id = Element.Id(element=filterByBoolMask_3.out)
string_from_object = FromObject(obj=id)
code_block_7 = CodeBlock { "+"; }
o_string_join = Orchid.Common.String.Join(string=string_from_object, separator=code_block_7)
geometry_2 = Element.Geometry(element=filterByBoolMask_3.out)
flatten_3 = List.Flatten(list=geometry_2@L3)
geometry_3 = Element.Geometry(element=filterByBoolMask_2.out)
intersectAll_2 = Geometry.IntersectAll(geometry=flatten_3, others=geometry_3, lacing=Longest)
volume = Solid.Volume(solid=intersectAll_2)
flatten_4 = List.Flatten(list=volume@L3)
volume_2 = Solid.Volume(solid=geometry_3)
div = flatten_4@L2 / volume_2@L3  # lacing=Longest
code_block_8 = CodeBlock { 100; }
mul = div * code_block_8
flatten_5 = List.Flatten(list=mul@L3)
sum = Math.Sum(values=flatten_5)
floor = Math.Floor(number=sum)
string_from_object_2 = FromObject(obj=floor)
code_block_9 = CodeBlock(c=o_string_join, d=string_from_object_2) { "OverLap With " + c+  " = " + d +" %"; }
ʳʰʸᵗʰᵐ_elements = Rhythm.Revit.Elements.Elements.SetParameterByNameTypeOrInstance(element=filterByBoolMask_2.out, parameterName=code_block_6, value=code_block_9)
