# Dynamo graph script.dyn (Dynamo 2.6.1.8786)
# packages: BIM4Struc.Productivity 2.2.2, WombatDynamo 1.3.2, Structural Design 2021.9.23, Clockwork for Dynamo 2.x 2.3.0, Structural Design 2020.4.10, Structural Design 2021.1.5

disallowJoins = Custom[StructuralFraming.DisallowJoins]()  # package BIM4Struc.Productivity; Disallow joins at start and/or end of selected Strucural Framing elements; unwired: elements, DisallowAtStart, DisallowAtEnd
boolean = BoolSelector(true)  # frozen
pickObjects = StructuralDesign.Model.Selection.PickObjects(refresh=boolean)
string_from_object = FromObject(obj=pickObjects)
code_block = CodeBlock(A=string_from_object) { A=="Walls"; A=="Structural Framing"; }
list_create = List.Create(item0=code_block.out0, item1=code_block.out1)
transpose = List.Transpose(lists=list_create)
anyTrue = Custom[Booleans.AnyTrue](seq=transpose)  # package Clockwork for Dynamo 2.x; Returns true if any item in a list of booleans is true.
filterByBoolMask = List.FilterByBoolMask(list=pickObjects, mask=anyTrue)
categories = Categories("OST_StructuralFraming")
boolean_2 = BoolSelector(true)
pickObjectsOfCategory = StructuralDesign.Model.Selection.PickObjectsOfCategory(category=categories, refresh=boolean_2)
boolean_3 = BoolSelector(false)
allowDisallowJoins = WombatDynamo.Wall.AllowDisallowJoins(wall=pickObjectsOfCategory, allow=boolean_3)
code_block_2 = CodeBlock { 0; 1; }
disallowJoinAtEnd = StructuralDesign.Model.RevitFrame.RevitFrame.DisallowJoinAtEnd(structuralFraming=pickObjectsOfCategory, end=code_block_2.out0, allow=boolean_3)
disallowJoinAtEnd_2 = StructuralDesign.Model.RevitFrame.RevitFrame.DisallowJoinAtEnd(structuralFraming=pickObjectsOfCategory, end=code_block_2.out1, allow=boolean_3)
