# Dynamo graph script.dyn (Dynamo 2.6.1.8786)
# packages: Data-Shapes 2022.2.96, Orchid 203.3.1.8192, OpenMEP 1.0.0, RIE 2020.11.18, Rhythm 2020.7.25, TBF 1.0.9

code_block = CodeBlock { "Select Parameter to Export excel"; "Export"; true; "Cancle"; 900; }
code_block_2 = CodeBlock { "File Path"; "Sheet Name"; "StartRow"; "StartCol"; "0"; true; }
string = StringInput("D:\Binhngo\01-Project\00-Project\SkyVilla")
filepath_data = Custom[FilePath Data](InputName=code_block_2.out0, DefaulPath=string)  # package Data-Shapes; Create filepath input for UI.MultipleInputForm ++ . Check out www.data-shapes.net for more infos !
textbox_data = Custom[TextBox Data](InputName=code_block_2.out1, DefaultText=code_block_2.out1)  # package Data-Shapes; Create Data for TextBox input in UI.MultipleInputForm ++ . Check out www.data-shapes.net for more informations
textbox_data_2 = Custom[TextBox Data](InputName=code_block_2.out2, DefaultText=code_block_2.out4, IsNumberEntry=code_block_2.out5)
textbox_data_3 = Custom[TextBox Data](InputName=code_block_2.out3, DefaultText=code_block_2.out4, IsNumberEntry=code_block_2.out5)
code_block_3 = CodeBlock { "Select Parameter"; 350; true; }
code_block_4 = CodeBlock { "Select Category fist"; "Next"; true; "Cancel"; 400; 400; }
code_block_5 = CodeBlock { "Select Category"; 400; true; }
o_category_indocument = Orchid.RevitProject.Elements.Category.InDocument()
o_category_categorytype = Orchid.RevitProject.Elements.Category.CategoryType(category=o_category_indocument)
groupByKey = List.GroupByKey(list=o_category_indocument, keys=o_category_categorytype)
addItemToFront = List.AddItemToFront(item=groupByKey.unique_keys@L1, list=groupByKey.groups@L2)
treeview_input = Custom[TreeView input](InputName=code_block_5.out0, Data=addItemToFront@L3, FirstItemIsTitle=code_block_5.out2)  # package Data-Shapes; Create a TreeView input for UI.MultipleInputForm ++ . Check out www.data-shapes.net for more infos and tips!
multipleinputform = Custom[MultipleInputForm ++](Description_optional=code_block_4.out0, ButtonText_optional=code_block_4.out1, Inputs=treeview_input, Toggle=code_block_4.out2, CancelButtonText_optional=code_block_4.out3)  # package Data-Shapes; Create a form with multiple inputs. see www.data-shapes.net for tutorials and infos!
code_block_6 = CodeBlock(Categorys=multipleinputform.User_Inputs) { Categorys[0]; }
isEmpty = List.IsEmpty(list=code_block_6)
getSelectedElements = OpenMEPRevit.Document.Selection.GetSelectedElements(flag=isEmpty)
python_script = Python(IN[0]=code_block_6)
# ---------- python_script.python (111 lines) ----------
import clr
import System
# Revit API
clr.AddReference('RevitAPI')
from Autodesk.Revit.DB import *

# Dynamo → Revit
clr.AddReference('RevitNodes')
import Revit
clr.ImportExtensions(Revit.Elements)

# Dynamo services
clr.AddReference('RevitServices')
from RevitServices.Persistence import DocumentManager
from RevitServices.Transactions import TransactionManager

doc = DocumentManager.Instance.CurrentDBDocument


# ---------------------------
# Helper: Convert Dynamo category → DB.Category
# ---------------------------
def get_db_category(cat):
    try:
        # TH: Dynamo category (Revit.Elements.Category)
        db_cat = UnwrapElement(cat)
        if db_cat: 
            return db_cat
    except:
        pass

    # TH: đã là DB.Category
    if hasattr(cat, "Id") and "Autodesk.Revit.DB.Category" in str(type(cat)):
        return cat

    return None


# ---------------------------
# Helper: Check if category is Loadable Family Category
# ---------------------------
def is_loadable_family_category(doc, db_cat):
    try:
        bic = System.Enum.ToObject(BuiltInCategory, db_cat.Id.IntegerValue)
        els = FilteredElementCollector(doc).OfCategory(bic).WhereElementIsElementType().ToElements()
        if els:
            # If all elements are FamilySymbol → loadable family
            return all(isinstance(e, FamilySymbol) for e in els)
    except:
        pass
    return False


# ---------------------------
# Main: Get Element Types or Family Types
# ---------------------------
def get_types_by_category(doc, db_cat):
    results = []

    if db_cat is None:
        return results

    bic = System.Enum.ToObject(BuiltInCategory, db_cat.Id.IntegerValue)

    # ----------------------------------------
    # CASE 1: Loadable family category
    # ----------------------------------------
    if is_loadable_family_category(doc, db_cat):
        fams = FilteredElementCollector(doc).OfClass(Family).ToElements()
        fams = [f for f in fams if f.FamilyCategory and f.FamilyCategory.Id == db_cat.Id]

        for f in fams:
            for sid in f.GetFamilySymbolIds():
                sym = doc.GetElement(sid)
                if sym:
                    results.append(sym)
        return results

    # ----------------------------------------
    # CASE 2: System family category
    # ----------------------------------------
    types = FilteredElementCollector(doc).OfCategory(bic).WhereElementIsElementType().ToElements()

    for t in types:
        results.append(t)

    return results


# ---------------------------
# INPUT
# ---------------------------
cat_input = IN[0]   # Category from Dynamo


# Normalize input to list
if not isinstance(cat_input, list):
    cat_input = [cat_input]

output = []

# Process each category
for cat in cat_input:
    db_cat = get_db_category(cat)
    types = get_types_by_category(doc, db_cat)
    output.append([t for t in types])   # return DB elements

# ---------------------------
# OUTPUT
# ---------------------------
OUT = output
# ----------------------------------------
firstItem = List.FirstItem(list=python_script@L2)
RIE_If = Custom[RIE_If](Test=isEmpty, True=getSelectedElements, False=firstItem)  # package RIE; An If node that keeps list structure, empty lists and so forth.
parameters = Element.Parameters(element=RIE_If)
name = Parameter.Name(parameter=parameters)
flatten = List.Flatten(list=name)
uniqueItems = List.UniqueItems(list=flatten)
code_block_7 = CodeBlock { "Id"; }
join = List.Join(list0=uniqueItems, list1=code_block_7)
listview_data = Custom[Listview Data](InputName=code_block_3.out0, Keys=join, Values=join, Height_optionnal=code_block_3.out1, SortItems_optionnal=code_block_3.out2)  # package Data-Shapes; Create data for ListView input in UI.MultiInputForm ++ . Check out www.data-shapes.net for more infos.
list_create = List.Create(item0=filepath_data, item1=textbox_data, item2=textbox_data_2, item3=textbox_data_3, item4=listview_data)
multipleinputform_2 = Custom[MultipleInputForm ++](Description_optional=code_block.out0, ButtonText_optional=code_block.out1, Inputs=list_create, Toggle=code_block.out2, CancelButtonText_optional=code_block.out3, MaxHeight_optional=code_block.out4)
code_block_8 = CodeBlock(FILEPATH=multipleinputform_2.User_Inputs, SHEETNAME=multipleinputform_2.User_Inputs, STARTROW=multipleinputform_2.User_Inputs, STARTCOL=multipleinputform_2.User_Inputs, Parameters=multipleinputform_2.User_Inputs) { FILEPATH[0]; SHEETNAME[1]; STARTROW[2]; STARTCOL[3]; Parameters[4]; }
flatten_2 = List.Flatten(list=RIE_If)
ʳʰʸᵗʰᵐ_elements = Rhythm.Revit.Elements.Elements.GetParameterValueByNameTypeOrInstance(element=flatten_2, parameterName=code_block_8.out4@L1)
contains = Custom[List.Contains](list=code_block_8.out4, item=code_block_7)  # package TBF; List filter correct word
code_block_9 = CodeBlock { true; }
indexOf = List.IndexOf(list=contains, element=code_block_9)
id = Element.Id(element=flatten_2)
RIE_ReplaceItemsAtIndices = Custom[RIE_ReplaceItemsAtIndices](list=ʳʰʸᵗʰᵐ_elements, Indices=indexOf, Item=id)  # package RIE; Replaces items at indices with input value. One value for each index needed.
addItemToFront_2 = List.AddItemToFront(item=code_block_8.out4@L1, list=RIE_ReplaceItemsAtIndices@L2)
transpose = List.Transpose(lists=addItemToFront_2)
code_block_10 = CodeBlock { true; }
exportExcel = Data.ExportExcel(filePath=code_block_8.out0, sheetName=code_block_8.out1, startRow=code_block_8.out2, startCol=code_block_8.out3, data=transpose, overWrite=code_block_10)
