# Dynamo graph script.dyn (Dynamo 2.3.0.5885)
# packages: Data-Shapes 2022.2.96, Rhythm 2020.7.25, Orchid 203.3.1.8192, Structural Design 2019.12.11

boolean = BoolSelector(true)
pickElementsByRectangle = StructuralDesign.Model.Selection.PickElementsByRectangle(refresh=boolean)
code_block = CodeBlock { "SetParameter Over Group"; "Set"; true; "Cancle"; 500; 400; 200; }
code_block_2 = CodeBlock { "Parameter Name"; "Sub_Zone"; "Parameter Value"; }
o_document_projectparameters = Orchid.RevitProject.Common.Document.ProjectParameters()
name = Element.Name(element=o_document_projectparameters.Parameter)
o_document_sharedparameters = Orchid.RevitProject.Common.Document.SharedParameters()
name_2 = Element.Name(element=o_document_sharedparameters.Parameter)
join = List.Join(list0=name, list1=name_2)
sort = List.Sort(list=join)
dropdown_data = Custom[DropDown Data](InputName=code_block_2.out0, Keys=sort, Values=sort)  # package Data-Shapes; Create data for DropDown input in UI.MultiInputForm ++ . Check out www.data-shapes.net for more infos.
textbox_data = Custom[TextBox Data](InputName=code_block_2.out2)  # package Data-Shapes; Create Data for TextBox input in UI.MultipleInputForm ++ . Check out www.data-shapes.net for more informations
list_create = List.Create(item0=dropdown_data, item1=textbox_data)
multipleinputform = Custom[MultipleInputForm ++](Description_optional=code_block.out0, ButtonText_optional=code_block.out1, Inputs=list_create, Toggle=code_block.out2, CancelButtonText_optional=code_block.out3, MaxHeight_optional=code_block.out4, Width_optional=code_block.out5, LabelWidth_optional=code_block.out6)  # package Data-Shapes; Create a form with multiple inputs. see www.data-shapes.net for tutorials and infos!
code_block_3 = CodeBlock(ELEMENTS=pickElementsByRectangle, ParaName=multipleinputform.User_Inputs, ParaValue=multipleinputform.User_Inputs) { ELEMENTS; ParaName[0]; ParaValue[1]; }
string_from_object = FromObject(obj=code_block_3.ELEMENTS)
code_block_4 = CodeBlock { "Group"; }
ne = string_from_object != code_block_4
filterByBoolMask = List.FilterByBoolMask(list=code_block_3.ELEMENTS, mask=ne)
ʳʰʸᵗʰᵐ_elements = Rhythm.Revit.Elements.Elements.SetParameterByNameTypeOrInstance(element=filterByBoolMask.in, parameterName=code_block_3.out1, value=code_block_3.out2)
