# Dynamo graph script.dyn (Dynamo 2.3.0.5885)
# packages: BN-NormalNode 0.0.1, Structural Design 2019.12.11, Rhythm 2020.7.25, Data-Shapes 2022.2.96

code_block = CodeBlock { 0; true; }
pickElementsByRectangle = StructuralDesign.Model.Selection.PickElementsByRectangle(refresh=code_block.out1)
selectElement = NormalNode.Selection.SelectElement(ObjectType=code_block.out0)
parameters = Element.Parameters(element=selectElement)
name = Parameter.Name(parameter=parameters)
code_block_2 = CodeBlock { "Copy Parameter"; "Paste"; true; "Cancle"; 700; 300; 100; }
code_block_3 = CodeBlock { "ParaName ?"; 200; true; }
group = Parameter.Group(parameter=parameters)
groupByKey = List.GroupByKey(list=name, keys=group)
addItemToFront = List.AddItemToFront(item=groupByKey.unique_keys@L1, list=groupByKey.groups@L2)
treeview_input = Custom[TreeView input](InputName=code_block_3.out0, Data=addItemToFront, FirstItemIsTitle=code_block_3.out2)  # package Data-Shapes; Create a TreeView input for UI.MultipleInputForm ++ . Check out www.data-shapes.net for more infos and tips!
multipleinputform = Custom[MultipleInputForm ++](Description_optional=code_block_2.out0, ButtonText_optional=code_block_2.out1, Inputs=treeview_input, Toggle=code_block_2.out2, CancelButtonText_optional=code_block_2.out3, MaxHeight_optional=code_block_2.out4, Width_optional=code_block_2.out5, LabelWidth_optional=code_block_2.out6)  # package Data-Shapes; Create a form with multiple inputs. see www.data-shapes.net for tutorials and infos!
code_block_4 = CodeBlock(paraname=multipleinputform.User_Inputs) { paraname; }
indexOf = List.IndexOf(list=name, element=code_block_4)
getItemAtIndex = List.GetItemAtIndex(list=parameters, index=indexOf)
name_2 = Parameter.Name(parameter=getItemAtIndex)
value = Parameter.Value(parameter=getItemAtIndex)
ʳʰʸᵗʰᵐ_elements = Rhythm.Revit.Elements.Elements.SetParameterByNameTypeOrInstance(element=pickElementsByRectangle, parameterName=name_2@L1, value=value@L1)
code_block_5 = CodeBlock { ["STG-Level","Zone","Sub_Zone","Group_SubZone","STG_Mark","Unit"]; }
