# Dynamo graph script.dyn (Dynamo 2.3.0.5885)
# packages: Rhythm 2020.7.25, archi-lab.net 2021.25.15, BN-NormalNode 0.0.1

code_block = CodeBlock { 0; }
selectElement = NormalNode.Selection.SelectElement(ObjectType=code_block)
elementType = Element.ElementType(element=selectElement)
name = Element.Name(element=elementType)
code_block_2 = CodeBlock(A=name) { A+" COPY"; }
duplicate = archilab.Revit.Elements.ElementTypes.Duplicate(element=elementType, name=code_block_2)  # frozen
parameters = Element.Parameters(element=elementType)
flatten = List.Flatten(list=parameters)
group = Parameter.Group(parameter=flatten)
groupByKey = List.GroupByKey(list=flatten, keys=group)
code_block_3 = CodeBlock()
# ---------- code_block_3.designscript (2 lines) ----------
["PG_IDENTITY_DATA",
"PG_CONSTRUCTION","PG_GEOMETRY"];
# ----------------------------------------
indexOf = List.IndexOf(list=groupByKey.unique_keys, element=code_block_3)
getItemAtIndex = List.GetItemAtIndex(list=groupByKey.groups, index=indexOf)
parameterType = Parameter.ParameterType(parameter=getItemAtIndex)
code_block_4 = CodeBlock(a=parameterType) { a != "Invalid"; }
filterByBoolMask = List.FilterByBoolMask(list=getItemAtIndex, mask=code_block_4)
code_block_5 = CodeBlock(ParacanSet=filterByBoolMask.in) { ParacanSet; }
flatten_2 = List.Flatten(list=code_block_5)
name_2 = Parameter.Name(parameter=flatten_2)
flatten_3 = List.Flatten(list=name_2)
code_block_6 = CodeBlock { "s"; }
count = List.Count(list=flatten_3)
cycle = List.Cycle(list=code_block_6, amount=count)
boolean = BoolSelector(true)
python_script = Python(IN[0]=flatten_3, IN[1]=cycle, IN[2]=boolean)
# ---------- python_script.python (214 lines) ----------
#Copyright (c) mostafa el ayoubi ,  2016
#Data-Shapes http://www.data-shapes.net , elayoubi.mostafa@gmail.com

import clr
clr.AddReference('System.Windows.Forms')
clr.AddReference('System.Drawing')

from System.Drawing import Point
from System.Windows.Forms import Application, Button, Form, Label, TextBox, CheckBox, FolderBrowserDialog, OpenFileDialog, DialogResult, ComboBox, FormBorderStyle
from System.Collections.Generic import *

clr.AddReference('RevitAPIUI')
from  Autodesk.Revit.UI import Selection

clr.AddReference('RevitNodes')
import Revit
clr.ImportExtensions(Revit.Elements)
clr.ImportExtensions(Revit.GeometryConversion)

clr.AddReference('RevitServices')
from RevitServices.Persistence import DocumentManager
doc = DocumentManager.Instance.CurrentDBDocument
uidoc = DocumentManager.Instance.CurrentUIApplication.ActiveUIDocument

class MultiTextBoxForm(Form):
	

    def __init__(self):
        self.Text = 'Data-Shapes | Multi Input UI'
        self.output = []
        self.values = []

    def setclose(self, sender, event):
    	cbindexread = 0
    	for f in self.output:
    		if f.GetType() == TextBox:
    			self.values.append(f.Text)
    		if f.GetType() == CheckBox:
    			self.values.append(f.Checked)
    		if f.GetType() == Button:
    			if f.Tag == None :
    				self.values.append(f.Text)
    			else:
    				self.values.append(f.Tag)
    		if f.GetType() == ComboBox:
    			self.values.append(globals() ['dict%d'%(cbindexread)][f.Text])
    			cbindexread += 1
    	self.Close()

    def reset(self, sender, event):
		pass

    def openfile(self, sender, event):
		ofd = OpenFileDialog()
		dr = ofd.ShowDialog()
		if dr == DialogResult.OK:
			sender.Text = ofd.FileName

    def opendirectory(self, sender, event):
		fbd = FolderBrowserDialog()
		dr = fbd.ShowDialog()
		if dr == DialogResult.OK:
			sender.Text = fbd.SelectedPath

    def pickobjects(self, sender, event):
		sel = uidoc.Selection.PickObjects(Selection.ObjectType.Element,'')
		selelem = [doc.GetElement(s.ElementId) for s in sel]
		sender.Tag = (selelem)

    def pickfaces(self, sender, event):
		selface = uidoc.Selection.PickObjects(Selection.ObjectType.Face,'')
		faces = [uidoc.Document.GetElement(s).GetGeometryObjectFromReference(s).ToProtoType(True) for s in selface]
		sender.Tag = [i for f in faces for i in f]

    def pickedges(self, sender, event):
		seledge = uidoc.Selection.PickObjects(Selection.ObjectType.Edge,'')
		edges = [uidoc.Document.GetElement(s).GetGeometryObjectFromReference(s).AsCurve().ToProtoType(True) for s in seledge]
		sender.Tag = edges

    def topmost(self):
		self.TopMost = True
	


form = MultiTextBoxForm()
form.topmost()

xlabel = 25
xinput = 170
y = 10
fields = []
error = 0
cbindex = 0
#Input form

if isinstance(IN[0],list):
	inputnames = IN[0]
else:
	inputnames = [IN[0]]

if isinstance(IN[1],list):
	inputtypes = IN[1]
else:
	inputtypes = [IN[1]]

for i,j in zip(inputnames,inputtypes):
	label = Label()
	label.Location = Point(xlabel,y+4)
	label.Height = 20
	label.Width = 150
	label.Text = str(i)
	form.Controls.Add(label)
	if isinstance(j,list):
		cb = ComboBox()
		cb.Location = Point(xinput,y)
		cb.Width = 125
		globals()['dict%d'%(cbindex)] = {}
		try :
			for k in j:
				globals()['dict%d'%(cbindex)][k.Name] = k
				cb.Items.Add(k.Name)
		except :
			for k in j:
				try:
					globals()['dict%d'%(cbindex)][str(k)] = k
				except:
					globals()['dict%d'%(cbindex)][k.encode('utf-8').decode('utf-8')] = k
				cb.Items.Add(k)
		form.Controls.Add(cb)
		form.output.append(cb)
		cbindex += 1
	elif j == 's':
		tb = TextBox()
		tb.Text = ""
		tb.Width = 100
		tb.Location = Point(xinput,y)
		form.Controls.Add(tb)
		form.Controls.Add(label)
		form.output.append(tb)
	elif j == 'bool':
		yn = CheckBox()
		yn.Location = Point(xinput,y)
		yn.Text = 'Yes/No'
		form.Controls.Add(yn)
		form.output.append(yn)
	elif j == 'fp':
		fp = Button()
		fp.Width = 150
		fp.Text = 'FilePath'
		fp.Location = Point(xinput,y)
		form.Controls.Add(fp)
		fp.Click += form.openfile
		form.output.append(fp)
	elif j == 'dp':
		dp = Button()
		dp.Width = 150
		dp.Text = 'DirectoryPath'
		dp.Location = Point(xinput,y)
		form.Controls.Add(dp)
		dp.Click += form.opendirectory
		form.output.append(dp)
	elif j == 'se':
		se = Button()
		se.Width = 150
		se.Text = 'Select model element(s)'
		se.Location = Point(xinput,y)
		form.Controls.Add(se)
		se.Click += form.pickobjects
		form.output.append(se)
	elif j == 'sf':
		sf = Button()
		sf.Width = 150
		sf.Text = 'Select face(s)'
		sf.Location = Point(xinput,y)
		form.Controls.Add(sf)
		sf.Click += form.pickfaces
		form.output.append(sf)
	elif j == 'sed':
		sed = Button()
		sed.Width = 150
		sed.Text = 'Select Edge(s)'
		sed.Location = Point(xinput,y)
		form.Controls.Add(sed)
		sed.Click += form.pickedges
		form.output.append(sed)

	else :
		error = 'One or more input types are invalid, visit http://www.data-shapes.net for more informations'
	y+= 25


button = Button()
button.Text = 'Set values'
button.Width = 100
button.Location = Point (100,y+30)
button.Click += form.setclose
form.Controls.Add(button)

form.MaximizeBox = False
form.MinimizeBox = False
form.FormBorderStyle = FormBorderStyle.FixedSingle


form.Height = y + 120


if error == 0 and IN[2] == True:
	Application.Run(form)
	result = form.values
	OUT = result,True

elif IN[2] == False:
	result = "Set toggle to true!"
	OUT = result,False
# ----------------------------------------
code_block_7 = CodeBlock { 0; }
getItemAtIndex_2 = List.GetItemAtIndex(list=python_script, index=code_block_7)
code_block_8 = CodeBlock(a=getItemAtIndex_2) { a!=""; }
filterByBoolMask_2 = List.FilterByBoolMask(list=flatten_3, mask=code_block_8)
toNumber = String.ToNumber(str=getItemAtIndex_2)
isNull = Object.IsNull(obj=toNumber)
if_ = If(test=isNull, true=getItemAtIndex_2, false=toNumber)
filterByBoolMask_3 = List.FilterByBoolMask(list=if_, mask=code_block_8)
ʳʰʸᵗʰᵐ_elements = Rhythm.Revit.Elements.Elements.SetParameterValueByNameCaSeiNSeNSiTiVe(element=duplicate, parameterName=filterByBoolMask_2.in, value=filterByBoolMask_3.in, lacing=Longest)
ʳʰʸᵗʰᵐ_elements_2 = Rhythm.Revit.Elements.Elements.GetParameterValueByNameCaSeiNSeNSiTiVe(element=elementType, parameterName=name_2)
