# Dynamo graph script.dyn (Dynamo 2.3.0.5885)
# packages: Rhythm 2020.7.25, BN-NormalNode 0.0.1, Data-Shapes 2022.2.96

categories = Categories("OST_Walls")
selectByRectangleandCategory = NormalNode.Selection.SelectByRectangleandCategory(category=categories)
code_block = CodeBlock()
# ---------- code_block.designscript (8 lines) ----------
["Base Offset",
"Top Constraint",
"Top Offset"];

0;
1;
2;
3;
# ----------------------------------------
code_block_2 = CodeBlock(a=code_block.out0) { a; }
code_block_3 = CodeBlock()
# ---------- code_block_3.designscript (4 lines) ----------
["Base Constraint",
"Base Offset",
"Top Constraint",
"Unconnected Height"];
# ----------------------------------------
ʳʰʸᵗʰᵐ_elements = Rhythm.Revit.Elements.Elements.GetParameterValueByNameTypeOrInstance(element=selectByRectangleandCategory, parameterName=code_block_3@L1)
transpose = List.Transpose(lists=ʳʰʸᵗʰᵐ_elements)
code_block_4 = CodeBlock { 2; }
getItemAtIndex = List.GetItemAtIndex(list=transpose@L2, index=code_block_4)
code_block_5 = CodeBlock(a=getItemAtIndex) { a=="Unconnected"; }
filterByBoolMask = List.FilterByBoolMask(list=transpose, mask=code_block_5)
getItemAtIndex_2 = List.GetItemAtIndex(list=filterByBoolMask.in@L2, index=code_block.out2)
code_block_6 = CodeBlock { "SetUnconectedHeight"; "set"; true; "cancel"; 250; 200; 100; }
code_block_7 = CodeBlock { "(-)BaseOffset"; "100"; true; }
textbox_data = Custom[TextBox Data](InputName=code_block_7.out0, DefaultText=code_block_7.out1, IsNumberEntry=code_block_7.out2)  # package Data-Shapes; Create Data for TextBox input in UI.MultipleInputForm ++ . Check out www.data-shapes.net for more informations
multipleinputform = Custom[MultipleInputForm ++](Description_optional=code_block_6.out0, ButtonText_optional=code_block_6.out1, Inputs=textbox_data, Toggle=code_block_6.out2, CancelButtonText_optional=code_block_6.out3, MaxHeight_optional=code_block_6.out4, Width_optional=code_block_6.out5, LabelWidth_optional=code_block_6.out6)  # package Data-Shapes; Create a form with multiple inputs. see www.data-shapes.net for tutorials and infos!
flatten = List.Flatten(list=multipleinputform.User_Inputs)
code_block_8 = CodeBlock(Baseoffsettrue=flatten) { -Baseoffsettrue[0]; }
getItemAtIndex_3 = List.GetItemAtIndex(list=filterByBoolMask.in@L2, index=code_block.out4)
code_block_9 = CodeBlock(a=getItemAtIndex_2, Baseoffset=code_block_8, UnconnectedHeight=getItemAtIndex_3) { a+(-a)+Baseoffset; UnconnectedHeight+DSCore.Math.Round(a); }
getItemAtIndex_4 = List.GetItemAtIndex(list=filterByBoolMask.in@L2, index=code_block.out1)
list_create = List.Create(item0=code_block_9.out0, item1=getItemAtIndex_4, item2=code_block_9.out1)
ʳʰʸᵗʰᵐ_elements_2 = Rhythm.Revit.Elements.Elements.SetParameterByNameTypeOrInstance(element=selectByRectangleandCategory, parameterName=code_block_2@L1, value=list_create@L2)
ʳʰʸᵗʰᵐ_elements_3 = Rhythm.Revit.Elements.Elements.GetParameterValueByNameTypeOrInstance(element=ʳʰʸᵗʰᵐ_elements_2, parameterName=code_block_2)
