# Dynamo graph script.dyn (Dynamo 2.19.3.6394)
# packages: spring nodes 132.2.5, Structural Design 2023.10.10

boolean = BoolSelector(true)
pickElementsByRectangle = StructuralDesign.Model.Selection.PickElementsByRectangle(refresh=boolean)
code_block = CodeBlock(A=pickElementsByRectangle) { A; }
string_from_object = FromObject(obj=code_block)
code_block_2 = CodeBlock(A=string_from_object) { A=="Group"; }
filterByBoolMask = List.FilterByBoolMask(list=code_block, mask=code_block_2)
boolean_2 = BoolSelector(true)
selectInRevit = Custom[Springs.SelectInRevit](element=filterByBoolMask.out, reset=boolean_2)  # package spring nodes; Selects the input elements inside the Revit UI.
