# Dynamo graph script.dyn (Dynamo 2.6.1.8786)
# packages: RIE 2020.11.18, spring nodes 132.2.5, Rhythm 2020.7.25, Data-Shapes 2022.2.96, Clockwork for Dynamo 2.x 2.3.0, OpenMEP 1.0.0

code_block = CodeBlock { "Select Element in Activeview With Same Parameter"; "Select"; true; "Cancle"; 400; 150; }
code_block_2 = CodeBlock { "WithAll-Category"; false; "Yes---No"; }
boolean_input = Custom[Boolean input](InputName=code_block_2.out0, DefaultValue=code_block_2.out1, SideText=code_block_2.out2)  # package Data-Shapes; Creates a boolean input for UI.MultipleInputForm ++ . Check out www.data-shapes.net for more infos!
code_block_3 = CodeBlock { "Select Parameter"; 370; true; false; }
boolean = BoolSelector(false)
pickOrderElements = OpenMEPRevit.Document.Selection.PickOrderElements(flag=boolean)
parameters = Element.Parameters(element=pickOrderElements)
flatten = List.Flatten(list=parameters)
name = Parameter.Name(parameter=flatten)  # graph output
listview_data = Custom[Listview Data](InputName=code_block_3.out0, Keys=name, Values=flatten, Height_optionnal=code_block_3.out1, SortItems_optionnal=code_block_3.out2, ShowId_optionnal=code_block_3.out3)  # package Data-Shapes; Create data for ListView input in UI.MultiInputForm ++ . Check out www.data-shapes.net for more infos.
list_create = List.Create(item0=boolean_input, item1=listview_data)
flatten_2 = List.Flatten(list=list_create)
multipleinputform = Custom[MultipleInputForm ++](Description_optional=code_block.out0, ButtonText_optional=code_block.out1, Inputs=flatten_2, Toggle=code_block.out2, CancelButtonText_optional=code_block.out3, Width_optional=code_block.out4, LabelWidth_optional=code_block.out5)  # package Data-Shapes; Create a form with multiple inputs. see www.data-shapes.net for tutorials and infos!
code_block_4 = CodeBlock(element=multipleinputform.User_Inputs, type=multipleinputform.User_Inputs) { element[1]; type[0]; }
all_elements_in_active_view = ElementsInView()
category = Custom[Element.Category+](element=pickOrderElements)  # package Clockwork for Dynamo 2.x; Returns the category of a given element. Unlike the OOTB node Element.GetCategory, it will work for subcategories, families, family documents, schedules, graphics styles and view filters as well.
RIE_ActiveView = Custom[RIE_ActiveView]()  # package RIE; Returns active view in current document.
all_elements_of_category_in_view = ElementsOfCategoryInView(Category=category.category, View=RIE_ActiveView)
RIE_If = Custom[RIE_If](Test=code_block_4.out1, True=all_elements_in_active_view, False=all_elements_of_category_in_view)  # package RIE; An If node that keeps list structure, empty lists and so forth.
flatten_3 = List.Flatten(list=RIE_If)
name_2 = Parameter.Name(parameter=code_block_4.out0)
ʳʰʸᵗʰᵐ_elements = Rhythm.Revit.Elements.Elements.GetParameterValueByNameTypeOrInstance(element=flatten_3, parameterName=name_2@L2, lacing=Longest)
string_from_object = FromObject(obj=ʳʰʸᵗʰᵐ_elements)
value = Parameter.Value(parameter=code_block_4.out0)
string_from_object_2 = FromObject(obj=value)
eq = string_from_object@L2 == string_from_object_2@L2  # lacing=Longest
allTrue = List.AllTrue(list=eq@L2)
filterByBoolMask = List.FilterByBoolMask(list=flatten_3, mask=allTrue)
refresh_select_element = BoolSelector(true)  # graph input
selectInRevit = Custom[Springs.SelectInRevit](element=filterByBoolMask.in, reset=refresh_select_element)  # package spring nodes; Selects the input elements inside the Revit UI.
