# Dynamo graph script.dyn (Dynamo 2.6.1.8786)
# packages: OpenMEP 1.0.0, Data-Shapes 2022.2.103, RIE 2021.7.1, spring nodes 132.2.5

boolean = BoolSelector(true)
RIE_ActiveView = Custom[RIE_ActiveView](Refresh=boolean)  # package RIE; Returns active view in current document.
all_elements_in_view_s = Custom[All Elements In View(s)](Views=RIE_ActiveView)  # package Data-Shapes; Retrieves all visible element in a view or a set of views
flatten = List.Flatten(list=all_elements_in_view_s)
pickOrderElements = OpenMEPRevit.Document.Selection.PickOrderElements(flag=boolean)
elementType = Element.ElementType(element=pickOrderElements)
id = Element.Id(element=elementType)
elementType_2 = Element.ElementType(element=flatten)
id_2 = Element.Id(element=elementType_2)
eq = id == id_2  # lacing=CrossProduct
filterByBoolMask = List.FilterByBoolMask(list=flatten, mask=eq@L2)
flatten_2 = List.Flatten(list=filterByBoolMask.in)
selectInRevit = Custom[Springs.SelectInRevit](element=flatten_2)  # package spring nodes; Selects the input elements inside the Revit UI.
