# Dynamo graph script.dyn (Dynamo 2.3.2.15696)
# packages: Genius Loci 2020.8.3, RIE 2020.11.18, Data-Shapes 2022.2.96

boolean = BoolSelector(true)
activeView = Custom[RIE.ActiveView](Refresh=boolean)  # package RIE; Returns active view in current document.
code_block = CodeBlock { "ADD FILTER TO ACTIVE VIEW"; "ADD"; true; "CANCLE"; 800; 600; 200; }
code_block_2 = CodeBlock { "Select filter to add"; 500; true; false; }
element_types = ElementTypes("FilterElement")
all_elements_of_type = Custom[All Elements of Type+](type=element_types)  # package Genius Loci; Get the instances of the given type. Works with ElementType, FamilyType, ViewFamilyType, Wall/Floor/Roof/CeilingType, GroupType, FilledRegionType and TextNoteType.
name = Element.Name(element=all_elements_of_type)
listview_data = Custom[Listview Data](InputName=code_block_2.out0, Keys=name, Values=all_elements_of_type, Height_optionnal=code_block_2.out1, SortItems_optionnal=code_block_2.out2, ShowId_optionnal=code_block_2.out3)  # package Data-Shapes; Create data for ListView input in UI.MultiInputForm ++ . Check out www.data-shapes.net for more infos.
multipleinputform = Custom[MultipleInputForm ++](Description_optional=code_block.out0, ButtonText_optional=code_block.out1, Inputs=listview_data, Toggle=code_block.out2, CancelButtonText_optional=code_block.out3, MaxHeight_optional=code_block.out4, Width_optional=code_block.out5, LabelWidth_optional=code_block.out6)  # package Data-Shapes; Create a form with multiple inputs. see www.data-shapes.net for tutorials and infos!
code_block_3 = CodeBlock(filter=multipleinputform.User_Inputs) { filter[0]; }
flatten = List.Flatten(list=code_block_3)
create_overridegraphicsettings = Custom[Create OverrideGraphicSettings](lacing=Longest)  # package Genius Loci; Create a OverrideGraphicSettings (All graphic inputs are optional). Unlike the OOTB OverrideGraphicSettings.ByProperties node, the Foreground and background patterns are available. Note : Prior to Revit 2019, the materials have only one surface pattern and one cut pattern.
view_add_filter = Custom[View Add Filter](view=activeView, filterElement=flatten, overrides=create_overridegraphicsettings, lacing=Longest)  # package Genius Loci; Add a Filter and set its overrides to a view. Unlike the OOTB nodes, it also works with SelectionFilterElement. For use with the Create OverrideGraphicSettings node.
