# Dynamo graph script.dyn (Dynamo 2.3.0.5885)
# packages: Structural Design 2019.12.11

code_block = CodeBlock { 1; "Pick Orther element"; true; }
pickObjects = StructuralDesign.Model.Selection.PickObjects(objectType=code_block.out0, statusPrompt=code_block.out1, refresh=code_block.out2)
geometry = Element.Geometry(element=pickObjects)
code_block_2 = CodeBlock { 4; }
cycle = List.Cycle(list=geometry@L2, amount=code_block_2)
code_block_3 = CodeBlock { [0.25,0.75]; }
list_create = List.Create()  # unwired: item0, item1
code_block_4 = CodeBlock { 50; }
length = Curve.Length(curve=geometry)
div = code_block_4 / length
code_block_5 = CodeBlock(a=div) { 1-a; }
combine = List.Combine(comb=list_create, list1=div, list2=code_block_5)
flatten = List.Flatten(list=combine@L3)
addItemToFront = List.AddItemToFront(item=code_block_3, list=flatten@L2)
flatten_2 = List.Flatten(list=addItemToFront@L3)
pointAtParameter = Curve.PointAtParameter(curve=cycle, param=flatten_2, lacing=Longest)
normalAtParameter = Curve.NormalAtParameter(curve=cycle@L2, param=flatten_2@L1, lacing=Longest)
code_block_6 = CodeBlock { 800; }
byStartPointDirectionLength = Line.ByStartPointDirectionLength(startPoint=pointAtParameter, direction=normalAtParameter, length=code_block_6, lacing=Longest)
extendStart = Curve.ExtendStart(curve=byStartPointDirectionLength, distance=code_block_6)
byCurve = ModelCurve.ByCurve(curve=extendStart)
