# Dynamo graph script.dyn (Dynamo 2.5.0.7460)
# packages: LinkDWG 0.3.91, spring nodes 132.2.5, Dynamo for Rebar 2.0.2, LinkDWG2 0.4.18, KYSUDO 2019.8.5, Orchid 203.3.1.8192, Data-Shapes 2022.2.96, RIE 2020.11.18, Chynamo 0.8.5, Rhythm 2020.7.25, Structural Design 2019.12.11, Structural Design 2023.10.10

o_string_join = Orchid.Common.String.Join()  # unwired: string, separator
code_block = CodeBlock { "Rebar Was created"; }
boolean = BoolSelector(true)
code_block_2 = CodeBlock { "Create Rebar FromCAD"; "Create"; true; "Cancel"; 700; 500; 300; }
code_block_3 = CodeBlock()
# ---------- code_block_3.designscript (11 lines) ----------
"Run Package in FirstTimes";
true;
"Select?";
"Create MainRebar";
"Create Stirrup";
true;
"Create StirrupAdd at addRebar";
"Run?";
"Spacing Stirrup ADD";
"500";
true;
# ----------------------------------------
boolean_input = Custom[Boolean input](InputName=code_block_3.out0, DefaultValue=code_block_3.out1, SideText=code_block_3.out7)  # package Data-Shapes; Creates a boolean input for UI.MultipleInputForm ++ . Check out www.data-shapes.net for more infos!
boolean_input_2 = Custom[Boolean input](InputName=code_block_3.out3, DefaultValue=code_block_3.out5, SideText=code_block_3.out2)
boolean_input_3 = Custom[Boolean input](InputName=code_block_3.out4, DefaultValue=code_block_3.out5, SideText=code_block_3.out2)
boolean_input_4 = Custom[Boolean input](InputName=code_block_3.out6, DefaultValue=code_block_3.out5, SideText=code_block_3.out2)
textbox_data = Custom[TextBox Data](InputName=code_block_3.out8, DefaultText=code_block_3.out9, IsNumberEntry=code_block_3.out10)  # package Data-Shapes; Create Data for TextBox input in UI.MultipleInputForm ++ . Check out www.data-shapes.net for more informations
code_block_4 = CodeBlock { "Select Beams"; "Selects"; }
categories = Categories("OST_StructuralFraming")
selectmodelelements_data = Custom[SelectModelElements Data](InputName=code_block_4.out0, ButtonText=code_block_4.out1, CategoryFilter=categories)  # package Data-Shapes; Creates a Revit element selection input for UI.MultipleInputForm++ . Check out www.data-shapes.net for more infos!
code_block_5 = CodeBlock { "Select face"; "Pick"; }
selectfaces_data = Custom[SelectFaces Data](InputName=code_block_5.out0, ButtonText=code_block_5.out1)  # package Data-Shapes; Creates a Revit face selection input for UI.MultipleInputForm++. Check out www.data-shapes.net for more infos!
list_create = List.Create(item0=boolean_input, item1=boolean_input_2, item2=boolean_input_3, item3=boolean_input_4, item4=textbox_data, item5=selectmodelelements_data, item6=selectfaces_data)
boolean_2 = BoolSelector(true)
multipleinputform = Custom[MultipleInputForm ++](Description_optional=code_block_2.out0, ButtonText_optional=code_block_2.out1, Inputs=list_create, Toggle=boolean_2, CancelButtonText_optional=code_block_2.out3, MaxHeight_optional=code_block_2.out4, Width_optional=code_block_2.out5, LabelWidth_optional=code_block_2.out6)  # package Data-Shapes; Create a form with multiple inputs. see www.data-shapes.net for tutorials and infos!
code_block_6 = CodeBlock(RunMeFirst=multipleinputform.User_Inputs, CreateMainRebar=multipleinputform.User_Inputs, CreateStirrup=multipleinputform.User_Inputs, Beams=multipleinputform.User_Inputs, Surface=multipleinputform.User_Inputs, CreateStirrupAdd=multipleinputform.User_Inputs, SpacingStirrupAdd=multipleinputform.User_Inputs) { RunMeFirst[0]; CreateMainRebar[1]; CreateStirrup[2]; Beams[5]; Surface[6]; CreateStirrupAdd[3]; SpacingStirrupAdd[4]; }
code_block_7 = CodeBlock()
# ---------- code_block_7.designscript (4 lines) ----------
"Select Main Rebar in Cad and Select Properties at the same time ";
"Select Stirrups";
"Select Circle in cad";
"Select REBARADD to create Stirrupadd";
# ----------------------------------------
selectObjects = Custom[SelectObjects](Run=boolean, ShowSwitchAlert=code_block_6.out1, Message=code_block_7.out0)  # package LinkDWG
count = List.Count(list=selectObjects)
code_block_8 = CodeBlock(n=count) { [0..n-1..2]; [1..n..2]; }
getItemAtIndex = List.GetItemAtIndex(list=selectObjects, index=code_block_8.out0)
flatten = List.Flatten(list=getItemAtIndex)
count_2 = List.Count(list=flatten)
getItemAtIndex_2 = List.GetItemAtIndex(list=selectObjects, index=code_block_8.out1)
flatten_2 = List.Flatten(list=getItemAtIndex_2)
count_3 = List.Count(list=flatten_2)
eq = count_2 == count_3
list_create_2 = List.Create(item0=flatten, item1=flatten_2)
code_block_9 = CodeBlock { "Please select again"; }
if_ = RefactoredIf(test=eq, true=list_create_2, false=code_block_9)
code_block_10 = CodeBlock(Rebarcurves=if_, RebarProperties=if_) { Rebarcurves[0]; RebarProperties[1]; }
polylineProperties = Custom[PolylineProperties](COM_Polyline=code_block_10.out0)  # package LinkDWG
uniqueItems = List.UniqueItems(list=polylineProperties.4_Vertices@L2)
byPoints = PolyCurve.ByPoints(points=uniqueItems)
selectObjects_2 = Custom[SelectObjects](Run=code_block_6.out1, ShowSwitchAlert=boolean, Message=code_block_7.out2)
circleProperties = Custom[CircleProperties](COM_Circle=selectObjects_2)  # package LinkDWG
code_block_11 = CodeBlock { 0.5; }
pointAtParameter = Surface.PointAtParameter(surface=code_block_6.out4, u=code_block_11, v=code_block_11)
normalAtParameter = Surface.NormalAtParameter(surface=code_block_6.out4, u=code_block_11, v=code_block_11)
byOriginNormal = Plane.ByOriginNormal(origin=pointAtParameter, normal=normalAtParameter)
element_faces = Custom[Element Faces](element=code_block_6.out3)  # package KYSUDO
code_block_12 = CodeBlock(a=element_faces.Top) { a; }
XAxis = Vector.XAxis()
getLocation = Element.GetLocation(element=code_block_6.out3)
direction = Line.Direction(line=getLocation)
isParallel = Vector.IsParallel(vector=XAxis, other=direction)
code_block_13 = CodeBlock { 0; 1; }
if_2 = RefactoredIf(test=isParallel, true=code_block_13.out0, false=code_block_13.out1)
code_block_14 = CodeBlock { 0.5; }
getIsoline = Surface.GetIsoline(surface=code_block_12, isoDirection=if_2, parameter=code_block_14)
flatten_3 = List.Flatten(list=getIsoline)
length = Curve.Length(curve=flatten_3)
maximumItem = List.MaximumItem(list=length)
indexOf = List.IndexOf(list=length, element=maximumItem)
getItemAtIndex_3 = List.GetItemAtIndex(list=flatten_3, index=indexOf)
pointAtParameter_2 = Curve.PointAtParameter(curve=getItemAtIndex_3, param=code_block_11)
closestPointTo = Geometry.ClosestPointTo(geometry=byOriginNormal, other=pointAtParameter_2)
byStartPointEndPoint = Line.ByStartPointEndPoint(startPoint=circleProperties.0_Center, endPoint=closestPointTo)
direction_2 = Line.Direction(line=byStartPointEndPoint)
length_2 = Curve.Length(curve=byStartPointEndPoint)
translate = Geometry.Translate(geometry=byPoints, direction=direction_2, distance=length_2, lacing=Longest)
ZAxis = Vector.ZAxis()
code_block_15 = CodeBlock { 0; 90; }
if_3 = If(test=isParallel, true=code_block_15.out0, false=code_block_15.out1)
rotate = Geometry.Rotate(geometry=translate, origin=closestPointTo, axis=ZAxis, degrees=if_3, lacing=Longest)
XAxis_2 = Vector.XAxis()
YAxis = Vector.YAxis()
if_4 = If(test=isParallel, true=XAxis_2, false=YAxis)
code_block_16 = CodeBlock { 90; }
rotate_2 = Geometry.Rotate(geometry=rotate, origin=closestPointTo, axis=if_4, degrees=code_block_16, lacing=Longest)
byStartPointEndPoint_2 = Line.ByStartPointEndPoint(startPoint=closestPointTo, endPoint=pointAtParameter_2)
code_block_17 = CodeBlock { 0.5; }
normalAtParameter_2 = Curve.NormalAtParameter(curve=byStartPointEndPoint_2, param=code_block_17)
reverse = Vector.Reverse(vector=normalAtParameter_2)
code_block_18 = CodeBlock { "b"; }
ʳʰʸᵗʰᵐ_elements = Rhythm.Revit.Elements.Elements.GetParameterValueByNameTypeOrInstance(element=code_block_6.out3, parameterName=code_block_18)
rebarHostCover = StructuralDesign.Rebar.Properties.RebarHostCover(element=code_block_6.out3)
code_block_19 = CodeBlock(b=ʳʰʸᵗʰᵐ_elements, cover=rebarHostCover.Other) { b/2-cover-20; }
translate_2 = Geometry.Translate(geometry=rotate_2, direction=reverse, distance=code_block_19, lacing=Longest)
explode = Geometry.Explode(geometry=translate_2)
length_3 = Curve.Length(curve=explode)
code_block_20 = CodeBlock(Lengths=length_3) { Lengths>100; }
filterByBoolMask = List.FilterByBoolMask(list=explode, mask=code_block_20)
code_block_21 = CodeBlock { 200; }
merge = Custom[Springs.LineLoop.Merge](lines=filterByBoolMask.in, margin=code_block_21)  # package spring nodes; Attempts to join lines into a single chain of joined curves. The node returns the new lines as a chain and with the original order. The success outputs returns the success of the execution as a true/false boolean.
code_block_22 = CodeBlock(a=code_block_6.out3) { a[0]; }
code_block_23 = CodeBlock(Beams=code_block_22) { Beams; }

# group: Rebar Properties
byJoinedCurves = PolyCurve.ByJoinedCurves(curves=merge.lines)
id = Element.Id(element=code_block_23)
code_block_24 = CodeBlock { 0.5; }
normalAtParameter_3 = Curve.NormalAtParameter(curve=getLocation, param=code_block_24)

rebarStyle = RevitRebarStyle("Standard")
rebarBarType = RevitRebarBarType("Ø16")
rebarHookOrientation = RevitRebarHookOrientation("Left")
rebarHookType = RevitRebarHookType("None")

# group: Create rebar
byCurve = Rebar.ByCurve(curve=byJoinedCurves, hostElementId=id, rebarStyle=rebarStyle, rebarBarType=rebarBarType, startHookOrientation=rebarHookOrientation, endHookOrientation=rebarHookOrientation, startHookType=rebarHookType, endHookType=rebarHookType, vector=normalAtParameter_3, lacing=Longest)

code_block_25 = CodeBlock(A=byCurve) { A; }
code_block_26 = CodeBlock(b=ʳʰʸᵗʰᵐ_elements, cover=rebarHostCover.Other) { b; cover; }
blockProperties = Custom[BlockProperties](COM_Block=code_block_10.out1)  # package LinkDWG

# group: Properties MainDiameter
attributeProperty = Custom[AttributeProperty](COM_Attributes=blockProperties.7_COM_NestAttributes)  # package LinkDWG2
code_block_27 = CodeBlock { 1; "c"; "%"; true; }
contains = String.Contains(str=attributeProperty.2_Value, searchFor=code_block_27.out2, ignoreCase=code_block_27.out3)
filterByBoolMask_2 = List.FilterByBoolMask(list=attributeProperty.2_Value, mask=contains)
replace = String.Replace(str=filterByBoolMask_2.in, searchFor=code_block_27.out1, replaceWith=code_block_27.out2)
split = String.Split(str=replace, separator0=code_block_27.out2)
flatten_4 = List.Flatten(list=split@L2)
code_block_28 = CodeBlock { 0; 1; }
quantity = List.GetItemAtIndex(list=flatten_4@L2, index=code_block_28.out0)
toNumber = String.ToNumber(str=quantity)
diameter = List.GetItemAtIndex(list=flatten_4@L2, index=code_block_28.out1)
code_block_29 = CodeBlock(Dia=diameter) { "Ø"+Dia; }
byName = RebarBarType.ByName(name=code_block_29)

# group: Set Properties
boolean_3 = BoolSelector(true)
formula = Formula("(b-cover*2-20*2);", b=code_block_26.b, cover=code_block_26.cover, lacing=Longest)
count_4 = List.Count(list=toNumber)
cycle = List.Cycle(list=formula, amount=count_4)
code_block_30 = CodeBlock { "Type"; }

boolean_4 = BoolSelector(true)
setLayoutAsFixedNumber = StructuralDesign.Rebar.Layout.SetLayoutAsFixedNumber(rebar=code_block_25, arrayLength=cycle, numberOfBarPositions=toNumber, barsOnNormalSide=boolean_4, includeFirstBar=boolean_4, includeLastBar=boolean_4)
ʳʰʸᵗʰᵐ_elements_2 = Rhythm.Revit.Elements.Elements.SetParameterByNameTypeOrInstance(element=setLayoutAsFixedNumber, parameterName=code_block_30, value=byName)
code_block_31 = CodeBlock { "Quantity"; }
ʳʰʸᵗʰᵐ_elements_3 = Rhythm.Revit.Elements.Elements.GetParameterValueByNameTypeOrInstance(element=ʳʰʸᵗʰᵐ_elements_2, parameterName=code_block_31)
elementType = Element.ElementType(element=ʳʰʸᵗʰᵐ_elements_2)
name = Element.Name(element=elementType)
code_block_32 = CodeBlock(QuantityS=ʳʰʸᵗʰᵐ_elements_3, Bartype=name) { QuantityS+Bartype; }
code_block_33 = CodeBlock { "You Created: "; "+"; }
concat = String.Concat(string0=code_block_32, string1=code_block_33.out1)
geometry = Element.Geometry(element=code_block_6.out3)
getLocation_2 = Element.GetLocation(element=code_block_6.out3)
code_block_34 = CodeBlock { 0.5; }
pointAtParameter_3 = Curve.PointAtParameter(curve=getLocation_2, param=code_block_34)
direction_3 = Line.Direction(line=getLocation_2)
byOriginNormal_2 = Plane.ByOriginNormal(origin=pointAtParameter_3, normal=direction_3)
intersect = Geometry.Intersect(geometry=geometry, other=byOriginNormal_2)
flatten_5 = List.Flatten(list=intersect)
perimeterCurves = Surface.PerimeterCurves(surface=flatten_5)
byJoinedCurves_2 = PolyCurve.ByJoinedCurves(curves=perimeterCurves)
reverse_2 = Vector.Reverse(vector=direction_3)
length_4 = Curve.Length(curve=getLocation_2)
code_block_35 = CodeBlock(length=length_4) { length/2; }
translate_3 = Geometry.Translate(geometry=byJoinedCurves_2, direction=reverse_2, distance=code_block_35)
code_block_36 = CodeBlock(length=length_4) { -100; length+200; }
translate_4 = Geometry.Translate(geometry=translate_3, direction=direction_3, distance=code_block_36.out0)
extrudeAsSolid = Curve.ExtrudeAsSolid(curve=translate_4, direction=direction_3, distance=code_block_36.out1)
byUnion = Solid.ByUnion(solids=extrudeAsSolid)
selectObjects_3 = Custom[SelectObjects](Execute=code_block_6.out2, ShowSwitchAlert=boolean)
filterDimension = Custom[FilterDimension](Run=boolean, COM_Objects=selectObjects_3)  # package LinkDWG2
dimensionProperty = Custom[DimensionProperty](COM_Dimensions=filterDimension)  # package LinkDWG2
join = List.Join(list0=dimensionProperty.1_Extline_Point1, list1=dimensionProperty.2_Extline_Point2)
uniqueItems_2 = List.UniqueItems(list=join)
list_create_3 = List.Create(item0=dimensionProperty.1_Extline_Point1, item1=dimensionProperty.2_Extline_Point2)
transpose = List.Transpose(lists=list_create_3)
flatten_6 = List.Flatten(list=transpose)
uniqueItems_3 = List.UniqueItems(list=flatten_6)
code_block_37 = CodeBlock(point=uniqueItems_3) { point[0]; point[1]; }
byStartPointEndPoint_3 = Line.ByStartPointEndPoint(startPoint=code_block_37.out0, endPoint=code_block_37.out1)
direction_4 = Line.Direction(line=byStartPointEndPoint_3)
XAxis_3 = Vector.XAxis()
isParallel_2 = Vector.IsParallel(vector=direction_4, other=XAxis_3)
X = Point.X(point=uniqueItems_2)
Y = Point.Y(point=uniqueItems_2)
if_5 = If(test=isParallel_2, true=X, false=Y)
sortByKey = List.SortByKey(list=uniqueItems_2, keys=if_5)
count_5 = List.Count(list=sortByKey.sorted_list)
code_block_38 = CodeBlock(points=sortByKey.sorted_list, n=count_5) { points[0..n-2..1]; points[1..n-1..1]; }
byStartPointEndPoint_4 = Line.ByStartPointEndPoint(startPoint=code_block_38.out0, endPoint=code_block_38.out1)
setDifference = List.SetDifference(list1=selectObjects_3, list2=filterDimension)
blockProperty = Custom[BlockProperty](COM_Blocks=setDifference)  # package LinkDWG2
byOriginNormal_3 = Plane.ByOriginNormal(origin=blockProperty.1_InsertionPoint, normal=direction, lacing=Longest)
doesIntersect = Geometry.DoesIntersect(geometry=byOriginNormal_3, other=byStartPointEndPoint_4, lacing=CrossProduct)
filterByBoolMask_3 = List.FilterByBoolMask(list=byStartPointEndPoint_4, mask=doesIntersect@L2)
code_block_39 = CodeBlock(lines=filterByBoolMask_3.in) { lines; }
flatten_7 = List.Flatten(list=code_block_39)
startPoint = Curve.StartPoint(curve=flatten_7)
translate_5 = Geometry.Translate(geometry=startPoint, direction=direction_2, distance=length_2, lacing=Longest)
rotate_3 = Geometry.Rotate(geometry=translate_5, origin=closestPointTo, axis=ZAxis, degrees=if_3, lacing=Longest)
direction_5 = Line.Direction(line=byStartPointEndPoint_2)
byOriginNormal_4 = Plane.ByOriginNormal(origin=rotate_3, normal=direction_5, lacing=Longest)
intersect_2 = Geometry.Intersect(geometry=byUnion, other=byOriginNormal_4, lacing=Longest)
flatten_8 = List.Flatten(list=intersect_2)
perimeterCurves_2 = Surface.PerimeterCurves(surface=flatten_8)
byJoinedCurves_3 = PolyCurve.ByJoinedCurves(curves=perimeterCurves_2)
code_block_40 = CodeBlock(Beams=code_block_23) { Beams; }
rebarHostCover_2 = StructuralDesign.Rebar.Properties.RebarHostCover(element=code_block_40)
code_block_41 = CodeBlock(cover=rebarHostCover_2.Other) { -cover; }
offset = Curve.Offset(curve=byJoinedCurves_3, distance=code_block_41)

# group: Rebar Properties
byJoinedCurves_4 = PolyCurve.ByJoinedCurves(curves=offset@L1)
id_2 = Element.Id(element=code_block_40)

rebarStyle_2 = RevitRebarStyle("StirrupTie")
rebarBarType_2 = RevitRebarBarType("Ø10")
rebarHookOrientation_2 = RevitRebarHookOrientation("Right")
rebarHookType_2 = RevitRebarHookType("Stirrup/Tie - 135 deg.")
code_block_42 = CodeBlock(a=flatten_7) { a[0]; }
translate_6 = Geometry.Translate(geometry=code_block_42, direction=direction_2, distance=length_2, lacing=Longest)
rotate_4 = Geometry.Rotate(geometry=translate_6, origin=closestPointTo, axis=ZAxis, degrees=if_3, lacing=Longest)
direction_6 = Line.Direction(line=rotate_4)

# group: Create rebar
byCurve_2 = Rebar.ByCurve(curve=byJoinedCurves_4, hostElementId=id_2, rebarStyle=rebarStyle_2, rebarBarType=rebarBarType_2, startHookOrientation=rebarHookOrientation_2, endHookOrientation=rebarHookOrientation_2, startHookType=rebarHookType_2, endHookType=rebarHookType_2, vector=direction_6, lacing=Longest)

nestAttributes = Custom[NestAttributes](COM_AttBlock=setDifference)  # package LinkDWG
string_from_object = FromObject(obj=nestAttributes)
code_block_43 = CodeBlock { "{"; "}"; }
split_2 = String.Split(str=string_from_object, separator0=code_block_43.out0)
split_3 = String.Split(str=split_2, separator0=code_block_43.out1)
flatten_9 = List.Flatten(list=split_3@L4)
code_block_44 = CodeBlock { "%"; }
contains_2 = String.Contains(str=flatten_9, searchFor=code_block_44)
filterByBoolMask_4 = List.FilterByBoolMask(list=flatten_9, mask=contains_2)
flatten_10 = List.Flatten(list=filterByBoolMask_4.in)

# group: Rebar Properties from cad
flatten_11 = List.Flatten(list=flatten_10)
code_block_45 = CodeBlock { "%"; "c"; "a"; 0; 3; }
contains_3 = String.Contains(str=flatten_11, searchFor=code_block_45.out0)
filterByBoolMask_5 = List.FilterByBoolMask(list=flatten_11, mask=contains_3)
replace_2 = String.Replace(str=filterByBoolMask_5.in, searchFor=code_block_45.out1, replaceWith=code_block_45.out0)
remove = String.Remove(str=replace_2, startIndex=code_block_45.out3, count=code_block_45.out4)
split_4 = String.Split(str=remove, separator0=code_block_45.out2)
code_block_46 = CodeBlock { 0; 1; }
spacingStirrup = List.GetItemAtIndex(list=split_4@L2, index=code_block_46.out1)
length_5 = Curve.Length(curve=flatten_7)
diameterStirrup = List.GetItemAtIndex(list=split_4@L2, index=code_block_46.out0)
code_block_47 = CodeBlock(Dia=diameterStirrup) { "Ø"+Dia; }

# group: Set Properties
toNumber_2 = String.ToNumber(str=spacingStirrup)
boolean_5 = BoolSelector(true)
boolean_6 = BoolSelector(false)
code_block_48 = CodeBlock { "Type"; "Hook At Start"; "Hook At End"; }
byName_2 = RebarBarType.ByName(name=code_block_47)

setLayoutAsMaximumSpacing = StructuralDesign.Rebar.Layout.SetLayoutAsMaximumSpacing(rebar=byCurve_2, spacing=toNumber_2, arrayLength=length_5, barsOnNormalSide=boolean_5, includeLastBar=boolean_6)
ʳʰʸᵗʰᵐ_elements_4 = Rhythm.Revit.Elements.Elements.SetParameterByNameTypeOrInstance(element=setLayoutAsMaximumSpacing, parameterName=code_block_48.out0, value=byName_2)
rebarHookType_3 = RevitRebarHookType("Hook-Stirrup_Tie-135")
ʳʰʸᵗʰᵐ_elements_5 = Rhythm.Revit.Elements.Elements.SetParameterByNameTypeOrInstance(element=ʳʰʸᵗʰᵐ_elements_4, parameterName=code_block_48.out1, value=rebarHookType_3, lacing=Longest)
ʳʰʸᵗʰᵐ_elements_6 = Rhythm.Revit.Elements.Elements.SetParameterByNameTypeOrInstance(element=ʳʰʸᵗʰᵐ_elements_5, parameterName=code_block_48.out2, value=rebarHookType_3, lacing=Longest)
elementType_2 = Element.ElementType(element=ʳʰʸᵗʰᵐ_elements_6)
name_2 = Element.Name(element=elementType_2)
code_block_49 = CodeBlock { "Spacing"; }
ʳʰʸᵗʰᵐ_elements_7 = Rhythm.Revit.Elements.Elements.GetParameterValueByNameTypeOrInstance(element=ʳʰʸᵗʰᵐ_elements_6, parameterName=code_block_49)
floor = Math.Floor(number=ʳʰʸᵗʰᵐ_elements_7)
code_block_50 = CodeBlock(Bartype=name_2, Spacing=floor) { " " + Bartype + "a" + Spacing+" "; }
code_block_51 = CodeBlock { "+"; }
concat_2 = String.Concat(string0=code_block_50, string1=code_block_51)
code_block_52 = CodeBlock(Mainrebar=concat, Stirrups=concat_2)
# ---------- code_block_52.designscript (4 lines) ----------
"You Created MainRebar: " + Mainrebar  +

         "             You Create Stirrup : "
+ Stirrups;
# ----------------------------------------
ʳʰʸᵗʰᵐ_helpers_simpleusermessage = Rhythm.Revit.Helpers.Helpers.SimpleUserMessage(caption=code_block, message=code_block_52)
selectObjects_4 = Custom[SelectObjects](Run=code_block_6.out5, ShowSwitchAlert=code_block_6.out5, Message=code_block_7.out3)
polylineProperties_2 = Custom[PolylineProperties](COM_Polyline=selectObjects_4)
translate_7 = Geometry.Translate(geometry=polylineProperties_2.0_PolyCurve, direction=direction_2, distance=length_2, lacing=Longest)
rotate_5 = Geometry.Rotate(geometry=translate_7, origin=closestPointTo, axis=ZAxis, degrees=if_3, lacing=Longest)
rotate_6 = Geometry.Rotate(geometry=rotate_5, origin=closestPointTo, axis=if_4, degrees=code_block_16, lacing=Longest)
translate_8 = Geometry.Translate(geometry=rotate_6, direction=reverse, distance=code_block_19, lacing=Longest)
explode_2 = Geometry.Explode(geometry=translate_8)
length_6 = Curve.Length(curve=explode_2)
code_block_53 = CodeBlock(Lengths=length_6) { Lengths>100; }
filterByBoolMask_6 = List.FilterByBoolMask(list=explode_2, mask=code_block_53)
code_block_54 = CodeBlock(q=filterByBoolMask_6.in) { q; }
code_block_55 = CodeBlock { 170; -170; }
extendStart = Curve.ExtendStart(curve=code_block_54, distance=code_block_55.out1)
extendEnd = Curve.ExtendEnd(curve=extendStart, distance=code_block_55.out1)
startPoint_2 = Curve.StartPoint(curve=extendEnd)
byCurve_3 = Custom[ByCurve](curve=extendEnd)  # package Chynamo; Create line from curve start and end points
direction_7 = Line.Direction(line=byCurve_3)
byOriginNormal_5 = Plane.ByOriginNormal(origin=startPoint_2, normal=direction_7)
intersect_3 = Geometry.Intersect(geometry=byOriginNormal_5, other=byUnion)
flatten_12 = List.Flatten(list=intersect_3)
ZAxis_2 = Vector.ZAxis()
byOriginNormal_6 = Plane.ByOriginNormal(origin=startPoint_2, normal=ZAxis_2)
flatten_13 = List.Flatten(list=byOriginNormal_6)
intersect_4 = Geometry.Intersect(geometry=flatten_12, other=flatten_13)
flatten_14 = List.Flatten(list=intersect_4)
code_block_56 = CodeBlock(cover=rebarHostCover.Other) { -cover; }
extendStart_2 = Curve.ExtendStart(curve=flatten_14, distance=code_block_56, lacing=Longest)
extendEnd_2 = Curve.ExtendEnd(curve=extendStart_2, distance=code_block_56, lacing=Longest)

# group: Rebar Properties
byJoinedCurves_5 = PolyCurve.ByJoinedCurves(curves=extendEnd_2@L1)
id_3 = Element.Id(element=code_block_23)

rebarStyle_3 = RevitRebarStyle("StirrupTie")
rebarBarType_3 = RevitRebarBarType("Ø8")
rebarHookOrientation_3 = RevitRebarHookOrientation("Left")
rebarHookType_4 = RevitRebarHookType("None")
direction_8 = Line.Direction(line=byCurve_3)

# group: Create rebar
byCurve_4 = Rebar.ByCurve(curve=byJoinedCurves_5, hostElementId=id_3, rebarStyle=rebarStyle_3, rebarBarType=rebarBarType_3, startHookOrientation=rebarHookOrientation_3, endHookOrientation=rebarHookOrientation_3, startHookType=rebarHookType_4, endHookType=rebarHookType_4, vector=direction_8, lacing=Longest)

length_7 = Curve.Length(curve=extendEnd)

# group: Set Properties
round = Math.Round(number=length_7)
boolean_7 = BoolSelector(true)
code_block_57 = CodeBlock { "Type"; "Hook At Start"; "Hook At End"; }

setLayoutAsMaximumSpacing_2 = StructuralDesign.Rebar.Layout.SetLayoutAsMaximumSpacing(rebar=byCurve_4, spacing=code_block_6.out6, arrayLength=round, barsOnNormalSide=boolean_7, includeFirstBar=boolean_7, includeLastBar=boolean_7)
rebarHookType_5 = RevitRebarHookType("Hook-Stirrup_Tie-180")
ʳʰʸᵗʰᵐ_elements_8 = Rhythm.Revit.Elements.Elements.SetParameterByNameTypeOrInstance(element=setLayoutAsMaximumSpacing_2, parameterName=code_block_57.out1, value=rebarHookType_5, lacing=Longest)
ʳʰʸᵗʰᵐ_elements_9 = Rhythm.Revit.Elements.Elements.SetParameterByNameTypeOrInstance(element=ʳʰʸᵗʰᵐ_elements_8, parameterName=code_block_57.out2, value=rebarHookType_5, lacing=Longest)
join_2 = List.Join(list0=ʳʰʸᵗʰᵐ_elements_2, list1=ʳʰʸᵗʰᵐ_elements_6, list2=ʳʰʸᵗʰᵐ_elements_9)
boolean_8 = BoolSelector(true)
RIE_ActiveView = Custom[RIE_ActiveView](Refresh=boolean_8)  # package RIE; Returns active view in current document.
setSolidInView = StructuralDesign.Rebar.Create.SetSolidInView(rebar=join_2, view=RIE_ActiveView, solid=boolean_8)
setUnobscuredInView = StructuralDesign.Rebar.Create.SetUnobscuredInView(rebar=join_2, view=RIE_ActiveView, unobscured=boolean_8)
code_block_58 = CodeBlock(A=code_block_6.out1) { A; }
byCurve_5 = Rebar.ByCurve(curve=byJoinedCurves_4, hostElementId=id_2, rebarStyle=rebarStyle_2, rebarBarType=rebarBarType_2, startHookOrientation=rebarHookOrientation_2, endHookOrientation=rebarHookOrientation_2, startHookType=rebarHookType_2, endHookType=rebarHookType_2, vector=direction_6, lacing=Longest)
code_block_59 = CodeBlock(A=geometry) { A; }
centroid = Solid.Centroid(solid=code_block_59)
byPlane = CoordinateSystem.ByPlane()
byWidthLength = Rectangle.ByWidthLength(cs=byPlane)
sortPointsOnCurve = Custom[SortPointsOnCurve]()  # package Chynamo; Project points on curves and sort them by their parameters to curve start point; unwired: curve, points
sortByDistance = Custom[SortByDistance]()  # package Chynamo; Sort points along a line; unwired: points
