# Dynamo graph script.dyn (Dynamo 2.3.0.5885)
# packages: BIM4Struc.Rebar 1.3.0, Structural Design 2019.12.11, Dynamo for Rebar 2.0.2, KYSUDO 2019.8.5, Clockwork for Dynamo 2.x 2.3.0, Rhythm 2020.7.25, Data-Shapes 2022.2.96

boolean = BoolSelector(true)
select_face_s_pickobject = Custom[Select Face (s) (PickObject)](Refresh=boolean)  # package Data-Shapes; Same as OOTB Select Faces, but can be used through Dynamo Player
flatten = List.Flatten(list=select_face_s_pickobject)
code_block = CodeBlock { 0.5; }
pointAtParameter = Surface.PointAtParameter(surface=flatten, u=code_block, v=code_block)
code_block_2 = CodeBlock(a=pointAtParameter) { a[0]; a[1]; }
byStartPointEndPoint = Line.ByStartPointEndPoint(startPoint=code_block_2.out0, endPoint=code_block_2.out1)
categories = Categories("OST_StructuralFraming")
isolated_pick_model_elements = Custom[Isolated Pick Model Elements(ordered)](refresh=boolean, category=categories)  # package Rhythm; Pick model elements in desired order of a desired category.
lastItem = List.LastItem(list=isolated_pick_model_elements)
setDifference = List.SetDifference(list1=isolated_pick_model_elements, list2=lastItem)
getLocation = Element.GetLocation(element=setDifference)
code_block_3 = CodeBlock { 0.5; }
pointAtParameter_2 = Curve.PointAtParameter(curve=getLocation, param=code_block_3)
ZAxis = Vector.ZAxis()
code_block_4 = CodeBlock { 500; }
translate = Geometry.Translate(geometry=pointAtParameter_2, direction=ZAxis, distance=code_block_4)
byLineAndPoint = Plane.ByLineAndPoint(line=getLocation, point=translate)
intersectAll = Geometry.IntersectAll(geometry=byStartPointEndPoint, others=byLineAndPoint)
getLocation_2 = Element.GetLocation(element=lastItem)
direction = Line.Direction(line=getLocation_2)

# group: XAC DINH PHUONG CHIEU CUA DOAN RAI
code_block_5 = CodeBlock { [0,0.25,0.75,1]; }
pointAtParameter_3 = Curve.PointAtParameter(curve=byStartPointEndPoint, param=code_block_5)
XAxis = Vector.XAxis()
isParallel = Vector.IsParallel(vector=direction, other=XAxis)
X = Point.X(point=pointAtParameter_3)
Y = Point.Y(point=pointAtParameter_3)
if_Plus = Custom[If_Plus](If_Here=isParallel, if_True=X, If_False=Y)  # package KYSUDO
flatten_2 = List.Flatten(list=if_Plus)
sortByKey = List.SortByKey(list=pointAtParameter_3, keys=flatten_2)
code_block_6 = CodeBlock(a=sortByKey.sorted_list) { a[0]; a[3]; }
byStartPointEndPoint_2 = Line.ByStartPointEndPoint(startPoint=code_block_6.out0, endPoint=code_block_6.out1)
direction_2 = Line.Direction(line=byStartPointEndPoint_2)

# group: InPut
code_block_7 = CodeBlock { "RebarProperties"; "Create"; true; "Cancle"; 400; 400; 150; }
code_block_8 = CodeBlock { "Rebar Diameter"; "10"; "NumberBar A50"; "4"; true; }
textbox_data = Custom[TextBox Data](InputName=code_block_8.out0, DefaultText=code_block_8.out1)  # package Data-Shapes; Create Data for TextBox input in UI.MultipleInputForm ++ . Check out www.data-shapes.net for more informations
textbox_data_2 = Custom[TextBox Data](InputName=code_block_8.out2, DefaultText=code_block_8.out3, IsNumberEntry=code_block_8.out4)
list_create = List.Create(item0=textbox_data, item1=textbox_data_2)
multipleinputform = Custom[MultipleInputForm ++](Description_optional=code_block_7.out0, ButtonText_optional=code_block_7.out1, Inputs=list_create, Toggle=code_block_7.out2, CancelButtonText_optional=code_block_7.out3, MaxHeight_optional=code_block_7.out4, Width_optional=code_block_7.out5, LabelWidth_optional=code_block_7.out6)  # package Data-Shapes; Create a form with multiple inputs. see www.data-shapes.net for tutorials and infos!
code_block_9 = CodeBlock(a=multipleinputform.User_Inputs) { a[0]; a[1]; }
element_types = ElementTypes("RebarBarType")
all_elements_of_type = ElementsOfType(element_type=element_types)
name = Element.Name(element=all_elements_of_type)
code_block_10 = CodeBlock { 0; 1; }
remove = String.Remove(str=name, startIndex=code_block_10.out0, count=code_block_10.out1)
eq = remove == code_block_9.out0
boolean_2 = BoolSelector(false)

code_block_11 = CodeBlock { "b"; }
ʳʰʸᵗʰᵐ_elements = Rhythm.Revit.Elements.Elements.GetParameterValueByNameTypeOrInstance(element=setDifference, parameterName=code_block_11)

# group: BO SUNG 2 DIEM MOI
code_block_12 = CodeBlock(n=code_block_9.out1, b=ʳʰʸᵗʰᵐ_elements) { n*50+b/2+50; }
translate_2 = Geometry.Translate(geometry=intersectAll, direction=direction_2, distance=code_block_12)
reverse = Vector.Reverse(vector=direction_2)
translate_3 = Geometry.Translate(geometry=intersectAll, direction=reverse, distance=code_block_12)
join = List.Join(list0=pointAtParameter_3, list1=translate_2, list2=translate_3)
XAxis_2 = Vector.XAxis()
isParallel_2 = Vector.IsParallel(vector=direction, other=XAxis_2)
X_2 = Point.X(point=join)
Y_2 = Point.Y(point=join)
if_Plus_2 = Custom[If_Plus](If_Here=isParallel_2, if_True=X_2, If_False=Y_2)
flatten_3 = List.Flatten(list=if_Plus_2)
sortByKey_2 = List.SortByKey(list=join, keys=flatten_3)

# group: SÔ DIEM
indexOf = List.IndexOf(list=sortByKey_2.sorted_list, element=translate_2)
indexOf_2 = List.IndexOf(list=sortByKey_2.sorted_list, element=translate_3)
code_block_13 = CodeBlock(a=indexOf, b=indexOf_2) { a-b; b+1; }
code_block_14 = CodeBlock(a=code_block_13.out0) { a>1; }
removeItemAtIndex = List.RemoveItemAtIndex(list=sortByKey_2.sorted_list, indices=code_block_13.out1)
if_Plus_3 = Custom[If_Plus](If_Here=code_block_14@L1, if_True=removeItemAtIndex, If_False=sortByKey_2.sorted_list)
flatten_4 = List.Flatten(list=if_Plus_3)

code_block_15 = CodeBlock(ListPoint=flatten_4) { ListPoint; }
count = List.Count(list=code_block_15@L2)
code_block_16 = CodeBlock(n=count) { 0..n-2; 1..n-1; }
getItemAtIndex = List.GetItemAtIndex(list=code_block_15@L2, index=code_block_16.out0@L2)
getItemAtIndex_2 = List.GetItemAtIndex(list=code_block_15@L2, index=code_block_16.out1@L2)
byStartPointEndPoint_3 = Line.ByStartPointEndPoint(startPoint=getItemAtIndex, endPoint=getItemAtIndex_2)
list_create_2 = List.Create()  # unwired: item0, item1, item2
count_2 = List.Count(list=flatten_4@@L2)
code_block_17 = CodeBlock { 1; }
chop = List.Chop(list=count_2, lengths=code_block_17)
code_block_18 = CodeBlock(n=chop) { 0..n-2; }
flatten_5 = List.Flatten(list=code_block_18@L2)
code_block_19 = CodeBlock(a=chop) { a<=5; }
list_create_3 = List.Create()  # unwired: item0, item1
code_block_20 = CodeBlock(n=chop) { 0; n-2; 2; n-n; }
combine = List.Combine(comb=list_create_3, list1=code_block_20.out3, list2=code_block_20.out1)
flatten_6 = List.Flatten(list=combine@L3)
join_2 = List.Join()  # unwired: list0, list1
range = Range(start=code_block_20.out0, end=code_block_20.out1, step=code_block_20.out2)
combine_2 = List.Combine(comb=join_2, list1=range, list2=code_block_20.out1)
flatten_7 = List.Flatten(list=combine_2@L3)
if_Plus_4 = Custom[If_Plus](If_Here=code_block_19@L1, if_True=flatten_6@L2, If_False=flatten_7@L2)
flatten_8 = List.Flatten(list=if_Plus_4@L3)
list_uniqueitems = List.UniqueItems(list=flatten_8@L2)
index_first_point_of_a50 = CodeBlock(a50=indexOf_2) { a50; }
join_3 = List.Join(list0=list_uniqueitems, list1=index_first_point_of_a50)
flatten_9 = List.Flatten(list=join_3)
list_setdifference_index_first = List.SetDifference(list1=flatten_5, list2=flatten_9)  # "List.SetDifference(index first point of a200)"
list_setdifference_index_first_2 = List.SetDifference(list1=list_uniqueitems, list2=indexOf_2)  # "List.SetDifference(index first point of a100)"
code_block_21 = CodeBlock(fpa200=list_setdifference_index_first, fpa100=list_setdifference_index_first_2, fpa50=index_first_point_of_a50) { fpa200; fpa100; fpa50; }
combine_3 = List.Combine(comb=list_create_2, list1=code_block_21.fpa200, list2=code_block_21.fpa100, list3=code_block_21.fpa50)
flatten_10 = List.Flatten(list=combine_3@L3)
code_block_22 = CodeBlock { -1; }
KSD_RemoveItem = Custom[KSD_RemoveItem](list=flatten_10@L2, item=code_block_22)  # package KYSUDO
getItemAtIndex_3 = List.GetItemAtIndex(list=byStartPointEndPoint_3@L2, index=KSD_RemoveItem@L2)
flatten_11 = List.Flatten(list=getItemAtIndex_3)
startPoint = Curve.StartPoint(curve=flatten_11)
code_block_23 = CodeBlock(Damve=lastItem) { Damve; }
getLocation_3 = Element.GetLocation(element=code_block_23)
direction_3 = Line.Direction(line=getLocation_3)
filterByBoolMask = List.FilterByBoolMask(list=all_elements_of_type, mask=eq)
code_block_24 = CodeBlock { 200; 100; 50; }
count_3 = List.Count(list=code_block_21.fpa200@@L2)
cycle = List.Cycle(list=code_block_24.out0, amount=count_3)
count_4 = List.Count(list=code_block_21.fpa100@@L2)
cycle_2 = List.Cycle(list=code_block_24.out1, amount=count_4)
count_5 = List.Count(list=code_block_21.fpa50@@L2)
code_block_25 = CodeBlock(n=count_5) { n*2; }
cycle_3 = List.Cycle(list=code_block_24.out2, amount=code_block_25)
combine_4 = List.Combine(comb=list_create_2, list1=cycle, list2=cycle_2, list3=cycle_3)
flatten_12 = List.Flatten(list=combine_4)
length = Curve.Length(curve=flatten_11)
code_block_26 = CodeBlock(a=length) { a>150; }
list_filterbyboolmask_spacing = List.FilterByBoolMask(list=flatten_12, mask=code_block_26)
list_filterbyboolmask_length_for = List.FilterByBoolMask(list=length, mask=code_block_26)  # "List.FilterByBoolMask(length for spacing)"

# group: XAC DINH DIEM BAT DAU, KHOANG RAI, KHOANG CACH RAI CHO THEP
lastItem_2 = List.LastItem(list=startPoint)
code_block_27 = CodeBlock(n=code_block_9.out1, b=ʳʰʸᵗʰᵐ_elements) { n*50+b+50; }
translate_4 = Geometry.Translate(geometry=lastItem_2, direction=direction_2, distance=code_block_27)
addItemToEnd = List.AddItemToEnd(item=translate_4, list=startPoint)
flatten_13 = List.Flatten(list=addItemToEnd)
number = DoubleInput(50)
addItemToEnd_2 = List.AddItemToEnd(item=number, list=list_filterbyboolmask_spacing.in)
code_block_28 = CodeBlock(n=code_block_9.out1) { n*50; }
cycle_4 = List.Cycle(list=code_block_28, amount=code_block_25)
flatten_14 = List.Flatten(list=cycle_4@L2)
dropLastItem = Custom[List.DropLastItem](list=list_filterbyboolmask_length_for.in)  # package Clockwork for Dynamo 2.x; Drops the last item from a given list.
addItemToEnd_3 = List.AddItemToEnd(item=flatten_14, list=dropLastItem)
flatten_15 = List.Flatten(list=addItemToEnd_3)

# group: get shape rebar by curve
byOriginNormal = Plane.ByOriginNormal(origin=flatten_13, normal=direction_3, lacing=Longest)
geometry = Element.Geometry(element=code_block_23)
intersectAll_2 = Geometry.IntersectAll(geometry=byOriginNormal, others=geometry, lacing=Longest)
flatten_16 = List.Flatten(list=intersectAll_2)
perimeterCurves = Surface.PerimeterCurves(surface=flatten_16)
byJoinedCurves = PolyCurve.ByJoinedCurves(curves=perimeterCurves)
getRebarCover = Custom[Element.GetRebarCover](element=code_block_23)  # package BIM4Struc.Rebar; Get the rebar cover dimensions for a selected element.
code_block_29 = CodeBlock(a=getRebarCover.Other) { -a; }
offset = Curve.Offset(curve=byJoinedCurves, distance=code_block_29, lacing=Longest)
explode = Geometry.Explode(geometry=offset)

# group: Properties of stirrup
byJoinedCurves_2 = PolyCurve.ByJoinedCurves(curves=explode)
code_block_30 = CodeBlock(beamrebar=code_block_23) { beamrebar; }
id = Element.Id(element=code_block_30)
rebarStyle = RevitRebarStyle("StirrupTie")
rebarHookOrientation = RevitRebarHookOrientation("Right")
rebarHookType = RevitRebarHookType("None")
direction_4 = Line.Direction(line=getLocation_3@L2)

# group: CREATE STIRRUP 0-L/4
byCurve = Rebar.ByCurve(curve=byJoinedCurves_2, hostElementId=id, rebarStyle=rebarStyle, rebarBarType=filterByBoolMask.in, startHookOrientation=rebarHookOrientation, endHookOrientation=rebarHookOrientation, startHookType=rebarHookType, endHookType=rebarHookType, vector=direction_4, lacing=Longest)
rebarShape = RevitRebarShape("S")  # graph input
setRebarShapeId = StructuralDesign.Rebar.Create.SetRebarShapeId(rebar=byCurve, rebarShape=rebarShape)
code_block_31 = CodeBlock { 0; }
round = Math.Round(number=flatten_15, digits=code_block_31)
boolean_3 = BoolSelector(false)
boolean_4 = BoolSelector(true)
setLayoutAsMaximumSpacing = StructuralDesign.Rebar.Layout.SetLayoutAsMaximumSpacing(rebar=setRebarShapeId, spacing=addItemToEnd_2, arrayLength=round, includeFirstBar=boolean_3, includeLastBar=boolean_4)
