# Dynamo graph script.dyn (Dynamo 2.6.1.8786)
# packages: Orchid 203.3.1.8192, Rhythm 2020.7.25, Data-Shapes 2022.2.96, Chynamo 0.8.5

code_block = CodeBlock { "How many floor was created? "; }
code_block_2 = CodeBlock { "Select model"; "Create"; true; "Cancle"; 800; 500; 200; }
code_block_3 = CodeBlock { "Select Structural Framing"; "Select Model Framing"; "Structural Framing"; }
byName = Category.ByName(name=code_block_3.out2)
selectmodelelements_data = Custom[SelectModelElements Data](InputName=code_block_3.out0, ButtonText=code_block_3.out1, CategoryFilter=byName)  # package Data-Shapes; Creates a Revit element selection input for UI.MultipleInputForm++ . Check out www.data-shapes.net for more infos!
code_block_4 = CodeBlock { "Select All Model"; "Select Model"; }
categories_list = Custom[Categories list]()  # package Data-Shapes; Gives list of all Revit categories and a matching list of their names
selectmodelelements_data_2 = Custom[SelectModelElements Data](InputName=code_block_4.out0, ButtonText=code_block_4.out1, CategoryFilter=categories_list.Revit_Categories)
code_block_5 = CodeBlock { "Select floor type to create"; }
code_block_6 = CodeBlock { "Floors"; }
byName_2 = Category.ByName(name=code_block_6)
o_elementtype_bycategory = Orchid.RevitProject.Elements.ElementType.ByCategory(category=byName_2)
name = Element.Name(element=o_elementtype_bycategory)
dropdown_data = Custom[DropDown Data](InputName=code_block_5, Keys=name, Values=o_elementtype_bycategory)  # package Data-Shapes; Create data for DropDown input in UI.MultiInputForm ++ . Check out www.data-shapes.net for more infos.
code_block_7 = CodeBlock { "Select Level to create"; }
code_block_8 = CodeBlock { "Levels"; }
byName_3 = Category.ByName(name=code_block_8)
all_elements_of_category = ElementsOfCategory(Category=byName_3)
name_2 = Element.Name(element=all_elements_of_category)
dropdown_data_2 = Custom[DropDown Data](InputName=code_block_7, Keys=name_2, Values=all_elements_of_category)
code_block_9 = CodeBlock { "Extend to with ??"; "100"; true; }
textbox_data = Custom[TextBox Data](InputName=code_block_9.out0, DefaultText=code_block_9.out1, IsNumberEntry=code_block_9.out2)  # package Data-Shapes; Create Data for TextBox input in UI.MultipleInputForm ++ . Check out www.data-shapes.net for more informations
list_create = List.Create(item0=selectmodelelements_data, item1=selectmodelelements_data_2, item2=dropdown_data, item3=dropdown_data_2, item4=textbox_data)
multipleinputform = Custom[MultipleInputForm ++](Description_optional=code_block_2.out0, ButtonText_optional=code_block_2.out1, Inputs=list_create, Toggle=code_block_2.out2, CancelButtonText_optional=code_block_2.out3, MaxHeight_optional=code_block_2.out4, Width_optional=code_block_2.out5, LabelWidth_optional=code_block_2.out6)  # package Data-Shapes; Create a form with multiple inputs. see www.data-shapes.net for tutorials and infos!
code_block_10 = CodeBlock(Framing=multipleinputform.User_Inputs, Orther=multipleinputform.User_Inputs, Floortype=multipleinputform.User_Inputs, Level=multipleinputform.User_Inputs, Extendto=multipleinputform.User_Inputs) { Framing[0]; Orther[1]; Floortype[2]; Level[3]; Extendto[4]; }
geometry = Element.Geometry(element=code_block_10.out0)
flatten = List.Flatten(list=geometry)
explode = Geometry.Explode(geometry=flatten)
code_block_11 = CodeBlock { 0.5; }
normalAtParameter = Surface.NormalAtParameter(surface=explode, u=code_block_11, v=code_block_11)
Z = Vector.Z(vector=normalAtParameter)
round = Math.Round(number=Z)
code_block_12 = CodeBlock(a=round) { a==0; }
filterByBoolMask = List.FilterByBoolMask(list=explode, mask=code_block_12)
code_block_13 = CodeBlock(a=filterByBoolMask.out) { a; }
code_block_14 = CodeBlock { 0.5; }
pointAtParameter = Surface.PointAtParameter(surface=code_block_13, u=code_block_14, v=code_block_14)
Z_2 = Point.Z(point=pointAtParameter)
round_2 = Math.Round(number=Z_2)
minimumItem = List.MinimumItem(list=round_2@L2)
o_list_indexof = Orchid.Common.List.IndexOf(list=round_2@L2, item=minimumItem, lacing=Longest)
flatten_2 = List.Flatten(list=o_list_indexof@L3)
getItemAtIndex = List.GetItemAtIndex(list=code_block_13@L2, index=flatten_2@L2)
perimeterCurves = Surface.PerimeterCurves(surface=getItemAtIndex)
byJoinedCurves = PolyCurve.ByJoinedCurves(curves=perimeterCurves)
offset = Curve.Offset(curve=byJoinedCurves, distance=code_block_10.out4)
flatten_3 = List.Flatten(list=offset)
removenull_lunchbox = Custom[RemoveNull-Lunchbox](list=flatten_3)  # package Chynamo; Remove null from input list, imported from Lunchbox
patch = Curve.Patch(curve=removenull_lunchbox)
setDifference = List.SetDifference(list1=code_block_10.out1, list2=code_block_10.out0)
geometry_2 = Element.Geometry(element=setDifference)
flatten_4 = List.Flatten(list=geometry_2)
byUnion = Solid.ByUnion(solids=flatten_4)
split = Geometry.Split(geometry=patch, other=byUnion)
flatten_5 = List.Flatten(list=split)
code_block_15 = CodeBlock { 5; }
thicken = Surface.Thicken(surface=flatten_5, thickness=code_block_15)
byUnion_2 = Solid.ByUnion(solids=thicken)
explode_2 = Geometry.Explode(geometry=byUnion_2)
code_block_16 = CodeBlock { 0.5; }
normalAtParameter_2 = Surface.NormalAtParameter(surface=explode_2, u=code_block_16, v=code_block_16)
Z_3 = Vector.Z(vector=normalAtParameter_2)
round_3 = Math.Round(number=Z_3)
code_block_17 = CodeBlock(a=round_3) { a==0; }
filterByBoolMask_2 = List.FilterByBoolMask(list=explode_2, mask=code_block_17)
code_block_18 = CodeBlock(a=filterByBoolMask_2.out) { a; }
code_block_19 = CodeBlock { 0.5; }
pointAtParameter_2 = Surface.PointAtParameter(surface=code_block_18, u=code_block_19, v=code_block_19)
X = Point.X(point=pointAtParameter_2)
Y = Point.Y(point=pointAtParameter_2)
code_block_20 = CodeBlock { 1; }
byCoordinates = Point.ByCoordinates(x=X, y=Y, z=code_block_20)
groupByKey = List.GroupByKey(list=code_block_18, keys=byCoordinates)
pointAtParameter_3 = Surface.PointAtParameter(surface=groupByKey.groups, u=code_block_19, v=code_block_19)
Z_4 = Point.Z(point=pointAtParameter_3)
minimumItem_2 = List.MinimumItem(list=Z_4@L2)
indexOf = List.IndexOf(list=Z_4@L2, element=minimumItem_2@L1)
getItemAtIndex_2 = List.GetItemAtIndex(list=groupByKey.groups@L2, index=indexOf@L1)
ZAxis = Vector.ZAxis()
code_block_21 = CodeBlock(a=code_block_15) { a/2; }
translate = Geometry.Translate(geometry=getItemAtIndex_2, direction=ZAxis, distance=code_block_21)
code_block_22 = CodeBlock { 0.5; }
pointAtParameter_4 = Surface.PointAtParameter(surface=translate, u=code_block_22, v=code_block_22)
Z_5 = Point.Z(point=pointAtParameter_4)
floor = Math.Floor(number=Z_5)
groupByKey_2 = List.GroupByKey(list=translate, keys=floor)
perimeterCurves_2 = Surface.PerimeterCurves(surface=groupByKey_2.groups)
removenull_lunchbox_2 = Custom[RemoveNull-Lunchbox](list=perimeterCurves_2@L3)
deconstruct = List.Deconstruct(list=removenull_lunchbox_2@L3)
code_block_23 = CodeBlock(Floortype=code_block_10.out2) { Floortype; }
byOutlineTypeAndLevel = Floor.ByOutlineTypeAndLevel(outlineCurves=deconstruct.first@L2, floorType=code_block_23, level=code_block_10.out3)
string_from_object = FromObject(obj=byOutlineTypeAndLevel)  # frozen
code_block_24 = CodeBlock(A=string_from_object) { A== "Floor"; }
countTrue = List.CountTrue(list=code_block_24)
countFalse = List.CountFalse(list=code_block_24)
code_block_25 = CodeBlock(F=countTrue, a=countFalse) { "Have " + F + " Floor was created " + "\n" + "Have " + a + " get error " + "\n" + "please check"; }
ʳʰʸᵗʰᵐ_helpers_simpleusermessage = Rhythm.Revit.Helpers.Helpers.SimpleUserMessage(caption=code_block, message=code_block_25)
code_block_26 = CodeBlock { false; }
o_list_indexof_2 = Orchid.Common.List.IndexOf(list=code_block_24, item=code_block_26)
byCurve = ModelCurve.ByCurve(curve=deconstruct.rest)
