# Dynamo graph script.dyn (Dynamo 2.3.0.5885)
# packages: Orchid 203.3.1.8192, Rhythm 2020.7.25, Data-Shapes 2022.2.96, Chynamo 0.8.5, KYSUDO 2019.8.5, archi-lab.net 2021.25.15

code_block = CodeBlock { "How many floor was created? "; }
code_block_2 = CodeBlock { "Create lean concrete"; "Create"; true; "Cancle"; 800; 500; 200; }
code_block_3 = CodeBlock { "Select Structural Foundation"; "Select"; "Structural Foundations"; }
byName = Category.ByName(name=code_block_3.out2)
selectmodelelements_data = Custom[SelectModelElements Data](InputName=code_block_3.out0, ButtonText=code_block_3.out1, CategoryFilter=byName)  # package Data-Shapes; Creates a Revit element selection input for UI.MultipleInputForm++ . Check out www.data-shapes.net for more infos!
code_block_4 = CodeBlock { "Select floor type to create"; 11; }
code_block_5 = CodeBlock { "Floors"; }
byName_2 = Category.ByName(name=code_block_5)
o_elementtype_bycategory = Orchid.RevitProject.Elements.ElementType.ByCategory(category=byName_2)
name = Element.Name(element=o_elementtype_bycategory)
code_block_6 = CodeBlock { "GS-033113.B10-LCC(100)"; }
indexOf = List.IndexOf(list=name, element=code_block_6)
dropdown_data = Custom[DropDown Data](InputName=code_block_4.out0, Keys=name, Values=o_elementtype_bycategory, DefaultValueIndex=indexOf)  # package Data-Shapes; Create data for DropDown input in UI.MultiInputForm ++ . Check out www.data-shapes.net for more infos.
code_block_7 = CodeBlock { "Select Level to create"; }
code_block_8 = CodeBlock { "Levels"; }
byName_3 = Category.ByName(name=code_block_8)
all_elements_of_category = ElementsOfCategory(Category=byName_3)
name_2 = Element.Name(element=all_elements_of_category)
dropdown_data_2 = Custom[DropDown Data](InputName=code_block_7, Keys=name_2, Values=all_elements_of_category)
code_block_9 = CodeBlock { "Extend to with ??"; "100"; true; }
textbox_data = Custom[TextBox Data](InputName=code_block_9.out0, DefaultText=code_block_9.out1, IsNumberEntry=code_block_9.out2)  # package Data-Shapes; Create Data for TextBox input in UI.MultipleInputForm ++ . Check out www.data-shapes.net for more informations
list_create = List.Create(item0=selectmodelelements_data, item1=dropdown_data, item2=dropdown_data_2, item3=textbox_data)
multipleinputform = Custom[MultipleInputForm ++](Description_optional=code_block_2.out0, ButtonText_optional=code_block_2.out1, Inputs=list_create, Toggle=code_block_2.out2, CancelButtonText_optional=code_block_2.out3, MaxHeight_optional=code_block_2.out4, Width_optional=code_block_2.out5, LabelWidth_optional=code_block_2.out6)  # package Data-Shapes; Create a form with multiple inputs. see www.data-shapes.net for tutorials and infos!
code_block_10 = CodeBlock(StructuralFoundation=multipleinputform.User_Inputs, Floortype=multipleinputform.User_Inputs, Level=multipleinputform.User_Inputs, Extendto=multipleinputform.User_Inputs) { StructuralFoundation[0]; Floortype[1]; Level[2]; Extendto[3]; }
geometry = Element.Geometry(element=code_block_10.out0)
flatten = List.Flatten(list=geometry)
explode = Geometry.Explode(geometry=flatten)
code_block_11 = CodeBlock { 0.5; }
normalAtParameter = Surface.NormalAtParameter(surface=explode, u=code_block_11, v=code_block_11)
Z = Vector.Z(vector=normalAtParameter)
round = Math.Round(number=Z)
code_block_12 = CodeBlock(a=round) { a==0; }
filterByBoolMask = List.FilterByBoolMask(list=explode, mask=code_block_12)
code_block_13 = CodeBlock(a=filterByBoolMask.out) { a; }
code_block_14 = CodeBlock { 0.5; }
pointAtParameter = Surface.PointAtParameter(surface=code_block_13, u=code_block_14, v=code_block_14)
Z_2 = Point.Z(point=pointAtParameter)
round_2 = Math.Round(number=Z_2)
maximumItem = List.MaximumItem(list=round_2@L2)
o_list_indexof = Orchid.Common.List.IndexOf(list=round_2@L2, item=maximumItem, lacing=Longest)
flatten_2 = List.Flatten(list=o_list_indexof@L3)
getItemAtIndex = List.GetItemAtIndex(list=code_block_13@L2, index=flatten_2@L2)
perimeterCurves = Surface.PerimeterCurves(surface=getItemAtIndex)
byJoinedCurves = PolyCurve.ByJoinedCurves(curves=perimeterCurves)
offset = Curve.Offset(curve=byJoinedCurves, distance=code_block_10.out3)
ZAxis = Vector.ZAxis()
reverse = Vector.Reverse(vector=ZAxis)
elementType = Element.ElementType(element=code_block_10.out0)
code_block_15 = CodeBlock { "Thickness"; }
getParameterValueByName = Element.GetParameterValueByName(element=elementType, parameterName=code_block_15)
translate = Geometry.Translate(geometry=offset, direction=reverse, distance=getParameterValueByName)
removenull_lunchbox = Custom[RemoveNull-Lunchbox](list=translate)  # package Chynamo; Remove null from input list, imported from Lunchbox
code_block_16 = CodeBlock(Floortype=code_block_10.out1, Level=code_block_10.out2) { Floortype; Level; }
byOutlineTypeAndLevel = Floor.ByOutlineTypeAndLevel(outlineCurves=removenull_lunchbox, floorType=code_block_16.Floortype, level=code_block_16.Level)
string_from_object = FromObject(obj=byOutlineTypeAndLevel)
code_block_17 = CodeBlock(A=string_from_object) { A== "Floor"; }
countTrue = List.CountTrue(list=code_block_17)
countFalse = List.CountFalse(list=code_block_17)
code_block_18 = CodeBlock(F=countTrue, a=countFalse) { "Have " + F + " Floor was created " + "\n" + "Have " + a + " get error " + "\n" + "please check"; }
ʳʰʸᵗʰᵐ_helpers_simpleusermessage = Rhythm.Revit.Helpers.Helpers.SimpleUserMessage(caption=code_block, message=code_block_18)
code_block_19 = CodeBlock { false; }
o_list_indexof_2 = Orchid.Common.List.IndexOf(list=code_block_17, item=code_block_19)
element_faces = Custom[Element Faces](element=byOutlineTypeAndLevel)  # package KYSUDO
perimeterCurves_2 = Surface.PerimeterCurves(surface=element_faces.Top)
byCurve = ModelCurve.ByCurve(curve=perimeterCurves_2)
code_block_20 = CodeBlock { "Height Offset From Level"; }
ʳʰʸᵗʰᵐ_elements = Rhythm.Revit.Elements.Elements.GetParameterValueByNameTypeOrInstance(element=byOutlineTypeAndLevel, parameterName=code_block_20)
groupByKey = List.GroupByKey(list=byOutlineTypeAndLevel, keys=ʳʰʸᵗʰᵐ_elements)
code_block_21 = CodeBlock { 0; }
removeItemAtIndex = List.RemoveItemAtIndex(list=groupByKey.groups@L2, indices=code_block_21)
delete = archilab.Revit.Elements.Elements.Delete(element=removeItemAtIndex)
