# Dynamo graph script.dyn (Dynamo 2.3.0.5885)
# packages: LinkDWG 0.3.91, LinkDWG2 0.4.18, Genius Loci 2022.8.5, MEPover 2022.10.30, Clockwork for Dynamo 2.x 2.3.0, WombatDynamo 1.3.2, Rhythm 2020.7.25, Data-Shapes 2022.2.96

# group: UI- Select
code_block = CodeBlock()
# ---------- code_block.designscript (8 lines) ----------
"Create Framing By Select cadLine like location Please select Beam Mark then line Location";
"Create Framing";
true;
"0367087873";
"Cancle";
500;
400;
200;
# ----------------------------------------
code_block_2 = CodeBlock { "Choose Family Type"; }
categories = Categories("OST_StructuralFraming")
all_families_of_category = Custom[All Families Of Category](category=categories)  # package Clockwork for Dynamo 2.x; Gets all famiies of a given category in the model (does *not *work for system families)
name = Element.Name(element=all_families_of_category)
dropdown_data = Custom[DropDown Data](InputName=code_block_2, Keys=name, Values=all_families_of_category)  # package Data-Shapes; Create data for DropDown input in UI.MultiInputForm ++ . Check out www.data-shapes.net for more infos.
code_block_3 = CodeBlock { "Select Line to Positioning"; "Pick Line"; true; }
categories_2 = Categories("OST_Lines")
selectmodelelements_data = Custom[SelectModelElements Data](InputName=code_block_3.out0, ButtonText=code_block_3.out1, CategoryFilter=categories_2, SelectSingleElement=code_block_3.out2)  # package Data-Shapes; Creates a Revit element selection input for UI.MultipleInputForm++ . Check out www.data-shapes.net for more infos!
list_create = List.Create(item0=dropdown_data, item1=selectmodelelements_data)
multipleinputform = Custom[MultipleInputForm ++](Description_optional=code_block.out0, ButtonText_optional=code_block.out1, Inputs=list_create, Toggle=code_block.out2, LinkToHelp_optional=code_block.out3, CancelButtonText_optional=code_block.out4, MaxHeight_optional=code_block.out5, Width_optional=code_block.out6, LabelWidth_optional=code_block.out7)  # package Data-Shapes; Create a form with multiple inputs. see www.data-shapes.net for tutorials and infos!

code_block_4 = CodeBlock(FamilyTypes=multipleinputform.User_Inputs, PositioningLine=multipleinputform.User_Inputs) { FamilyTypes[0]; PositioningLine[1]; }
isNotEmpty = Custom[List.IsNotEmpty](seq=code_block_4.out0)  # package Clockwork for Dynamo 2.x; Just the inversion of the built-in Is Empty List node.

# group: Select Line location framing in cad
selectObjects = Custom[SelectObjects](Execute=isNotEmpty, ShowSwitchAlert=isNotEmpty)  # package LinkDWG2; Select objects on screen
basicProperty = Custom[BasicProperty](COM_Objects=selectObjects)  # package LinkDWG2; Get basic general properties of COM object
code_block_5 = CodeBlock { "Text"; }
contains = String.Contains(str=basicProperty.0_ObjectName, searchFor=code_block_5)
filterByBoolMask = List.FilterByBoolMask(list=selectObjects, mask=contains)
geometry = Element.Geometry(element=code_block_4.out1)

# group: Properties to tranfer location beam, cad to revit
isEmpty = List.IsEmpty(list=selectObjects)
code_block_6 = CodeBlock { true; false; }
if_ = If(test=isEmpty, true=code_block_6.out1, false=code_block_6.out0)
selectObjects_2 = Custom[SelectObjects](Execute=if_)
lineProperty = Custom[LineProperty](COM_Lines=selectObjects_2)  # package LinkDWG2; Get COM line properties
startPoint = Curve.StartPoint(curve=geometry)
byStartPointEndPoint = Line.ByStartPointEndPoint(startPoint=lineProperty.0_StartPoint, endPoint=startPoint)
direction = Line.Direction(line=byStartPointEndPoint)
length = Curve.Length(curve=byStartPointEndPoint)
ZAxis = Vector.ZAxis()
byStartPointEndPoint_2 = Line.ByStartPointEndPoint(startPoint=lineProperty.0_StartPoint, endPoint=lineProperty.1_EndPoint)
direction_2 = Line.Direction(line=byStartPointEndPoint_2)
direction_3 = Line.Direction(line=geometry)
angleAboutAxis = Vector.AngleAboutAxis(vector=direction_2, otherVector=direction_3, rotationAxis=ZAxis)

# group: GET LOCATION FOR FRAMING
code_block_7 = CodeBlock(ElementLocation=filterByBoolMask.out) { ElementLocation; }
polylineProperties = Custom[PolylineProperties](COM_Polyline=code_block_7)  # package LinkDWG; Get the COM LWPolyline properties
translate = Geometry.Translate(geometry=polylineProperties.0_PolyCurve, direction=direction, distance=length, lacing=Longest)
rotate = Geometry.Rotate(geometry=translate, origin=startPoint, axis=ZAxis, degrees=angleAboutAxis, lacing=Longest)
code_block_8 = CodeBlock(PolyCurves=rotate) { PolyCurves; }
explode = Geometry.Explode(geometry=code_block_8)

flatten = List.Flatten(list=explode)
levels = Levels("Level 2")

# group: Get Family Type Name by Name in cad
MTextProperty = Custom[MTextProperty](COM_TextMTexts=filterByBoolMask.in)  # package LinkDWG2; Get COM text/mtext property
code_block_9 = CodeBlock(TypeElement=MTextProperty.2_PureText_Content) { TypeElement; }
code_block_10 = CodeBlock { ["(",")"]; 1; }
split = String.Split(str=code_block_9, separator0=code_block_10.out0, lacing=Longest)
getItemAtIndex = List.GetItemAtIndex(list=split@L2, index=code_block_10.out1)

# group: Duplicate Element Type
code_block_11 = CodeBlock(FamilyTypeS=code_block_4.out0) { FamilyTypeS; }
family_types_of_family = Custom[Family types of family](family=code_block_11)  # package MEPover; Returns every family type of the given Family
code_block_12 = CodeBlock(FamilyTypeDup=family_types_of_family) { FamilyTypeDup[0]; }
uniqueItems = List.UniqueItems(list=getItemAtIndex)
name_2 = Element.Name(element=family_types_of_family)
setIntersection = List.SetIntersection(list1=name_2, list2=uniqueItems)
setDifference = List.SetDifference(list1=uniqueItems, list2=setIntersection)
element_duplicate = Custom[Element Duplicate](element=code_block_12, name=setDifference)  # package Genius Loci; Duplicates the given element (view, element type).

# group: Set Value parameter
uniqueItems_2 = List.UniqueItems(list=element_duplicate)
code_block_13 = CodeBlock { "b"; "h"; }
name_3 = Element.Name(element=uniqueItems_2)
code_block_14 = CodeBlock { "x"; }
split_2 = String.Split(str=name_3, separator0=code_block_14)
transpose = List.Transpose(lists=split_2)
code_block_15 = CodeBlock(b=transpose, h=transpose) { b[0]; h[1]; }
toNumber = String.ToNumber(str=code_block_15.out0)
ʳʰʸᵗʰᵐ_elements = Rhythm.Revit.Elements.Elements.SetParameterByNameTypeOrInstance(element=uniqueItems_2, parameterName=code_block_13.out0, value=toNumber)
toNumber_2 = String.ToNumber(str=code_block_15.out1)
ʳʰʸᵗʰᵐ_elements_2 = Rhythm.Revit.Elements.Elements.SetParameterByNameTypeOrInstance(element=ʳʰʸᵗʰᵐ_elements, parameterName=code_block_13.out1, value=toNumber_2)

# group (continued): Duplicate Element Type
passthrough = Custom[Passthrough](passThrough=code_block_11, waitFor=ʳʰʸᵗʰᵐ_elements_2)  # package Clockwork for Dynamo 2.x; Forces a sequential order of execution. The node wired into the output of the Passthrough node will be executed *after* the node wired into the waitFor input (e.g. important for some Revit operations). The value of the passThrough input will be passed on to the node wired into the output port of the Passthrough node.
family_types_of_family_2 = Custom[Family types of family](family=passthrough)

# group: Get family Type to create Element
name_4 = Element.Name(element=family_types_of_family_2)
indexOf = List.IndexOf(list=name_4, element=getItemAtIndex)
getItemAtIndex_2 = List.GetItemAtIndex(list=family_types_of_family_2, index=indexOf)

beamByCurve = StructuralFraming.BeamByCurve(curve=flatten, level=levels, structuralFramingType=getItemAtIndex_2)

# group: Set Location "y Justification"
code_block_16 = CodeBlock { "y Justification"; 0; }
setParameterValuesByNames = WombatDynamo.Element.SetParameterValuesByNames(element=beamByCurve, parameterNames=code_block_16.out0, values=code_block_16.out1)

count = List.Count(list=setParameterValuesByNames)
code_block_17 = CodeBlock(n=count) { "Structural Framing Was Create ?"; "Had " + n + " Structural Framing Create Please check Location Line"; }
ʳʰʸᵗʰᵐ_helpers_simpleusermessage = Rhythm.Revit.Helpers.Helpers.SimpleUserMessage(caption=code_block_17.out0, message=code_block_17.out1)
