# Dynamo graph script.dyn (Dynamo 2.3.0.5885)
# packages: LinkDWG 0.3.91, LinkDWG2 0.4.18, Genius Loci 2022.8.5, MEPover 2022.10.30, Clockwork for Dynamo 2.x 2.3.0, Rhythm 2020.7.25, Data-Shapes 2022.2.96, RIE 2020.11.18, Orchid 203.3.1.8192

# group: UI- Select
code_block = CodeBlock()
# ---------- code_block.designscript (8 lines) ----------
"Create Column By Select cadLine like location Please select PileCapMark then line Location";
"Create Column";
true;
"0367087873";
"Cancle";
500;
400;
200;
# ----------------------------------------
code_block_2 = CodeBlock { "Choose Family Type"; }
categories = Categories("OST_StructuralColumns")
all_families_of_category = Custom[All Families Of Category](category=categories)  # package Clockwork for Dynamo 2.x; Gets all famiies of a given category in the model (does *not *work for system families)
name = Element.Name(element=all_families_of_category)
dropdown_data = Custom[DropDown Data](InputName=code_block_2, Keys=name, Values=all_families_of_category)  # package Data-Shapes; Create data for DropDown input in UI.MultiInputForm ++ . Check out www.data-shapes.net for more infos.
code_block_3 = CodeBlock { "Select Line to Positioning"; "Pick Line"; true; }
categories_2 = Categories("OST_Lines")
selectmodelelements_data = Custom[SelectModelElements Data](InputName=code_block_3.out0, ButtonText=code_block_3.out1, CategoryFilter=categories_2, SelectSingleElement=code_block_3.out2)  # package Data-Shapes; Creates a Revit element selection input for UI.MultipleInputForm++ . Check out www.data-shapes.net for more infos!
list_create = List.Create(item0=dropdown_data, item1=selectmodelelements_data)
multipleinputform = Custom[MultipleInputForm ++](Description_optional=code_block.out0, ButtonText_optional=code_block.out1, Inputs=list_create, Toggle=code_block.out2, LinkToHelp_optional=code_block.out3, CancelButtonText_optional=code_block.out4, MaxHeight_optional=code_block.out5, Width_optional=code_block.out6, LabelWidth_optional=code_block.out7)  # package Data-Shapes; Create a form with multiple inputs. see www.data-shapes.net for tutorials and infos!

code_block_4 = CodeBlock(FamilyTypes=multipleinputform.User_Inputs, PositioningLine=multipleinputform.User_Inputs) { FamilyTypes[0]; PositioningLine[1]; }
isNotEmpty = Custom[List.IsNotEmpty](seq=code_block_4.out0)  # package Clockwork for Dynamo 2.x; Just the inversion of the built-in Is Empty List node.

# group: Select Line location framing in cad
selectObjects = Custom[SelectObjects](Execute=isNotEmpty, ShowSwitchAlert=isNotEmpty)  # package LinkDWG2; Select objects on screen
basicProperty = Custom[BasicProperty](COM_Objects=selectObjects)  # package LinkDWG2; Get basic general properties of COM object
code_block_5 = CodeBlock { "Text"; }
contains = String.Contains(str=basicProperty.0_ObjectName, searchFor=code_block_5)
geometry = Element.Geometry(element=code_block_4.out1)
filterByBoolMask = List.FilterByBoolMask(list=selectObjects, mask=contains)

# group: Start index
boolean = BoolSelector(true)
o_list_indexof = Orchid.Common.List.IndexOf(list=contains, item=boolean)
code_block_6 = CodeBlock(a=o_list_indexof) { a+1; }

# group: EndIndex
count = List.Count(list=contains)
addItemToEnd = List.AddItemToEnd(item=count@@L2, list=o_list_indexof)
flatten = List.Flatten(list=addItemToEnd@L2)
code_block_7 = CodeBlock { 0; }
removeItemAtIndex = List.RemoveItemAtIndex(list=flatten, indices=code_block_7)
code_block_8 = CodeBlock(a=removeItemAtIndex) { a-1; }

code_block_9 = CodeBlock(start=code_block_6, end=code_block_8) { start..end..1; }
flatten_2 = List.Flatten(list=code_block_9@L2)
getItemAtIndex = List.GetItemAtIndex(list=selectObjects, index=flatten_2)

# group: Properties to tranfer location beam, cad to revit
isEmpty = List.IsEmpty(list=selectObjects)
code_block_10 = CodeBlock { true; false; }
if_ = If(test=isEmpty, true=code_block_10.out1, false=code_block_10.out0)
selectObjects_2 = Custom[SelectObjects](Execute=if_)
lineProperty = Custom[LineProperty](COM_Lines=selectObjects_2)  # package LinkDWG2; Get COM line properties
startPoint = Curve.StartPoint(curve=geometry)
byStartPointEndPoint = Line.ByStartPointEndPoint(startPoint=lineProperty.0_StartPoint, endPoint=startPoint)
direction = Line.Direction(line=byStartPointEndPoint)
length = Curve.Length(curve=byStartPointEndPoint)
ZAxis = Vector.ZAxis()
byStartPointEndPoint_2 = Line.ByStartPointEndPoint(startPoint=lineProperty.0_StartPoint, endPoint=lineProperty.1_EndPoint)
direction_2 = Line.Direction(line=byStartPointEndPoint_2)
direction_3 = Line.Direction(line=geometry)
angleAboutAxis = Vector.AngleAboutAxis(vector=direction_2, otherVector=direction_3, rotationAxis=ZAxis)

# group: GET LOCATION FOR FRAMING
code_block_11 = CodeBlock(ElementLocation=getItemAtIndex) { ElementLocation; }
polylineProperties = Custom[PolylineProperties](COM_Polyline=code_block_11)  # package LinkDWG; Get the COM LWPolyline properties
translate = Geometry.Translate(geometry=polylineProperties.0_PolyCurve, direction=direction, distance=length, lacing=Longest)
rotate = Geometry.Rotate(geometry=translate, origin=startPoint, axis=ZAxis, degrees=angleAboutAxis, lacing=Longest)
code_block_12 = CodeBlock(PolyCurves=rotate) { PolyCurves; }
explode = Geometry.Explode(geometry=code_block_12)

length_2 = Curve.Length(curve=explode)
round = Math.Round(number=length_2)
uniqueItems = List.UniqueItems(list=round@@L2)
count_2 = List.Count(list=uniqueItems@@L2)
code_block_13 = CodeBlock(a=count_2) { a==1; }
code_block_14 = CodeBlock { 2; }
cycle = List.Cycle(list=uniqueItems@@L2, amount=code_block_14)
RIE_If = Custom[RIE_If](Test=code_block_13@L1, True=cycle@@L2, False=uniqueItems@L2)  # package RIE; An If node that keeps list structure, empty lists and so forth.
sort = List.Sort(list=RIE_If@@L2)
transpose = List.Transpose(lists=sort@@L2)
code_block_15 = CodeBlock { 0; 1; }
getItemAtIndex_2 = List.GetItemAtIndex(list=transpose@@L2, index=code_block_15.out0)
floor = Math.Floor(number=getItemAtIndex_2)
getItemAtIndex_3 = List.GetItemAtIndex(list=transpose@@L2, index=code_block_15.out1)
floor_2 = Math.Floor(number=getItemAtIndex_3)
code_block_16 = CodeBlock(b=floor, h=floor_2) { b + "x" + h; }
flatten_3 = List.Flatten(list=code_block_16)
uniqueItems_2 = List.UniqueItems(list=flatten_3)

# group: Duplicate Element Type
code_block_17 = CodeBlock(FamilyTypeS=code_block_4.out0) { FamilyTypeS; }
family_types_of_family = Custom[Family types of family](family=code_block_17)  # package MEPover; Returns every family type of the given Family
code_block_18 = CodeBlock(FamilyTypeDup=family_types_of_family) { FamilyTypeDup[0]; }
name_2 = Element.Name(element=family_types_of_family)
setIntersection = List.SetIntersection(list1=name_2, list2=uniqueItems_2)
setDifference = List.SetDifference(list1=uniqueItems_2, list2=setIntersection)
element_duplicate = Custom[Element Duplicate](element=code_block_18, name=setDifference)  # package Genius Loci; Duplicates the given element (view, element type).

code_block_19 = CodeBlock { ["x"]; }
split = String.Split(str=uniqueItems_2, separator0=code_block_19, lacing=Longest)
code_block_20 = CodeBlock { 0; 1; }
getItemAtIndex_4 = List.GetItemAtIndex(list=split@@L2, index=code_block_20.out0)
toNumber = String.ToNumber(str=getItemAtIndex_4)
getItemAtIndex_5 = List.GetItemAtIndex(list=split@@L2, index=code_block_20.out1)
toNumber_2 = String.ToNumber(str=getItemAtIndex_5)

# group: Set Value parameter
uniqueItems_3 = List.UniqueItems(list=element_duplicate)
code_block_21 = CodeBlock { "b"; "h"; }
ʳʰʸᵗʰᵐ_elements = Rhythm.Revit.Elements.Elements.SetParameterByNameTypeOrInstance(element=uniqueItems_3, parameterName=code_block_21.out0, value=toNumber)
ʳʰʸᵗʰᵐ_elements_2 = Rhythm.Revit.Elements.Elements.SetParameterByNameTypeOrInstance(element=ʳʰʸᵗʰᵐ_elements, parameterName=code_block_21.out1, value=toNumber_2)

# group (continued): Duplicate Element Type
passthrough = Custom[Passthrough](passThrough=code_block_17, waitFor=ʳʰʸᵗʰᵐ_elements_2)  # package Clockwork for Dynamo 2.x; Forces a sequential order of execution. The node wired into the output of the Passthrough node will be executed *after* the node wired into the waitFor input (e.g. important for some Revit operations). The value of the passThrough input will be passed on to the node wired into the output port of the Passthrough node.
family_types_of_family_2 = Custom[Family types of family](family=passthrough)

# group: Get family Type to create Element
name_3 = Element.Name(element=family_types_of_family_2)
indexOf = List.IndexOf(list=name_3, element=code_block_16)
getItemAtIndex_6 = List.GetItemAtIndex(list=family_types_of_family_2, index=indexOf)

patch = Curve.Patch(curve=code_block_12)
code_block_22 = CodeBlock { 0.5; }
pointAtParameter = Surface.PointAtParameter(surface=patch, u=code_block_22, v=code_block_22)
levels = Levels("Level 2")
byPointAndLevel = FamilyInstance.ByPointAndLevel(familyType=getItemAtIndex_6, point=pointAtParameter, level=levels)
count_3 = List.Count(list=byPointAndLevel)
code_block_23 = CodeBlock(n=count_3) { "Column Was Create ?"; "Had " + n + " Column Create Please check and rotate element"; }
ʳʰʸᵗʰᵐ_helpers_simpleusermessage = Rhythm.Revit.Helpers.Helpers.SimpleUserMessage(caption=code_block_23.out0, message=code_block_23.out1)
code_block_24 = CodeBlock { "STG_Mark"; }

# group: Get Family Type Name by Name in cad
MTextProperty = Custom[MTextProperty](COM_TextMTexts=filterByBoolMask.in)  # package LinkDWG2; Get COM text/mtext property
code_block_25 = CodeBlock(TypeElement=MTextProperty.2_PureText_Content) { TypeElement; }

code_block_26 = CodeBlock { 1; }
chop = List.Chop(list=code_block_25, lengths=code_block_26)
count_4 = List.Count(list=code_block_16@@L2)
cycle_2 = List.Cycle(list=chop@L1, amount=count_4@L1)
flatten_4 = List.Flatten(list=cycle_2@L2)
ʳʰʸᵗʰᵐ_elements_3 = Rhythm.Revit.Elements.Elements.SetParameterByNameTypeOrInstance(element=byPointAndLevel, parameterName=code_block_24, value=flatten_4)
