# Dynamo graph script.dyn (Dynamo 2.3.0.5885)
# packages: LinkDWG 0.3.91, LinkDWG2 0.4.18, Genius Loci 2022.8.5, MEPover 2022.10.30, Clockwork for Dynamo 2.x 2.3.0, Rhythm 2020.7.25, Data-Shapes 2022.2.96, RIE 2020.11.18, Orchid 203.3.1.8192

code_block = CodeBlock { "Thickness Foundation"; "1000"; true; }
textbox_data = Custom[TextBox Data](InputName=code_block.out0, DefaultText=code_block.out1, IsNumberEntry=code_block.out2)  # package Data-Shapes; Create Data for TextBox input in UI.MultipleInputForm ++ . Check out www.data-shapes.net for more informations

# group: UI- Select
code_block_2 = CodeBlock()
# ---------- code_block_2.designscript (6 lines) ----------
"Create PileCap By Select cadLine like location Please select PileCapMark then line Location";
"Create PileCap";
true;
"0367087873";
"Cancle";
200;
# ----------------------------------------
code_block_3 = CodeBlock { "Choose Family Type"; "Select Leve Base"; }
categories = Categories("OST_StructuralFoundation")
all_families_of_category = Custom[All Families Of Category](category=categories)  # package Clockwork for Dynamo 2.x; Gets all famiies of a given category in the model (does *not *work for system families)
name = Element.Name(element=all_families_of_category)
dropdown_data = Custom[DropDown Data](InputName=code_block_3.out0, Keys=name, Values=all_families_of_category)  # package Data-Shapes; Create data for DropDown input in UI.MultiInputForm ++ . Check out www.data-shapes.net for more infos.
code_block_4 = CodeBlock { "Select Line to Positioning"; "Pick Line"; true; }
categories_2 = Categories("OST_Lines")
selectmodelelements_data = Custom[SelectModelElements Data](InputName=code_block_4.out0, ButtonText=code_block_4.out1, CategoryFilter=categories_2, SelectSingleElement=code_block_4.out2)  # package Data-Shapes; Creates a Revit element selection input for UI.MultipleInputForm++ . Check out www.data-shapes.net for more infos!

o_level_all = Orchid.RevitProject.Datums.Level.All()
name_2 = Element.Name(element=o_level_all)
dropdown_data_2 = Custom[DropDown Data](InputName=code_block_3.out1, Keys=name_2, Values=o_level_all)

# group (continued): UI- Select
list_create = List.Create(item0=dropdown_data, item1=selectmodelelements_data, item2=textbox_data, item3=dropdown_data_2)
multipleinputform = Custom[MultipleInputForm ++](Description_optional=code_block_2.out0, ButtonText_optional=code_block_2.out1, Inputs=list_create, Toggle=code_block_2.out2, LinkToHelp_optional=code_block_2.out3, CancelButtonText_optional=code_block_2.out4, LabelWidth_optional=code_block_2.out5)  # package Data-Shapes; Create a form with multiple inputs. see www.data-shapes.net for tutorials and infos!

code_block_5 = CodeBlock(FamilyTypes=multipleinputform.User_Inputs, PositioningLine=multipleinputform.User_Inputs, FoundationThickness=multipleinputform.User_Inputs, LevelBase=multipleinputform.User_Inputs) { FamilyTypes[0]; PositioningLine[1]; FoundationThickness[2]; LevelBase[3]; }
isNotEmpty = Custom[List.IsNotEmpty](seq=code_block_5.out0)  # package Clockwork for Dynamo 2.x; Just the inversion of the built-in Is Empty List node.

# group: Select Line location framing in cad
selectObjects = Custom[SelectObjects](Execute=isNotEmpty, ShowSwitchAlert=isNotEmpty)  # package LinkDWG2; Select objects on screen
basicProperty = Custom[BasicProperty](COM_Objects=selectObjects)  # package LinkDWG2; Get basic general properties of COM object
code_block_6 = CodeBlock { "Text"; }
contains = String.Contains(str=basicProperty.0_ObjectName, searchFor=code_block_6)
filterByBoolMask = List.FilterByBoolMask(list=selectObjects, mask=contains)
geometry = Element.Geometry(element=code_block_5.out1)

# group: Get Family Type Name by Name in cad
MTextProperty = Custom[MTextProperty](COM_TextMTexts=filterByBoolMask.in)  # package LinkDWG2; Get COM text/mtext property
code_block_7 = CodeBlock(TypeElement=MTextProperty.2_PureText_Content) { TypeElement; }

# group: Start index
boolean = BoolSelector(true)
o_list_indexof = Orchid.Common.List.IndexOf(list=contains, item=boolean)
code_block_8 = CodeBlock(a=o_list_indexof) { a+1; }

# group: EndIndex
count = List.Count(list=contains)
addItemToEnd = List.AddItemToEnd(item=count@@L2, list=o_list_indexof)
flatten = List.Flatten(list=addItemToEnd@L2)
code_block_9 = CodeBlock { 0; }
removeItemAtIndex = List.RemoveItemAtIndex(list=flatten, indices=code_block_9)
code_block_10 = CodeBlock(a=removeItemAtIndex) { a-1; }

code_block_11 = CodeBlock(start=code_block_8, end=code_block_10) { start..end..1; }
flatten_2 = List.Flatten(list=code_block_11@L2)
getItemAtIndex = List.GetItemAtIndex(list=selectObjects, index=flatten_2)

# group: Properties to tranfer location beam, cad to revit
isEmpty = List.IsEmpty(list=selectObjects)
code_block_12 = CodeBlock { true; false; }
if_ = If(test=isEmpty, true=code_block_12.out1, false=code_block_12.out0)
selectObjects_2 = Custom[SelectObjects](Execute=if_)
lineProperty = Custom[LineProperty](COM_Lines=selectObjects_2)  # package LinkDWG2; Get COM line properties
startPoint = Curve.StartPoint(curve=geometry)
byStartPointEndPoint = Line.ByStartPointEndPoint(startPoint=lineProperty.0_StartPoint, endPoint=startPoint)
direction = Line.Direction(line=byStartPointEndPoint)
length = Curve.Length(curve=byStartPointEndPoint)
ZAxis = Vector.ZAxis()
byStartPointEndPoint_2 = Line.ByStartPointEndPoint(startPoint=lineProperty.0_StartPoint, endPoint=lineProperty.1_EndPoint)
direction_2 = Line.Direction(line=byStartPointEndPoint_2)
direction_3 = Line.Direction(line=geometry)
angleAboutAxis = Vector.AngleAboutAxis(vector=direction_2, otherVector=direction_3, rotationAxis=ZAxis)

# group: GET LOCATION FOR FRAMING
code_block_13 = CodeBlock(ElementLocation=getItemAtIndex) { ElementLocation; }
polylineProperties = Custom[PolylineProperties](COM_Polyline=code_block_13)  # package LinkDWG; Get the COM LWPolyline properties
translate = Geometry.Translate(geometry=polylineProperties.0_PolyCurve, direction=direction, distance=length, lacing=Longest)
rotate = Geometry.Rotate(geometry=translate, origin=startPoint, axis=ZAxis, degrees=angleAboutAxis, lacing=Longest)
code_block_14 = CodeBlock(PolyCurves=rotate) { PolyCurves; }
explode = Geometry.Explode(geometry=code_block_14)

length_2 = Curve.Length(curve=explode)
round = Math.Round(number=length_2)
uniqueItems = List.UniqueItems(list=round@@L2)
count_2 = List.Count(list=uniqueItems@@L2)
code_block_15 = CodeBlock(a=count_2) { a==1; }
code_block_16 = CodeBlock { 2; }
cycle = List.Cycle(list=uniqueItems@@L2, amount=code_block_16)
RIE_If = Custom[RIE_If](Test=code_block_15@L1, True=cycle@@L2, False=uniqueItems@L2)  # package RIE; An If node that keeps list structure, empty lists and so forth.
sort = List.Sort(list=RIE_If@@L2)
addItemToEnd_2 = List.AddItemToEnd(item=code_block_5.out2, list=sort@@L2)
transpose = List.Transpose(lists=addItemToEnd_2@@L2)
code_block_17 = CodeBlock { 0; 1; 2; }
getItemAtIndex_2 = List.GetItemAtIndex(list=transpose@@L2, index=code_block_17.out0)
floor = Math.Floor(number=getItemAtIndex_2)
getItemAtIndex_3 = List.GetItemAtIndex(list=transpose@@L2, index=code_block_17.out1)
floor_2 = Math.Floor(number=getItemAtIndex_3)
getItemAtIndex_4 = List.GetItemAtIndex(list=transpose@@L2, index=code_block_17.out2)
floor_3 = Math.Floor(number=getItemAtIndex_4)
code_block_18 = CodeBlock(mark=code_block_7, w=floor, l=floor_2, h=floor_3) { mark + "-" + w + "x" + l + "x"+ h; }
flatten_3 = List.Flatten(list=code_block_18)
uniqueItems_2 = List.UniqueItems(list=flatten_3)

# group: Duplicate Element Type
code_block_19 = CodeBlock(FamilyTypeS=code_block_5.out0) { FamilyTypeS; }
family_types_of_family = Custom[Family types of family](family=code_block_19)  # package MEPover; Returns every family type of the given Family
code_block_20 = CodeBlock(FamilyTypeDup=family_types_of_family) { FamilyTypeDup[0]; }
name_3 = Element.Name(element=family_types_of_family)
setIntersection = List.SetIntersection(list1=name_3, list2=uniqueItems_2)
setDifference = List.SetDifference(list1=uniqueItems_2, list2=setIntersection)
element_duplicate = Custom[Element Duplicate](element=code_block_20, name=setDifference)  # package Genius Loci; Duplicates the given element (view, element type).

code_block_21 = CodeBlock { ["x","-"]; }
split = String.Split(str=uniqueItems_2, separator0=code_block_21, lacing=Longest)
count_3 = List.Count(list=split@@L2)
code_block_22 = CodeBlock(n=count_3) { n-3; n-2; n-1; }
getItemAtIndex_5 = List.GetItemAtIndex(list=split@@L2, index=code_block_22.out0@L1)
toNumber = String.ToNumber(str=getItemAtIndex_5)
getItemAtIndex_6 = List.GetItemAtIndex(list=split@@L2, index=code_block_22.out1@L1)
toNumber_2 = String.ToNumber(str=getItemAtIndex_6)

# group: Set Value parameter
uniqueItems_3 = List.UniqueItems(list=element_duplicate)
code_block_23 = CodeBlock { "Width"; "Length"; "Thickness"; }
ʳʰʸᵗʰᵐ_elements = Rhythm.Revit.Elements.Elements.SetParameterByNameTypeOrInstance(element=uniqueItems_3, parameterName=code_block_23.out0, value=toNumber)
ʳʰʸᵗʰᵐ_elements_2 = Rhythm.Revit.Elements.Elements.SetParameterByNameTypeOrInstance(element=ʳʰʸᵗʰᵐ_elements, parameterName=code_block_23.out1, value=toNumber_2)

# group (continued): Duplicate Element Type
passthrough = Custom[Passthrough](passThrough=code_block_19, waitFor=ʳʰʸᵗʰᵐ_elements_2)  # package Clockwork for Dynamo 2.x; Forces a sequential order of execution. The node wired into the output of the Passthrough node will be executed *after* the node wired into the waitFor input (e.g. important for some Revit operations). The value of the passThrough input will be passed on to the node wired into the output port of the Passthrough node.
family_types_of_family_2 = Custom[Family types of family](family=passthrough)

# group: Get family Type to create Element
name_4 = Element.Name(element=family_types_of_family_2)
indexOf = List.IndexOf(list=name_4, element=code_block_18)
getItemAtIndex_7 = List.GetItemAtIndex(list=family_types_of_family_2, index=indexOf)

patch = Curve.Patch(curve=code_block_14)
code_block_24 = CodeBlock { 0.5; }
pointAtParameter = Surface.PointAtParameter(surface=patch, u=code_block_24, v=code_block_24)
levels = Levels("Level 2")
byPointAndLevel = FamilyInstance.ByPointAndLevel(familyType=getItemAtIndex_7, point=pointAtParameter, level=levels)
code_block_25 = CodeBlock { "Level"; "Height Offset From Level"; 0; }
ʳʰʸᵗʰᵐ_elements_3 = Rhythm.Revit.Elements.Elements.SetParameterByNameTypeOrInstance(element=byPointAndLevel, parameterName=code_block_25.out0, value=code_block_5.out3)
ʳʰʸᵗʰᵐ_elements_4 = Rhythm.Revit.Elements.Elements.SetParameterByNameTypeOrInstance(element=ʳʰʸᵗʰᵐ_elements_3, parameterName=code_block_25.out1, value=code_block_25.out2)
count_4 = List.Count(list=ʳʰʸᵗʰᵐ_elements_4)
code_block_26 = CodeBlock(n=count_4) { "PileCap Was Create ?"; "Had " + n + " PileCap Create Please check and rotate element"; }
ʳʰʸᵗʰᵐ_helpers_simpleusermessage = Rhythm.Revit.Helpers.Helpers.SimpleUserMessage(caption=code_block_26.out0, message=code_block_26.out1)
getItemAtIndex_8 = List.GetItemAtIndex(list=split@@L2, index=code_block_22.out2@L1)
toNumber_3 = String.ToNumber(str=getItemAtIndex_8)
ʳʰʸᵗʰᵐ_elements_5 = Rhythm.Revit.Elements.Elements.SetParameterByNameTypeOrInstance(element=ʳʰʸᵗʰᵐ_elements, parameterName=code_block_23.out2, value=toNumber_3)
