# Dynamo graph script.dyn (Dynamo 2.3.0.5885)
# packages: LinkDWG2 0.4.18, MEPover 2022.10.30, Data-Shapes 2022.2.96, Clockwork for Dynamo 2.x 2.3.0, Rhythm 2020.7.25

code_block = CodeBlock { "Choose LevelBase"; }
categories = Categories("OST_Levels")
all_elements_of_category = ElementsOfCategory(Category=categories)
name = Element.Name(element=all_elements_of_category)
dropdown_data = Custom[DropDown Data](InputName=code_block, Keys=name, Values=all_elements_of_category)  # package Data-Shapes; Create data for DropDown input in UI.MultiInputForm ++ . Check out www.data-shapes.net for more infos.

# group: UI- Select
code_block_2 = CodeBlock()
# ---------- code_block_2.designscript (8 lines) ----------
"Create PileCap By Select cadLine like location Please select PileCapMark then line Location";
"Create PileCap";
true;
"0367087873";
"Cancle";
500;
400;
200;
# ----------------------------------------
code_block_3 = CodeBlock { "Choose Family Type"; }
categories_2 = Categories("OST_StructuralFoundation")
all_families_of_category = Custom[All Families Of Category](category=categories_2)  # package Clockwork for Dynamo 2.x; Gets all famiies of a given category in the model (does *not *work for system families)
name_2 = Element.Name(element=all_families_of_category)
dropdown_data_2 = Custom[DropDown Data](InputName=code_block_3, Keys=name_2, Values=all_families_of_category)
code_block_4 = CodeBlock { "Select Line to Positioning"; "Pick Line"; true; }
categories_3 = Categories("OST_Lines")
selectmodelelements_data = Custom[SelectModelElements Data](InputName=code_block_4.out0, ButtonText=code_block_4.out1, CategoryFilter=categories_3, SelectSingleElement=code_block_4.out2)  # package Data-Shapes; Creates a Revit element selection input for UI.MultipleInputForm++ . Check out www.data-shapes.net for more infos!
list_create = List.Create(item0=dropdown_data_2, item1=selectmodelelements_data, item2=dropdown_data)
multipleinputform = Custom[MultipleInputForm ++](Description_optional=code_block_2.out0, ButtonText_optional=code_block_2.out1, Inputs=list_create, Toggle=code_block_2.out2, LinkToHelp_optional=code_block_2.out3, CancelButtonText_optional=code_block_2.out4, MaxHeight_optional=code_block_2.out5, Width_optional=code_block_2.out6, LabelWidth_optional=code_block_2.out7)  # package Data-Shapes; Create a form with multiple inputs. see www.data-shapes.net for tutorials and infos!

code_block_5 = CodeBlock(FamilyTypes=multipleinputform.User_Inputs, PositioningLine=multipleinputform.User_Inputs, LevelBase=multipleinputform.User_Inputs) { FamilyTypes[0]; PositioningLine[1]; LevelBase[2]; }
isNotEmpty = Custom[List.IsNotEmpty](seq=code_block_5.out0)  # package Clockwork for Dynamo 2.x; Just the inversion of the built-in Is Empty List node.

# group: SELECT OBJECT CREATE MODEL
selectObjects = Custom[SelectObjects](Execute=isNotEmpty, ShowSwitchAlert=isNotEmpty)  # package LinkDWG2; Select objects on screen
basicProperty = Custom[BasicProperty](COM_Objects=selectObjects)  # package LinkDWG2; Get basic general properties of COM object
code_block_6 = CodeBlock { "Text"; }
contains = String.Contains(str=basicProperty.0_ObjectName, searchFor=code_block_6)
filterByBoolMask = List.FilterByBoolMask(list=selectObjects, mask=contains)
geometry = Element.Geometry(element=code_block_5.out1)

circleProperty = Custom[CircleProperty](COM_Circles=selectObjects)  # package LinkDWG2; Get COM circle properties

# group: Gets elementtype to place
code_block_7 = CodeBlock(FamilyTypeS=code_block_5.out0) { FamilyTypeS; }
family_types_of_family = Custom[Family types of family](family=code_block_7)  # package MEPover; Returns every family type of the given Family
round = Math.Round(number=circleProperty.1_Radius)
code_block_8 = CodeBlock(r=round) { D=r*2; }
code_block_9 = CodeBlock { "Pile_Diameter"; }
ʳʰʸᵗʰᵐ_elements = Rhythm.Revit.Elements.Elements.GetParameterValueByNameTypeOrInstance(element=family_types_of_family, parameterName=code_block_9)
eq = code_block_8 == ʳʰʸᵗʰᵐ_elements  # lacing=CrossProduct
filterByBoolMask_2 = List.FilterByBoolMask(list=family_types_of_family, mask=eq@L2)
firstItem = List.FirstItem(list=filterByBoolMask_2.in@L2)
code_block_10 = CodeBlock { a==b; }  # unwired: a, b

code_block_11 = CodeBlock(CenterPoints=circleProperty.0_CenterPoint) { CenterPoints; }

# group: Properties to tranfer location beam, cad to revit
isEmpty = List.IsEmpty(list=selectObjects)
code_block_12 = CodeBlock { true; false; }
if_ = If(test=isEmpty, true=code_block_12.out1, false=code_block_12.out0)
selectObjects_2 = Custom[SelectObjects](Execute=if_)
lineProperty = Custom[LineProperty](COM_Lines=selectObjects_2)  # package LinkDWG2; Get COM line properties
startPoint = Curve.StartPoint(curve=geometry)
byStartPointEndPoint = Line.ByStartPointEndPoint(startPoint=lineProperty.0_StartPoint, endPoint=startPoint)
direction = Line.Direction(line=byStartPointEndPoint)
length = Curve.Length(curve=byStartPointEndPoint)
ZAxis = Vector.ZAxis()
byStartPointEndPoint_2 = Line.ByStartPointEndPoint(startPoint=lineProperty.0_StartPoint, endPoint=lineProperty.1_EndPoint)
direction_2 = Line.Direction(line=byStartPointEndPoint_2)
direction_3 = Line.Direction(line=geometry)
angleAboutAxis = Vector.AngleAboutAxis(vector=direction_2, otherVector=direction_3, rotationAxis=ZAxis)

# group: GET LOCATION FOR FRAMING
code_block_13 = CodeBlock(ElementLocation=code_block_11) { ElementLocation; }
translate = Geometry.Translate(geometry=code_block_13, direction=direction, distance=length, lacing=Longest)
rotate = Geometry.Rotate(geometry=translate, origin=startPoint, axis=ZAxis, degrees=angleAboutAxis, lacing=Longest)

byPointAndLevel = FamilyInstance.ByPointAndLevel(familyType=firstItem, point=rotate, level=code_block_5.out2)
isNull = Object.IsNull(obj=byPointAndLevel)
countFalse = List.CountFalse(list=isNull)
code_block_14 = CodeBlock(n=countFalse) { "PileCap Was Create ?"; "Had " + n + " PileCap Create Please check and rotate element"; }
ʳʰʸᵗʰᵐ_helpers_simpleusermessage = Rhythm.Revit.Helpers.Helpers.SimpleUserMessage(caption=code_block_14.out0, message=code_block_14.out1)
