# Dynamo graph script.dyn (Dynamo 2.3.0.5885)
# packages: spring nodes 132.2.5, Structural Design 2019.12.11

categories = Categories("OST_Rebar")
all_elements_of_category = ElementsOfCategory(Category=categories)
boolean = BoolSelector(true)
pickElementsByRectangle = StructuralDesign.Model.Selection.PickElementsByRectangle(refresh=boolean)
id = Element.Id(element=pickElementsByRectangle)
rebarHostElement = StructuralDesign.Rebar.Properties.RebarHostElement(rebar=all_elements_of_category)
id_2 = Element.Id(element=rebarHostElement)
eq = id == id_2  # lacing=CrossProduct
filterByBoolMask = List.FilterByBoolMask(list=all_elements_of_category, mask=eq@L2)
flatten = List.Flatten(list=filterByBoolMask.in)
selectInRevit = Custom[Springs.SelectInRevit](element=flatten)  # package spring nodes; Selects the input elements inside the Revit UI.
