# Dynamo graph script.dyn (Dynamo 2.3.0.5885)
# packages: Rhythm 2020.7.25, Structural Design 2019.12.11

code_block = CodeBlock { "Tổng Rebar"; "Total Quantity"; }
code_block_2 = CodeBlock { "__"; }
list_create = List.Create()  # unwired: item0, item1
boolean = BoolSelector(true)
pickElementsByRectangle = StructuralDesign.Model.Selection.PickElementsByRectangle(refresh=boolean)
elementType = Element.ElementType(element=pickElementsByRectangle)
name = Element.Name(element=elementType)
groupByKey = List.GroupByKey(list=pickElementsByRectangle, keys=name)
code_block_3 = CodeBlock { "Quantity"; }
ʳʰʸᵗʰᵐ_elements = Rhythm.Revit.Elements.Elements.GetParameterValueByNameTypeOrInstance(element=groupByKey.groups, parameterName=code_block_3)
sum = Math.Sum(values=ʳʰʸᵗʰᵐ_elements)
floor = Math.Floor(number=sum)
string_from_object = FromObject(obj=floor)
code_block_4 = CodeBlock(a=string_from_object) { a+"-"; }
code_block_5 = CodeBlock(a=groupByKey.unique_keys) { a; }
combine = List.Combine(comb=list_create, list1=code_block_4, list2=code_block_5)
concat = String.Concat(string0=combine)
flatten = List.Flatten(list=concat)
join = String.Join(separator=code_block_2, string0=flatten)
ʳʰʸᵗʰᵐ_helpers_usermessage = Rhythm.Revit.Helpers.Helpers.UserMessage(caption=code_block.out0, message=join, obj=sum)
