# Dynamo graph script.dyn (Dynamo 2.19.3.6394)
# packages: Clockwork for Dynamo 2.x 2.3.0, Structural Design 2019.12.11, Dynamo for Rebar 2.0.2

boolean = BoolSelector(true)
pickElementsByRectangle = StructuralDesign.Model.Selection.PickElementsByRectangle(refresh=boolean)
category = Custom[Element.Category+](element=pickElementsByRectangle)  # package Clockwork for Dynamo 2.x
string_from_object = FromObject(obj=category.category)
code_block = CodeBlock(A=string_from_object) { A=="Structural Rebar"; A=="Structural Area Reinforcement"; A=="Structural Path Reinforcement"; }
filterByBoolMask = List.FilterByBoolMask(list=pickElementsByRectangle, mask=code_block.out0)
filterByBoolMask_2 = List.FilterByBoolMask(list=pickElementsByRectangle, mask=code_block.out1)
filterByBoolMask_3 = List.FilterByBoolMask(list=pickElementsByRectangle, mask=code_block.out2)
join = List.Join(list0=filterByBoolMask.in, list1=filterByBoolMask_2.in, list2=filterByBoolMask_3.in)
current = Document.Current()
activeView = Document.ActiveView(document=current)
setSolidInView = StructuralDesign.Rebar.AreaReinforcement.AreaReinforcement.SetSolidInView(areaReinforcement=join, view=activeView, solid=boolean)
setUnobscuredInView = StructuralDesign.Rebar.AreaReinforcement.AreaReinforcement.SetUnobscuredInView(areaReinforcement=join, view=activeView, unobscured=boolean)
setUnobscuredInView_2 = Rebar.SetUnobscuredInView(rebar=join, view=activeView, unobscured=boolean)
setSolidInView_2 = Rebar.SetSolidInView(rebar=join, view=activeView, solid=boolean)
