# Dynamo graph script.dyn (Dynamo 2.3.0.5885)
# packages: Rhythm 2020.7.25, archi-lab.net 2021.25.15, Data-Shapes 2022.2.96, Clockwork for Dynamo 2.x 2.3.0, Orchid 203.3.1.8192

code_block = CodeBlock { "SET COVER MuilTible"; "Set"; "Cancel"; 600; 300; 150; true; }
code_block_2 = CodeBlock { "SELECT Category"; "Select"; }
categories_list = Custom[Categories list]()  # package Data-Shapes; Gives list of all Revit categories and a matching list of their names
dropdown_data = Custom[DropDown Data](InputName=code_block_2.out0, Keys=categories_list.Category_name_s, Values=categories_list.Category_name_s)  # package Data-Shapes; Create data for DropDown input in UI.MultiInputForm ++ . Check out www.data-shapes.net for more infos.
code_block_3 = CodeBlock { "SELECT ELEMENT (S)"; "Select"; }
selectmodelelements_data = Custom[SelectModelElements Data](InputName=code_block_3.out0, ButtonText=code_block_3.out1)  # package Data-Shapes; Creates a Revit element selection input for UI.MultipleInputForm++ . Check out www.data-shapes.net for more infos!
code_block_4 = CodeBlock { "Cover_Top/Ex"; "Cover_Bot/In"; "Cover_Orther"; }
current_document = Custom[Current Document]()  # package archi-lab.net; Retrieves Current Document
element_types = ElementTypes("RebarCoverType")
ʳʰʸᵗʰᵐ_collector = Rhythm.Revit.Selection.Collector.ElementsOfTypeInDocument(document=current_document, elementType=element_types)
name = Element.Name(element=ʳʰʸᵗʰᵐ_collector)
dropdown_data_2 = Custom[DropDown Data](InputName=code_block_4.out0, Keys=name, Values=ʳʰʸᵗʰᵐ_collector)
dropdown_data_3 = Custom[DropDown Data](InputName=code_block_4.out1, Keys=name, Values=ʳʰʸᵗʰᵐ_collector)
dropdown_data_4 = Custom[DropDown Data](InputName=code_block_4.out2, Keys=name, Values=ʳʰʸᵗʰᵐ_collector)
list_create = List.Create(item0=dropdown_data, item1=selectmodelelements_data, item2=dropdown_data_2, item3=dropdown_data_3, item4=dropdown_data_4)
multipleinputform = Custom[MultipleInputForm ++](Description_optional=code_block.out0, ButtonText_optional=code_block.out1, Inputs=list_create, Toggle=code_block.out6, CancelButtonText_optional=code_block.out2, MaxHeight_optional=code_block.out3, Width_optional=code_block.out4, LabelWidth_optional=code_block.out5)  # package Data-Shapes; Create a form with multiple inputs. see www.data-shapes.net for tutorials and infos!

# group: Control
code_block_5 = CodeBlock(a=multipleinputform.User_Inputs) { a; }
code_block_6 = CodeBlock(Cater=code_block_5, Elements=code_block_5, CoverTopEx=code_block_5, CoverBotIn=code_block_5, CoverOrther=code_block_5) { Cater[0]; Elements[1]; CoverTopEx[2]; CoverBotIn[3]; CoverOrther[4]; }
category = Custom[Element.Category+](element=code_block_6.out1)  # package Clockwork for Dynamo 2.x; Returns the category of a given element. Unlike the OOTB node Element.GetCategory, it will work for subcategories, families, family documents, schedules, subcategories and graphics styles as well.
string_from_object = FromObject(obj=category.category)
code_block_7 = CodeBlock { true; }
o_string_contains = Orchid.Common.String.Contains(string=string_from_object, searchFor=code_block_6.out0, ignoreCase=code_block_7)
filterByBoolMask = List.FilterByBoolMask(list=code_block_6.out1, mask=o_string_contains)
code_block_8 = CodeBlock(a=filterByBoolMask.in) { a; }
parameters = Element.Parameters(element=filterByBoolMask.in)
name_2 = Parameter.Name(parameter=parameters)
code_block_9 = CodeBlock { "Rebar Cover -"; false; }
contains = String.Contains(str=name_2@L2, searchFor=code_block_9.out0, ignoreCase=code_block_9.out1)
filterByBoolMask_2 = List.FilterByBoolMask(list=name_2, mask=contains)
code_block_10 = CodeBlock(a=filterByBoolMask_2.in) { a; }
code_block_11 = CodeBlock { ["Col","Fram","Floor"]; true; }
o_string_contains_2 = Orchid.Common.String.Contains(string=code_block_6.out0, searchFor=code_block_11.out0, ignoreCase=code_block_11.out1)
column_floor_beam = List.Create(item0=code_block_6.out3, item1=code_block_6.out4, item2=code_block_6.out2)
wall = List.Create(item0=code_block_6.out2, item1=code_block_6.out3, item2=code_block_6.out4)
if_ = If(test=o_string_contains_2, true=column_floor_beam, false=wall)
ʳʰʸᵗʰᵐ_elements = Rhythm.Revit.Elements.Elements.SetParameterByNameTypeOrInstance(element=code_block_8, parameterName=code_block_10@L2, value=if_@L2, lacing=Longest)
