# Dynamo graph script.dyn (Dynamo 2.3.0.5885)
# packages: Structural Design 2019.12.11, Clockwork for Dynamo 2.x 2.3.0, archi-lab.net 2020.23.13, Orchid 203.3.1.8192

code_block = CodeBlock { "Select element rebar and maybe orther"; }
boolean = BoolSelector(true)
pickElements = StructuralDesign.Model.Selection.PickElements(statusPrompt=code_block, refresh=boolean)
categories = Categories("OST_Rebar")
string_from_object = FromObject(obj=categories)
category = Custom[Element.Category+](element=pickElements)  # package Clockwork for Dynamo 2.x; Returns the category of a given element. Unlike the OOTB node Element.GetCategory, it will work for subcategories, families, family documents, schedules, subcategories and graphics styles as well.
string_from_object_2 = FromObject(obj=category.category)
code_block_2 = CodeBlock(a=string_from_object, b=string_from_object_2) { a==b; }
filterByBoolMask = List.FilterByBoolMask(list=pickElements, mask=code_block_2)
rebarProperties = StructuralDesign.Rebar.Properties.RebarProperties(rebar=filterByBoolMask.in)
code_block_3 = CodeBlock(rebarstype=rebarProperties.Rebar_Style) { rebarstype; }
code_block_4 = CodeBlock(a=code_block_3) { a== "Standard"; }
filterByBoolMask_2 = List.FilterByBoolMask(list=filterByBoolMask.in, mask=code_block_4)
rebarCenterlineCurves = StructuralDesign.Rebar.Properties.RebarCenterlineCurves(rebar=filterByBoolMask_2.in)
byJoinedCurves = PolyCurve.ByJoinedCurves(curves=rebarCenterlineCurves)
length = Curve.Length(curve=byJoinedCurves)
round = Math.Round(number=length)
groupByKey = List.GroupByKey(list=filterByBoolMask_2.in, keys=round)
rebarCenterlineCurves_2 = StructuralDesign.Rebar.Properties.RebarCenterlineCurves(rebar=groupByKey.groups)
byJoinedCurves_2 = PolyCurve.ByJoinedCurves(curves=rebarCenterlineCurves_2)
code_block_5 = CodeBlock { 0.5; }
pointAtParameter = Curve.PointAtParameter(curve=byJoinedCurves_2, param=code_block_5)
select_faces = SelectFaces()  # 1 picked in the model
distanceTo = Geometry.DistanceTo(geometry=pointAtParameter@L2, other=select_faces@L1, lacing=Longest)
round_2 = Math.Round(number=distanceTo)
minimumItem = List.MinimumItem(list=round_2)
o_list_indexof = Orchid.Common.List.IndexOf(list=round_2@L2, item=minimumItem@L1)
getItemAtIndex = List.GetItemAtIndex(list=groupByKey.groups@L2, index=o_list_indexof@L2)
maximumItem = List.MaximumItem(list=round_2)
o_list_indexof_2 = Orchid.Common.List.IndexOf(list=round_2@L2, item=maximumItem@L1)
getItemAtIndex_2 = List.GetItemAtIndex(list=groupByKey.groups@L2, index=o_list_indexof_2@L2)
rebarCenterlineCurves_3 = StructuralDesign.Rebar.Properties.RebarCenterlineCurves(rebar=getItemAtIndex_2)
byJoinedCurves_3 = PolyCurve.ByJoinedCurves(curves=rebarCenterlineCurves_3)
pointAtParameter_2 = Curve.PointAtParameter(curve=byJoinedCurves_3, param=code_block_5)
rebarCenterlineCurves_4 = StructuralDesign.Rebar.Properties.RebarCenterlineCurves(rebar=getItemAtIndex)
byJoinedCurves_4 = PolyCurve.ByJoinedCurves(curves=rebarCenterlineCurves_4)
pointAtParameter_3 = Curve.PointAtParameter(curve=byJoinedCurves_4, param=code_block_5)
byStartPointEndPoint = Line.ByStartPointEndPoint(startPoint=pointAtParameter_2, endPoint=pointAtParameter_3)
length_2 = Curve.Length(curve=byStartPointEndPoint)
round_3 = Math.Round(number=length_2)
code_block_6 = CodeBlock(a=groupByKey.groups) { a; }
setDifference = List.SetDifference(list1=code_block_6, list2=getItemAtIndex, lacing=Longest)
delete = archilab.Revit.Elements.Elements.Delete(element=setDifference)
passthrough = Custom[Passthrough](passThrough=round_3, waitFor=delete)  # package Clockwork for Dynamo 2.x; Forces a sequential order of execution. The node wired into the output of the Passthrough node will be executed *after* the node wired into the waitFor input (e.g. important for some Revit operations). The value of the passThrough input will be passed on to the node wired into the output port of the Passthrough node.
count = List.Count(list=groupByKey.groups@L2)
boolean_2 = BoolSelector(true)
setLayoutAsFixedNumber = StructuralDesign.Rebar.Layout.SetLayoutAsFixedNumber(rebar=getItemAtIndex, arrayLength=passthrough, numberOfBarPositions=count, barsOnNormalSide=boolean_2, lacing=Longest)
code_block_7 = CodeBlock { "Select Surface"; true; }
pickFaces = StructuralDesign.Model.Selection.PickFaces(statusPrompt=code_block_7.out0, refresh=code_block_7.out1)
surfacesFromFace = StructuralDesign.Model.Geometry.SurfacesFromFace(face=pickFaces)
