# Dynamo graph script.dyn "SetLayout" (Dynamo 2.3.2.15696)
# packages: Structural Design 2019.12.11, Rhythm 2020.7.25

pickObjects = StructuralDesign.Model.Selection.PickObjects()
code_block = CodeBlock { "Layout Rule"; }
code_block_2 = CodeBlock { 2; }
ʳʰʸᵗʰᵐ_elements = Rhythm.Revit.Elements.Elements.SetParameterByNameTypeOrInstance(element=pickObjects, parameterName=code_block, value=code_block_2)
