# Dynamo graph script.dyn (Dynamo 2.3.0.5885)
# packages: Structural Design 2019.12.11, Rhythm 2020.7.25, Clockwork for Dynamo 2.x 2.3.0, Orchid 203.3.1.8192

code_block = CodeBlock { ["Structural Rebar","Structural Area Reinforcement"]; 1; "Select Rebar in view"; true; false; }
byName = Category.ByName(name=code_block.out0)
pickObjectsOfCategory = StructuralDesign.Model.Selection.PickObjectsOfCategory(category=byName, objectType=code_block.out1, statusPrompt=code_block.out2, preselection=code_block.out4, refresh=code_block.out3)
rebarHostElement = StructuralDesign.Rebar.Properties.RebarHostElement(rebar=pickObjectsOfCategory)
groupByKey = List.GroupByKey(list=pickObjectsOfCategory, keys=rebarHostElement)
code_block_2 = CodeBlock { "STG_Mark"; "Partition"; }
getParameterValueByName = Element.GetParameterValueByName(element=groupByKey.unique_keys, parameterName=code_block_2.out0)
ʳʰʸᵗʰᵐ_elements = Rhythm.Revit.Elements.Elements.SetParameterValueByNameCaSeiNSeNSiTiVe(element=groupByKey.groups, parameterName=code_block_2.out1, value=getParameterValueByName)
category = Custom[Element.Category+](element=rebarHostElement)  # package Clockwork for Dynamo 2.x; Returns the category of a given element. Unlike the OOTB node Element.GetCategory, it will work for subcategories, families, family documents, schedules, subcategories and graphics styles as well.
uniqueItems = List.UniqueItems(list=category.category)
current = Document.Current()
activeView = Document.ActiveView(document=current)
all_elements_of_category_in_view = ElementsOfCategoryInView(Category=uniqueItems, View=activeView)
flatten = List.Flatten(list=all_elements_of_category_in_view)
getParameterValueByName_2 = Element.GetParameterValueByName(element=flatten, parameterName=code_block_2.out0)
o_list_indexof = Orchid.Common.List.IndexOf(list=getParameterValueByName_2, item=getParameterValueByName)
flatten_2 = List.Flatten(list=o_list_indexof)
getItemAtIndex = List.GetItemAtIndex(list=flatten, index=flatten_2)
color_palette = ColorPalette({R: 0, G: 250, B: 154, A: 255})
overrideColorInView = Element.OverrideColorInView(element=getItemAtIndex, color=color_palette)
